# Dynamo graph shape1_direct increase.dyn (Dynamo 0.9.1.3872)

code_block = CodeBlock { {1,5,10,33,50,100,250}; }
code_block_2 = CodeBlock { {false,true,true,false,false,false,false}; }
code_block_3 = CodeBlock(sc=code_block, b1=code_block_2) { shape1(sc,b1); }
file_path = Filename("F:\sat_raw scale\sat_raw scale_")
code_block_4 = CodeBlock(path=file_path, sc=code_block) { path+sc; }
exportToSAT = Geometry.ExportToSAT(code_block_3, code_block_4, lacing=Longest)
watch = Watch(exportToSAT)
code_block_5 = CodeBlock()
# ---------- code_block_5.designscript (8 lines) ----------
def shape1(sc,b1){
r1 = Rectangle.ByWidthLength(100*sc,168*sc).Fillet(30*sc,b1);
pl1 = r1.PlaneAtParameter(0..0.995..#10);
c1 = Circle.ByPlaneRadius(pl1,10*sc);
c2 = c1.Rotate(pl1,0..180..#10);
profs = Polygon.RegularPolygon(c2,6);
return = Solid.ByLoft(profs, r1);
};
# ----------------------------------------
fillet = PolyCurve.Fillet()
