# Dynamo graph shape1_scale.dyn (Dynamo 0.9.1.3872)

boolean = BoolSelector(false)
code_block = CodeBlock(b1=boolean)
# ---------- code_block.designscript (6 lines) ----------
r1 = Rectangle.ByWidthLength(100,168).Fillet(30,b1);
pl1 = r1.PlaneAtParameter(0..0.995..#10);
c1 = Circle.ByPlaneRadius(pl1,10);
c2 = c1.Rotate(pl1,0..180..#10);
profs = Polygon.RegularPolygon(c2,6);
s1 = Solid.ByLoft(profs, r1);
# ----------------------------------------
code_block_2 = CodeBlock { {0.5,0.1,0.05,0.01,0.001}; }
scale = Geometry.Scale(geometry=code_block.s1, amount=code_block_2)
join = List.Join(code_block.s1, scale)
file_path = Filename("E:\sat test\sat_no scale")
file_path_2 = Filename("E:\sat test\sat_scale_")
code_block_3 = CodeBlock(path=file_path_2, sc=code_block_2) { path + sc; }
join_2 = List.Join(file_path, code_block_3)
exportToSAT = Geometry.ExportToSAT(join, join_2, lacing=Longest)
watch = Watch(exportToSAT)
