# Dynamo graph shape2_scale.dyn (Dynamo 0.9.1.4062)

file_path = Filename("E:\sat test\sat_no scale")
file_path_2 = Filename("E:\sat test\sat_scale_")
code_block = CodeBlock { {0.5,0.1,0.05,0.01,0.001}; }
code_block_2 = CodeBlock(path=file_path_2, sc=code_block) { path + sc; }
join = List.Join(file_path, code_block_2)
exportToSAT = Geometry.ExportToSAT(arg1=join, lacing=Longest)
watch = Watch(exportToSAT)
code_block_3 = CodeBlock { 8; 2500; -500; 29; 600; 6; }
code_block_4 = CodeBlock { Plane.XY(); }
code_block_5 = CodeBlock(n1=code_block_3.out0, h1=code_block_3.out1, o1=code_block_3.out2, a1=code_block_3.out3, pl1=code_block_4, r1=code_block_3.out4, s1=code_block_3.out5)
# ---------- code_block_5.designscript (6 lines) ----------
d1 = 0..#n1..h1;
off1 = 0..#n1..-o1;
rot1 = 0..#n1..a1;
s1 = Solid.ByLoft(Polygon.RegularPolygon(Circle.
ByPlaneRadius(pl1, r1),s1).Offset(off1).Translate
(pl1.Normal,d1).Rotate(pl1,rot1));
# ----------------------------------------
scale = Geometry.Scale(geometry=code_block_5.s1, amount=code_block)
join_2 = List.Join(code_block_5.s1, scale)
