# Dynamo graph backup-issue.6663.dyn (Dynamo 1.0.0.1180)

code_block = CodeBlock { {"A".."C",1..3,11..13}; }
code_block_2 = CodeBlock { 0; }
getItemAtIndex = List.GetItemAtIndex(list=code_block, index=code_block_2)
firstIndexOf = List.FirstIndexOf(item=getItemAtIndex)
reorder = Reorder(code_block, firstIndexOf)
code_block_3 = CodeBlock()
# ---------- code_block_3.designscript (2 lines) ----------
//prefered order
{"B", "C", "A"};
# ----------------------------------------
