# Dynamo custom node Active View.dyf (Dynamo 0.8.2.2392)
# category: SpringNodes.Revit.Views
# Selects the current document's active view. Supports more view types

python_script = Python()
# ---------- python_script.python (15 lines) ----------
#Copyright(c) 2015, Dimitar Venkov
# @5devene, dimitar.ven@gmail.com

import clr

clr.AddReference("RevitServices")
import RevitServices
from RevitServices.Persistence import DocumentManager
doc = DocumentManager.Instance.CurrentDBDocument

clr.AddReference("RevitNodes")
import Revit
clr.ImportExtensions(Revit.Elements)

OUT = doc.ActiveView.ToDSType(True)
# ----------------------------------------
View = Output(python_script)
