# Dynamo custom node AreaPlan.ByLevelName.dyf (Dynamo 4.0.2.3852)
# category: Springs.Revit.Create
# Creates an area plan at the designated levels. Each new view needs a name. An area scheme must first be activated before it can be used. To activate a scheme, place one view of that type in the project(you can then delete it).  If a view with the same scheme and name exists, you'll get a null instead.

level = Input(level: var[])
name = Input(name: var[])
schemeName = Input(schemeName: var)
python_script = Python(IN[0]=level, IN[1]=name, IN[2]=schemeName)  # PythonNet3
# ---------- python_script.python (77 lines) ----------
#-Reope----------------------------------------#
#                                              #
#      Copyright(c) 2017, Dimitar Venkov       #
#                                              #
# https://github.com/dimven/SpringNodes/issues #
# https://www.reope.com/                       #
#                                              #
#    ____    _____   _____   ____    _____     #
#   |  _ \ *|  ___|*|  _  |*|  _ \ *|  ___|    #
#   | |_) |*| |___ *| | | |*| |_) |*| |___     #
#   |  _ < *|  ___|*| | | |*|  __/ *|  ___|    #
#   | | | |*| |___ *| |_| |*| |    *| |___     #
#   |_| \_|*|_____|*|_____|*|_|    *|_____|    #
#                                              #
#                                              #
#-Reope-----Updated by Mark Ackerley-----------#

import clr
clr.AddReference('RevitServices')
from RevitServices.Persistence import DocumentManager
from RevitServices.Transactions import TransactionManager
doc = DocumentManager.Instance.CurrentDBDocument
clr.AddReference('RevitNodes')
import Revit
clr.ImportExtensions(Revit.Elements)
clr.AddReference('RevitAPI')
from Autodesk.Revit.DB import *

def tolist(obj1):
    if isinstance(obj1, str): return [obj1]
    return obj1 if isinstance(obj1, list) else [obj1]

def first(obj1):
    return obj1[0] if isinstance(obj1, list) else obj1

try:
    lvls = UnwrapElement(tolist(IN[0]))
    names = tolist(IN[1])
    plan_type = str(first(IN[2]))

    vt1 = None
    fec1 = FilteredElementCollector(doc).OfClass(ViewFamilyType)
    for f in fec1:
        if Element.Name.__get__(f) == plan_type:
            vt1 = f.Id
            break

    fec2 = FilteredElementCollector(doc).OfClass(View)
    plan_names = [f.Name for f in fec2 if f.GetTypeId().Equals(vt1)]

    as1 = None
    fec3 = FilteredElementCollector(doc).OfClass(AreaScheme)
    for f in fec3:
        if f.Name == plan_type:
            as1 = f.Id
            break

    if as1 is not None:
        OUT = []
        TransactionManager.Instance.EnsureInTransaction(doc)
        for l, n in zip(lvls, names):
            if n not in plan_names:
                v1 = ViewPlan.CreateAreaPlan(doc, as1, l.Id)
                v1.Name = n
                OUT.append(v1.ToDSType(False))
            else:
                OUT.append(None)
        TransactionManager.Instance.TransactionTaskDone()
    else:
        OUT = 'Area scheme with that name not found.'

except Exception as e:
    import traceback
    OUT = "Exception:\n{0}\n\nTraceback:\n{1}".format(
        str(e),
        traceback.format_exc()
    )
# ----------------------------------------
AreaPlan = Output(python_script)
