# Dynamo custom node Beams.FixExtents.dyf "Springs.Beams.FixExtents" (Dynamo 1.2.1.3083)
# category: Springs.Revit.Utility
# Detects all beams from the input list with broken extents(actual length - cut length <  margin) and attemts to correct them.

code_block = CodeBlock()
# ---------- code_block.designscript (5 lines) ----------
def filter1(l1:var[], margin)
{
test1 = (l1[0] > l1[1] ? l1[0] - l1[1] : l1[1] - l1[0]);
return = test1 > margin;
};
# ----------------------------------------
beams = Input(beams:var[])
code_block_2 = CodeBlock { "framing"; }
byClassName = Custom[Filter.ByClassName](object=beams, className=code_block_2)  # "Springs.Filter.ByClassName"; Filters a list of objects by the object's class name. Note that Dynamo elements belong to different classes than their Revit counterparts. Use the Object.Class node to check an object's class.
margin = Input(margin:double = 300)
code_block_3 = CodeBlock(str1=byClassName.in, margin=margin)
# ---------- code_block_3.designscript (4 lines) ----------
len1 = str1<1>.GetParameterValueByName(
{"Length","Cut Length"}<2>);
mask1 = filter1(len1, margin);
DSCore.List.FilterByBoolMask(str1,mask1)["in"];
# ----------------------------------------
python_script = Python(IN[0]=code_block_3.out2)
# ---------- python_script.python (44 lines) ----------
#Copyright(c) 2015, Dimitar Venkov
# @5devene, dimitar.ven@gmail.com

import clr

clr.AddReference("RevitServices")
import RevitServices
from RevitServices.Persistence import DocumentManager
from RevitServices.Transactions import TransactionManager
doc = DocumentManager.Instance.CurrentDBDocument
uidoc=DocumentManager.Instance.CurrentUIApplication.ActiveUIDocument

clr.AddReference("RevitNodes")
import Revit
clr.ImportExtensions(Revit.Elements)

clr.AddReference("RevitAPI")
from Autodesk.Revit.DB import ElementId
from Autodesk.Revit.DB.Structure import StructuralFramingUtils

clr.AddReference("System")
from System.Collections.Generic import List as cList

def tolist(obj1):
	if hasattr(obj1,"__iter__"):
		return obj1
	else:
		return [obj1]

beams = UnwrapElement(tolist(IN[0]))

TransactionManager.Instance.EnsureInTransaction(doc)
for b in beams:
	try:
		StructuralFramingUtils.DisallowJoinAtEnd(b,0)
		StructuralFramingUtils.DisallowJoinAtEnd(b,1)
	except:
		pass
		
ids1 = [e.Id for e in beams]
ids2 = cList[ElementId](ids1)
uidoc.Selection.SetElementIds(ids2)
OUT = "%s beams corrected in Revit." %ids2.Count
TransactionManager.Instance.TransactionTaskDone()
# ----------------------------------------
result = Output(python_script)
