# Dynamo custom node BoundingBox.2dRectangle.dyf "Springs.BoundingBox.2dRectangle" (Dynamo 1.3.2.2480)
# category: Springs.Geometry
# Returns a 2d rectangle from a bounding box

boundingBox = Input(boundingBox:BoundingBox)
code_block = CodeBlock(bb=boundingBox)
# ---------- code_block.designscript (7 lines) ----------
a = bb.MinPoint;
b = bb.MaxPoint;
r1 = Rectangle.ByCornerPoints(
  Point.ByCoordinates(a.X, a.Y),
  Point.ByCoordinates(b.X, a.Y),
  Point.ByCoordinates(b.X, b.Y),
  Point.ByCoordinates(a.X, b.Y) );
# ----------------------------------------
rectangle = Output(code_block.r1)
