# Dynamo custom node BoundingBox.MidPoint.dyf "Springs.BoundingBox.MidPoint" (Dynamo 1.0.0.1180)
# category: Springs.Geometry
# Fetches the mid point of the bounding box.

code_block = CodeBlock()
# ---------- code_block.designscript (8 lines) ----------
def bbMid(bb1){
p1 = bb1.MinPoint;
p2 = bb1.MaxPoint;
return = Point.ByCoordinates(
Math.Average({p1.X, p2.X}),
Math.Average({p1.Y, p2.Y}),
Math.Average({p1.Z, p2.Z}));
};
# ----------------------------------------
boundingBox = Input(boundingBox:var)
code_block_2 = CodeBlock(bb1=boundingBox) { bbMid(bb1); }
Point = Output(code_block_2)
