# Dynamo custom node BoundingBox.Scale.dyf "Springs.BoundingBox.Scale" (Dynamo 0.8.2.2392)
# category: Springs.Geometry
# Scales the bounding box in three dimensions according to it's center.

code_block = CodeBlock()
# ---------- code_block.designscript (20 lines) ----------
def ptAvr(pts:var[]){
return = Point.ByCoordinates(
Math.Average(pts.X),
Math.Average(pts.Y),
Math.Average(pts.Z));
}

def bbScale(bb1,xA,yA,zA){
cs1=bb1.ContextCoordinateSystem;
min = bb1.MinPoint;
max = bb1.MaxPoint;
cent = ptAvr({min,max});
pl1 = Plane.ByOriginNormal
(cent, Vector.ZAxis());
min1 = min.Scale(pl1,xA,yA,zA);
max1 = max.Scale(pl1,xA,yA,zA);
return = BoundingBox.
ByCornersCoordinateSystem
(min1,max1,cs1);
};
# ----------------------------------------
boundingBox = Input(boundingBox:BoundingBox)
xAmmount = Input(xAmmount:double = 1)
yAmmount = Input(yAmmount:double = 1)
zAmmount = Input(zAmmount:double = 1)
code_block_2 = CodeBlock(bb1=boundingBox, xA=xAmmount, yA=yAmmount, zA=zAmmount) { bbScale(bb1,xA,yA,zA); }
boundingBox_2 = Output(code_block_2)  # "boundingBox"
