# Dynamo custom node ClosedCurve.Offset+(0.9).dyf (Dynamo 0.8.2.2392)
# category: SpringNodes.Geometry
# Offsets a curve both ways and correctly differenciates the external and internal offset. If an offset goes beyond the curve's bounds, the result will fail and a null value will be appended instead. Also works for convex curves like arcs.

code_block = CodeBlock()
# ---------- code_block.designscript (15 lines) ----------
def offset1(c,dist,f1){
c1 = c.Offset(dist);
c2 = c.Offset(-dist);
c1 = c1 == null ? c : c1;
c2 = c2 == null ? c : c2;
l1 = SortByFunction({c1,c2},f1);
//replace the original with a null
test = IndexOf(l1,c);
return = test == -1 ? l1 :
List.ReplaceItemAtIndex(l1,test,null);
};

def secondItem(l1:var[]){
return = l1[1];
};
# ----------------------------------------
curve = Input(curve:var)
distance = Input(distance:double)
length = Curve.Length()
code_block_2 = CodeBlock(c=curve, dist=distance, f1=length) { off1 = offset1(c, dist, f1); min = List.FirstItem(off1<1>); max = secondItem(off1); }
internal_offset = Output(code_block_2.min)
external_offset = Output(code_block_2.max)
