# Dynamo custom node ClosedCurve.Offset+.dyf "Springs.ClosedCurve.Offset+" (Dynamo 0.8.2.2392)
# category: Springs.Geometry
# Offsets a curve both ways and correctly differenciates the external and internal offset. If an offset goes beyond the curve's bounds, the result will fail and a null value will be appended instead. Also works for convex curves like arcs.

code_block = CodeBlock()
# ---------- code_block.designscript (29 lines) ----------
def offset1(c,dist){
return = [Imperative]{
 c1_fail = false;
 c2_fail = false;
 rev = 0;
 c1 = c.Offset(dist);
 c2 = c.Offset(-dist);
 if (c1 == null){
  c1 = c;
  c1_fail = true;
 }
 if (c2 == null){
  c2 = c;
  c2_fail = true;
 }
 out1 = {c1,c2};
 if (c1.Length > c2.Length){
  out1 = {c2,c1};
  rev = 1;
 }
 if (c1_fail){
 out1[0-rev] = null;
 }
 if (c2_fail){
 out1[1-rev] = null;
 }
 return = out1;
}
};
# ----------------------------------------
curve = Input(curve:var)
distance = Input(distance:double)
code_block_2 = CodeBlock(c=curve, dist=distance) { off1 = offset1(c, dist); off1[0]; off1[1]; }
internal_offset = Output(code_block_2.out1)
external_offset = Output(code_block_2.out2)
