# Dynamo custom node Collect.LinkedInstanceElements.dyf (Dynamo 4.0.2.3852)
# category: Springs.Revit.Selection.Actions
# Extract elements by category from the selected linked instances. The transform CS can be used to get the exact location of the elements in the host file. If an error occurs or the linked document is unloaded, an error will be returned in the elements output and the appropriate transform will be a null. You can use those nulls to filter out the errors.

linkInstance = Input(linkInstance: var[])
CategoryOrClass = Input(CategoryOrClass: var[])
refresh = Input(refresh: bool = true)
python_script = Python(IN[0]=linkInstance, IN[1]=CategoryOrClass, IN[2]=refresh)  # PythonNet3
# ---------- python_script.python (93 lines) ----------
#-Reope----------------------------------------#
#                                              #
#      Copyright(c) 2019, Dimitar Venkov       #
#                                              #
# https://github.com/dimven/SpringNodes/issues #
# https://www.reope.com/                       #
#                                              #
#    ____    _____   _____   ____    _____     #
#   |  _ \ *|  ___|*|  _  |*|  _ \ *|  ___|    #
#   | |_) |*| |___ *| | | |*| |_) |*| |___     #
#   |  _ < *|  ___|*| | | |*|  __/ *|  ___|    #
#   | | | |*| |___ *| |_| |*| |    *| |___     #
#   |_| \_|*|_____|*|_____|*|_|    *|_____|    #
#                                              #
#                                              #
#-Reope-----Updated by Mark Ackerley-----------#

import clr
clr.AddReference("RevitNodes")
import Revit
clr.ImportExtensions(Revit.Elements)
clr.ImportExtensions(Revit.GeometryConversion)

clr.AddReference('RevitServices')
from RevitServices.Persistence import DocumentManager
doc = DocumentManager.Instance.CurrentDBDocument

clr.AddReference("RevitAPI")
from Autodesk.Revit.DB import FilteredElementCollector, RevitLinkType, ElementMulticategoryFilter, ElementId
import Autodesk.Revit.DB as DB

from System.Collections.Generic import List
import System

def tolist(obj1):
    if isinstance(obj1, str): return [obj1]
    return obj1 if isinstance(obj1, list) else [obj1]

try:
    links = UnwrapElement(tolist(IN[0]))
    cats = UnwrapElement(tolist(IN[1]))

    elements, transforms = [], []

    ueWrapper = None
    wrappers = clr.GetClrType(Revit.Elements.ElementWrapper).GetMethods()
    for w in wrappers:
        if w.ToString().startswith("Revit.Elements.UnknownElement"):
            ueWrapper = w
            break

    for link in links:
        try:
            if RevitLinkType.IsLoaded(doc, link.GetTypeId()):
                linkDoc = link.GetLinkDocument()

                if isinstance(cats[0], DB.Category):
                    catId = List[DB.ElementId](c.Id for c in cats)
                    filter = DB.ElementMulticategoryFilter(catId)
                elif isinstance(cats[0], DB.ElementType):
                    types = List[System.Type](t.GetType() for t in cats)
                    filter = DB.ElementMulticlassFilter(types)
                else:
                    types = List[System.Type](cats)
                    filter = DB.ElementMulticlassFilter(types)

                fec = FilteredElementCollector(linkDoc).WhereElementIsNotElementType().WherePasses(filter)
                linkEls = []
                for e in fec:
                    try:
                        linkEls.append(e.ToDSType(True))
                    except:
                        if ueWrapper:
                            linkEls.append(ueWrapper.Invoke(None, (e, True)))
                elements.append(linkEls)
                transforms.append(link.GetTotalTransform().ToCoordinateSystem(True))
                fec.Dispose()
                filter.Dispose()
            else:
                elements.append('Linked document is unloaded')
                transforms.append(None)
        except Exception as ex:
            elements.append(str(ex))
            transforms.append(None)

    OUT = elements, transforms

except Exception as e:
    import traceback
    OUT = "Exception:\n{0}\n\nTraceback:\n{1}".format(
        str(e),
        traceback.format_exc()
    )
# ----------------------------------------
code_block = CodeBlock(res=python_script) { res[0]; res[1]; }
elements = Output(code_block.out0)
transform = Output(code_block.out1)
