# Dynamo custom node Collect.Revisions.dyf (Dynamo 4.0.2.3852)
# category: Springs.Revit.Selection.Actions
# Collects all revision clouds from a specific date.

date = Input(date: string)
refresh = Input(refresh: bool = true)
python_script = Python(IN[0]=date, IN[1]=refresh)  # PythonNet3
# ---------- python_script.python (53 lines) ----------
#-Reope----------------------------------------#
#                                              #
#      Copyright(c) 2016, Dimitar Venkov       #
#                                              #
# https://github.com/dimven/SpringNodes/issues #
# https://www.reope.com/                       #
#                                              #
#    ____    _____   _____   ____    _____     #
#   |  _ \ *|  ___|*|  _  |*|  _ \ *|  ___|    #
#   | |_) |*| |_--- *| | | |*| |_) |*| |___     #
#   |  _ < *|  ___|*| | | |*|  __/ *|  ___|    #
#   | | | |*| |_--- *| |_| |*| |    *| |___     #
#   |_| \_|*|_____|*|_____|*|_|    *|_____|    #
#                                              #
#                                              #
#-Reope-----Updated by Mark Ackerley-----------#

import clr
clr.AddReference("RevitServices")
import RevitServices
from RevitServices.Persistence import DocumentManager
doc = DocumentManager.Instance.CurrentDBDocument

clr.AddReference("RevitAPI")
from Autodesk.Revit.DB import *

clr.AddReference("RevitNodes")
import Revit
clr.ImportExtensions(Revit.Elements)

try:
    rdat = IN[0].lower()
    all_rev, match = [], []

    fec = FilteredElementCollector(doc).OfCategory(BuiltInCategory.OST_Revisions)
    for f in fec:
        rev1 = f.ToDSType(True)
        all_rev.append(rev1)
        par1 = f.get_Parameter(BuiltInParameter.PROJECT_REVISION_REVISION_DATE)
        if par1.AsString().lower() == rdat:
            match.append(rev1)

    if len(match) != 0:
        OUT = match, all_rev
    else:
        OUT = "No revisions found from date %s" % rdat, all_rev

except Exception as e:
    import traceback
    OUT = "Exception:\n{0}\n\nTraceback:\n{1}".format(
        str(e),
        traceback.format_exc()
    )
# ----------------------------------------
code_block = CodeBlock(rev=python_script) { rev[0]; rev[1]; }
matched = Output(code_block.out0)
all_revisions = Output(code_block.out1)
