# Dynamo custom node Collect.Sheets.dyf (Dynamo 4.0.2.3852)
# category: Springs.Revit.Selection.Actions
# Search for sheets by either their name or their number. Use a false boolean switch to search by number.

searchFor = Input(searchFor: var[])
NameOrNumber = Input(NameOrNumber: bool = true)
refresh = Input(refresh: bool = true)
python_script = Python(IN[0]=searchFor, IN[1]=NameOrNumber, IN[2]=refresh)  # PythonNet3
# ---------- python_script.python (63 lines) ----------
#-Reope----------------------------------------#
#                                              #
#      Copyright(c) 2016, Dimitar Venkov       #
#                                              #
# https://github.com/dimven/SpringNodes/issues #
# https://www.reope.com/                       #
#                                              #
#    ____    _____   _____   ____    _____     #
#   |  _ \ *|  ___|*|  _  |*|  _ \ *|  ___|    #
#   | |_) |*| |_--- *| | | |*| |_) |*| |___     #
#   |  _ < *|  ___|*| | | |*|  __/ *|  ___|    #
#   | | | |*| |_--- *| |_| |*| |    *| |___     #
#   |_| \_|*|_____|*|_____|*|_|    *|_____|    #
#                                              #
#                                              #
#-Reope-----Updated by Mark Ackerley-----------#

import clr
clr.AddReference("RevitServices")
import RevitServices
from RevitServices.Persistence import DocumentManager
doc = DocumentManager.Instance.CurrentDBDocument

clr.AddReference("RevitAPI")
from Autodesk.Revit.DB import *

clr.AddReference("RevitNodes")
import Revit
clr.ImportExtensions(Revit.Elements)

def tolist(obj1):
    if isinstance(obj1, str): return [obj1]
    return obj1 if isinstance(obj1, list) else [obj1]

try:
    fn = list(map(str, tolist(IN[0])))
    NameNumber = IN[1]

    result, similar, names = [], [], []
    fec = FilteredElementCollector(doc).OfClass(View)

    for i in fec:
        if i.ViewType.ToString() == "DrawingSheet":
            n1 = i.Name if NameNumber else i.SheetNumber
            names.append(n1)
            if any(fn1 == n1 for fn1 in fn):
                result.append(i.ToDSType(True))
            elif any(fn1.lower() in n1.lower() for fn1 in fn):
                similar.append(i.ToDSType(True))

    if len(result) > 0:
        OUT = result, similar
    elif len(similar) > 0:
        OUT = "No exact match found. Check partial below:", similar
    else:
        OUT = "No match found! Check values below:", names

except Exception as e:
    import traceback
    OUT = "Exception:\n{0}\n\nTraceback:\n{1}".format(
        str(e),
        traceback.format_exc()
    )
# ----------------------------------------
code_block = CodeBlock(v=python_script) { v[0]; v[1]; }
exact_match = Output(code_block.out0)
partial_match = Output(code_block.out1)
