# Dynamo custom node Collect.View3DTemplates.dyf (Dynamo 4.0.2.3852)
# category: Springs.Revit.Selection.Actions
# Gets all 3d view templates and returns them to Dynamo as generic Elements

refresh = Input(refresh: bool = true)
python_script = Python(IN[0]=refresh)  # PythonNet3
# ---------- python_script.python (46 lines) ----------
#-Reope----------------------------------------#
#                                              #
#      Copyright(c) 2016, Dimitar Venkov       #
#                                              #
# https://github.com/dimven/SpringNodes/issues #
# https://www.reope.com/                       #
#                                              #
#    ____    _____   _____   ____    _____     #
#   |  _ \ *|  ___|*|  _  |*|  _ \ *|  ___|    #
#   | |_) |*| |___ *| | | |*| |_) |*| |___     #
#   |  _ < *|  ___|*| | | |*|  __/ *|  ___|    #
#   | | | |*| |___ *| |_| |*| |    *| |___     #
#   |_| \_|*|_____|*|_____|*|_|    *|_____|    #
#                                              #
#                                              #
#-Reope-----Updated by Mark Ackerley-----------#

import clr
clr.AddReference('RevitAPI')
import Autodesk.Revit.DB as DB

clr.AddReference('RevitServices')
from RevitServices.Persistence import DocumentManager
doc = DocumentManager.Instance.CurrentDBDocument

clr.AddReference('RevitNodes')
import Revit
clr.ImportExtensions(Revit.Elements)

try:
    ueWrapper = None
    wrappers = clr.GetClrType(Revit.Elements.ElementWrapper).GetMethods()
    for w in wrappers:
        if w.ToString().startswith("Revit.Elements.UnknownElement"):
            ueWrapper = w
            break

    fec = DB.FilteredElementCollector(doc).OfClass(DB.View3D)
    OUT = [ueWrapper.Invoke(None, (i, True)) for i in fec if i.IsTemplate]

except Exception as e:
    import traceback
    OUT = "Exception:\n{0}\n\nTraceback:\n{1}".format(
        str(e),
        traceback.format_exc()
    )
# ----------------------------------------
Templates = Output(python_script)
