# Dynamo custom node Collector.AllElementTypesOf.dyf "Springs.Collector.AllElementTypesOf" (Dynamo 1.3.2.2480)
# category: Springs.Revit.Collectors
# Works with either categories, element types or revit classes and uses multi-filters to get multiple groups with a single query. Can be applied as a function. No ties to the Document.Changed event.

CategoryOrElemType = Input(CategoryOrElemType:var[])
refresh = Input(refresh:bool=true)
python_script = Python(IN[0]=CategoryOrElemType, IN[1]=refresh)
# ---------- python_script.python (38 lines) ----------
import System
import clr
clr.AddReference('RevitAPI')
import Autodesk.Revit.DB as DB

clr.AddReference("RevitServices")
import RevitServices
from RevitServices.Persistence import DocumentManager
doc = DocumentManager.Instance.CurrentDBDocument

clr.AddReference('RevitNodes')
import Revit
clr.ImportExtensions(Revit.Elements)

from System.Collections.Generic import List

def tolist(x):
	if hasattr(x,'__iter__'): return x
	else : return [x]

x = UnwrapElement(tolist(IN[0]))

fec = DB.FilteredElementCollector(doc).WhereElementIsElementType()
if isinstance(x[0], DB.Category):
	catId = List[DB.ElementId](c.Id for c in x)
	filter = DB.ElementMulticategoryFilter(catId)
	
elif isinstance(x[0], DB.ElementType):
	types = List[System.Type](t.GetType() for t in x)
	filter = DB.ElementMulticlassFilter(types)
else:
	types = List[System.Type](x)
	filter = DB.ElementMulticlassFilter(types)

fec.WherePasses(filter)
OUT = [e.ToDSType(1) for e in fec]
fec.Dispose()
filter.Dispose()
# ----------------------------------------
elements = Output(python_script)
