# Dynamo custom node Collector.AllElementsOf.dyf "Springs.Collector.AllElementsOf" (Dynamo 1.3.2.2480)
# category: Springs._Depreciated
# Depreciated, use the Springs.Collector.AllElementsOf+ version instead.
# Works with either categories or types and uses the built in collecotor functions. Can be applied as a function. No ties to the Document.Changed event.

CategoryOrType = Input(CategoryOrType: var)
code_block = CodeBlock(CategoryOrType)
# ---------- code_block.designscript (10 lines) ----------
el = [Imperative]{
isType = String.StartsWith(ToString(x), "Autodesk.Revit.DB.", 0);
if (isType)
{
  return = ElementQueries.OfElementType(x);
}
else
{
  return = ElementQueries.OfCategory(x);
}};
# ----------------------------------------
elements = Output(code_block)
refresh = Input(refresh:bool = true)
