# Dynamo custom node Collector.CurrentSelection.dyf (Dynamo 0.8.2.2392)
# category: SpringNodes.Revit.Collectors
# Gets the currently selected elements. Connect a boolean switch to refresh the selection. Compatible with Revit 2016

refresh = Input(refresh:bool = true)
python_script = Python(IN[0]=refresh)
# ---------- python_script.python (27 lines) ----------
#Copyright(c) 2016, Dimitar Venkov
# @5devene, dimitar.ven@gmail.com

import clr

clr.AddReference("RevitNodes")
import Revit
clr.ImportExtensions(Revit.Elements)

clr.AddReference("RevitServices")
import RevitServices
from RevitServices.Persistence import DocumentManager
doc = DocumentManager.Instance.CurrentDBDocument
uiapp = DocumentManager.Instance.CurrentUIApplication
app = uiapp.Application
uidoc=uiapp.ActiveUIDocument

def output1(l1):
	if len(l1) == 1: return l1[0]
	else: return l1

if app.VersionName == "Autodesk Revit 2016":
	selid = uidoc.Selection.GetElementIds()
	OUT = output1([doc.GetElement(id).ToDSType(True) for id in selid])
else:
	sel = uidoc.Selection.Elements
	OUT = output1([s.ToDSType(True) for s in sel])
# ----------------------------------------
element_s = Output(python_script)  # "element(s)"
