# Dynamo custom node Collector.FamilyTypes.dyf (Dynamo 0.8.2.2392)
# category: SpringNodes.Revit.Collectors
# Collects non-system family types that fully match or partially match the provided names. If no matches are found, a list of all type names will be output.

type_name_s = Input()  # "type name(s)"
refresh = Input(refresh:bool = true)
python_script = Python(IN[0]=type_name_s, IN[1]=refresh)
# ---------- python_script.python (46 lines) ----------
#Copyright(c) 2015, Dimitar Venkov
# @5devene, dimitar.ven@gmail.com

import clr

clr.AddReference("RevitServices")
import RevitServices
from RevitServices.Persistence import DocumentManager
doc = DocumentManager.Instance.CurrentDBDocument

clr.AddReference("RevitAPI")
from Autodesk.Revit.DB import *

clr.AddReference("RevitNodes")
import Revit
clr.ImportExtensions(Revit.Elements)

def tolist(obj1):
	if hasattr(obj1,"__iter__"):
		return obj1
	else:
		return [obj1]

fn = tolist(IN[0])

fec = FilteredElementCollector(doc).OfClass(FamilySymbol).GetElementIterator()
fec.Reset()

result = []
similar = []
names = []

for i in fec:
	n1 = i.ToDSType(True).Name
	names.append(n1)
	if any(fn1 == n1 for fn1 in fn):
		result.append(i.ToDSType(True))
	elif any(fn1.lower() in n1.lower() for fn1 in fn):
		similar.append(i.ToDSType(True))

if len(result) > 0:
	OUT = result,similar
if len(result) == 0 and len(similar) > 0:
	OUT = "No exact match found. Check partial below:",similar
if len(result) == 0 and len(similar) == 0:
	OUT = "No match found! Check names below:", names
# ----------------------------------------
code_block = CodeBlock(a=python_script) { a[0]; a[1]; }
exact_match = Output(code_block.out0)
partial_match = Output(code_block.out1)
