# Dynamo custom node Collector.Revisions.dyf (Dynamo 0.8.2.2392)
# category: SpringNodes.Revit.Collectors
# Collects all revisions from a specific date.

rev_date_s = Input()  # "rev. date(s)"
refresh = Input(refresh:bool = true)
python_script = Python(IN[0]=rev_date_s, IN[1]=refresh)
# ---------- python_script.python (29 lines) ----------
#Copyright(c) 2015, Dimitar Venkov
# @5devene, dimitar.ven@gmail.com

import clr

clr.AddReference("RevitServices")
import RevitServices
from RevitServices.Persistence import DocumentManager
doc = DocumentManager.Instance.CurrentDBDocument

clr.AddReference("RevitAPI")
import Autodesk
from Autodesk.Revit.DB import FilteredElementCollector, BuiltInCategory

clr.AddReference("RevitNodes")
import Revit
clr.ImportExtensions(Revit.Elements)

dataEnteringNode = IN
rdat = IN[0]

rev = FilteredElementCollector(doc).OfCategory(BuiltInCategory.OST_Revisions).ToElements()
rev = [r.ToDSType(True) for r in rev]
match = []
[match.append(r) for r in rev if r.GetParameterValueByName("Revision Date") in rdat]
if len(match) != 0:
	OUT = match, rev
else:
	OUT = "No revision found from date %s" %rdat, rev
# ----------------------------------------
code_block = CodeBlock(rev=python_script) { rev[0]; rev[1]; }
matched = Output(code_block.out0)
all_revisions = Output(code_block.out1)
