# Dynamo custom node Collector.Sheets.dyf (Dynamo 0.8.2.2392)
# category: SpringNodes.Revit.Collectors
# Search for sheets by either their name or their number. Use a false boolean switch to search by number.

name_s_number_s = Input()  # "name(s)/number(s)"
NameOrNumber = Input(NameOrNumber:bool = true)
refresh = Input(refresh:bool = true)
python_script = Python(IN[0]=name_s_number_s, IN[1]=NameOrNumber, IN[2]=refresh)
# ---------- python_script.python (55 lines) ----------
#Copyright(c) 2015, Dimitar Venkov
# @5devene, dimitar.ven@gmail.com

import clr

clr.AddReference("RevitServices")
import RevitServices
from RevitServices.Persistence import DocumentManager


clr.AddReference("RevitAPI")
from Autodesk.Revit.DB import *

doc = DocumentManager.Instance.CurrentDBDocument

clr.AddReference("RevitNodes")
import Revit
clr.ImportExtensions(Revit.Elements)


def tolist(obj1):
	if hasattr(obj1,"__iter__"):
		return obj1
	else:
		return [obj1]

dataEnteringNode = IN
fn = tolist(IN[0])
fn = [str(n) for n in fn]
NameNumber = IN[1]


fec = FilteredElementCollector(doc).OfClass(View).GetElementIterator()
fec.Reset()
result = []
similar = []
names = []

for i in fec:
	if i.ViewType == ViewType.DrawingSheet:
		if NameNumber:
			n1 = i.ViewName
		else:
			n1 = i.SheetNumber
		names.append(n1)
		if any(fn1 == n1 for fn1 in fn):
			result.append(i.ToDSType(True))
		elif any(fn1.lower() in n1.lower() for fn1 in fn):
			similar.append(i.ToDSType(True))
if len(result) > 0:
	OUT = result,similar
if len(result) == 0 and len(similar) > 0:
	OUT = "No exact match found. Check partial below:",similar
if len(result) == 0 and len(similar) == 0:
	OUT = "No match found! Check values below:", names
# ----------------------------------------
code_block = CodeBlock(v=python_script) { v[0]; v[1]; }
exact_match = Output(code_block.out0)
partial_match = Output(code_block.out1)
