# Dynamo custom node Collector.Views.dyf (Dynamo 0.8.2.2392)
# category: SpringNodes.Revit.Collectors
# Search for views based on naming. You can choose to either include or exclude schedules. Use the sheet collector for sheets.

name_s = Input()  # "name(s)"
IncludeSheets = Input(IncludeSheets:bool = false)
refresh = Input(refresh:bool = true)
python_script = Python(IN[0]=name_s, IN[1]=IncludeSheets, IN[2]=refresh)
# ---------- python_script.python (51 lines) ----------
#Copyright(c) 2015, Dimitar Venkov
# @5devene, dimitar.ven@gmail.com

import clr

clr.AddReference("RevitServices")
import RevitServices
from RevitServices.Persistence import DocumentManager
doc = DocumentManager.Instance.CurrentDBDocument

clr.AddReference("RevitAPI")
from Autodesk.Revit.DB import *

clr.AddReference("RevitNodes")
import Revit
clr.ImportExtensions(Revit.Elements)

def tolist(obj1):
	if hasattr(obj1,"__iter__"):
		return obj1
	else:
		return [obj1]

fn = tolist(IN[0])
fn = [str(n) for n in fn]
IncSchedules = IN[1]

fec = FilteredElementCollector(doc).OfClass(View).GetElementIterator()
fec.Reset()

result = []
similar = []
names = []
if IncSchedules:
	exclude = ["DrawingSheet"]
else:
	exclude = ["DrawingSheet", "Schedule"]
for i in fec:
	if not i.IsTemplate and not any(e in str(i.ViewType) for e in exclude):
		n1 = i.ViewName
		names.append(n1)
		if any(fn1 == n1 for fn1 in fn):
			result.append(i.ToDSType(True))
		elif any(fn1.lower() in n1.lower() for fn1 in fn):
			similar.append(i.ToDSType(True))
if len(result) > 0:
	OUT = result,similar
if len(result) == 0 and len(similar) > 0:
	OUT = "No exact match found. Check partial below:",similar
if len(result) == 0 and len(similar) == 0:
	OUT = "No match found! Check names below:", names
# ----------------------------------------
code_block = CodeBlock(v=python_script) { v[0]; v[1]; }
exact_match = Output(code_block.out0)
partial_match = Output(code_block.out1)
