# Dynamo custom node Color2Decimal.dyf "Springs.Color2Decimal" (Dynamo 1.0.0.1180)
# category: Springs.Revit.Color
# Converts a Dynamo colour its Revit equivalent  decimal value.

code_block = CodeBlock()
# ---------- code_block.designscript (6 lines) ----------
def clr2dec(c){
r = c.Red;
g = c.Green;
b = c.Blue;
return = b*256*256 + g*256 + r;
};
# ----------------------------------------
color = Input(color:Color)
code_block_2 = CodeBlock(c=color) { clr2dec(c); }
decimal = Output(code_block_2)
