# Dynamo custom node Curve.Offset+.dyf "Springs.Curve.Offset+" (Dynamo 0.8.2.2392)
# category: Springs.Geometry
# Offsets a curve towards the specified point

code_block = CodeBlock()
# ---------- code_block.designscript (5 lines) ----------
def offset1(c:Curve, dist:double,fn1){
d1 = {- dist, dist};
cl1 = c.Offset(d1<1>);
return = MinimumItemByKey(cl1, fn1);
};
# ----------------------------------------
curve = Input(curve:var)
distance = Input(distance:var)
point = Input(point:var)
distanceTo = Geometry.DistanceTo(other=point)
code_block_2 = CodeBlock(c=curve, dist=distance, fn1=distanceTo) { offset1(c,dist,fn1); }
curve_2 = Output(code_block_2)  # "curve"
