# Dynamo custom node CurveLoop.Simplify.dyf "Springs.CurveLoop.Simplify" (Dynamo 1.2.1.3083)
# category: Springs.Geometry
# Attempts to simplify an open or a closed curve loop by connecting straight separate line segments into a single line.

code_block = CodeBlock()
# ---------- code_block.designscript (52 lines) ----------
def cPts(c1){
return = {c1.StartPoint,c1.EndPoint};
};

def isLine(c1){
return = Math.Abs(c1.Length - Line.ByBestFitThroughPoints
 (cPts(c1) ).Length) <= 0.0001;
};

def cVec(c1){
pts = cPts(c1);
return = Vector.ByTwoPoints(pts[0], pts[1]);
};

def merge1(lines:var[]){
return = [Imperative]{
pc1 = PolyCurve.ByJoinedCurves(lines);
lines = pc1.Curves();
if (pc1.IsClosed)
{
 lines = List.AddItemToEnd(lines[0], lines);
}
i = 0;
out1 = {};
while (i < Count(lines) -1)
{
 pts = cPts(lines[i]);
 while (isLine(lines[i+1]) && cVec(lines[i])
  .AngleWithVector(cVec(lines[i+1])) < 0.0001)
 {
  pts = List.Join({pts, cPts(lines[i+1])});
  i = i + 1;
 }
 if (Count(pts) == 2)
 {
  out1 = List.Join({out1,lines[i]});
  i = i + 1;
 }
 else
 {
  out1 = List.Join({out1,Line.
   ByBestFitThroughPoints(pts)});
  i = i + 1;
 }
}
if (out1[-1].Intersect(out1[0])[0].Length != null
    && Count(out1) > 1)
 {
  //out1 = List.RestOfItems(out1);
 }
return = out1;
}};
# ----------------------------------------
curveLoop = Input(curveLoop: var[])
code_block_2 = CodeBlock(lines=curveLoop) { merge1(lines); }
curve_loop = Output(code_block_2)
