# Dynamo custom node Decimal.ToColor.dyf (Dynamo 4.0.2.3852)
# category: Springs.Revit.Actions
# Converts a revit colour decimal value to its Dynamo equivalent.

decimal = Input(decimal: var)
code_block = CodeBlock(x=decimal) { r = x % 256; x1 = ((x - r)/256); g = x1 % 256; b = (x1 - g)/256; c = Color.ByARGB(255,r,g,b); }
color = Output(code_block.c)
