# Dynamo custom node Decimal2Color.dyf "Springs.Decimal2Color" (Dynamo 1.0.0.1180)
# category: Springs.Revit.Color
# Converts a revit colour decimal value to its Dynamo equivalent.

code_block = CodeBlock()
# ---------- code_block.designscript (7 lines) ----------
def dec2clr(x){
r = x % 256;
x1 = ((x - r)/256);
g = x1 % 256;
b = (x1 - g)/256;
return = Color.ByARGB(255,r,g,b);
};
# ----------------------------------------
decimal = Input(decimal:var)
code_block_2 = CodeBlock(x=decimal) { dec2clr(x); }
color = Output(code_block_2)
