# Dynamo custom node Delaunay2D.ByPoints.dyf "Springs.Delaunay2D.ByPoints" (Dynamo 1.2.1.3083)
# category: Springs.Geometry
# Create a delaunay triangulation of a set of planar points. You can get the result as points or as lines.

points = Input(points:var[])
asPoints = Input(asPoints: bool = false)
code_block = CodeBlock(points, asPoints)
# ---------- code_block.designscript (11 lines) ----------
def delaunay1(pts0:var[], asPts:bool){
p0 = Point.ByCoordinates(12345,12345,12345);
pts1 = DSCore.List.AddItemToEnd(p0, pts0);
c1 = DSCore.List.Chop(Delaunay.ByPoints(pts1), 3);
p1 = c1.StartPoint;
m1 = AllFalse(p0.IsAlmostEqualTo(p1)<1>);
r1 = asPts ? p1 : c1;
return = DSCore.List.FilterByBoolMask(r1, m1)["in"];
};

delaunay1(a, b);
# ----------------------------------------
pts_lines = Output(code_block)  # "pts/lines"
