# Dynamo custom node DirectShape.ByGeometry.dyf "Springs.DirectShape.ByGeometry" (Dynamo 1.1.0.2094)
# category: Springs.Revit.DirectShape
# Convert the input geometry to DirectShape element inside the Revit document.  It supports solids or surfaces.It is based on an alternative process that uses a SAT import and can produce smooth surfaces. Each created DS will have a unique type. Make sure that each input geometry has a unique name. You can either feed a single category for all geometries or a unique category for each geometry - the node's lacing is set to longest by default.

geometry = Input(geometry:var[])
category = Input(category:var[] = Category.ByName("OST_GenericModel"))
name = Input(name:var[])
python_script = Python(IN[0]=geometry, IN[1]=category, IN[2]=name)
# ---------- python_script.python (133 lines) ----------
#Copyright(c) 2017, Dimitar Venkov
# @5devene, dimitar.ven@gmail.com
# www.badmonkeys.net

import clr
import System
from System.Collections.Generic import *

from itertools import repeat

pf_path = System.Environment.GetFolderPath(System.Environment.SpecialFolder.ProgramFilesX86)
import sys
sys.path.append("%s\IronPython 2.7\Lib" %pf_path)
import traceback

clr.AddReference('ProtoGeometry')
from Autodesk.DesignScript.Geometry import *

clr.AddReference("RevitServices")
import RevitServices
from RevitServices.Persistence import DocumentManager
from RevitServices.Transactions import TransactionManager
doc = DocumentManager.Instance.CurrentDBDocument

clr.AddReference("RevitNodes")
import Revit
clr.ImportExtensions(Revit.Elements)
clr.ImportExtensions(Revit.GeometryConversion)

clr.AddReference("RevitAPI")
from Autodesk.Revit.DB import *

def tolist(obj1):
	if hasattr(obj1,"__iter__"): return obj1
	else: return [obj1]

def output1(l1):
	if len(l1) == 1: return l1[0]
	else: return l1

def PadLists(lists):
	len1 = len(lists[0])
	for i in xrange(1,len(lists)):
		len2 = len(lists[i])
		if len2 == len1 : continue
		elif len2 > len1: lists[i] = lists[i][:len1]
		else : lists[i].extend(repeat(lists[i][-1],len1 - len2))
	return lists

def NewDS(s1,cat,name1):
	message = None
	temp_path = System.IO.Path.GetTempPath()
	sat_path = "%s%s.sat"% (temp_path, name1)
	try:
		if factor != 1:
			s1 = s1.Scale(factor)
		sat1 = Geometry.ExportToSAT(s1, sat_path)
		satId = doc.Import(sat1, satOpt, view1)
		el1 = doc.GetElement(satId)
		geom1 = el1.get_Geometry(opt1)
		enum = geom1.GetEnumerator()
		enum.MoveNext()
		geom2 = enum.Current.GetInstanceGeometry()
		enum2 = geom2.GetEnumerator()
		enum2.MoveNext()
		s1 = enum2.Current
		doc.Delete(satId)
		System.IO.File.Delete(sat_path)
	except:
		message = traceback.format_exc()
		pass
	if message == None:
		try:
			if name1 in dst_enum:
				old_type = dst_enum[name1]
				old_type.SetShape([s1])
				fec1 = FilteredElementCollector(doc).OfClass(DirectShape).WhereElementIsNotElementType()
				insts = [i for i in fec1 if i.GetTypeId().Equals(old_type.Id)]
				if insts:
					return insts[0].ToDSType(False)
				else:
					dsLib.AddDefinitionType(name1, old_type.Id)
					ds1 =  DirectShape.CreateElementInstance(doc, old_type.Id, cat.Id, name1, tf1, "Dynamo","spring nodes")
					ds1.SetTypeId(old_type.Id)
					return ds1.ToDSType(False) 
			else:
				dsType1 = DirectShapeType.Create(doc, name1, cat.Id)
				dsType1.SetShape([s1])
				dsLib.AddDefinitionType(name1, dsType1.Id)
				ds1 =  DirectShape.CreateElementInstance(doc, dsType1.Id, cat.Id, name1, tf1, "Dynamo","spring nodes")
				ds1.SetTypeId(dsType1.Id)
				return ds1.ToDSType(False)
		except:
			message = traceback.format_exc()
			return message
	else: return message

solids = tolist(IN[0])
cat = tolist(IN[1])
cat = [UnwrapElement(c) for c in cat]
names = tolist(IN[2])

satOpt = SATImportOptions()
satOpt.Placement = ImportPlacement.Origin
satOpt.Unit = ImportUnit.Foot
opt1 = Options()
opt1.ComputeReferences = True
acceptable_views = ("ThreeD", "FloorPlan", "EngineeringPlan", "CeilingPlan", "Elevation", "Section")
view_fec = FilteredElementCollector(doc).OfClass(View)
view1 = None
for v in view_fec:
	if str(v.ViewType) in acceptable_views and not v.IsTemplate:
		view1 = v
		break
units = doc.GetUnits().GetFormatOptions(UnitType.UT_Length).DisplayUnits
factor = UnitUtils.ConvertToInternalUnits(1,units)
dsLib = DirectShapeLibrary.GetDirectShapeLibrary(doc)
tf1 = Transform.Identity
dst_fec = FilteredElementCollector(doc).OfClass(DirectShapeType)
dst_enum = dict([(Element.Name.__get__(i), i) for i in dst_fec])
if len(solids) == len(cat) == len(names):
	TransactionManager.Instance.EnsureInTransaction(doc)
	OUT = output1(map(NewDS, solids, cat, names))
	TransactionManager.Instance.TransactionTaskDone()
elif len(solids) == len(names):
	padded = PadLists([solids,cat])
	p_cat = padded[1]
	TransactionManager.Instance.EnsureInTransaction(doc)
	OUT = output1(map(NewDS, solids, p_cat, names))
	TransactionManager.Instance.TransactionTaskDone()
else : OUT = "Make sure that each geometry\nobject has a unique type name."
satOpt.Dispose()
opt1.Dispose()
# ----------------------------------------
DirectShape = Output(python_script)
