# Dynamo custom node DirectShape.Transform.dyf (Dynamo 4.0.2.3852)
# category: Springs.Revit.Actions
# Transforms the typed DirectShape element from the identity coordinate system to the input coordinate system(s), in a manner similar to Dynamo's Geometry.Transform node.

directShape = Input(directShape: var)
coordSystem = Input(coordSystem: var[])
python_script = Python(IN[0]=directShape, IN[1]=coordSystem)  # PythonNet3
# ---------- python_script.python (84 lines) ----------
#-Reope----------------------------------------#
#                                              #
#      Copyright(c) 2016, Dimitar Venkov       #
#                                              #
# https://github.com/dimven/SpringNodes/issues #
# https://www.reope.com/                       #
#                                              #
#    ____    _____   _____   ____    _____     #
#   |  _ \ *|  ___|*|  _  |*|  _ \ *|  ___|    #
#   | |_) |*| |___ *| | | |*| |_) |*| |___     #
#   |  _ < *|  ___|*| | | |*|  __/ *|  ___|    #
#   | | | |*| |_--- *| |_| |*| |    *| |___     #
#   |_| \_|*|_____|*|_____|*|_|    *|_____|    #
#                                              #
#                                              #
#-Reope-----Updated by Mark Ackerley-----------#

import clr
clr.AddReference("RevitServices")
import RevitServices
from RevitServices.Persistence import DocumentManager
from RevitServices.Transactions import TransactionManager
doc = DocumentManager.Instance.CurrentDBDocument

clr.AddReference("RevitNodes")
import Revit
clr.ImportExtensions(Revit.Elements)
clr.ImportExtensions(Revit.GeometryConversion)

clr.AddReference("RevitAPI")
from Autodesk.Revit.DB import *

def tolist(obj1):
    if isinstance(obj1, str): return [obj1]
    return obj1 if isinstance(obj1, list) else [obj1]

try:
    units = doc.GetUnits().GetFormatOptions(SpecTypeId.Length).GetUnitTypeId()
    factor = 1 / UnitUtils.ConvertToInternalUnits(1, units)

    def cs2Trans(cs, scale=factor):
        tf1 = Transform(Transform.Identity)
        tf1.Origin = cs.Origin.ToXyz(True)
        tf1.BasisX = cs.XAxis.ToXyz(True)
        tf1.BasisY = cs.YAxis.ToXyz(True)
        tf1.BasisZ = cs.ZAxis.ToXyz(True)
        return tf1.ScaleBasis(scale)

    is_list = isinstance(IN[0], list)
    dsTyped = tolist(UnwrapElement(IN[0]))
    cs1 = tolist(IN[1])

    if len(dsTyped) != len(cs1):
        OUT = "Error: number of shapes ({}) must match number of coordinate systems ({}).".format(
            len(dsTyped), len(cs1)
        )
    else:
        dsLib = DirectShapeLibrary.GetDirectShapeLibrary(doc)

        TransactionManager.Instance.EnsureInTransaction(doc)
        output = []
        for ds, cs in zip(dsTyped, cs1):
            try:
                TypeId = ds.GetTypeId()
                cat_id = ds.Category.Id
                Lib_TypeId = TypeId.ToString()
                if not dsLib.ContainsType(Lib_TypeId):
                    dsLib.AddDefinitionType(Lib_TypeId, TypeId)
                transf = cs2Trans(cs)
                ds1 = DirectShape.CreateElementInstance(doc, TypeId, cat_id, Lib_TypeId, transf)
                ds1.SetTypeId(TypeId)
                output.append(ds1.ToDSType(False))
            except Exception as inner_e:
                import traceback
                output.append("Error on element: {0}".format(traceback.format_exc()))
        TransactionManager.Instance.TransactionTaskDone()
        OUT = output if is_list else output[0]

except Exception as e:
    import traceback
    OUT = "Exception:\n{0}\n\nTraceback:\n{1}".format(
        str(e),
        traceback.format_exc()
    )
# ----------------------------------------
directShape_2 = Output(python_script)  # "directShape"
