# Dynamo custom node Doc.CentralPath.dyf "Springs.Doc.CentralPath" (Dynamo 1.2.1.3083)
# category: Springs.Revit.Document
# If the document is workshared, the node returns the path to the central document as a string. Otherwise a null value will be returned.

refresh = Input(refresh:bool = true)
centralPath = Python(IN[0]=refresh)  # "Doc.CentralPath"
# ---------- centralPath.python (13 lines) ----------
import clr

clr.AddReference('RevitServices')
from RevitServices.Persistence import DocumentManager
doc = DocumentManager.Instance.CurrentDBDocument

clr.AddReference('RevitAPI')
from Autodesk.Revit.DB import *

OUT = None
if doc.IsWorkshared:
	cp = doc.GetWorksharingCentralModelPath()
	OUT = ModelPathUtils.ConvertModelPathToUserVisiblePath(cp)
# ----------------------------------------
path = Output(centralPath)
