# Dynamo custom node Doc.DeleteElements.dyf "Springs.Doc.DeleteElements" (Dynamo 0.8.2.2392)
# category: Springs.Revit.Document
# Attempts to delete the input list of elements from the active Revit document.The node returns the number of successfully deleted elements and their Ids as a string. Carefully observe the deleted elements count. It may be greater than the input list because hosted elements or tags will be deleted as well. If an element in the list can not be deleted (for example last revision or last view), the whole list will fail to be deleted.

element = Input(element:var[])
confirm = Input(confirm:bool)
python_script = Python(IN[0]=element, IN[1]=confirm)
# ---------- python_script.python (35 lines) ----------
#Copyright(c) 2016, Dimitar Venkov
# @5devene, dimitar.ven@gmail.com

import clr

clr.AddReference("RevitServices")
import RevitServices
from RevitServices.Persistence import DocumentManager
from RevitServices.Transactions import TransactionManager
doc = DocumentManager.Instance.CurrentDBDocument

clr.AddReference("RevitAPI")
from Autodesk.Revit.DB import ElementId

from System.Collections.Generic import *

def tolist(obj1):
	if hasattr(obj1,"__iter__"): return obj1
	else: return [obj1]

elements = UnwrapElement(tolist(IN[0]))
confirm = IN[1]
if confirm:
	idsToDelete = List[ElementId]()
	for i in xrange(len(elements)):
		try: idsToDelete.Add(elements[i].Id)
		except: pass
	TransactionManager.Instance.EnsureInTransaction(doc)
	try: deleted = doc.Delete(idsToDelete)
	except: deleted = []
	TransactionManager.Instance.TransactionTaskDone()
	str_list = [d.ToString() for d in deleted]
	OUT = len(deleted), ';'.join([s for s in str_list])
else:
	OUT = "Set confirm to True"
# ----------------------------------------
code_block = CodeBlock(d=python_script) { d[0]; d[1]; }
count = Output(code_block.out0)
ids_str = Output(code_block.out1)  # "ids(str)"
