# Dynamo custom node Document.CentralPath.dyf (Dynamo 4.0.2.3852)
# category: Springs.Revit.Query
# If the document is workshared, the node returns the path to the central document as a string. Otherwise a null value will be returned.

refresh = Input(refresh: bool = true)
centralPath = Python(IN[0]=refresh)  # "Doc.CentralPath"; PythonNet3
# ---------- centralPath.python (45 lines) ----------
#-Reope----------------------------------------#
#                                              #
#      Copyright(c) 2016, Dimitar Venkov       #
#                                              #
# https://github.com/dimven/SpringNodes/issues #
# https://www.reope.com/                       #
#                                              #
#    ____    _____   _____   ____    _____     #
#   |  _ \ *|  ___|*|  _  |*|  _ \ *|  ___|    #
#   | |_) |*| |_--- *| | | |*| |_) |*| |___     #
#   |  _ < *|  ___|*| | | |*|  __/ *|  ___|    #
#   | | | |*| |_--- *| |_| |*| |    *| |___     #
#   |_| \_|*|_____|*|_____|*|_|    *|_____|    #
#                                              #
#                                              #
#-Reope-----Updated by Mark Ackerley-----------#

import clr
clr.AddReference('RevitServices')
from RevitServices.Persistence import DocumentManager
doc = DocumentManager.Instance.CurrentDBDocument

clr.AddReference('RevitAPI')
from Autodesk.Revit.DB import *

try:
    if doc.IsWorkshared:
        cp = doc.GetWorksharingCentralModelPath()
        if cp.CloudPath:
            OUT = "Cloud model: Region={0}, ProjectGUID={1}, ModelGUID={2}".format(
                cp.Region,
                cp.GetProjectGUID(),
                cp.GetModelGUID()
            )
        else:
            OUT = ModelPathUtils.ConvertModelPathToUserVisiblePath(cp)
    else:
        OUT = None

except Exception as e:
    import traceback
    OUT = "Exception:\n{0}\n\nTraceback:\n{1}".format(
        str(e),
        traceback.format_exc()
    )
# ----------------------------------------
path = Output(centralPath)
