# Dynamo custom node Document.CopyFromLinkInstance.dyf (Dynamo 4.0.2.3852)
# category: Springs.Revit.Create
# The node will use the total transformation of the link instance to copy the input elements into the local document.

linkInstance = Input(linkInstance: var)
element = Input(element: var[])
python_script = Python(IN[0]=linkInstance, IN[1]=element)  # PythonNet3
# ---------- python_script.python (68 lines) ----------
#-Reope----------------------------------------#
#                                              #
#      Copyright(c) 2016, Dimitar Venkov       #
#                                              #
# https://github.com/dimven/SpringNodes/issues #
# https://www.reope.com/                       #
#                                              #
#    ____    _____   _____   ____    _____     #
#   |  _ \ *|  ___|*|  _  |*|  _ \ *|  ___|    #
#   | |_) |*| |_--- *| | | |*| |_) |*| |___     #
#   |  _ < *|  ___|*| | | |*|  __/ *|  ___|    #
#   | | | |*| |_--- *| |_| |*| |    *| |___     #
#   |_| \_|*|_____|*|_____|*|_|    *|_____|    #
#                                              #
#                                              #
#-Reope-----Updated by Mark Ackerley-----------#

import clr
clr.AddReference('RevitServices')
from RevitServices.Persistence import DocumentManager
from RevitServices.Transactions import TransactionManager
doc = DocumentManager.Instance.CurrentDBDocument

clr.AddReference('RevitAPI')
from Autodesk.Revit.DB import *
from System.Collections.Generic import List

clr.AddReference('RevitNodes')
import Revit
clr.ImportExtensions(Revit.Elements)

def tolist(obj1):
    if isinstance(obj1, str): return [obj1]
    return obj1 if isinstance(obj1, list) else [obj1]

try:
    is_list = isinstance(IN[1], list)
    linkInst = UnwrapElement(tolist(IN[0])[0])
    elements = UnwrapElement(tolist(IN[1]))

    linkDoc = linkInst.GetLinkDocument()
    tf1 = linkInst.GetTotalTransform()

    eId = List[ElementId]()
    for e in tolist(elements):
        try:
            eId.Add(e.Id)
        except:
            continue

    TransactionManager.Instance.EnsureInTransaction(doc)
    copy = ElementTransformUtils.CopyElements(linkDoc, eId, doc, tf1, None)
    TransactionManager.Instance.TransactionTaskDone()

    result = []
    for i in copy:
        e = doc.GetElement(i)
        if e is not None:
            result.append(e.ToDSType(False))

    OUT = result if is_list else result[0]

except Exception as e:
    import traceback
    OUT = "Exception:\n{0}\n\nTraceback:\n{1}".format(
        str(e),
        traceback.format_exc()
    )
# ----------------------------------------
local_element = Output(python_script)
