# Dynamo custom node Document.CopyFromViewToView.dyf (Dynamo 4.0.2.3852)
# category: Springs.Revit.Create
# The node will copy the input (view based) elements from the source view into the destination view.

sourceView = Input(sourceView: var)
destView = Input(destView: var)
elements = Input(elements: var[])
transform = Input(transform: var = null)
copyByViews = Python(IN[0]=sourceView, IN[1]=destView, IN[2]=elements, IN[3]=transform)  # "Elements.CopyByViews"; PythonNet3
# ---------- copyByViews.python (61 lines) ----------
#-Reope----------------------------------------#
#                                              #
#      Copyright(c) 2016, Dimitar Venkov       #
#                                              #
# https://github.com/dimven/SpringNodes/issues #
# https://www.reope.com/                       #
#                                              #
#    ____    _____   _____   ____    _____     #
#   |  _ \ *|  ___|*|  _  |*|  _ \ *|  ___|    #
#   | |_) |*| |_--- *| | | |*| |_) |*| |___     #
#   |  _ < *|  ___|*| | | |*|  __/ *|  ___|    #
#   | | | |*| |_--- *| |_| |*| |    *| |___     #
#   |_| \_|*|_____|*|_____|*|_|    *|_____|    #
#                                              #
#                                              #
#-Reope-----Updated by Mark Ackerley-----------#

import clr
clr.AddReference('RevitServices')
from RevitServices.Persistence import DocumentManager
from RevitServices.Transactions import TransactionManager
doc = DocumentManager.Instance.CurrentDBDocument

clr.AddReference('RevitAPI')
from Autodesk.Revit.DB import *
from System.Collections.Generic import List

clr.AddReference('RevitNodes')
import Revit
clr.ImportExtensions(Revit.Elements)
clr.ImportExtensions(Revit.GeometryConversion)

def tolist(obj1):
    if isinstance(obj1, str): return [obj1]
    return obj1 if isinstance(obj1, list) else [obj1]

try:
    is_list = isinstance(IN[2], list)
    source = UnwrapElement(tolist(IN[0])[0])
    dest = UnwrapElement(tolist(IN[1])[0])
    elements = UnwrapElement(tolist(IN[2]))

    tf1 = tolist(IN[3])[0] if IN[3] is not None else None
    if tf1 is not None:
        tf1 = tf1.ToTransform(True)

    eId = List[ElementId](e.Id for e in tolist(elements) if hasattr(e, "Id"))

    TransactionManager.Instance.EnsureInTransaction(doc)
    copy = ElementTransformUtils.CopyElements(source, eId, dest, tf1, None)
    TransactionManager.Instance.TransactionTaskDone()

    result = [doc.GetElement(i).ToDSType(False) for i in copy]
    OUT = result if is_list else result[0]

except Exception as e:
    import traceback
    OUT = "Exception:\n{0}\n\nTraceback:\n{1}".format(
        str(e),
        traceback.format_exc()
    )
# ----------------------------------------
new_elements = Output(copyByViews)
