# Dynamo custom node Document.DeleteElements.dyf (Dynamo 4.0.2.3852)
# category: Springs.Revit.Actions
# Attempts to delete the input list of elements from the active Revit document.The node returns the number of successfully deleted elements and their Ids as a string. Carefully observe the deleted elements count. It may be greater than the input list because hosted elements or tags will be deleted as well. If an element in the list can not be deleted (for example last revision or last view), the whole list will fail to be deleted.

element = Input(element: var[])
confirm = Input(confirm: bool)
python_script = Python(IN[0]=element, IN[1]=confirm)  # PythonNet3
# ---------- python_script.python (56 lines) ----------
#-Reope----------------------------------------#
#                                              #
#      Copyright(c) 2016, Dimitar Venkov       #
#                                              #
# https://github.com/dimven/SpringNodes/issues #
# https://www.reope.com/                       #
#                                              #
#    ____    _____   _____   ____    _____     #
#   |  _ \ *|  ___|*|  _  |*|  _ \ *|  ___|    #
#   | |_) |*| |_--- *| | | |*| |_) |*| |___     #
#   |  _ < *|  ___|*| | | |*|  __/ *|  ___|    #
#   | | | |*| |_--- *| |_| |*| |    *| |___     #
#   |_| \_|*|_____|*|_____|*|_|    *|_____|    #
#                                              #
#                                              #
#-Reope-----Updated by Mark Ackerley-----------#

import clr
clr.AddReference("RevitServices")
import RevitServices
from RevitServices.Persistence import DocumentManager
from RevitServices.Transactions import TransactionManager
doc = DocumentManager.Instance.CurrentDBDocument

def tolist(obj1):
    if isinstance(obj1, str): return [obj1]
    return obj1 if isinstance(obj1, list) else [obj1]

try:
    elems = UnwrapElement(tolist(IN[0]))

    if IN[1]:
        deleted, failed = [], []
        TransactionManager.Instance.EnsureInTransaction(doc)
        for e in elems:
            id = None
            try:
                id = e.Id
                del_id = doc.Delete(id)
                deleted.extend([d.ToString() for d in del_id])
            except:
                if id is not None:
                    failed.append(id.ToString())
        TransactionManager.Instance.TransactionTaskDone()
        s = set(deleted)
        failed1 = [x for x in failed if x not in s]
        OUT = len(deleted), ';'.join(deleted), ';'.join(failed1)
    else:
        OUT = "Set confirm to True", "", ""

except Exception as e:
    import traceback
    OUT = "Exception:\n{0}\n\nTraceback:\n{1}".format(
        str(e),
        traceback.format_exc()
    )
# ----------------------------------------
code_block = CodeBlock(d=python_script) { d[0]; d[1]; d[2]; }
count = Output(code_block.out0)
deletedIds_str = Output(code_block.out1)  # "deletedIds(str)"
failedIds_str = Output(code_block.out2)  # "failedIds(str)"
