# Dynamo custom node Element.AddVoidCut.dyf (Dynamo 0.8.2.2392)
# category: SpringNodes.Revit.VoidCuts
# Accepts single or list inputs. If an element that can be cut and a family that can act as a void cutting entity are provided, the element will be cut. Please make sure that the geometries of the elements actually cut. Otherwise an empty cut will be created that may impede the performance of your file. Add void cuts sparcely because they affect the size of your project.

element_s_ToBeCut = Input()  # "element(s)ToBeCut"
cuttingElement_s = Input()  # "cuttingElement(s)"
python_script = Python(IN[0]=element_s_ToBeCut, IN[1]=cuttingElement_s)
# ---------- python_script.python (41 lines) ----------
import clr

clr.AddReference("RevitServices")
import RevitServices
from RevitServices.Persistence import DocumentManager
from RevitServices.Transactions import TransactionManager
doc = DocumentManager.Instance.CurrentDBDocument

clr.AddReference("RevitAPI")
from Autodesk.Revit.DB import *

def tolist(obj1):
	if hasattr(obj1,"__iter__"): return obj1
	else: return [obj1]

def output1(l1):
	if len(l1) == 1: return l1[0]
	else: return l1

ToBeCut = UnwrapElement(tolist(IN[0]))
Cuts = UnwrapElement(tolist(IN[1]))
out1 = []

cutU = InstanceVoidCutUtils
TransactionManager.Instance.EnsureInTransaction(doc)
for i in xrange(len(ToBeCut)):
	if cutU.CanBeCutWithVoid(ToBeCut[i]):
		count = 0
		for j in xrange(len(Cuts)):
			if cutU.IsVoidInstanceCuttingElement(Cuts[j]) and \
			not cutU.InstanceVoidCutExists(ToBeCut[i],Cuts[j]):
				try: 
					cutU.AddInstanceVoidCut(doc,ToBeCut[i],Cuts[j])
					count += 1
				except: pass
		out1.append("%s out of %s cuts created." %(count, len(Cuts)) )
	else:
		out1.append("Element could not be cut")
TransactionManager.Instance.TransactionTaskDone()

OUT = output1(out1)
# ----------------------------------------
result = Output(python_script)
