# Dynamo custom node Element.Copy.dyf (Dynamo 0.8.2.2392)
# category: SpringNodes.Revit.Modify
# WARNING: Do not use this node in Automatic mode! Copy the input Revit elements with the help of a translation vector, similarly to the Geometry.Translate node.

element_s = Input()  # "element(s)"
vector_s = Input()  # "vector(s)"
python_script = Python(IN[0]=element_s, IN[1]=vector_s)
# ---------- python_script.python (58 lines) ----------
#Copyright(c) 2016, Dimitar Venkov
# @5devene, dimitar.ven@gmail.com

import clr

clr.AddReference("RevitServices")
import RevitServices
from RevitServices.Persistence import DocumentManager
from RevitServices.Transactions import TransactionManager
doc = DocumentManager.Instance.CurrentDBDocument

clr.AddReference("RevitNodes")
import Revit
clr.ImportExtensions(Revit.Elements)
clr.ImportExtensions(Revit.GeometryConversion)

clr.AddReference("RevitAPI")
from Autodesk.Revit.DB import *

clr.AddReference("System")
from System.Collections.Generic import List as cList

def tolist(obj1):
	if hasattr(obj1,"__iter__"): return obj1
	else: return [obj1]

def output1(l1):
	if len(l1) == 1: return out1[0]
	else: return l1

elements = UnwrapElement(tolist(IN[0]))
vecs = tolist(IN[1])

oldId = []
for i in xrange(len(elements)):
	try: oldId.append(elements[i].Id)
	except: pass
oldId1 = cList[ElementId](oldId)
transforms = []
for i in xrange(len(vecs)):
	try: transforms.append(vecs[i].ToXyz(True))
	except: pass
	
def CopyEls(oldId1, transforms):
	out1 = []
	for i in xrange(len(transforms)):
		try:
			newId = ElementTransformUtils.CopyElements(doc, oldId1, transforms[i])
			if len(newId) == 1 :
				out1.append(doc.GetElement(newId[0]).ToDSType(False))
			else:
				[out1.append(doc.GetElement(newId[i]).ToDSType(False)) for i in xrange(len(newId))]
		except: out1.append([])
	return out1
	
TransactionManager.Instance.EnsureInTransaction(doc)
OUT = output1(CopyEls(oldId1, transforms))
TransactionManager.Instance.TransactionTaskDone()
# ----------------------------------------
element_s_2 = Output(python_script)  # "element(s)"
