# Dynamo custom node Element.GetParameterUnitValue.dyf (Dynamo 4.0.2.3852)
# category: Springs.Revit.Query
# Converts from internal units to the currently set Revit display units. Useful only for parameters with numeric values. If no Value is found, will return a blank string.

element = Input(element: var[])
paramName = Input(paramName: string)
getParameterUnitValue = Python(IN[0]=element, IN[1]=paramName)  # "Element.GetParameterUnitValue"; PythonNet3
# ---------- getParameterUnitValue.python (47 lines) ----------
#-Reope----------------------------------------#
#                                              #
#      Copyright(c) 2017, Dimitar Venkov       #
#                                              #
# https://github.com/dimven/SpringNodes/issues #
# https://www.reope.com/                       #
#                                              #
#    ____    _____   _____   ____    _____     #
#   |  _ \ *|  ___|*|  _  |*|  _ \ *|  ___|    #
#   | |_) |*| |_--- *| | | |*| |_) |*| |___     #
#   |  _ < *|  ___|*| | | |*|  __/ *|  ___|    #
#   | | | |*| |_--- *| |_| |*| |    *| |___     #
#   |_| \_|*|_____|*|_____|*|_|    *|_____|    #
#                                              #
#                                              #
#-Reope-----Updated by Mark Ackerley-----------#

import clr
clr.AddReference('RevitAPI')
import Autodesk.Revit.DB as DB

def tolist(obj1):
    if isinstance(obj1, str): return [obj1]
    return obj1 if isinstance(obj1, list) else [obj1]

try:
    is_list = isinstance(IN[0], list)
    elems = UnwrapElement(tolist(IN[0]))
    parName = IN[1]

    out1 = []
    for e in elems:
        par = e.LookupParameter(parName)
        if par is None or par.StorageType.ToString() != "Double" or not par.HasValue:
            out1.append("")
            continue
        val = DB.UnitUtils.ConvertFromInternalUnits(par.AsDouble(), par.GetUnitTypeId())
        out1.append(val)

    OUT = out1 if is_list else out1[0]

except Exception as e:
    import traceback
    OUT = "Exception:\n{0}\n\nTraceback:\n{1}".format(
        str(e),
        traceback.format_exc()
    )
# ----------------------------------------
value = Output(getParameterUnitValue)
