# Dynamo custom node Element.IsCutting.dyf "Springs.Element.IsCutting" (Dynamo 1.1.1.1841)
# category: Springs.Revit.Element
# Tests if the input element (or elements) is a void cut and if it is cutting any elements. In such cases, the cut elements will be provided.

element = Input(element:var[])
python_script = Python(IN[0]=element)
# ---------- python_script.python (43 lines) ----------
import clr

clr.AddReference("RevitServices")
import RevitServices
from RevitServices.Persistence import DocumentManager
doc = DocumentManager.Instance.CurrentDBDocument

clr.AddReference("RevitAPI")
from Autodesk.Revit.DB import *

clr.AddReference("RevitNodes")
import Revit
clr.ImportExtensions(Revit.Elements)

def tolist(obj1):
	if hasattr(obj1,"__iter__"): return obj1
	else: return [obj1]

def output1(l1):
	if len(l1) == 1: return l1[0]
	else: return l1

elements = UnwrapElement(tolist(IN[0]))
out1 = []
cut_el = []

cutU = InstanceVoidCutUtils
for i in xrange(len(elements)):
	try:
		if cutU.IsVoidInstanceCuttingElement(elements[i]):
			cut1 = cutU.GetElementsBeingCut(elements[i])
			if cut1.Count != 0:
				cut1 = [doc.GetElement(id).ToDSType(True) for id in cut1]
			out1.append(True)
			cut_el.append(cut1)
		else:
			out1.append(False)
			cut_el.append([])
	except:
		out1.append(False)
		cut_el.append([])		

OUT = output1(out1), cut_el
# ----------------------------------------
code_block = CodeBlock(res=python_script) { res[0]; res[1]; }
bool = Output(code_block.out0)
cutElements = Output(code_block.out1)
