# Dynamo custom node Element.MeshGeometry.dyf (Dynamo 4.0.2.3852)
# category: Springs.Revit.Query
# Reads an element's geometry and converts it to either a Dynamo mesh or a toolkit mesh representation.  The node will return Dynamo meshes by default.
# The LOD input represents the triangulation factor. Its range is from 0 to 1. 0 is the lowest level of detail and 1 is the highest. It's set to 0 by default.

element = Input(element: var[])
LOD = Input(LOD: int = 0)
asToolkitMesh = Input(asToolkitMesh: bool = false)
python_script = Python(IN[0]=element, IN[1]=LOD, IN[2]=asToolkitMesh)  # PythonNet3
# ---------- python_script.python (90 lines) ----------
#-Reope----------------------------------------#
#                                              #
#      Copyright(c) 2017, Dimitar Venkov       #
#                                              #
# https://github.com/dimven/SpringNodes/issues #
# https://www.reope.com/                       #
#                                              #
#    ____    _____   _____   ____    _____     #
#   |  _ \ *|  ___|*|  _  |*|  _ \ *|  _---|    #
#   | |_) |*| |_--- *| | | |*| |_) |*| |___     #
#   |  _ < *|  ___|*| | | |*|  __/ *|  ___|    #
#   | | | |*| |_--- *| |_| |*| |    *| |___     #
#   |_| \_|*|_____|*|_____|*|_|    *|_____|    #
#                                              #
#                                              #
#-Reope-----Updated by Mark Ackerley-----------#

import clr
clr.AddReference('RevitServices')
from RevitServices.Persistence import DocumentManager
doc = DocumentManager.Instance.CurrentDBDocument

clr.AddReference('RevitNodes')
import Revit
clr.ImportExtensions(Revit.GeometryConversion)

clr.AddReference('RevitAPI')
import Autodesk.Revit.DB as DB
from System.Collections.Generic import List

def tolist(obj1):
    if isinstance(obj1, str): return [obj1]
    return obj1 if isinstance(obj1, list) else [obj1]

try:
    is_list = isinstance(IN[0], list)
    elems = UnwrapElement(tolist(IN[0]))
    tessFactor = IN[1]
    asTkMesh = IN[2]

    indices = List[int]()

    def toTkMesh(m, indices=indices, N=range(3)):
        verts = (v.ToPoint(1) for v in m.Vertices)
        indices.Clear()
        for i in range(m.NumTriangles):
            for j in N:
                indices.Add(m.Triangle[i].Index[j])
        return mtk.Mesh.ByVerticesAndIndices(verts, indices)

    opt1 = DB.Options()

    if asTkMesh:
        clr.AddReference('MeshToolkit')
        import Autodesk.Dynamo.MeshToolkit as mtk

    def getMeshGeo(rvtGeo, geoList=None, opt1=opt1):
        if geoList is None:
            geoList = []
        for g in rvtGeo:
            if isinstance(g, DB.GeometryInstance):
                getMeshGeo(g.GetInstanceGeometry(), geoList)
            elif isinstance(g, DB.Mesh):
                geoList.append(g)
            elif isinstance(g, DB.Face):
                geoList.append(g.Triangulate(tessFactor))
            elif isinstance(g, DB.Solid):
                vol = getattr(g, 'Volume', 0)
                if vol > 0:
                    geoList.extend(f.Triangulate(tessFactor) for f in g.Faces)
        return geoList

    OUT = []
    for e in elems:
        meshGeo = getMeshGeo(e.get_Geometry(opt1))
        if asTkMesh:
            OUT.append(list(map(toTkMesh, meshGeo)))
        else:
            OUT.append([m.Convert() for m in meshGeo])

    opt1.Dispose()

    OUT = OUT if is_list else OUT[0]

except Exception as e:
    import traceback
    OUT = "Exception:\n{0}\n\nTraceback:\n{1}".format(
        str(e),
        traceback.format_exc()
    )
# ----------------------------------------
meshes = Output(python_script)
