# Dynamo custom node Element.RemoveVoidCut.dyf (Dynamo 4.0.2.3852)
# category: Springs.Revit.Actions
# Removes the void cut between the input elements, if such exists.

elementBeingCut = Input(elementBeingCut: var)
cuttingElement = Input(cuttingElement: var[])
python_script = Python(IN[0]=elementBeingCut, IN[1]=cuttingElement)  # PythonNet3
# ---------- python_script.python (56 lines) ----------
#-Reope----------------------------------------#
#                                              #
#      Copyright(c) 2017, Dimitar Venkov       #
#                                              #
# https://github.com/dimven/SpringNodes/issues #
# https://www.reope.com/                       #
#                                              #
#    ____    _____   _____   ____    _____     #
#   |  _ \ *|  ___|*|  _  |*|  _ \ *|  ___|    #
#   | |_) |*| |_--- *| | | |*| |_) |*| |___     #
#   |  _ < *|  ___|*| | | |*|  __/ *|  ___|    #
#   | | | |*| |_--- *| |_| |*| |    *| |___     #
#   |_| \_|*|_____|*|_____|*|_|    *|_____|    #
#                                              #
#                                              #
#-Reope-----Updated by Mark Ackerley-----------#

import clr
clr.AddReference("RevitServices")
import RevitServices
from RevitServices.Persistence import DocumentManager
from RevitServices.Transactions import TransactionManager
doc = DocumentManager.Instance.CurrentDBDocument

clr.AddReference("RevitAPI")
from Autodesk.Revit.DB import *

def tolist(obj1):
    if isinstance(obj1, str): return [obj1]
    return obj1 if isinstance(obj1, list) else [obj1]

try:
    elem = UnwrapElement(tolist(IN[0])[0])
    cuts = UnwrapElement(tolist(IN[1]))

    cutU = InstanceVoidCutUtils
    OUT = 0

    if cutU.CanBeCutWithVoid(elem):
        TransactionManager.Instance.EnsureInTransaction(doc)
        for c in cuts:
            if cutU.IsVoidInstanceCuttingElement(c) and \
            cutU.InstanceVoidCutExists(elem, c):
                try:
                    cutU.RemoveInstanceVoidCut(doc, elem, c)
                    OUT += 1
                except:
                    pass
        TransactionManager.Instance.TransactionTaskDone()

except Exception as e:
    import traceback
    OUT = "Exception:\n{0}\n\nTraceback:\n{1}".format(
        str(e),
        traceback.format_exc()
    )
# ----------------------------------------
uncutCount = Output(python_script)
