# Dynamo custom node Element.SetLocation.dyf (Dynamo 4.0.2.3852)
# category: Springs.Revit.Actions
# Attempts to modify the location of the input element. This can effectively add as a move comand in Revit. Works for both line based and point based elements.

element = Input(element: var[])
location = Input(location: var[])
python_script = Python(IN[0]=element, IN[1]=location)  # PythonNet3
# ---------- python_script.python (91 lines) ----------
#-Reope----------------------------------------#
#                                              #
#      Copyright(c) 2017, Dimitar Venkov       #
#                                              #
# https://github.com/dimven/SpringNodes/issues #
# https://www.reope.com/                       #
#                                              #
#    ____    _____   _____   ____    _____     #
#   |  _ \ *|  ___|*|  _  |*|  _ \ *|  ___|    #
#   | |_) |*| |_--- *| | | |*| |_) |*| |___     #
#   |  _ < *|  ___|*| | | |*|  __/ *|  ___|    #
#   | | | |*| |_--- *| |_| |*| |    *| |___     #
#   |_| \_|*|_____|*|_____|*|_|    *|_____|    #
#                                              #
#                                              #
#-Reope-----Updated by Mark Ackerley-----------#

import clr
clr.AddReference("RevitServices")
import RevitServices
from RevitServices.Persistence import DocumentManager
from RevitServices.Transactions import TransactionManager
doc = DocumentManager.Instance.CurrentDBDocument

clr.AddReference("RevitNodes")
import Revit
clr.ImportExtensions(Revit.Elements)
clr.ImportExtensions(Revit.GeometryConversion)

clr.AddReference("RevitAPI")
from Autodesk.Revit.DB import *
from Autodesk.Revit.DB.Structure import StructuralFramingUtils, StructuralType

FrU = StructuralFramingUtils

def tolist(obj1):
    if isinstance(obj1, str): return [obj1]
    return obj1 if isinstance(obj1, list) else [obj1]

try:
    is_list = isinstance(IN[0], list)
    elements = UnwrapElement(tolist(IN[0]))
    newloc = UnwrapElement(tolist(IN[1]))

    framing = ("Beam", "Brace")
    out1 = []

    TransactionManager.Instance.EnsureInTransaction(doc)
    for i in range(len(elements)):
        try:
            el_typ = elements[i].GetType().ToString()
            isWall, isBeam = False, False
            if el_typ == "Autodesk.Revit.DB.Wall":
                w_start = WallUtils.IsWallJoinAllowedAtEnd(elements[i], 0)
                w_end = WallUtils.IsWallJoinAllowedAtEnd(elements[i], 1)
                WallUtils.DisallowWallJoinAtEnd(elements[i], 0)
                WallUtils.DisallowWallJoinAtEnd(elements[i], 1)
                isWall = True
            elif el_typ == "Autodesk.Revit.DB.FamilyInstance":
                if elements[i].StructuralType.ToString() in framing:
                    b_start = FrU.IsJoinAllowedAtEnd(elements[i], 0)
                    b_end = FrU.IsJoinAllowedAtEnd(elements[i], 1)
                    FrU.DisallowJoinAtEnd(elements[i], 0)
                    FrU.DisallowJoinAtEnd(elements[i], 1)
                    isBeam = True
            newloc1 = newloc[i].ToRevitType()
            oldloc = elements[i].Location
            loc_typ = oldloc.GetType().ToString()
            if loc_typ == "Autodesk.Revit.DB.LocationCurve":
                oldloc.Curve = newloc1
            elif loc_typ == "Autodesk.Revit.DB.LocationPoint":
                oldloc.Point = newloc1
            if isWall:
                if w_start: WallUtils.AllowWallJoinAtEnd(elements[i], 0)
                if w_end: WallUtils.AllowWallJoinAtEnd(elements[i], 1)
            if isBeam:
                if b_start: FrU.AllowJoinAtEnd(elements[i], 0)
                if b_end: FrU.AllowJoinAtEnd(elements[i], 1)
            out1.append(elements[i].ToDSType(True))
        except:
            out1.append(None)
    TransactionManager.Instance.TransactionTaskDone()

    OUT = out1 if is_list else out1[0]

except Exception as e:
    import traceback
    OUT = "Exception:\n{0}\n\nTraceback:\n{1}".format(
        str(e),
        traceback.format_exc()
    )
# ----------------------------------------
element_2 = Output(python_script)  # "element"
