# Dynamo custom node Element.SetParameterToNone.dyf (Dynamo 4.0.2.3852)
# category: Springs.Revit.Actions
# Used to set parameters such as View Template, Phase Demolished or Top Constraint to None / Unconstrained.

element = Input(element: var[])
paramName = Input(paramName: string)
python_script = Python(IN[0]=element, IN[1]=paramName)  # PythonNet3
# ---------- python_script.python (58 lines) ----------
#-Reope----------------------------------------#
#                                              #
#      Copyright(c) 2018, Dimitar Venkov       #
#                                              #
# https://github.com/dimven/SpringNodes/issues #
# https://www.reope.com/                       #
#                                              #
#    ____    _____   _____   ____    _____     #
#   |  _ \ *|  ___|*|  _  |*|  _ \ *|  ___|    #
#   | |_) |*| |_--- *| | | |*| |_) |*| |___     #
#   |  _ < *|  ___|*| | | |*|  __/ *|  ___|    #
#   | | | |*| |_--- *| |_| |*| |    *| |___     #
#   |_| \_|*|_____|*|_____|*|_|    *|_____|    #
#                                              #
#                                              #
#-Reope-----Updated by Mark Ackerley-----------#

import clr
clr.AddReference('RevitAPI')
from Autodesk.Revit.DB import ElementId

clr.AddReference('RevitServices')
from RevitServices.Persistence import DocumentManager
from RevitServices.Transactions import TransactionManager
doc = DocumentManager.Instance.CurrentDBDocument

def tolist(obj1):
    if isinstance(obj1, str): return [obj1]
    return obj1 if isinstance(obj1, list) else [obj1]

try:
    is_list = isinstance(IN[0], list)
    items = tolist(IN[0])
    param = IN[1]
    inv = ElementId.InvalidElementId

    out1 = []
    TransactionManager.Instance.EnsureInTransaction(doc)
    for i in items:
        itm = None
        par = i.InternalElement.LookupParameter(param)
        if par is not None:
            try:
                par.Set(inv)
                itm = i
            except:
                pass
        out1.append(itm)
    TransactionManager.Instance.TransactionTaskDone()

    OUT = out1 if is_list else out1[0]

except Exception as e:
    import traceback
    OUT = "Exception:\n{0}\n\nTraceback:\n{1}".format(
        str(e),
        traceback.format_exc()
    )
# ----------------------------------------
element_2 = Output(python_script)  # "element"
