# Dynamo custom node Element.Unjoin.dyf (Dynamo 4.0.2.3852)
# category: Springs.Revit.Actions
# Unjoins the element(s) in the second list from the primary input element.

firstElement = Input(firstElement: var)
secondElement = Input(secondElement: var[])
python_script = Python(IN[0]=firstElement, IN[1]=secondElement)  # PythonNet3
# ---------- python_script.python (50 lines) ----------
#-Reope----------------------------------------#
#                                              #
#      Copyright(c) 2017, Dimitar Venkov       #
#                                              #
# https://github.com/dimven/SpringNodes/issues #
# https://www.reope.com/                       #
#                                              #
#    ____    _____   _____   ____    _____     #
#   |  _ \ *|  ___|*|  _  |*|  _ \ *|  ___|    #
#   | |_) |*| |_--- *| | | |*| |_) |*| |___     #
#   |  _ < *|  ___|*| | | |*|  __/ *|  ___|    #
#   | | | |*| |_--- *| |_| |*| |    *| |___     #
#   |_| \_|*|_____|*|_____|*|_|    *|_____|    #
#                                              #
#                                              #
#-Reope-----Updated by Mark Ackerley-----------#

import clr
clr.AddReference('RevitAPI')
from Autodesk.Revit.DB import *
from System.Collections.Generic import *

clr.AddReference("RevitServices")
import RevitServices
from RevitServices.Persistence import DocumentManager
from RevitServices.Transactions import TransactionManager
doc = DocumentManager.Instance.CurrentDBDocument

def tolist(obj1):
    if isinstance(obj1, str): return [obj1]
    return obj1 if isinstance(obj1, list) else [obj1]

try:
    floor = UnwrapElement(tolist(IN[0])[0])
    beams = UnwrapElement(tolist(IN[1]))

    OUT = 0
    TransactionManager.Instance.EnsureInTransaction(doc)
    for b in beams:
        if JoinGeometryUtils.AreElementsJoined(doc, floor, b):
            JoinGeometryUtils.UnjoinGeometry(doc, floor, b)
            OUT += 1
    TransactionManager.Instance.TransactionTaskDone()

except Exception as e:
    import traceback
    OUT = "Exception:\n{0}\n\nTraceback:\n{1}".format(
        str(e),
        traceback.format_exc()
    )
# ----------------------------------------
unjoinCount = Output(python_script)
