# Dynamo custom node ElementType.Duplicate.dyf (Dynamo 4.0.2.3852)
# category: Springs.Revit.Create
# Create duplicate element types. If the type exists, it will be appended instead.

elementType = Input(elementType: var[])
newName = Input(newName: var[])
python_script = Python(IN[0]=elementType, IN[1]=newName)  # PythonNet3
# ---------- python_script.python (67 lines) ----------
#-Reope----------------------------------------#
#                                              #
#      Copyright(c) 2017, Dimitar Venkov       #
#                                              #
# https://github.com/dimven/SpringNodes/issues #
# https://www.reope.com/                       #
#                                              #
#    ____    _____   _____   ____    _____     #
#   |  _ \ *|  ___|*|  _  |*|  _ \ *|  ___|    #
#   | |_) |*| |_--- *| | | |*| |_) |*| |___     #
#   |  _ < *|  ___|*| | | |*|  __/ *|  ___|    #
#   | | | |*| |_--- *| |_| |*| |    *| |___     #
#   |_| \_|*|_____|*|_____|*|_|    *|_____|    #
#                                              #
#                                              #
#-Reope-----Updated by Mark Ackerley-----------#


import clr
clr.AddReference('RevitAPI')
from Autodesk.Revit.DB import *

clr.AddReference('RevitNodes')
import Revit
clr.ImportExtensions(Revit.Elements)

clr.AddReference('RevitServices')
import RevitServices
from RevitServices.Persistence import DocumentManager
from RevitServices.Transactions import TransactionManager
doc = DocumentManager.Instance.CurrentDBDocument

def tolist(obj1):
    if isinstance(obj1, str): return [obj1]
    return obj1 if isinstance(obj1, list) else [obj1]
    
try:
    famtypes = UnwrapElement(tolist(IN[0]) )
    newnames = tolist(IN[1])

    output = []
    fec = FilteredElementCollector(doc).OfClass(famtypes[0].GetType() )
    type_dict = dict([(Element.Name.__get__(i), i) for i in fec])

    ft_len = len(famtypes) == 1
    TransactionManager.Instance.EnsureInTransaction(doc)
    for i in range(len(newnames) ):
        j = 0 if ft_len else i
        n1 = str(newnames[i])
        if n1 in type_dict:
            output.append(type_dict[n1].ToDSType(False) ) #do I want to wrap this?
        else:
            try:
                nt1 = famtypes[j].Duplicate(n1)
                type_dict[n1] = nt1
                output.append(nt1.ToDSType(True) )
            except:
                output.append(None)
    TransactionManager.Instance.TransactionTaskDone()
    OUT = output

except Exception as e:
    import traceback
    OUT = "Exception:\n{0}\n\nTraceback:\n{1}".format(
        str(e),
        traceback.format_exc()
    )
# ----------------------------------------
ElementType = Output(python_script)
