# Dynamo custom node ElementType.Instances.dyf (Dynamo 4.0.2.3852)
# category: Springs.Revit.Query
# Fetches all instances of the input element type

type = Input(type: var[])
python_script = Python(IN[0]=type)  # PythonNet3
# ---------- python_script.python (71 lines) ----------
#-Reope----------------------------------------#
#                                              #
#      Copyright(c) 2017, Dimitar Venkov       #
#                                              #
# https://github.com/dimven/SpringNodes/issues #
# https://www.reope.com/                       #
#                                              #
#    ____    _____   _____   ____    _____     #
#   |  _ \ *|  ___|*|  _  |*|  _ \ *|  _---|    #
#   | |_) |*| |_--- *| | | |*| |_) |*| |___     #
#   |  _ < *|  ___|*| | | |*|  __/ *|  ___|    #
#   | | | |*| |_--- *| |_| |*| |    *| |___     #
#   |_| \_|*|_____|*|_____|*|_|    *|_____|    #
#                                              #
#                                              #
#-Reope-----Updated by Mark Ackerley-----------#


import clr
clr.AddReference('RevitAPI')
from Autodesk.Revit.DB import *

clr.AddReference("RevitServices")
import RevitServices
from RevitServices.Persistence import DocumentManager
doc = DocumentManager.Instance.CurrentDBDocument

clr.AddReference('RevitNodes')
import Revit
clr.ImportExtensions(Revit.Elements)

from System.Collections.Generic import List

def tolist(obj1):
    if isinstance(obj1, str): return [obj1]
    return obj1 if isinstance(obj1, list) else [obj1]

try:
    types = UnwrapElement(tolist(IN[0]) )
    catNames = set()
    for t in types:
        c1 = t.Category
        if c1 is not None:
            catNames.add(c1.Name)

    catId = List[ElementId]()
    allCats = doc.Settings.Categories
    for cn in catNames:
        if allCats.Contains(cn):
            catId.Add(allCats[cn].Id)

    type_storage = dict()
    fec = FilteredElementCollector(doc).WhereElementIsNotElementType()
    if catId:
        fec = fec.WherePasses(ElementMulticategoryFilter(catId) )

    for e in fec:
        id1 = e.GetTypeId().Value
        if id1 in type_storage:
            type_storage[id1].append(e.ToDSType(True) )
        else:
            type_storage[id1] = [e.ToDSType(True)]

    OUT = [type_storage.get(t.Id.Value, None) for t in types]

except Exception as e:
    import traceback
    OUT = "Exception:\n{0}\n\nTraceback:\n{1}".format(
        str(e),
        traceback.format_exc()
    )
# ----------------------------------------
instances = Output(python_script)
