# Dynamo custom node Elements.GroupByDistance.dyf (Dynamo 4.0.2.3852)
# category: Springs.Revit.Utility.Actions
# You'll need two equal length lists of geometry objects and elements. Splits the list of elements into groups if the distance between the coresponding geometry is less than the provided margin.

elements = Input(elements: var[])
geometry = Input(geometry: var[])
margin = Input(margin: double = 10)
python_script = Python(IN[0]=elements, IN[1]=geometry, IN[2]=margin)  # PythonNet3
# ---------- python_script.python (50 lines) ----------
#-Reope----------------------------------------#
#                                              #
#      Copyright(c) 2017, Dimitar Venkov       #
#                                              #
# https://github.com/dimven/SpringNodes/issues #
# https://www.reope.com/                       #
#                                              #
#    ____    _____   _____   ____    _____     #
#   |  _ \ *|  ___|*|  _  |*|  _ \ *|  ___|    #
#   | |_) |*| |___ *| | | |*| |_) |*| |___     #
#   |  _ < *|  ___|*| | | |*|  __/ *|  ___|    #
#   | | | |*| |___ *| |_| |*| |    *| |___     #
#   |_| \_|*|_____|*|_____|*|_|    *|_____|    #
#                                              #
#                                              #
#-Reope-----Updated by Mark Ackerley-----------#

# Inspired from the "Group Curves" node by Konrad Sobon
# @arch_laboratory, http://archi-lab.net

import clr
clr.AddReference('ProtoGeometry')
from Autodesk.DesignScript.Geometry import Geometry

try:
    elem, loc, margin = IN
    pts = list(zip(elem, loc))

    Groups, Queue = [], []
    while pts:
        group = []
        Queue.append(pts.pop())
        while Queue:
            p1 = Queue.pop()
            group.append(p1)
            for i in range(len(pts) - 1, -1, -1):
                if p1[1].DistanceTo(pts[i][1]) <= margin:
                    Queue.append(pts.pop(i))
        Groups.append(group)

    elem1 = [[j[0] for j in i] for i in Groups]
    pts1 = [[j[1] for j in i] for i in Groups]
    OUT = elem1, pts1

except Exception as e:
    import traceback
    OUT = "Exception:\n{0}\n\nTraceback:\n{1}".format(
        str(e),
        traceback.format_exc()
    )
# ----------------------------------------
code_block = CodeBlock(r=python_script) { r[0]; r[1]; }
elements_2 = Output(code_block.out0)  # "elements"
points = Output(code_block.out1)
