# Dynamo custom node ElementsOfCategory.dyf "Springs.ElementsOfCategory" (Dynamo 1.0.0.1180)
# category: Springs.Revit.Utility
# Same as the built in "All Elements of Category" but can act as a function object and does not get refreshed automatically.

category = Input(category:Category)
all_elements_of_category = ElementsOfCategory(category)
elements = Output(all_elements_of_category)
refresh = Input(refresh:bool = true)
