# Dynamo custom node ErrorReport.Parse.dyf "Springs.ErrorReport.Parse" (Dynamo 1.1.0.2094)
# category: Springs.Revit.Utility
# Process a Revit error report (HTML file) and extract the error types, all affected elements and the total number of errors. If you are executing from a document different than the one the error report belongs to, be sure to set "fetch_elements" to false.

report = Input(report:var)
fetch_elements = Input(fetch_elements : bool = true)
python_script = Python(IN[0]=report, IN[1]=fetch_elements)
# ---------- python_script.python (64 lines) ----------
import clr
import System
pf_path = System.Environment.GetFolderPath(System.Environment.SpecialFolder.ProgramFilesX86)
import sys
sys.path.append("%s\IronPython 2.7\Lib" %pf_path)

from sgmllib import SGMLParser
from collections import Counter
import re
from operator import itemgetter

class ReportParser(SGMLParser):
	def __init__(self, verbose=0):
		SGMLParser.__init__(self, verbose)
		self.data1 = []
		self.temp_data = []
	def handle_data(self, data):
		if data != "\n" and data not in known_errors:
			self.temp_data.append(data)
	def unknown_starttag(self, tag, attrs):
		if tag == "tr":
			self.data1.append(self.temp_data)
			self.temp_data = []

def extractId(list1):
	return [i for j in list1 for i in id_expression.findall(j)]
def pullElement(list1):
	out1 = []
	for i in list1:
		try: out1.append(doc.GetElement(ElementId(int(i))))
		except: out1.append(i)
	return out1

report1, fetch_elements = IN

known_errors = ("  ", "td>  ", "&")
parser = ReportParser()
with open(report1, 'r') as f:
	for line in f:
		parser.feed(line)
parser.data1.pop(0)
parser.data1.append(parser.temp_data)
report_data = parser.data1
parser.close()
report_errors = [i.pop(0) for i in report_data]
group_errors = Counter(report_errors).most_common()
unique_errors = map(itemgetter(0), group_errors)
sum_errors = map(itemgetter(1), group_errors)
sum_errors.append("Total errors : %d" % sum(sum_errors) )

#id_expression = re.compile("\D(\d{5,8})\D")
id_expression = re.compile(" id (.*)  ")
elements = map(extractId, report_data)

if fetch_elements:	#imports moved here to be able to process externally
	clr.AddReference("RevitServices")
	from RevitServices.Persistence import DocumentManager
	doc = DocumentManager.Instance.CurrentDBDocument
	clr.AddReference("RevitAPI")
	from Autodesk.Revit.DB import ElementId
	
	elements = map(pullElement, elements)
	
OUT = report_errors, elements, unique_errors, sum_errors
# ----------------------------------------
code_block = CodeBlock(res=python_script) { res[0]; res[1]; res[2]; res[3]; }
error_messages = Output(code_block.out0)
affected_elements = Output(code_block.out1)
unique_errors = Output(code_block.out2)
number_of_errors = Output(code_block.out3)
