# Dynamo custom node FamilyInsance.ByFacePoints.dyf (Dynamo 0.8.2.2392)
# category: SpringNodes.Revit.FamilyInstances
# Places instances on the input face oriented to the face's U tangent and the global Z axis.

face = Input()
type = Input()
point_s = Input()  # "point(s)"
python_script = Python(IN[0]=face, IN[1]=type, IN[2]=point_s)
# ---------- python_script.python (47 lines) ----------
#Copyright(c) 2016, Dimitar Venkov
# @5devene, dimitar.ven@gmail.com

import clr

clr.AddReference('ProtoGeometry')
from Autodesk.DesignScript.Geometry import *

clr.AddReference('RevitServices')
import RevitServices
from RevitServices.Persistence import DocumentManager
from RevitServices.Transactions import TransactionManager
doc = DocumentManager.Instance.CurrentDBDocument

clr.AddReference('RevitNodes')
import Revit
clr.ImportExtensions(Revit.Elements)
clr.ImportExtensions(Revit.GeometryConversion)

def tolist(obj1):
	if hasattr(obj1,'__iter__'): return obj1
	else: return [obj1]

def output1(l1):
	if len(l1) == 1: return l1[0]
	else: return l1

def first(obj1):
	if hasattr(obj1,'__iter__'): return obj1[0]
	else: return obj1

host = first(IN[0])
ftype = UnwrapElement(first(IN[1]))
pts = tolist(IN[2])

out1 = []
ref1 = host.Tags.LookupTag("RevitFaceReference")
TransactionManager.Instance.EnsureInTransaction(doc)
for i in xrange(len(pts) ):
	uv1 = host.UVParameterAtPoint(pts[i])
	dir1 = host.TangentAtUParameter(uv1.U,uv1.V).ToXyz()
	try:
		inst1 = doc.Create.NewFamilyInstance(ref1,pts[i].ToXyz(),dir1,ftype)
		out1.append(inst1.ToDSType(False) )
	except: out1.append(None)
TransactionManager.Instance.TransactionTaskDone()
OUT = output1(out1)
# ----------------------------------------
FamilyInstance = Output(python_script)
