# Dynamo custom node FamilyInstance.ByHostAndPoint.dyf (Dynamo 4.0.2.3852)
# category: Springs.Revit.Create
# Creates hosted family instances(doors/windows) at the specified points. You can feed either a single family type or a unique type for each instance.

host = Input(host: var[])
type = Input(type: var[])
point = Input(point: var[])
python_script = Python(IN[0]=host, IN[1]=type, IN[2]=point)  # PythonNet3
# ---------- python_script.python (70 lines) ----------
#-Reope----------------------------------------#
#                                              #
#      Copyright(c) 2016, Dimitar Venkov       #
#                                              #
# https://github.com/dimven/SpringNodes/issues #
# https://www.reope.com/                       #
#                                              #
#    ____    _____   _____   ____    _____     #
#   |  _ \ *|  ___|*|  _  |*|  _ \ *|  _---|    #
#   | |_) |*| |_--- *| | | |*| |_) |*| |___     #
#   |  _ < *|  ___|*| | | |*|  __/ *|  ___|    #
#   | | | |*| |_--- *| |_| |*| |    *| |___     #
#   |_| \_|*|_____|*|_____|*|_|    *|_____|    #
#                                              #
#                                              #
#-Reope-----Updated by Mark Ackerley-----------#

import clr
clr.AddReference("RevitServices")
import RevitServices
from RevitServices.Persistence import DocumentManager
from RevitServices.Transactions import TransactionManager
doc = DocumentManager.Instance.CurrentDBDocument

clr.AddReference("RevitAPI")
import Autodesk

clr.AddReference("RevitNodes")
import Revit
clr.ImportExtensions(Revit.Elements)
clr.ImportExtensions(Revit.GeometryConversion)

def tolist(obj1):
    if isinstance(obj1, str): return [obj1]
    return obj1 if isinstance(obj1, list) else [obj1]

try:
    is_list = isinstance(IN[2], list)
    host = UnwrapElement(tolist(IN[0]))
    ftype = UnwrapElement(tolist(IN[1]))
    fpts = tolist(IN[2])

    strt = Autodesk.Revit.DB.Structure.StructuralType.NonStructural
    ftp_len = len(ftype) == 1
    hst_len = len(host) == 1

    out1 = []
    TransactionManager.Instance.EnsureInTransaction(doc)
    for i, pt in enumerate(fpts):
        p = pt.ToXyz(True)
        j = 0 if ftp_len else i
        k = 0 if hst_len else i
        try:
            if not ftype[j].IsActive:
                ftype[j].Activate()
            level = doc.GetElement(host[k].LevelId)
            nf = doc.Create.NewFamilyInstance(p, ftype[j], host[k], level, strt)
            out1.append(nf.ToDSType(False))
        except:
            out1.append(None)
    TransactionManager.Instance.TransactionTaskDone()

    OUT = out1 if is_list else out1[0]

except Exception as e:
    import traceback
    OUT = "Exception:\n{0}\n\nTraceback:\n{1}".format(
        str(e),
        traceback.format_exc()
    )
# ----------------------------------------
FamilyInstance = Output(python_script)
