# Dynamo custom node FamilyInstance.ByPointsLevelsBatch.dyf (Dynamo 4.0.2.3852)
# category: Springs.Revit.Create
# This node batch ceates level hosted family instances. You can feed either a single type/level that will be used for all instances or a unique type/level for each instance. Set track to false if you'd like to place instances on every run.

points = Input(points: var[])
type = Input(type: var[])
level = Input(level: var[])
track = Input(track: bool = true)
batch_generate_instances = Python(IN[0]=points, IN[1]=type, IN[2]=level, IN[3]=track)  # PythonNet3
# ---------- batch_generate_instances.python (76 lines) ----------
#-Reope----------------------------------------#
#                                              #
#      Copyright(c) 2018, Dimitar Venkov       #
#                                              #
# https://github.com/dimven/SpringNodes/issues #
# https://www.reope.com/                       #
#                                              #
#    ____    _____   _____   ____    _____     #
#   |  _ \ *|  ___|*|  _  |*|  _ \ *|  _---|    #
#   | |_) |*| |_--- *| | | |*| |_) |*| |___     #
#   |  _ < *|  ___|*| | | |*|  __/ *|  ___|    #
#   | | | |*| |_--- *| |_| |*| |    *| |___     #
#   |_| \_|*|_____|*|_____|*|_|    *|_____|    #
#                                              #
#                                              #
#-Reope-----Updated by Mark Ackerley-----------#

import clr
clr.AddReference("RevitAPI")
from Autodesk.Revit.Creation import FamilyInstanceCreationData
from Autodesk.Revit.DB.Structure import StructuralType

clr.AddReference("RevitServices")
import RevitServices
from RevitServices.Persistence import DocumentManager
from RevitServices.Transactions import TransactionManager
doc = DocumentManager.Instance.CurrentDBDocument

clr.AddReference("RevitNodes")
import Revit
clr.ImportExtensions(Revit.Elements)
clr.ImportExtensions(Revit.GeometryConversion)

clr.AddReference("System")
from System.Collections.Generic import List

def tolist(obj1):
    if isinstance(obj1, str): return [obj1]
    return obj1 if isinstance(obj1, list) else [obj1]

try:
    is_list = isinstance(IN[0], list)
    pts = tolist(IN[0])
    types = UnwrapElement(tolist(IN[1]))
    lvls = UnwrapElement(tolist(IN[2]))
    track = tolist(IN[3])[0]

    trackElems = not track
    types_len = len(types) == 1
    lvl_len = len(lvls) == 1
    st1 = StructuralType.NonStructural

    FICD1 = List[FamilyInstanceCreationData]()
    
    TransactionManager.Instance.EnsureInTransaction(doc)
        
    for i, p in enumerate(pts):
        t1 = types[0] if types_len else types[i]
        lvl = lvls[0] if lvl_len else lvls[i]
        if not t1.IsActive:
            t1.Activate()
        FICD1.Add(FamilyInstanceCreationData(p.ToXyz(True), t1, lvl, st1))


    new_inst = doc.Create.NewFamilyInstances2(FICD1)
    TransactionManager.Instance.TransactionTaskDone()

    result = [doc.GetElement(i).ToDSType(trackElems) for i in new_inst]
    OUT = result if is_list else result[0]

except Exception as e:
    import traceback
    OUT = "Exception:\n{0}\n\nTraceback:\n{1}".format(
        str(e),
        traceback.format_exc()
    )
# ----------------------------------------
FamilyInstances = Output(batch_generate_instances)
