# Dynamo custom node FamilyInstance.ByViewAndPoint.dyf (Dynamo 2.0.2.6826)
# category: Springs.Revit.Create
# Places a view hosted family instance at a given point in the view (e.g. a detail component, 2d annotation).
# Set track to false if you'd like to place instances on every run.

view = Input(view: var[])
type = Input(type: var[])
point = Input(point: var[])
track = Input(track: bool = true)
python_script = Python(IN[0]=view, IN[1]=type, IN[2]=point, IN[3]=track)
# ---------- python_script.python (58 lines) ----------
#-Reope----------------------------------------#
#                                              #
#      Copyright(c) 2016, Dimitar Venkov       #
#                                              #
# https://github.com/dimven/SpringNodes/issues #
# https://www.reope.com/                       #
#                                              #
#    ____    _____   _____   ____    _____     #
#   |  _ \ *|  ___|*|  _  |*|  _ \ *|  ___|    #
#   | |_) |*| |___ *| | | |*| |_) |*| |___     #
#   |  _ < *|  ___|*| | | |*|  __/ *|  ___|    #
#   | | | |*| |___ *| |_| |*| |    *| |___     #
#   |_| \_|*|_____|*|_____|*|_|    *|_____|    #
#                                              #
#                                              #
#-Reope-----Updated by Mark Ackerley-----------#

import clr

clr.AddReference("RevitServices")
import RevitServices
from RevitServices.Persistence import DocumentManager
from RevitServices.Transactions import TransactionManager
doc = DocumentManager.Instance.CurrentDBDocument

clr.AddReference("RevitAPI")
import Autodesk

clr.AddReference("RevitNodes")
import Revit
clr.ImportExtensions(Revit.Elements)
clr.ImportExtensions(Revit.GeometryConversion)

def tolist(obj1):
	if hasattr(obj1,"__iter__"): return obj1
	else: return [obj1]

view = UnwrapElement(tolist(IN[0]))
ftype = UnwrapElement(tolist(IN[1]))
fpts = UnwrapElement(tolist(IN[2]))
persistent = not IN[3]

OUT = []
ftp_len = len(ftype) == 1
view_len = len(view) == 1

TransactionManager.Instance.EnsureInTransaction(doc)
for i in xrange(len(fpts) ):
	p = fpts[i].ToXyz(True)
	j = 0 if ftp_len else i
	k = 0 if view_len else i
	try:
		if not ftype[j].IsActive : ftype[j].Activate()
		nf = doc.Create.NewFamilyInstance(p, ftype[j], view[k])
		OUT.append(nf.ToDSType(persistent) )
	except:
		OUT.append(None)
TransactionManager.Instance.TransactionTaskDone()
# ----------------------------------------
FamilyInstance = Output(python_script)
