# Dynamo custom node FamilyInstance.Rotation.dyf "Springs.FamilyInstance.Rotation" (Dynamo 1.0.0.1180)
# category: Springs.Revit.FamilyInstance
# Fetches the angle of rotation around the insertion point of a point based element. The angle is always measured counter-clockwise.

element = Input(element:var[])
python_script = Python(IN[0]=element)
# ---------- python_script.python (20 lines) ----------
#Copyright(c) 2016, Dimitar Venkov
# @5devene, dimitar.ven@gmail.com
#Thanks for the idea Kulkul

import clr
import math
def tolist(obj1):
	if hasattr(obj1,"__iter__"): return obj1
	else: return [obj1]

def output1(l1):
	if len(l1) == 1: return l1[0]
	else: return l1

elements = UnwrapElement(tolist(IN[0]))
out1 = []
for i in xrange(len(elements)):
	try: out1.append(math.degrees(elements[i].Location.Rotation))
	except: out1.append([])
OUT = output1(out1)
# ----------------------------------------
angle = Output(python_script)
