# Dynamo custom node FamilyType.Duplicate.dyf (Dynamo 0.8.2.2392)
# category: SpringNodes.Revit.ElementTypes
# Create duplicate family types with the specified name. If the type exists, it is called.

family_type = Input()
name_s = Input()  # "name(s)"
python_script = Python(IN[0]=family_type, IN[1]=name_s)
# ---------- python_script.python (45 lines) ----------
#Copyright(c) 2015, Dimitar Venkov
# @5devene, dimitar.ven@gmail.com

import clr

clr.AddReference("RevitServices")
import RevitServices
from RevitServices.Persistence import DocumentManager
from RevitServices.Transactions import TransactionManager
doc = DocumentManager.Instance.CurrentDBDocument

clr.AddReference("RevitNodes")
import Revit
clr.ImportExtensions(Revit.Elements)

clr.AddReference("RevitAPI")
import Autodesk

def tolist(obj1):
	if hasattr(obj1,"__iter__"):
		return obj1
	else:
		return [obj1]

fs = UnwrapElement(IN[0])
names = tolist(IN[1])
nfs = []

TransactionManager.Instance.EnsureInTransaction(doc)

for n in names:
	try:
		try:
			x = fs.Duplicate(str(n))
			nfs.append(x.ToDSType(False))
		except:
			nfs.append(Revit.Elements.FamilySymbol.ByName(n))
	except:
		nfs.append(None)
TransactionManager.Instance.TransactionTaskDone()

if len(nfs) == 1 :
	OUT = nfs[0]
else:
	OUT = nfs
# ----------------------------------------
new_type_s = Output(python_script)  # "new type(s)"
