# Dynamo custom node Feet2Fraction.dyf "Springs.Feet2Fraction" (Dynamo 1.3.2.2480)
# category: Springs.Core.Units
# Converts a decimal foot value to a fractional foot/inch string.

number = Input(number:var)
toString = Custom[Number.ToString]()  # "Springs.Number.ToString"; Converts the input number(s) to string. Can process lists.; unwired: num
code_block = CodeBlock(_x=number, f1=toString)
# ---------- code_block.designscript (23 lines) ----------
sign = _x < 0 ? "-" : "";
x = Math.Abs(_x);
frac = Math.Pow(2, 1..8);
ft1 = Math.Floor(x);
in1 = (x - ft1) * 12;
in2 = Math.Floor(in1);
fr1 = (in1 - in2) * frac;
fr2 = Math.Round(fr1);
v1 = Math.Abs(fr1 - fr2);
ind1 = DSCore.List.FirstIndexOf(v1, DSCore.List.MinimumItem(v1));
fr3 = (__Apply(f1,fr2[ind1]) + "/" + __Apply(f1,frac[ind1]) )[0];
t0 = fr3[0] == fr3[-1];
in3 = t0 ? (in2 + 1) : in2;
ft1s = __Apply(f1,ft1)[0] + "'";
in3s = __Apply(f1,in3)[0];
ft1s = ft1s == "0'" ? "" : ft1s;
t1 = in3 == 0;
t2 = fr3 == "0/2";
in2s = t1 ? "" : in3s;
fr3s = t2 || t0 ? "" : fr3;
mid = t1 || t2 || t0 ? "" : " ";
end = t1 && t2 ? "" : "\"";
sign+ft1s+in2s+mid+fr3s+end;
# ----------------------------------------
fraction_str = Output(code_block.out21)  # "fraction(str)"
