# Dynamo custom node File.Size.dyf "Springs.File.Size" (Dynamo 1.2.1.3083)
# category: Springs.Core.File.Query
# Outputs the the file size in kilobytes or megabytes. Provide a file path as a string. Set kbOnly to true for a consistent output.

path = Input(path:var[])
kbOnly = Input(kbOnly:bool = false)
python_script = Python(IN[0]=path, IN[1]=kbOnly)
# ---------- python_script.python (25 lines) ----------
# Copyright(c) 2017, Dimitar Venkov
# @5devene, dimitar.ven@gmail.com
# www.badmonkeys.net

from System.IO import FileInfo

def tolist(x):
	if hasattr(x,'__iter__'): return x
	else : return [x]

def output(x):
	if len(x) == 1: return x[0]
	else : return x

paths = tolist(IN[0])
mb = 1048576.0
kb = 1024.0
def getSize(p, mb=mb, kb=kb, kbOnly = IN[1]):
	sb = FileInfo(p).Length
	if sb < mb or kbOnly:
		return '%.3f KB' % (sb / kb)
	else:
		return '%.3f MB' % (sb / mb)

OUT = output(map(getSize, paths) )
# ----------------------------------------
size = Output(python_script)
