# Dynamo custom node FilePath.CanWriteTo.dyf (Dynamo 4.0.2.3852)
# category: Springs.FileSystem.Query
# Checks if the user and application has write access to the specified path's directory

path = Input(path: var[])
canWriteTo = Python(IN[0]=path)  # "FilePath.CanWriteTo"; PythonNet3
# ---------- canWriteTo.python (60 lines) ----------
#----------------------------------------------#
#                                              #
#      Copyright(c) 2020, Dimitar Venkov       #
#                                              #
# https://github.com/dimven/SpringNodes/issues #
# https://www.reope.com/                       #
#                                              #
#    ____    _____   _____   ____    _____     #
#   |  _ \ *|  ___|*|  _  |*|  _ \ *|  ___|    #
#   | |_) |*| |___ *| | | |*| |_) |*| |___     #
#   |  _ < *|  ___|*| | | |*|  __/ *|  ___|    #
#   | | | |*| |___ *| |_| |*| |    *| |___     #
#   |_| \_|*|_____|*|_____|*|_|    *|_____|    #
#                                              #
#                                              #
#-----------Updated by Mark Ackerley-----------#


import clr
import traceback

clr.AddReference("System.IO")
from System.IO import File, Path, Directory, FileOptions

def tolist(obj1):
    return obj1 if isinstance(obj1, list) else [obj1]

def getDirectory(p):
    if File.Exists(p):
        return Path.GetDirectoryName(p)
    if Directory.Exists(p):
        return p
    return None

def canWriteToDir(d):
    try:
        f = File.Create(Path.Combine(d, "__test_file_name__"), 1, FileOptions.DeleteOnClose)
        f.Close()
        return True
    except Exception as e:
        msg = str(e)
        if "Access to the path" in msg and "is denied" in msg:
            return "Access denied - administrator rights required"
        return "Cannot write: {0}".format(msg.splitlines()[0])

OUT = []

try:
    paths = tolist(IN[0])
    for p in paths:
        d = getDirectory(p)
        if d is not None:
            OUT.append(canWriteToDir(d))
        else:
            OUT.append(False)
except Exception as e:
    OUT = "Exception:\n{0}\n\nTraceback:\n{1}".format(
        str(e),
        traceback.format_exc()
    )
# ----------------------------------------
bool = Output(canWriteTo)
