# Dynamo custom node FilePath.Size.dyf (Dynamo 3.3.0.6316)
# category: Springs.FileSystem.Query
# Outputs the the file size in kilobytes or megabytes. Provide a file path as a string. Set kbOnly to true for a consistent output.

path = Input(path: var[])
kbOnly = Input(kbOnly: bool = false)
python_script = Python(IN[0]=path, IN[1]=kbOnly)  # PythonNet3
# ---------- python_script.python (37 lines) ----------
#----------------------------------------------#
#                                              #
#      Copyright(c) 2020, Dimitar Venkov       #
#                                              #
# https://github.com/dimven/SpringNodes/issues #
# https://www.reope.com/                       #
#                                              #
#    ____    _____   _____   ____    _____     #
#   |  _ \ *|  ___|*|  _  |*|  _ \ *|  ___|    #
#   | |_) |*| |___ *| | | |*| |_) |*| |___     #
#   |  _ < *|  ___|*| | | |*|  __/ *|  ___|    #
#   | | | |*| |___ *| |_| |*| |    *| |___     #
#   |_| \_|*|_____|*|_____|*|_|    *|_____|    #
#                                              #
#                                              #
#-----------Updated by Mark Ackerley-----------#

import clr
clr.AddReference("System.IO")

from System.IO import FileInfo


def tolist(obj1):
    return obj1 if isinstance(obj1, list) else [obj1]

paths = tolist(IN[0])
mb = 1048576.0
kb = 1024.0
def getSize(p, mb=mb, kb=kb, kbOnly = IN[1]):
	sb = FileInfo(p).Length
	if sb < mb or kbOnly:
		return '%.3f KB' % (sb / kb)
	else:
		return '%.3f MB' % (sb / mb)

OUT = map(getSize, paths)
# ----------------------------------------
size = Output(python_script)
