# Dynamo custom node Filter.ByCategoryName.dyf "Springs.Filter.ByCategoryName" (Dynamo 1.2.1.3083)
# category: Springs.Revit.Utility
# Filters the input elements by their category name. You can input multiple category names.

element = Input(element:var[])
categoryName = Input(categoryName:var[])
python_script = Python(IN[0]=element, IN[1]=categoryName)
# ---------- python_script.python (25 lines) ----------
# Copyright(c) 2017, Dimitar Venkov
# @5devene, dimitar.ven@gmail.com
# www.badmonkeys.net

from itertools import imap

def tolist(obj1):
	if hasattr(obj1,"__iter__"): return obj1
	else: return [obj1]

elements = tolist(IN[0])
filter = map(str.lower, imap(str, tolist(IN[1]) ) )
in1, out1, nulls = [], [], []
OUT = in1, out1, nulls

for e in elements:
	c1 = UnwrapElement(e).Category
	if c1 is None:
		nulls.append(e)
	else:
		n1 = c1.Name.lower()
		if any(f in n1 for f in filter):
			in1.append(e)
		else:
			out1.append(e)
# ----------------------------------------
code_block = CodeBlock(f=python_script) { f[0]; f[1]; f[2]; }
in_ = Output(code_block.out0)  # "in"
out = Output(code_block.out1)
nulls = Output(code_block.out2)
