# Dynamo custom node Filter.ByClassName.dyf (Dynamo 0.8.2.2392)
# category: SpringNodes.Core
# Filters a list of objects by the object's class name. Note that Dynamo elements belong to different classes than their Revit counterparts. Use the Object.Class node to check an object's class.

object_s = Input()  # "object(s)"
Class_name_s = Input()  # "Class name(s)"
python_script = Python(IN[0]=object_s, IN[1]=Class_name_s)
# ---------- python_script.python (30 lines) ----------
#Copyright(c) 2015, Dimitar Venkov
# @5devene, dimitar.ven@gmail.com

import clr

clr.AddReference("RevitNodes")
import Revit
clr.ImportExtensions(Revit.Elements)

def tolist(obj1):
	if hasattr(obj1,"__iter__"):
		return obj1
	else:
		return [obj1]

in1,out1 = [],[]

elements = tolist(IN[0])
filter = tolist(IN[1])
for e in elements:
	try:
		n1 = e.GetType().ToString().lower()
	except:
		n1 = "null"
	if any(f.lower() in n1 for f in filter):
		in1.append(e)
	else:
		out1.append(e)
	
OUT = in1, out1
# ----------------------------------------
code_block = CodeBlock(f=python_script) { f[0]; f[1]; }
in_ = Output(code_block.out0)  # "in"
out = Output(code_block.out1)
