# Dynamo custom node Fn.ElementsOfCategory.dyf (Dynamo 0.8.2.2392)
# category: SpringNodes.SmartCopyMon
# Same as the built in "All Elements of Category" but can act as a function object.

category = Input()
all_elements_of_category = ElementsOfCategory(category)
elements = Output(all_elements_of_category)
