# Dynamo custom node Form.ByGeometry(SAT).dyf (Dynamo 0.8.2.2392)
# category: SpringNodes.Revit.Forms
# Attempts to convert the input geometry to a Revit Form object. Forms can exist only in the family environment. You can convert complicated solids or surfaces directly into forms. Solids can be converted into voids. Provide either one true boolean to convert everything into voids or a unique boolean for each geometry object. This node works in millimeters.

geometry = Input()
isVoid = Input(isVoid:var[]..[] = false)
python_script = Python(IN[0]=geometry, IN[1]=isVoid)
# ---------- python_script.python (79 lines) ----------
import clr
import System
from System.Collections.Generic import *

clr.AddReference('ProtoGeometry')
from Autodesk.DesignScript.Geometry import *

clr.AddReference("RevitServices")
import RevitServices
from RevitServices.Persistence import DocumentManager
from RevitServices.Transactions import TransactionManager
doc = DocumentManager.Instance.CurrentDBDocument

clr.AddReference("RevitNodes")
import Revit
clr.ImportExtensions(Revit.Elements)
clr.ImportExtensions(Revit.GeometryConversion)

clr.AddReference("RevitAPI")
from Autodesk.Revit.DB import *

def tolist(obj1):
	if hasattr(obj1,"__iter__"): return obj1
	else: return [obj1]

def output1(l1):
	if len(l1) == 1: return l1[0]
	else: return l1

def NewForm(s1):
	message = None
	temp_path = System.IO.Path.GetTempPath()
	rand_name = System.Guid.NewGuid().ToString()
	sat_path = temp_path + rand_name + ".sat"
	try: sat1 = Geometry.ExportToSAT(s1, sat_path, 1000)
	except: message = "No write access to temp folder"
	satOpt = SATImportOptions()
	satOpt.Placement = ImportPlacement.Origin
	satOpt.Unit = ImportUnit.Millimeter
	try: satId = doc.Import(sat1, satOpt, doc.ActiveView)
	except: message = "Please switch to a model view"
	opt1 = Options()
	opt1.ComputeReferences = True
	el1 = doc.GetElement(satId)
	geom1 = el1.get_Geometry(opt1)
	enum = geom1.GetEnumerator()
	enum.MoveNext()
	geom2 = enum.Current.GetInstanceGeometry()
	enum2 = geom2.GetEnumerator()
	enum2.MoveNext()
	s1 = enum2.Current
	doc.Delete(satId)
	System.IO.File.Delete(sat_path)
	if message == None:
		try:
			s2 = FreeFormElement.Create(doc,s1)
			return s2.ToDSType(False)
		except:
			return None
	else:
		return message

geom = tolist(IN[0])
isVoid = tolist(IN[1])
out1 = []

if doc.IsFamilyDocument:
	TransactionManager.Instance.EnsureInTransaction(doc)
	for g in geom:
		try: out1.append(NewForm(g))
		except: out1.append(None)
	TransactionManager.Instance.TransactionTaskDone()
	if len(isVoid) == 1 and len(out1) >= 1:
		[f.SetParameterByName("Solid/Void", isVoid[0]) for f in out1 if f != None]
	elif len(isVoid) > 1 and len(out1) > 1:
		[f.SetParameterByName("Solid/Void", val) for f, val in zip(out1,isVoid) if f != None]
	OUT = output1(out1)
else:
	OUT = "Forms can only exist in family documents"
# ----------------------------------------
Form = Output(python_script)
