# Dynamo custom node Fraction.ToFeet.dyf (Dynamo 4.0.2.3852)
# category: Springs.Units.Actions
# Converts a fractioned feet /inch string value into a decimal foot value.

fraction = Input(fraction: var)
code_block = CodeBlock(s1=fraction)
# ---------- code_block.designscript (50 lines) ----------
num = [Imperative]{
s0 = "";
s1 = String.TrimWhitespace(s1);
n1 = 0;
n2 = 0;
n3 = 0;
n4 = 0;
n5 = 0;
sign = 1;
if(String.StartsWith(s1,"-",true))
{
	s1 = String.Substring(s1, 1,
	  String.Length(s1) - 1);
	sign = -1;
}

if(String.Contains(s1,"'",true))
{
	s0 = String.Split(s1,["'"]);
	n1 = String.ToNumber(s0[0]);
	s1 = String.TrimWhitespace(s0[1]);
}
if(String.Contains(s1," ",true))
{
	s0 = String.Split(s1,[" "]);
	n2 = String.ToNumber(s0[0])/12;
	s1 = s0[1];
}
if(String.Contains(s1,"/",true))
{
	s0 = String.Split(s1,["/"]);
	n3 = String.ToNumber(s0[0]);
	n4 = String.ToNumber(
	String.Split(s0[1],["\""])[0]);
}
elseif(!String.Contains(s1,"/",true))
{
	n2 = String.ToNumber(
	String.Split(s1,["\""])[0])/12;
}
if (n3 != 0 && n4 != 0)
{
	n5 = (n3/n4)/12;
}
if (n2 == null)
{
    n2 = 0;
}
return = sign * (n1 + n2 + n5);
};
# ----------------------------------------
number = Output(code_block)
