# Dynamo custom node Geometry.DifferentiateDisplay.dyf "Springs.Geometry.DifferentiateDisplay" (Dynamo 1.3.2.2480)
# category: Springs.Geometry
# Paints the input geometry using the default color range. Also works well with lists of geometry.

geo = Input()
code_block = CodeBlock(geo=geo)
# ---------- code_block.designscript (4 lines) ----------
dcr = ColorRange1D.Default();
col = ColorRange1D.GetColorAtParameter
  (dcr, 0..1..#(Count(geo)));
Display.ByGeometryColor(geo, col);
# ----------------------------------------
displayGeo = Output(code_block.out2)
