# Dynamo custom node Geometry.GroupByDistance.dyf (Dynamo 3.3.0.6316)
# category: Springs.Geometry.Actions
# Splits the list of geometry elements into groups if the distance between them is less than the provided margin.

geometry = Input(geometry: var[])
margin = Input(margin: double = 1)
python_script = Python(IN[0]=geometry, IN[1]=margin)  # CPython3
# ---------- python_script.python (41 lines) ----------
#-Reope----------------------------------------#
#                                              #
#      Copyright(c) 2020, Dimitar Venkov       #
#                                              #
# https://github.com/dimven/SpringNodes/issues #
# https://www.reope.com/                       #
#                                              #
#    ____    _____   _____   ____    _____     #
#   |  _ \ *|  ___|*|  _  |*|  _ \ *|  ___|    #
#   | |_) |*| |___ *| | | |*| |_) |*| |___     #
#   |  _ < *|  ___|*| | | |*|  __/ *|  ___|    #
#   | | | |*| |___ *| |_| |*| |    *| |___     #
#   |_| \_|*|_____|*|_____|*|_|    *|_____|    #
#                                              #
#                                              #
#-Reope-----Updated by Mark Ackerley-----------#

#Inspired from the "Group Curves" node by Konrad Sobon
# @arch_laboratory, http://archi-lab.net

import clr
clr.AddReference('ProtoGeometry')
from Autodesk.DesignScript.Geometry import Geometry

pts = IN[0]
margin = IN[1]
dist1 = Geometry.DistanceTo

Groups, Queue = [], []
while pts:
	group = []
	Queue.append(pts.pop() )
	while Queue:
		p1 = Queue.pop()
		group.append(p1)
		for i in range(len(pts)-1,-1,-1):
			if dist1(p1, pts[i]) <= margin:
				Queue.append(pts.pop(i) )
	Groups.append(group)

OUT = Groups
# ----------------------------------------
geometry_2 = Output(python_script)  # "geometry[][]"
