# Dynamo custom node Geometry.IndexByDistance.dyf (Dynamo 3.3.0.6316)
# category: Springs.Geometry.Actions
# Provides the index of the closest or farthest geometry. Should prove faster than getting the geometry and finding its index in two separate operations.

geometry = Input(geometry: var[])
other = Input(other: var[])
isClosest = Input(isClosest: bool = true)
python_script = Python(IN[0]=geometry, IN[1]=other, IN[2]=isClosest)  # PythonNet3
# ---------- python_script.python (45 lines) ----------
#-Reope----------------------------------------#
#                                              #
#      Copyright(c) 2020, Dimitar Venkov       #
#                                              #
# https://github.com/dimven/SpringNodes/issues #
# https://www.reope.com/                       #
#                                              #
#    ____    _____   _____   ____    _____     #
#   |  _ \ *|  ___|*|  _  |*|  _ \ *|  ___|    #
#   | |_) |*| |___ *| | | |*| |_) |*| |___     #
#   |  _ < *|  ___|*| | | |*|  __/ *|  ___|    #
#   | | | |*| |___ *| |_| |*| |    *| |___     #
#   |_| \_|*|_____|*|_____|*|_|    *|_____|    #
#                                              #
#                                              #
#-Reope-----Updated by Mark Ackerley-----------#


from operator import lt, gt
from sys import maxsize

def tolist(x):
	if hasattr(x,'__iter__'): return x
	else : return [x]

geom = tolist(IN[0])
other = tolist(IN[1])
isClosest = IN[2]

_fn = lt if isClosest else gt
_base = maxsize if isClosest else -maxsize
inds, dists = [], []
OUT = inds, dists

for g in geom:
	d = _base
	ind, i = 0, 0
	for o in other:
		d1 = g.DistanceTo(o)
		if _fn(d1, d):
			d = d1
			ind = i
		i += 1
	inds.append(ind)
	dists.append(d)
# ----------------------------------------
code_block = CodeBlock(r=python_script) { r[0]; r[1]; }
index = Output(code_block.out0)
distance = Output(code_block.out1)
