# Dynamo custom node Geometry.SplitRecursively.dyf (Dynamo 3.3.0.6316)
# category: Springs.Geometry.Actions
# Splits a surface or a solid recursively, using the resulting reduced geometry for every consecutive split. Select a point or another geometry to control the direction of the split.

geometry = Input(geometry: var)
tools = Input(tools: var[])
pickPoint = Input(pickPoint: var)
python_script = Python(IN[0]=geometry, IN[1]=tools, IN[2]=pickPoint)  # PythonNet3
# ---------- python_script.python (71 lines) ----------
#----------------------------------------------#
#                                              #
#      Copyright(c) 2020, Dimitar Venkov       #
#                                              #
# https://github.com/dimven/SpringNodes/issues #
# https://www.reope.com/                       #
#                                              #
#    ____    _____   _____   ____    _____     #
#   |  _ \ *|  ___|*|  _  |*|  _ \ *|  ___|    #
#   | |_) |*| |___ *| | | |*| |_) |*| |___     #
#   |  _ < *|  ___|*| | | |*|  __/ *|  ___|    #
#   | | | |*| |___ *| |_| |*| |    *| |___     #
#   |_| \_|*|_____|*|_____|*|_|    *|_____|    #
#                                              #
#                                              #
#-----------Updated by Mark Ackerley-----------#




import clr
clr.AddReference('ProtoGeometry')
from Autodesk.DesignScript.Geometry import *

from collections.abc import Iterable


surface, cutting_list, point = IN

# Ensure cutting_list is always a list
if not isinstance(cutting_list, list):
    cutting_list = [cutting_list]

def exhaustive_split(initial_faces, planes, dir1):
    queue = list(initial_faces)
    result = []

    while queue:
        face = queue.pop(0)
        split_occurred = False

        for plane in planes:
            split = Geometry.Split(face, plane)

            # Normalize split to a list
            if split is None:
                split = []
                
            if not isinstance(split, Iterable):
                split = [split] if split else []


            if len(split) >= 2:
                distances = [dir1.DistanceTo(s) for s in split]
                sorted_indices = sorted(range(len(distances)), key=lambda i: distances[i])
                split = [split[i] for i in sorted_indices]

                queue.append(split[0])
                queue.append(split[1])
                split_occurred = True
                break  # restart with new pieces

        if not split_occurred:
            result.append(face)

    return result

try:
    OUT = exhaustive_split([surface], cutting_list, point)
except Exception as e:
    OUT = str(e)
# ----------------------------------------
geometry_2 = Output(python_script)  # "geometry"
