# Dynamo custom node Geometry.WriteTag.dyf (Dynamo 3.3.0.6316)
# category: Springs.Geometry.Actions
# Design script geometry can store a <string, object> dictionary for the duration of the active graph. You can store a name/value pair and retrieve it further down the graph.

geometry = Input(geometry: var)
tagName = Input(tagName: string)
value = Input(value: var)
override = Input(override: bool = true)
python_script = Python(IN[0]=geometry, IN[1]=tagName, IN[2]=value, IN[3]=override)  # PythonNet3
# ---------- python_script.python (26 lines) ----------
#----------------------------------------------#
#                                              #
#      Copyright(c) 2020, Dimitar Venkov       #
#                                              #
# https://github.com/dimven/SpringNodes/issues #
# https://www.reope.com/                       #
#                                              #
#    ____    _____   _____   ____    _____     #
#   |  _ \ *|  ___|*|  _  |*|  _ \ *|  ___|    #
#   | |_) |*| |___ *| | | |*| |_) |*| |___     #
#   |  _ < *|  ___|*| | | |*|  __/ *|  ___|    #
#   | | | |*| |___ *| |_| |*| |    *| |___     #
#   |_| \_|*|_____|*|_____|*|_|    *|_____|    #
#                                              #
#                                              #
#-----------Updated by Mark Ackerley-----------#

geo, par, val,override = IN
setPreviously = False
try:
	tags = geo.Tags
	if tags.LookupTag(par) is None or override:
		tags.AddTag(par, val)
except ValueError:
	setPreviously = True
OUT = IN[0], setPreviously
# ----------------------------------------
code_block = CodeBlock(r=python_script) { r[0]; r[1]; }
geometry_2 = Output(code_block.out0)  # "geometry"
setPreviously = Output(code_block.out1)
