# Dynamo custom node GetRelativeLevel.dyf "Springs.GetRelativeLevel" (Dynamo 1.2.1.3083)
# category: Springs.Revit.Utility
# Select the level closest to the input height from the list of input levels

zHeight = Input(zHeight:var[])
elevations = Input(elevations:var[])
levels = Input(levels:var[])
belowOnly = Input(belowOnly:bool = false)
python_script = Python(IN[0]=zHeight, IN[1]=elevations, IN[2]=levels, IN[3]=belowOnly)
# ---------- python_script.python (21 lines) ----------
# Copyright(c) 2017, Dimitar Venkov
# @5devene, dimitar.ven@gmail.com
# www.badmonkeys.net

from operator import itemgetter
from itertools import repeat

def key_fn(x, itemgetter=itemgetter): return abs(itemgetter(1)(x) )

heights, elevs, names, belowOnly = IN

def closestLevel(z, belowOnly=False, elevs=elevs, namaes=names, key_fn=key_fn):
	if z is not None:
		if belowOnly:
			elevs = [e for e in elevs if e < z]
		if elevs:
			i, _ = min(enumerate(z - e for e in elevs), key=key_fn)
			return names[i]
		return

OUT = map(closestLevel, heights, repeat(belowOnly, len(heights) ) )
# ----------------------------------------
level = Output(python_script)
