# Dynamo custom node Input.Wait.dyf "Springs.Input.Wait" (Dynamo 1.0.0.1180)
# category: Springs.Core.Input.Actions
# Waits for all inputs to be completed before continuing the execution process.Part of the SmartCopyMon workflow.

WaitForMe = Input()
identity = Object.Identity(WaitForMe)
Output = Input()
identity_2 = Object.Identity(Output)
Output_2 = Output(identity_2)  # "Output"
