# Dynamo custom node InterferenceCheck.Parse.dyf (Dynamo 0.8.2.2392)
# category: SpringNodes.Revit.Utility
# Process a Revit interference check (HTML file) and extract the interference categories, all affected elements and the total number of clashes. If you are executing from a document different than the one the error report belongs to, be sure to set "fetch_elements" to false.

report = Input()
fetch_elements = Input(fetch_elements : bool = true)
python_script = Python(IN[0]=report, IN[1]=fetch_elements)
# ---------- python_script.python (75 lines) ----------
import clr
import System
pf_path = System.Environment.GetFolderPath(System.Environment.SpecialFolder.ProgramFilesX86)
import sys
sys.path.append("%s\IronPython 2.7\Lib" %pf_path)

from sgmllib import SGMLParser
from collections import Counter
import re

class ReportParser(SGMLParser):
	def __init__(self, verbose=0):
		SGMLParser.__init__(self, verbose)
		self.data1 = []
		self.temp_data = []
	def handle_data(self, data):
		if data != "\n" and data not in known_errors:
			self.temp_data.append(data)
	def unknown_starttag(self, tag, attrs):
		if tag == "tr":
			self.data1.append(self.temp_data)
			self.temp_data = []

interference_cats = ("Structural Columns ", "Air Terminals ", "Assemblies ", "Cable Tray Fittings ", "Cable Tray Runs ", "Cable Trays ", "Casework ", "Ceilings ", "Columns ", "Conduit Fittings ", "Conduit Runs ", "Conduits ", "Curtain Panels ", "Curtain Systems ", "Curtain Wall Mullions ","Doors ", "Duct Accessories ", "Duct Fittings ", "Duct Insulations ", "Duct Linings ", "Duct Placeholders ", "Duct Systems ", "Ducts ", "Electrical Circuits ", "Electrical Equipment ", "Electrical Fixtures ", "Fabrication Parts ", "Flex Ducts ", "Flex Pipes ", "Floors ", "Furniture ", "Furniture Systems ", "Generic Models ", "Gutters ", "Lighting Devices ", "Lighting Fixtures ", "Mass Floors ", "Mass ", "Mechanical Equipment ", "Pads ", "Parts ", "Pipe Accessories ", "Pipe Fittings ", "Pipe Insulations ", "Pipe Placeholders ", "Pipes ", "Piping Systems ",  "Plumbing Fixtures ", "Railings ", "Ramps ", "Roofs ", "Roof Soffits ", "Shaft Openings ", "Slab Edges ", "Specialty Equipment ", "Sprinklers ", "Stairs ", "Structural Connections ", "Structural Foundations ", "Structural Framing ", "Structural Trusses ", "Wall Sweeps ", "Walls ", "Windows ", "Wires ")

def extractId(list1):
	return [i for j in list1 for i in id_expression.findall(j)]
def pullElement(list1):
	out1 = []
	for i in list1:
		try: out1.append(doc.GetElement(ElementId(int(i))))
		except: out1.append(i)
	return out1
icn = xrange(len(interference_cats))
def fetchCat(l1):
	s1 = []
	for i in xrange(len(l1)):
		for j in icn:
			if interference_cats[j] in l1[i]:
				s1.append(interference_cats[j])
				break
	if not s1: return "Unidentified"
	else: return "- ".join(s1)

report1 = IN[0]
fetch_elements = IN[1]

known_errors = ("  ", "td>  ", "&")
with open(report1, 'r') as f:
	read_data = f.read()
parser = ReportParser()
parser.feed(read_data)
parser.data1.append(parser.temp_data)
report_data = parser.data1[2:]
parser.close()
for i in xrange(len(report_data)): report_data[i].pop(0)
cases = map(fetchCat,report_data)
group_cases = Counter(cases).items()
unique_cases = [i[0] for i in group_cases]
sum_cases = [i[1] for i in group_cases]
sum_cases.append("Total interferences : %s"%sum(sum_cases))

id_expression = re.compile("\D(\d{5,7})\D")
elements = map(extractId, report_data)

if fetch_elements:	#imports moved here to be able to process externally
	clr.AddReference("RevitServices")
	from RevitServices.Persistence import DocumentManager
	doc = DocumentManager.Instance.CurrentDBDocument
	clr.AddReference("RevitAPI")
	from Autodesk.Revit.DB import ElementId
	
	elements = map(pullElement, elements)

OUT = cases, elements, unique_cases, sum_cases
# ----------------------------------------
code_block = CodeBlock(res=python_script) { res[0]; res[1]; res[2]; res[3]; }
clash_categories = Output(code_block.out0)
affected_elements = Output(code_block.out1)
unique_cases = Output(code_block.out2)
number_of_clashes = Output(code_block.out3)
