# Dynamo custom node Line.StraightenXY.dyf "Springs.Line.StraightenXY" (Dynamo 0.8.2.2392)
# category: Springs.Geometry
# Checks a line's end points for irregularities and corrects them if they are at or below the specified margin. The default margin is 1/5000 of the curve length, which is conservative.

line = Input(line:var)
margin = Input(margin : double = 5000)
code_block = CodeBlock(c=line, x=margin) { straighten(c,x); }
line_2 = Output(code_block)  # "line"
code_block_2 = CodeBlock()
# ---------- code_block_2.designscript (21 lines) ----------
def straighten(c, x){
margin = c.Length / x;
cS = c.StartPoint;
cE = c.EndPoint;
dX = Math.Abs(cS.X - cE.X);
dY = Math.Abs(cS.Y - cE.Y);
return = [Imperative]
{
 if (dX <= margin){
  return = Line.ByStartPointEndPoint(
  cS,Point.ByCoordinates(cS.X, cE.Y, cE.Z));
 }
 elseif (dY <= margin){
  return = Line.ByStartPointEndPoint(
  cS,Point.ByCoordinates(cE.X, cS.Y, cE.Z));
 }
 else{
  return = c;
 }
}
};
# ----------------------------------------
