# Dynamo custom node Line.StraightenZ.dyf "Springs.Line.StraightenZ" (Dynamo 0.8.2.2392)
# category: Springs.Geometry
# Checks a line's end points for irregularities in  the Z axis and corrects them if they are at or below the specified margin. The default margin is 1/2000 of the curve length, which is conservative.

code_block = CodeBlock()
# ---------- code_block.designscript (16 lines) ----------
def straightenZ(c, x){
margin = c.Length / x;
cS = c.StartPoint;
cE = c.EndPoint;
dZ = Math.Abs(cS.Z - cE.Z);
return = [Imperative]
{
 if (dZ <= margin){
  return = Line.ByStartPointEndPoint(
  cS,Point.ByCoordinates(cE.X, cE.Y, cS.Z));
 }
 else{
  return = c;
 }
}
};
# ----------------------------------------
line = Input(line:var)
margin = Input(margin : double = 5000)
code_block_2 = CodeBlock(c=line, x=margin) { straightenZ(c,x); }
line_2 = Output(code_block_2)  # "line"
