# Dynamo custom node Line.ToString.dyf (Dynamo 4.0.2.3852)
# category: Springs.Geometry.Serialization.Actions
# Serilize a line to a string. You can use a custom delimier  between the coordinates and apply an optional rounding. Works great with Revit text based parameters or Excel.

line = Input(line: var[])
separator = Input(separator: string = ",")
digits = Input(digits: int = null)
python_script = Python(IN[0]=line, IN[1]=separator, IN[2]=digits)  # PythonNet3
# ---------- python_script.python (50 lines) ----------
#----------------------------------------------#
#                                              #
#      Copyright(c) 2017, Dimitar Venkov       #
#                                              #
# https://github.com/dimven/SpringNodes/issues #
# https://www.reope.com/                       #
#                                              #
#    ____    _____   _____   ____    _____     #
#   |  _ \ *|  ___|*|  _  |*|  _ \ *|  ___|    #
#   | |_) |*| |___ *| | | |*| |_) |*| |___     #
#   |  _ < *|  ___|*| | | |*|  __/ *|  ___|    #
#   | | | |*| |___ *| |_| |*| |    *| |___     #
#   |_| \_|*|_____|*|_____|*|_|    *|_____|    #
#                                              #
#                                              #
#-----------Updated by Mark Ackerley-----------#

def tolist(x):
	if hasattr(x,'__iter__'): return x
	else : return [x]

def n2s(n, digits):
	if digits is not None:
		n = round(n, digits)
	s1 = str(n)
	if s1[-2:] == '.0':
		s1 = s1[:-2]
	return s1
def p2s(p, sep, digits):
	x = n2s(p.X, digits)
	y = n2s(p.Y, digits)
	z = n2s(p.Z, digits)
	return ''.join( (x, sep, y, sep, z) )
	
def l2s(l, sep=IN[1], digits=IN[2]):
	a = p2s(l.StartPoint, sep, digits)
	b = p2s(l.EndPoint, sep, digits)
	return ''.join( (a, sep, b) )

try:
    lines = tolist(IN[0])

    OUT = map(l2s, lines)

except Exception as e:
    import traceback
    OUT = "Exception:\n{0}\n\nTraceback:\n{1}".format(
        str(e),
        traceback.format_exc()
    )
# ----------------------------------------
string = Output(python_script)
