# Dynamo custom node LineLoop.Merge.dyf (Dynamo 3.3.0.6316)
# category: Springs.Geometry.Actions
# Attempts to join lines into a single chain of joined curves. The node returns the new lines as a chain and with the original order. The success outputs returns the success of the execution as a true/false boolean.

lines = Input(lines: var[])
margin = Input(margin: double = 100)
python_script = Python(IN[0]=lines, IN[1]=margin)  # PythonNet3
# ---------- python_script.python (157 lines) ----------
#----------------------------------------------#
#                                              #
#      Copyright(c) 2016, Dimitar Venkov       #
#                                              #
# https://github.com/dimven/SpringNodes/issues #
# https://www.reope.com/                       #
#                                              #
#    ____    _____   _____   ____    _____     #
#   |  _ \ *|  ___|*|  _  |*|  _ \ *|  ___|    #
#   | |_) |*| |___ *| | | |*| |_) |*| |___     #
#   |  _ < *|  ___|*| | | |*|  __/ *|  ___|    #
#   | | | |*| |___ *| |_| |*| |    *| |___     #
#   |_| \_|*|_____|*|_____|*|_|    *|_____|    #
#                                              #    
#                                              #
#-----------Updated by Mark Ackerley-----------#

import clr
clr.AddReference('ProtoGeometry')
from Autodesk.DesignScript.Geometry import *

curves = IN[0]
margin = IN[1]
original = curves[:]

output = []  # collect all intermediate values here

def endpointsTouch(c1, c2, tol=0.001):
    return bool(c1.Intersect(c2))


def sharedPoint(c1, c2):
    pts = c1.Intersect(c2)
    for pt in pts:
        if hasattr(pt, "X") and hasattr(pt, "Y") and hasattr(pt, "Z"):
            return pt
        elif hasattr(pt, "PointAtParameter"):
            return pt.PointAtParameter(0.5)
    return None

def switch1(i, j, cl0, cl1):
    cl0[i], cl0[j] = cl0[j], cl0[i]
    cl1[i], cl1[j] = cl1[j], cl1[i]

def OrderCurves(cl0, cl1):
    _ln = len(cl1)
    xr1 = range(_ln)
    int_test = [[endpointsTouch(cl1[i], cl1[j]) for j in xr1 if j != i] for i in xr1]
    output.append(["intersection matrix", int_test])
    countT = list(map(sum, int_test))
    output.append(["intersection counts", countT])

    if 0 not in countT:
        if 1 in countT and countT[0] != 1:
            switch1(0, countT.index(1), cl0, cl1)
        for i in range(_ln - 1):
            k = i + 1
            if endpointsTouch(cl1[i], cl1[k]):
                continue
            try:
                int_test = [endpointsTouch(cl1[i], cl1[j]) for j in range(k, _ln)]
                switch1(k, k + int_test.index(True), cl0, cl1)
            except Exception as e:
                output.append(["ordering exception", str(e)])
    return cl0, cl1

def ClosedCase(cl0, cl1):
    pts = []
    for i in range(len(cl1)):
        pt = sharedPoint(cl1[i - 1], cl1[i])
        if pt is None:
            output.append(["closed case fail", i])
            raise ValueError("No shared point at index {}".format(i))
        pts.append(pt)
    output.append(["closed case points", pts])
    return PolyCurve.ByPoints(pts, True)

def OpenCase(cl0, cl1):
    def FarPt(l1, p1):
        pts = (l1.StartPoint, l1.EndPoint)
        return max(pts, key=lambda pt: p1.DistanceTo(pt))

    pts = []
    for i in range(len(cl1) - 1):
        pt = sharedPoint(cl1[i], cl1[i + 1])
        if pt is None:
            output.append(["open case fail", i])
            raise ValueError("No shared point at index {}".format(i))
        pts.append(pt)

    pts.append(FarPt(cl0[-1], pts[-1]))
    pts.insert(0, FarPt(cl0[0], pts[0]))
    output.append(["open case points", pts])
    return PolyCurve.ByPoints(pts)

def joinCurves(cl0, th1):
    len1 = len(cl0)
    if len1 < 2:
        return cl0, False
    else:
        cl1 = []
        for c in cl0:
            c1 = c.ExtendStart(th1)
            c2 = c1.ExtendEnd(th1) if c1 else None
            if not c2:
                output.append(["extension fail", c])
                raise ValueError("Curve extension failed")
            cl1.append(c2)

        output.append(["extended curves", cl1])
        cl0, cl1 = OrderCurves(cl0, cl1)
        output.append(["ordered original", cl0])
        output.append(["ordered extended", cl1])

        isClosed = endpointsTouch(cl1[0], cl1[-1]) and len1 > 2
        output.append(["isClosed", isClosed])
        _fn = ClosedCase if isClosed else OpenCase

        try:
            result = _fn(cl0, cl1)
            return result, True
        except Exception as e:
            output.append(["join exception", str(e)])
            return cl0, False

def ReorderCurves(orig, new):
    reordered, new = [], list(new)
    app1, pop1, PaP = reordered.append, new.pop, Curve.PointAtParameter

    for i in range(len(orig)):
        p1 = PaP(orig[i], 0.5)
        p2 = [PaP(new[j], 0.5) for j in range(len(new))]
        ind1 = p2.index(min(p2, key=lambda pt: p1.DistanceTo(pt)))
        app1(pop1(ind1))
    output.append(["reordered curves", reordered])
    return reordered

# Run code
out1 = joinCurves(curves, margin)

try:
    joined = out1[0]
    # If joined is a PolyCurve, extract its segments for reordering
    if hasattr(joined, "Curves"):
        reordered = ReorderCurves(original, joined.Curves())
    # If joined is already a list of curves, pass through
    elif isinstance(joined, list):
        reordered = ReorderCurves(original, joined)
    # If joined is a single curve, wrap it in a list
    else:
        reordered = ReorderCurves(original, [joined])

    OUT = [(joined), (reordered), (out1[1]), ("debug", output)]

except Exception as e:
    import traceback
    OUT = [("exception", str(e)), ("traceback", traceback.format_exc()), ("debug", output)]
# ----------------------------------------
code_block = CodeBlock(o=python_script) { o[0]; o[1]; o[2]; }
lines_2 = Output(code_block.out0)  # "lines"
ordered = Output(code_block.out1)
success = Output(code_block.out2)
