# Dynamo custom node Lines.Group&FixCorners.dyf (Dynamo 0.8.2.2392)
# category: SpringNodes.Revit.Utility
# Groups unconnected lines into sub-lists by margin(the maximum distance between endpoints) and attempts to create clean corner connections between them. Built on top of the Group curves node found in archi-lab.net.

lines = Input()
margin = Input()
python_script = Python(IN[0]=lines, IN[1]=margin)
# ---------- python_script.python (112 lines) ----------
#Copyright(c) 2015, Dimitar Venkov
# @5devene, dimitar.ven@gmail.com
#Original node "Group Curves" by Konrad Sobon
# @arch_laboratory, http://archi-lab.net

import clr

clr.AddReference('ProtoGeometry')
from Autodesk.DesignScript.Geometry import *

inputCurves = IN[0]
original = inputCurves[:]
margin = IN[1]

#join/group curves function
def groupCurves(Line_List,ignore_distance): 
	Grouped_Lines = [] 
	Queue = set() 
	while Line_List: 
		Shape = [] 
		Queue.add(Line_List.pop()) # Move a line from the Line_List to our queue 
		while Queue: 
			Current_Line = Queue.pop() 
			Shape.append(Current_Line) 
			for Potential_Match in Line_List: 
				Points = (Potential_Match.StartPoint, Potential_Match.EndPoint)
				for P1 in Points: 
					for P2 in (Current_Line.StartPoint, Current_Line.EndPoint): 
						distance = P1.DistanceTo(P2) 
						if distance <= ignore_distance: 
							Queue.add(Potential_Match) 
			Line_List = [item for item in Line_List if item not in Queue]
		Grouped_Lines.append(Shape) 
	return Grouped_Lines

def CountTrue(l1):
	n = 0
	for i in l1:
		n += 1 if i == True else 0
	return n
	
def OrderCurves(cl0,cl1):
	test1 = []
	for i in xrange(len(cl1)):
		cl2 = cl1[:i] + cl1[i+1:]
		x1 = [cl1[i].DoesIntersect(c) for c in cl2]
		test1.append(x1)
	countT = [CountTrue(t) for t in test1]
	if 1 in countT and countT[0] != 1 :
		n = countT.index(1)
		cl0[0],cl0[n] = cl0[n],cl0[0]
		cl1[0],cl1[n] = cl1[n],cl1[0]
	return cl0,cl1

def ClosedCase(cl1):
	pts = []
	for i in xrange(len(cl1)):
		p1 = cl1[i-1].Intersect(cl1[i])[0]
		pts.append(p1)
	return PolyCurve.ByPoints(pts,True).Curves()

def FarPt(l1, p1):
	pts = [l1.StartPoint,l1.EndPoint]
	dist1 = [p1.DistanceTo(p2) for p2 in pts]
	i1 = dist1.index(max(dist1))
	return pts[i1]

def OpenCase(cl0,cl1):
	pts = []
	for i in xrange(len(cl1) -1):
		p1 = cl1[i].Intersect(cl1[i+1])[0]
		pts.append(p1)
	pts.append(FarPt(cl0[-1],pts[-1]))
	pts.insert(0,FarPt(cl0[0],pts[0]))
	return PolyCurve.ByPoints(pts).Curves()

def joinCurves(Clist1,th1):
	if len(Clist1) == 1:
		return Clist1
	else:
		Clist2 = [c.ExtendStart(th1).ExtendEnd(th1) for c in Clist1]
		ordered = OrderCurves(Clist1,Clist2)
		Clist1 = ordered[0]
		Clist2 = ordered[1]
		isClosed = Clist2[0].DoesIntersect(Clist2[-1]) and len(Clist2) > 2
		if isClosed:
			return ClosedCase(Clist2)
		else:
			return OpenCase(Clist1,Clist2)
		
def ReorderCurves(original, new):
	opt = [c.PointAtParameter(0.5) for c in original]
	npt = [c.PointAtParameter(0.5) for c in new]
	dist1 = [[o.DistanceTo(n) for n in npt] for o in opt]
	keys = [d.index(min(d)) for d in dist1]
	reordered = [new[k] for k in keys]
	return reordered

def Flatten(x):
    if hasattr(x, "__iter__"):
        return [a for i in x for a in Flatten(i)]
    else:
        return [x]

Gcurves = groupCurves(inputCurves,margin)
out1 = []
for cl1 in Gcurves:
	try:
		out1.append(joinCurves(cl1,margin))
	except:
		out1.append(cl1)
OUT = ReorderCurves(original,Flatten(out1)), out1
# ----------------------------------------
code_block = CodeBlock(l=python_script) { l[0]; l[1]; }
lines_original_order = Output(code_block.out0)  # "lines(original order)"
lines_grouped = Output(code_block.out1)  # "lines(grouped)"
