# Dynamo custom node Link.DwgGeometryByInstance.dyf "RevitLinkType.DwgGeometryByInstance" (Dynamo 4.0.2.3852)
# category: Springs.Revit
# Retrieves DWG Geometry from an Instance, attempts to parse to Dynamo geometry, where it can't, it returns the original. Each piece of geometry is returned with its layer name for future filtering

views = Input(views: var[])
setName = Input(setName: var)
Overwrite = Input(Overwrite: bool = false)
python_script = Python(IN[0]=views, IN[1]=setName, IN[2]=Overwrite)  # PythonNet3
# ---------- python_script.python (79 lines) ----------
#-Reope----------------------------------------#
#                                              #
#      Copyright(c) 2015, Dimitar Venkov       #
#                                              #
# https://github.com/dimven/SpringNodes/issues #
# https://www.reope.com/                       #
#                                              #
#    ____    _____   _____   ____    _____     #
#   |  _ \ *|  ___|*|  _  |*|  _ \ *|  ___|    #
#   | |_) |*| |___ *| | | |*| |_) |*| |___     #
#   |  _ < *|  ___|*| | | |*|  __/ *|  ___|    #
#   | | | |*| |___ *| |_| |*| |    *| |___     #
#   |_| \_|*|_____|*|_____|*|_|    *|_____|    #
#                                              #
#                                              #
#-Reope-----Updated by Mark Ackerley-----------#

# code inspired by Harry Mattison
# https://boostyourbim.wordpress.com

import clr
clr.AddReference("RevitServices")
import RevitServices
from RevitServices.Persistence import DocumentManager
from RevitServices.Transactions import TransactionManager
doc = DocumentManager.Instance.CurrentDBDocument

clr.AddReference("RevitAPI")
from Autodesk.Revit.DB import *

def tolist(obj1):
    if isinstance(obj1, str): return [obj1]
    return obj1 if isinstance(obj1, list) else [obj1]

def first(obj1):
    return obj1[0] if isinstance(obj1, list) else obj1

try:
    views = UnwrapElement(tolist(IN[0]))
    name1 = str(first(IN[1]))
    overwrite = IN[2]

    vs_exists = None
    fec = FilteredElementCollector(doc).OfClass(ViewSheetSet)
    for f in fec:
        if f.Name == name1:
            vs_exists = f
            break

    if vs_exists is not None and overwrite:
        TransactionManager.Instance.EnsureInTransaction(doc)
        doc.Delete(vs_exists.Id)
        TransactionManager.Instance.TransactionTaskDone()
        vs_exists = None
    elif vs_exists is not None and not overwrite:
        OUT = "There's a ViewSet with the same name.\nSet Overwrite to true to continue."

    if vs_exists is None:
        vs1 = ViewSet()
        for v in views:
            vs1.Insert(v)
        printMan = doc.PrintManager
        printMan.PrintRange = PrintRange.Select
        viewSS = printMan.ViewSheetSetting
        try:
            TransactionManager.Instance.EnsureInTransaction(doc)
            viewSS.CurrentViewSheetSet.Views = vs1
            viewSS.SaveAs(name1)
            TransactionManager.Instance.TransactionTaskDone()
            OUT = "ViewSet created with %s views inside." % len(views)
        except:
            OUT = "The ViewSet could not be created"

except Exception as e:
    import traceback
    OUT = "Exception:\n{0}\n\nTraceback:\n{1}".format(
        str(e),
        traceback.format_exc()
    )
# ----------------------------------------
result = Output(python_script)
