# Dynamo custom node List.DropFirstLast.dyf "Springs.List.DropFirstLast" (Dynamo 1.2.1.3083)
# category: Springs.Core.List
# Removes the first and last items from the list

list = Input(list:var[]..[])
code_block = CodeBlock(l1=list) { DSCore.List.DropItems(DSCore.List.DropItems(l1,1),-1); l1[{0,-1}]; }
list_2 = Output(code_block.out0)  # "list"
F_L = Output(code_block.out1)  # "F&L"
