# Dynamo custom node List.DropLast.dyf (Dynamo 0.7.6.4045)
# category: SpringNodes.Lists
# Removes the last value of the list.

list = Input()
code_block = CodeBlock(l1=list) { List.DropItems(l1,-1); }
list_2 = Output(code_block)  # "list"
