# Dynamo custom node List.EveryOther.dyf "Springs.List.EveryOther" (Dynamo 1.1.0.2094)
# category: Springs.Core.List
# Useful for when you want to combine an item on the list with every other item on the list. For example in list {1,2,3} , "2" will be paired up only with "1" and "3" and will not be paired up with itself.

list = Input(list:var[]..[])
removeItemAtIndex = List.RemoveItemAtIndex(list=list)  # unwired: indices
code_block = CodeBlock(fn1=removeItemAtIndex, l1=list) { __Map(fn1,GetKeys(l1)); }
lists = Output(code_block)
