# Dynamo custom node List.FilterByClassName.dyf (Dynamo 4.0.2.3852)
# category: Springs.Actions
# Filters a list of objects by the object's class name. Note that Dynamo elements belong to different classes than their Revit counterparts. Use the Object.Class node to check an object's class.

object = Input(object: var[])
optionalName = Input(optionalName: var[] = null)
className = Input(className: var[])
python_script = Python(IN[0]=object, IN[1]=optionalName, IN[2]=className)  # PythonNet3
# ---------- python_script.python (64 lines) ----------
#-Reope----------------------------------------#
#                                              #
#      Copyright(c) 2017, Dimitar Venkov       #
#                                              #
# https://github.com/dimven/SpringNodes/issues #
# https://www.reope.com/                       #
#                                              #
#    ____    _____   _____   ____    _____     #
#   |  _ \ *|  ___|*|  _  |*|  _ \ *|  ___|    #
#   | |_) |*| |___ *| | | |*| |_) |*| |___     #
#   |  _ < *|  ___|*| | | |*|  __/ *|  ___|    #
#   | | | |*| |___ *| |_| |*| |    *| |___     #
#   |_| \_|*|_____|*|_____|*|_|    *|_____|    #
#                                              #
#                                              #
#-Reope-----Updated by Mark Ackerley-----------#

import clr
from itertools import repeat

def tolist(obj1):
    if isinstance(obj1, str): return [obj1]
    return obj1 if isinstance(obj1, list) else [obj1]

try:
    elements = tolist(IN[0])
    opt_names = IN[1]
    terms = set(map(str.lower, map(str, tolist(IN[2]))))

    use_opt_names = (
        opt_names is not None and
        len(elements) == len(tolist(opt_names))
    )

    if use_opt_names:
        opt_names = list(map(str.lower, map(str, tolist(opt_names))))
    else:
        if opt_names is not None:
            raise ValueError(
                "optNames length ({}) does not match elements length ({})".format(
                    len(tolist(opt_names)), len(elements)
                )
            )
        opt_names = repeat("", len(elements))

    result = []
    for e, n in zip(elements, opt_names):
        if e is None:
            result.append(False)
            continue
        if use_opt_names:
            n1 = n
        else:
            n1 = e.GetType().Name.lower()
        result.append(any(f in n1 for f in terms))

    OUT = result

except Exception as e:
    import traceback
    OUT = "Exception:\n{0}\n\nTraceback:\n{1}".format(
        str(e),
        traceback.format_exc()
    )
# ----------------------------------------
bool = Output(python_script)
