# Dynamo custom node List.GetEven.dyf "Springs.List.GetEven" (Dynamo 1.0.0.1180)
# category: Springs.Core.List
# Gets even indices from the list.

list = Input(list:var[])
code_block = CodeBlock(l1=list) { List.TakeEveryNthItem(l1,2,0); }
list_2 = Output(code_block)  # "list"
