# Dynamo custom node List.GetOdd.dyf "Springs.List.GetOdd" (Dynamo 1.0.0.1180)
# category: Springs.Core.List
# Gets the odd indices from the list.

list = Input(list:var[])
code_block = CodeBlock(l1=list) { List.DropEveryNthItem(l1,2,0); }
list_2 = Output(code_block)  # "list"
