# Dynamo custom node List.ItemAtIndex+.dyf "Springs.List.ItemAtIndex+" (Dynamo 1.3.2.2480)
# category: Springs.Core.List
# Identical to the built in node but works with negative indices

list = Input(list:var[]..[])
index = Input(index:var[])
code_block = CodeBlock(items=list, idx=index) { items[idx]; }
item = Output(code_block)
