# Dynamo custom node List.MergeByBoolMask.dyf (Dynamo 4.0.2.3852)
# category: Springs.Create
# Merge two lists by a boolean mask list. The true count in the mask should be the same as the length of the true list and vice versa for the false list.

mask = Input(mask: var[]..[])
In = Input(In: var[]..[])
Out = Input(Out: var[]..[])
python_script = Python(IN[0]=mask, IN[1]=In, IN[2]=Out)  # PythonNet3
# ---------- python_script.python (33 lines) ----------
#-Reope----------------------------------------#
#                                              #
#      Copyright(c) 2017, Dimitar Venkov       #
#                                              #
# https://github.com/dimven/SpringNodes/issues #
# https://www.reope.com/                       #
#                                              #
#    ____    _____   _____   ____    _____     #
#   |  _ \ *|  ___|*|  _  |*|  _ \ *|  ___|    #
#   | |_) |*| |___ *| | | |*| |_) |*| |___     #
#   |  _ < *|  ___|*| | | |*|  __/ *|  ___|    #
#   | | | |*| |___ *| |_| |*| |    *| |___     #
#   |_| \_|*|_____|*|_____|*|_|    *|_____|    #
#                                              #
#                                              #
#-Reope-----Updated by Mark Ackerley-----------#


def tolist(obj1):
    return obj1 if isinstance(obj1, list) else [obj1]
    
t1 = tolist(IN[0])
l1 = list(reversed(tolist(IN[1]) ) )
l2 = list(reversed(tolist(IN[2]) ) )

try: OUT = [l1.pop() if i else l2.pop() for i in t1]

except Exception as e:
    import traceback
    OUT = "Exception:\n{0}\n\nTraceback:\n{1}".format(
        str(e),
        traceback.format_exc()
    )
# ----------------------------------------
list = Output(python_script)
