# Dynamo custom node List.MinIndex.dyf (Dynamo 4.0.2.3852)
# category: Springs.Actions
# Gets the minimum index of a list. Good for use with floating point values

list = Input(list: var[])
python_script = Python(IN[0]=list)  # PythonNet3
# ---------- python_script.python (33 lines) ----------
#-Reope----------------------------------------#
#                                              #
#      Copyright(c) 2019, Dimitar Venkov       #
#                                              #
# https://github.com/dimven/SpringNodes/issues #
# https://www.reope.com/                       #
#                                              #
#    ____    _____   _____   ____    _____     #
#   |  _ \ *|  ___|*|  _  |*|  _ \ *|  ___|    #
#   | |_) |*| |___ *| | | |*| |_) |*| |___     #
#   |  _ < *|  ___|*| | | |*|  __/ *|  ___|    #
#   | | | |*| |___ *| |_| |*| |    *| |___     #
#   |_| \_|*|_____|*|_____|*|_|    *|_____|    #
#                                              #
#                                              #
#-Reope-----Updated by Mark Ackerley-----------#



def tolist(obj1):
    if isinstance(obj1, str): return [obj1]
    return obj1 if isinstance(obj1, list) else [obj1]

try:
    data = tolist(IN[0])
    OUT = min(enumerate(data), key=lambda x: x[1])
    
except Exception as e:
    import traceback
    OUT = "Exception:\n{0}\n\nTraceback:\n{1}".format(
        str(e),
        traceback.format_exc()
    )
# ----------------------------------------
code_block = CodeBlock(r=python_script) { r[0]; r[1]; }
idx = Output(code_block.out0)
val = Output(code_block.out1)
