# Dynamo custom node List.NullIndexOf.dyf (Dynamo 4.0.2.3852)
# category: Springs.Actions
# Similar to the bult-in node but provides a null value instead of -1 of failure. Part of the SmartCopyMonitor workflow.

list = Input(list: var[])
element = Input(element: var)
code_block = CodeBlock(l1=list, el1=element) { ind0 = DSCore.List.IndexOf(l1,el1); ind1 = ind0 == -1 ? null : ind0; }
index = Output(code_block.ind1)
