# Dynamo custom node List.Randomise&Divide.dyf "Springs.List.Randomise&Divide" (Dynamo 1.3.2.2480)
# category: Springs.Core.List
# Shiffles the input list and divides it into sub-lists based on ratios(1/4 + 1/2 + 1/4 will give you three lists split accordingly) The smalest ratio will always be 1 / the list length and the largest ratio will be 1. A seed input can shuffle the list further.

list = Input(list:var[]..[])
ratios = Input(ratios:var[] = {1})
seed = Input(seed:var = "seed")
python_script = Python(IN[0]=list, IN[1]=ratios, IN[2]=seed)
# ---------- python_script.python (30 lines) ----------
import System
pf_path = System.Environment.GetFolderPath(System.Environment.SpecialFolder.ProgramFilesX86)
import sys
sys.path.append('%s\IronPython 2.7\Lib' %pf_path)
import random

def tolist(x):
	if hasattr(x,'__iter__'): return x
	else : return [x]

l1, rat, seed = IN
l1 = tolist(l1)
r = random.Random()
r.seed(seed)
r.shuffle(l1)
len1 = len(l1)
OUT = []
if len(rat) < 2:
	rat.append(1.0 - rat[0])
if sum(rat) < 1.0:
	rat.append(1.0 - sum(rat) )
start, end = 0, int(round(rat[0] * len1) )
len2 = len(rat)
for i in xrange(len2):
	OUT.append(l1[start : end])
	start = end
	j = (i + 1) % len2
	end += int(round(rat[j] * len1) )
if not OUT[-1]:
	del(OUT[-1])
# ----------------------------------------
lists = Output(python_script)
