# Dynamo custom node List.RandomiseDivide.dyf (Dynamo 4.0.2.3852)
# category: Springs.Create
# Shiffles the input list and divides it into sub-lists based on ratios(1/4 + 1/2 + 1/4 will give you three lists split accordingly) The smalest ratio will always be 1 / the list length and the largest ratio will be 1. A seed input can shuffle the list further.

list = Input(list: var[]..[])
ratios = Input(ratios: var[] = [1])
seed = Input(seed: var = "seed")
python_script = Python(IN[0]=list, IN[1]=ratios, IN[2]=seed)  # PythonNet3
# ---------- python_script.python (53 lines) ----------
#-Reope----------------------------------------#
#                                              #
#      Copyright(c) 2020, Dimitar Venkov       #
#                                              #
# https://github.com/dimven/SpringNodes/issues #
# https://www.reope.com/                       #
#                                              #
#    ____    _____   _____   ____    _____     #
#   |  _ \ *|  ___|*|  _  |*|  _ \ *|  ___|    #
#   | |_) |*| |___ *| | | |*| |_) |*| |___     #
#   |  _ < *|  ___|*| | | |*|  __/ *|  ___|    #
#   | | | |*| |___ *| |_| |*| |    *| |___     #
#   |_| \_|*|_____|*|_____|*|_|    *|_____|    #
#                                              #
#                                              #
#-Reope-----Updated by Mark Ackerley-----------#

import random

def tolist(obj1):
    return obj1 if isinstance(obj1, list) else [obj1]
 
try:    
    l1, rat, seed = IN
    l1 = tolist(l1)
    r = random.Random()
    r.seed(seed)
    r.shuffle(l1)
    len1 = len(l1)
    OUT = []
    if len(rat) < 2:
	    rat.append(1.0 - rat[0])
    if sum(rat) < 1.0:
	    rat.append(1.0 - sum(rat) )
    start, end = 0, int(round(rat[0] * len1) )
    len2 = len(rat)
    for i in range(len2):
	    OUT.append(l1[start : end])
	    start = end
	    j = (i + 1) % len2
	    end += int(round(rat[j] * len1) )
    if not OUT[-1]:
	    del(OUT[-1])
    remaining = len1 - sum(len(i) for i in OUT)
    if remaining > 0:
        OUT.append(l1[-remaining:])
    
except Exception as e:
    import traceback
    OUT = "Exception:\n{0}\n\nTraceback:\n{1}".format(
        str(e),
        traceback.format_exc()
    )
# ----------------------------------------
lists = Output(python_script)
