# Dynamo custom node List.ShiftIndices+.dyf (Dynamo 0.8.2.2392)
# category: SpringNodes.Lists
# The built in node fails if the shift number is greater than the lenght of the list. This node acts as a work-around.

list = Input(list:var[]..[])
ammount = Input(ammount:int)
code_block = CodeBlock(l1=list, n=ammount) { List.ShiftIndices(l1,n%Count(l1)); }
list_2 = Output(code_block)  # "list"
