# Dynamo custom node List.Split.dyf "Springs.List.Split" (Dynamo 1.1.0.2094)
# category: Springs.Core.List
# Splits a list at the desired length

list = Input(list:var[]..[])
amount = Input(amount:int)
code_block = CodeBlock(l1=list, amt=amount) { List.TakeItems(l1, amt); List.DropItems(l1, amt); }
list1 = Output(code_block.out0)
list2 = Output(code_block.out1)
