# Dynamo custom node Math.AlmostEqual.dyf "Springs.Math.AlmostEqual" (Dynamo 1.0.0.1180)
# category: Springs.Core.Math.Actions
# Checks if a number is almost equal to a value with a specified tollerance.

a = Input(a:var)
b = Input(b:var)
tolerance = Input(tolerance: double = 0.0001)
code_block = CodeBlock(a=a, b=b, tol=tolerance) { Almost1(a,b,tol); }
bool = Output(code_block)
code_block_2 = CodeBlock()
# ---------- code_block_2.designscript (4 lines) ----------
def Almost1(a,b,tol){
res = Math.Abs(a - b);
return = res <= tol;
};
# ----------------------------------------
