# Dynamo custom node Mesh.BoundingBox.dyf (Dynamo 3.6.1.9895)
# category: Springs.Geometry.Query
# Get the bounding box of a mesh. Works with both built-in meshes and toolkit meshes

mesh = Input(mesh: var[])
python_script = Python(IN[0]=mesh)  # PythonNet3
# ---------- python_script.python (35 lines) ----------
#----------------------------------------------#
#                                              #
#      Copyright(c) 2018, Dimitar Venkov       #
#                                              #
# https://github.com/dimven/SpringNodes/issues #
# https://www.reope.com/                       #
#                                              #
#    ____    _____   _____   ____    _____     #
#   |  _ \ *|  ___|*|  _  |*|  _ \ *|  ___|    #
#   | |_) |*| |___ *| | | |*| |_) |*| |___     #
#   |  _ < *|  ___|*| | | |*|  __/ *|  ___|    #
#   | | | |*| |___ *| |_| |*| |    *| |___     #
#   |_| \_|*|_____|*|_____|*|_|    *|_____|    #
#                                              #
#                                              #
#-----------Updated by Mark Ackerley-----------#

import clr
clr.AddReference('ProtoGeometry')
from Autodesk.DesignScript.Geometry import BoundingBox, Point, Mesh

def tolist(x):
        if hasattr(x,'__iter__'): return x
        else : return [x]

meshes = tolist(IN[0])
OUT = []

for m in meshes:
        if isinstance(m, Mesh):
                co = list(zip(*((v.X, v.Y, v.Z) for v in m.VertexPositions)))
        else:
                co = list(zip(*((v.X, v.Y, v.Z) for v in m.Vertices())))

        OUT.append(BoundingBox.ByCorners(Point.ByCoordinates(*list(map(min, co))), Point.ByCoordinates(*list(map(max, co)))))
# ----------------------------------------
boundingBox = Output(python_script)
