# Dynamo custom node Mesh.Flatten.dyf (Dynamo 4.1.0.4676)
# category: Springs.Geometry.Actions
# Sets the Z coordinate of each vertex of the mesh to the desired value.

mesh = Input(mesh: var[])
newZ = Input(newZ: double = 0)
python_script = Python(IN[0]=mesh, IN[1]=newZ)  # PythonNet3
# ---------- python_script.python (15 lines) ----------
# Copyright(c) 2020, Dimitar Venkov
# @5devene, dimitar.ven@gmail.com
# www.badmonkeys.net

import clr
clr.AddReference('ProtoGeometry')
import Autodesk.DesignScript.Geometry as DS

meshes, Z = IN

OUT = []
for m in meshes:
	vertices = [DS.Point.ByCoordinates(p.X, p.Y, Z) for p in m.VertexPositions]
	indices = m.VertexIndicesByTri()
	OUT.append(m.ByPointsIndices(vertices, indices))
# ----------------------------------------
mesh_2 = Output(python_script)  # "mesh"
