# Dynamo custom node Mesh.Merge.dyf (Dynamo 4.1.0.4676)
# category: Springs.Geometry.Actions
# Creates a single mesh entity from a list of meshes.

meshes = Input(meshes: var[])
python_script = Python(IN[0]=meshes)  # PythonNet3
# ---------- python_script.python (10 lines) ----------
meshes = IN[0]
vertices, indices = [], []
lastInd = 0

for m in meshes:
	vertices.extend(m.VertexPositions)
	indices.extend([i + lastInd for i in m.VertexIndicesByTri()])
	lastInd += int(m.VertexCount)

OUT = m.ByPointsIndices(vertices, indices)
# ----------------------------------------
mesh = Output(python_script)
