# Dynamo custom node Mesh.ToPolySurface.dyf (Dynamo 3.3.0.6316)
# category: Springs.Geometry.Actions
# Converts a Dynamo mesh to a polysurface. By default the node is single threaded, but if you specify a higher number of threads in the `NUMTHREAD` input, the node will run multi-threaded to speed up the conversion.
# *WARNING* Using multi-threaded code with Dynamo's geometry kernel may crash Revit in some cases.

mesh = Input(mesh: var[])
mergeAll = Input(mergeAll: bool = false)
NUMTHREADS = Input(NUMTHREADS: int = 1)
useQuads = Input(useQuads: bool = false)
python_script = Python(IN[0]=mesh, IN[1]=mergeAll, IN[2]=NUMTHREADS, IN[3]=useQuads)  # PythonNet3
# ---------- python_script.python (145 lines) ----------
#----------------------------------------------#
#                                              #
#      Copyright(c) 2016, Dimitar Venkov       #
#                                              #
# https://github.com/dimven/SpringNodes/issues #
# https://www.reope.com/                       #
#                                              #
#    ____    _____   _____   ____    _____     #
#   |  _ \ *|  ___|*|  _  |*|  _ \ *|  ___|    #
#   | |_) |*| |___ *| | | |*| |_) |*| |___     #
#   |  _ < *|  ___|*| | | |*|  __/ *|  ___|    #
#   | | | |*| |___ *| |_| |*| |    *| |___     #
#   |_| \_|*|_____|*|_____|*|_|    *|_____|    #
#                                              #    
#                                              #
#-----------Updated by Mark Ackerley-----------#

import clr
from System.Threading import Thread, ThreadStart

clr.AddReference('ProtoGeometry')
from Autodesk.DesignScript.Geometry import PolySurface, Surface

import math

meshes, mergeAll, NUMTHREADS, useQuads = IN
CHOPLIMIT = 10
output = []

def tolist(obj1):
    if hasattr(obj1, '__iter__'): return obj1
    return [obj1]

def chop(l1, n):
    return [l1[x:x+n] for x in range(0, len(l1), n)]
    
def order_face(face):
    # Project to XY plane and sort by angle from centroid
    centroid = average_point(face)
    def angle(pt):
        v = vector_to(centroid, pt)
        return math.atan2(v[1], v[0])
    return sorted(face, key=angle)
  
def vector_to(p1, p2):
    return (p2.X - p1.X, p2.Y - p1.Y, p2.Z - p1.Z)
   
def average_point(pts):
    n = len(pts)
    if n == 0: return None
    x = sum(p.X for p in pts) / n
    y = sum(p.Y for p in pts) / n
    z = sum(p.Z for p in pts) / n
    return pts[0].Translate(x - pts[0].X, y - pts[0].Y, z - pts[0].Z)

def repair_face(face, tol=0.001, offset=0):
    repaired = []
    for pt in face:
        if all(pt.DistanceTo(p2) >= tol for p2 in repaired):
            repaired.append(pt)
        else:
            # Try nudging in X and Y
            new_pt = pt.Translate(offset, offset, 0)
            if all(new_pt.DistanceTo(p2) >= tol for p2 in repaired):
                repaired.append(new_pt)
            else:
                # Try nudging in X only
                new_pt = pt.Translate(offset, 0, 0)
                if all(new_pt.DistanceTo(p2) >= tol for p2 in repaired):
                    repaired.append(new_pt)
                else:
                    # Give up and skip this point
                    continue
    return repaired if len(repaired) >= 3 else None

def ps_generator(ptslist,
                 f_ps1=PolySurface.ByJoinedSurfaces,
                 f_sf1=Surface.ByPerimeterPoints):

    repaired_faces = []
    for face in ptslist:
        output.append(["original face", face])
        repaired = repair_face(face)
        output.append(["repaired face", repaired])
        if repaired:
            repaired_faces.append(repaired)
            
    ordered_faces = [order_face(f) for f in repaired_faces]
    sflist = list(map(f_sf1, ordered_faces))
    
    
    for f in repaired_faces:
        centroid = average_point(f)
        ordered = order_face(f)
        angles = [math.atan2(vector_to(centroid, pt)[1], vector_to(centroid, pt)[0]) for pt in ordered]
        output.append(["ordered face", ordered])
        output.append(["angles", angles])

    
    
    while len(sflist) > CHOPLIMIT:
        new_sflist = list(map(f_ps1, chop(sflist, CHOPLIMIT)))
        for s in sflist: s.Dispose()
        sflist = new_sflist
    return sflist

def mesh2ps(mesh):
    vp = mesh.VertexPositions
    if useQuads:
        ptslist = [[vp[q.A], vp[q.B], vp[q.C], vp[q.D]] for q in mesh.FaceIndices]
    else:
        ptslist = [[vp[t.A], vp[t.B], vp[t.C]] for t in mesh.FaceIndices]
        
    len1 = len(ptslist) // NUMTHREADS + 1

    if len(ptslist) > NUMTHREADS * 3 and NUMTHREADS > 1:
        ptslist = chop(ptslist, len1)

        class Worker(object):
            __slots__ = 'fn', 'args', 'result'
            def __init__(self, fn, args):
                self.fn = fn
                self.args = args
                self.result = None
            def __call__(self):
                self.result = self.fn(*self.args)

        workers, tasks = [], []
        for p in ptslist:
            w = Worker(ps_generator, (p,))
            t = Thread(ThreadStart(w))
            workers.append(w)
            tasks.append(t)
            t.Start()

        for t in tasks: t.Join()
        return PolySurface.ByJoinedSurfaces(i for w in workers for i in w.result)
    else:
        return PolySurface.ByJoinedSurfaces(list(ps_generator(ptslist)))

try:
    OUT = list(map(mesh2ps, tolist(meshes)))
    if mergeAll: OUT = PolySurface.ByJoinedSurfaces(OUT)
except Exception as e:
    OUT = str(e)
# ----------------------------------------
PolySurface = Output(python_script)
