# Dynamo custom node Mesh.VolumeArea.dyf (Dynamo 4.0.2.3852)
# category: Springs.Geometry
# Gets the volume and the area of a mesh. Works with both built in meshes and toolkit meshes. Based on math from geometry3sharp.
# Note that if triangles don't define closed region, volume is probably nonsense.

mesh = Input(mesh: var[])
python_script = Python(IN[0]=mesh)  # PythonNet3
# ---------- python_script.python (83 lines) ----------
#----------------------------------------------#
#                                              #
#      Copyright(c) 2017, Dimitar Venkov       #
#                                              #
# https://github.com/dimven/SpringNodes/issues #
# https://www.reope.com/                       #
#                                              #
#    ____    _____   _____   ____    _____     #
#   |  _ \ *|  ___|*|  _  |*|  _ \ *|  ___|    #
#   | |_) |*| |___ *| | | |*| |_) |*| |___     #
#   |  _ < *|  ___|*| | | |*|  __/ *|  ___|    #
#   | | | |*| |___ *| |_| |*| |    *| |___     #
#   |_| \_|*|_____|*|_____|*|_|    *|_____|    #
#                                              #    
#                                              #
#-----------Updated by Mark Ackerley-----------#

from math import sqrt
from itertools import zip_longest
import clr
clr.AddReference('ProtoGeometry')
from Autodesk.DesignScript.Geometry import Vector, Point, Mesh

def tolist(obj1):
    if hasattr(obj1, '__iter__') and not isinstance(obj1, str):
        return obj1
    return [obj1]

def grouper(iterable, n, fillvalue=None):
    args = [iter(iterable)] * n
    return zip_longest(fillvalue=fillvalue, *args)

def tkMeshData(m):
    try:
        vol, area = 0, 0
        tris = grouper(m.TrianglesAsNineNumbers, 9)
        for t in tris:
            a, b, c = (Vector.ByCoordinates(*c) for c in grouper(t, 3))
            e1 = Vector.Subtract(b, a)
            e2 = Vector.Subtract(c, a)
            N = e1.Cross(e2)
            area += 0.5 * N.Length
            f = a.X + b.X + c.X
            vol += N.X * f
            for i in a, b, c, e1, e2, N:
                i.Dispose()
        return vol / 6.0, area
    except AttributeError:
        return "tkMeshData error: TrianglesAsNineNumbers not available", None

def meshData(m):
    vol, area = 0, 0
    vp = m.VertexPositions
    for i in m.FaceIndices:
        if i.Count == 4:
            face_tris = [[vp[i.A], vp[i.B], vp[i.C]], 
                         [vp[i.A], vp[i.C], vp[i.D]]]
        else:
            face_tris = [[vp[i.A], vp[i.B], vp[i.C]]]
        for pts in face_tris:
            a, b, c = map(Point.AsVector, pts)
            e1 = Vector.Subtract(b, a)
            e2 = Vector.Subtract(c, a)
            N = e1.Cross(e2)
            area += 0.5 * N.Length
            f = a.X + b.X + c.X
            vol += N.X * f
            for j in a, b, c, e1, e2, N:
                j.Dispose()
    return vol / 6.0, area

try:
    meshes = tolist(IN[0])
    volumes, areas = [], []
    OUT = volumes, areas
    for m in meshes:
        f = meshData if isinstance(m, Mesh) else tkMeshData
        v, a = f(m)
        volumes.append(v)
        areas.append(a)
except Exception as e:
    import traceback
    OUT = [("exception", str(e)), ("traceback", traceback.format_exc())]
# ----------------------------------------
code_block = CodeBlock(r=python_script) { r[0]; r[1]; }
volume = Output(code_block.out0)
area = Output(code_block.out1)
