# Dynamo custom node N-hedron.ByOriginVector.dyf "Springs.N-hedron.ByOriginVector" (Dynamo 1.2.1.3083)
# category: Springs.Geometry
# Creates a multi-sided poyhedron with defined side length and total height.

code_block = CodeBlock()
# ---------- code_block.designscript (10 lines) ----------
def Nhedron(pt,vec,n,l,h){
r1 = l/Math.Sin(360/n)/2;
c1 = Circle.ByCenterPointRadiusNormal(pt,r1,vec);
pol1 = Polygon.RegularPolygon(c1,n);
pt2 = pt.Translate(vec,h);
l1 = Line.ByStartPointEndPoint(pt2,pol1.Points);
l1 = DSCore.List.AddItemToEnd(l1[0],l1);
return = PolySurface.ByJoinedSurfaces({Surface.
 ByRuledLoft(l1),pol1.Patch()}).ExtractSolids()[0];
};
# ----------------------------------------
origin = Input(origin : Point = Point.Origin())
axis = Input(axis : Vector = Vector.ZAxis())
sides = Input(sides : int = 3)
length = Input(length : double = 10)
height = Input(height : double = 8)
code_block_2 = CodeBlock(pt=origin, vec=axis, n=sides, l=length, h=height) { Nhedron(pt,vec,n,l,h); }
solid = Output(code_block_2)
