# Dynamo custom node NullGetParameter.dyf "Springs.NullGetParameter" (Dynamo 1.0.0.1180)
# category: Springs.Revit.Element
# Similar to the built in node.Capable of handling null values, part of the SmartCopyMonitor workflow.

element = Input(element:var)
parameter = Input(parameter:var)
code_block = CodeBlock(element, parameter)
# ---------- code_block.designscript (12 lines) ----------
def NullGetPar(e1,par)
{
return = [Imperative]
{
if (e1 != null)
{
val = e1.GetParameterValueByName(par);
return = val;
}
}
};
NullGetPar(e1,par);
# ----------------------------------------
value = Output(code_block)
