# Dynamo custom node NullIndexOf.dyf "Springs.NullIndexOf" (Dynamo 1.0.0.1180)
# category: Springs.Core.List
# Similar to the bult-in node but provides a null value instead of -1 of failure. Part of the SmartCopyMonitor workflow.

list = Input(list:var[])
element = Input(element:var)
code_block = CodeBlock(list, element)
# ---------- code_block.designscript (6 lines) ----------
def IndexOf1(l1:var[],el1)
{
ind1 = IndexOf(l1,el1);
return = ind1 == -1 ? null : ind1;
};
IndexOf1(l1,el1);
# ----------------------------------------
index = Output(code_block)
