# Dynamo custom node NullReorder.dyf "Springs.NullReorder" (Dynamo 1.0.0.1180)
# category: Springs.Core.List
# Simiar to the built-in function with the difference that it can handle null indices. Part of the SmartCopyMonitor workflow.

list = Input(list:var[])
indices = Input(indices:var[])
code_block = CodeBlock(list, indices)
# ---------- code_block.designscript (22 lines) ----------
def NullReplace(l1:var[],l2:var[])
{
return = [Imperative]
{
out1 = {};
n = 0;
for (i in l2)
{
if (i == null)
{
n = n + 1;
}
else
{
out1[i] = l1[n];
n = n + 1;
}
}
return = out1;
}
};
NullReplace(list,indices);
# ----------------------------------------
list_2 = Output(code_block)  # "list"
