# Dynamo custom node NullSetDifference.dyf "Springs.NullSetDifference" (Dynamo 1.0.0.1180)
# category: Springs.Core.List
# Similar to the built in node, with a built-in safety for null values. Part of the SmartCopyMonitor workflow.

list1 = Input(list1:var[])
list2 = Input(list2:var[])
code_block = CodeBlock(list1, list2)
# ---------- code_block.designscript (15 lines) ----------
def NullSetDiff(newl:var[], oldl:var[])
{
return = [Imperative]
{
if (oldl != null)
{
return = SetDifference(newl,oldl);
}
else
{
return = newl;
}
}
};
NullSetDiff(l1, l2);
# ----------------------------------------
list = Output(code_block)
