# Dynamo custom node NullSetParameter.dyf "Springs.NullSetParameter" (Dynamo 1.0.0.1180)
# category: Springs.Revit.Element
# Similar to the built-in function but with the ability to handle null values. Part of the SmartCopyMon workflow.

element = Input(element:var)
parameter = Input(parameter:var)
value = Input(value:var)
code_block = CodeBlock(element, parameter, value)
# ---------- code_block.designscript (12 lines) ----------
def NullSet(e1,par,val)
{
return = [Imperative]
{
if (e1 != null)
{
e1.SetParameterByName(par,val);
return = e1;
}
}
};
NullSet(e1,par,val);
# ----------------------------------------
element_2 = Output(code_block)  # "element"
