# Dynamo custom node Number.ToString.dyf (Dynamo 4.0.2.3852)
# category: Springs.Create
# Converts the input number(s) to string. You can optionally limit the number of digits.

num = Input(num: var[])
digits = Input(digits: int = null)
python_script = Python(IN[0]=num, IN[1]=digits)  # PythonNet3
# ---------- python_script.python (38 lines) ----------
#-Reope----------------------------------------#
#                                              #
#      Copyright(c) 2017, Dimitar Venkov       #
#                                              #
# https://github.com/dimven/SpringNodes/issues #
# https://www.reope.com/                       #
#                                              #
#    ____    _____   _____   ____    _____     #
#   |  _ \ *|  ___|*|  _  |*|  _ \ *|  ___|    #
#   | |_) |*| |___ *| | | |*| |_) |*| |___     #
#   |  _ < *|  ___|*| | | |*|  __/ *|  ___|    #
#   | | | |*| |___ *| |_| |*| |    *| |___     #
#   |_| \_|*|_____|*|_____|*|_|    *|_____|    #
#                                              #
#                                              #
#-Reope-----Updated by Mark Ackerley-----------#

def tolist(obj1):
    if isinstance(obj1, str): return [obj1]
    return obj1 if isinstance(obj1, list) else [obj1]

def n2s(n, digits=IN[1]):
	if digits is not None:
		n = round(n, digits)
	n = unicode(n)
	if n.endswith('.0'):
		n = n[:-2]
	return n

try: 
    OUT = map(n2s, tolist(IN[0]))
    
except Exception as e:
    import traceback
    OUT = "Exception:\n{0}\n\nTraceback:\n{1}".format(
        str(e),
        traceback.format_exc()
    )
# ----------------------------------------
str = Output(python_script)
