# Dynamo custom node Opening.ShaftByCurves.dyf (Dynamo 4.0.2.3852)
# category: Springs.Revit.Create
# Creates a shaft opening. The top level MUST be higher than the base level for a successful execution. You can either provide one base and top level for all shafts or have unique levels for each shaft instance.

curves = Input(curves: var[][])
baseLevel = Input(baseLevel: var[])
topLevel = Input(topLevel: var[])
python_script = Python(IN[0]=curves, IN[1]=baseLevel, IN[2]=topLevel)  # PythonNet3
# ---------- python_script.python (80 lines) ----------
#-Reope----------------------------------------#
#                                              #
#      Copyright(c) 2016, Dimitar Venkov       #
#                                              #
# https://github.com/dimven/SpringNodes/issues #
# https://www.reope.com/                       #
#                                              #
#    ____    _____   _____   ____    _____     #
#   |  _ \ *|  ___|*|  _  |*|  _ \ *|  ___|    #
#   | |_) |*| |___ *| | | |*| |_) |*| |___     #
#   |  _ < *|  ___|*| | | |*|  __/ *|  ___|    #
#   | | | |*| |___ *| |_| |*| |    *| |___     #
#   |_| \_|*|_____|*|_____|*|_|    *|_____|    #
#                                              #
#                                              #
#-Reope-----Updated by Mark Ackerley-----------#

import clr
clr.AddReference("RevitAPI")
from Autodesk.Revit.DB import *

clr.AddReference("RevitServices")
import RevitServices
from RevitServices.Persistence import DocumentManager
from RevitServices.Transactions import TransactionManager
doc = DocumentManager.Instance.CurrentDBDocument

clr.AddReference("RevitNodes")
import Revit
clr.ImportExtensions(Revit.Elements)
clr.ImportExtensions(Revit.GeometryConversion)

def tolist(obj1):
    if isinstance(obj1, str): return [obj1]
    return obj1 if isinstance(obj1, list) else [obj1]

try:
    is_list = isinstance(IN[0], list)
    hole = IN[0]
    base_lvl = UnwrapElement(tolist(IN[1]))
    top_lvl = UnwrapElement(tolist(IN[2]))

    if not any(hasattr(h, "__iter__") for h in tolist(hole)):
        hole = [hole]
    else:
        hole = tolist(hole)

    newhl = []
    for h in hole:
        z = CurveArray()
        for j in h:
            z.Append(j.ToRevitType())
        newhl.append(z)

    openings = []
    TransactionManager.Instance.EnsureInTransaction(doc)
    if len(base_lvl) == 1 and len(top_lvl) == 1:
        for h in newhl:
            try:
                x = doc.Create.NewOpening(base_lvl[0], top_lvl[0], h)
                openings.append(x.ToDSType(False))
            except:
                openings.append(None)
    else:
        for h, b, t in zip(newhl, base_lvl, top_lvl):
            try:
                x = doc.Create.NewOpening(b, t, h)
                openings.append(x.ToDSType(False))
            except:
                openings.append(None)
    TransactionManager.Instance.TransactionTaskDone()

    OUT = openings if is_list else openings[0]

except Exception as e:
    import traceback
    OUT = "Exception:\n{0}\n\nTraceback:\n{1}".format(
        str(e),
        traceback.format_exc()
    )
# ----------------------------------------
Opening = Output(python_script)
