# Dynamo custom node Parse.ErrorReport.dyf (Dynamo 4.0.2.3852)
# category: Springs.Revit.Utility.Actions
# Process a Revit error report (HTML file) and extract the error types, all affected elements and the total number of errors. If you are executing from a document different than the one the error report belongs to, be sure to set "fetch_elements" to false.

report = Input(report: var)
fetch_elements = Input(fetch_elements: bool = true)
python_script = Python(IN[0]=report, IN[1]=fetch_elements)  # PythonNet3
# ---------- python_script.python (100 lines) ----------
#-Reope----------------------------------------#
#                                              #
#      Copyright(c) 2016, Dimitar Venkov       #
#                                              #
# https://github.com/dimven/SpringNodes/issues #
# https://www.reope.com/                       #
#                                              #
#    ____    _____   _____   ____    _____     #
#   |  _ \ *|  ___|*|  _  |*|  _ \ *|  ___|    #
#   | |_) |*| |___ *| | | |*| |_) |*| |___     #
#   |  _ < *|  ___|*| | | |*|  __/ *|  ___|    #
#   | | | |*| |___ *| |_| |*| |    *| |___     #
#   |_| \_|*|_____|*|_____|*|_|    *|_____|    #
#                                              #
#                                              #
#-Reope-----Updated by Mark Ackerley-----------#

import clr
import System
from collections import Counter
from html.parser import HTMLParser

class ReportParser(HTMLParser):
    def __init__(self):
        super().__init__()
        self.data1 = []
        self.temp_data = []

    def handle_data(self, data):
        if data != "\n" and data not in known_errors:
            self.temp_data.append(data)

    def handle_starttag(self, tag, attrs):
        if tag == "tr":
            self.data1.append(self.temp_data)
            self.temp_data = []

def getElement(i):
    try:
        return doc.GetElement(ElementId(i)).ToDSType(True)
    except:
        return i

try:
    report1, fetch_elements = IN

    if fetch_elements:
        clr.AddReference("RevitServices")
        from RevitServices.Persistence import DocumentManager
        doc = DocumentManager.Instance.CurrentDBDocument
        clr.AddReference("RevitAPI")
        from Autodesk.Revit.DB import ElementId
        clr.AddReference('RevitNodes')
        import Revit
        clr.ImportExtensions(Revit.Elements)

    known_errors = {"  ", "td>  "}
    parser = ReportParser()

    with System.IO.File.OpenText(report1.FullName) as f:
        while not f.EndOfStream:
            parser.feed(f.ReadLine().replace("&", ""))

    parser.data1.append(parser.temp_data)
    report_data = parser.data1[1:]
    parser.close()

    errors, elements = [], []
    for data in report_data:
        isError = True
        ids = []
        for d in data:
            if isError:
                errors.append(d.strip())
                isError = False
                continue
            id_str = ''.join(filter(str.isdigit, d.rsplit(" : ", 1)[-1]))
            if id_str.isdigit():
                id_val = int(id_str)
            else:
                continue
            if fetch_elements:
                id_val = getElement(id_val)
            ids.append(id_val)
        elements.append(ids)

    group_errors = Counter(errors).most_common()
    unique_errors, sum_errors = zip(*group_errors)
    unique_errors = list(unique_errors)
    sum_errors = list(sum_errors)
    sum_errors.append("Total errors : %d" % sum(sum_errors))

    OUT = errors, elements, unique_errors, sum_errors

except Exception as e:
    import traceback
    OUT = "Exception:\n{0}\n\nTraceback:\n{1}".format(
        str(e),
        traceback.format_exc()
    )
# ----------------------------------------
code_block = CodeBlock(res=python_script) { res[0]; res[1]; res[2]; res[3]; }
error_messages = Output(code_block.out0)
affected_elements = Output(code_block.out1)
unique_errors = Output(code_block.out2)
number_of_errors = Output(code_block.out3)
