# Dynamo custom node Point.PullOntoPlane.dyf "Springs.Point.PullOntoPlane" (Dynamo 0.8.2.2392)
# category: Springs.Geometry
# Pulls (projects) the point onto the input plane, following the plane normal.

code_block = CodeBlock()
# ---------- code_block.designscript (5 lines) ----------
def PtProj1(pt1,pl1){
l1 = Line.ByStartPointEndPoint(pt1,
pt1.Add(pl1.XAxis));
return = l1.PullOntoPlane(pl1).StartPoint;
};
# ----------------------------------------
point = Input(point:var)
plane = Input(plane:var)
code_block_2 = CodeBlock(pt=point, pl=plane) { PtProj1(pt,pl); }
point_2 = Output(code_block_2)  # "point"
