# Dynamo custom node Points.ConvexHull2D.dyf (Dynamo 3.6.1.9895)
# category: Springs.Geometry.Create
# Computes the XY convex hull of a given set of points based on the monotone chain algorithm.

points = Input(points: var[])
elevation = Input(elevation: double = 0)
python_script = Python(IN[0]=points, IN[1]=elevation)  # CPython3
# ---------- python_script.python (50 lines) ----------
#----------------------------------------------#
#                                              #
#      Copyright(c) 2020, Dimitar Venkov       #
#                                              #
# https://github.com/dimven/SpringNodes/issues #
# https://www.reope.com/                       #
#                                              #
#    ____    _____   _____   ____    _____     #
#   |  _ \ *|  ___|*|  _  |*|  _ \ *|  ___|    #
#   | |_) |*| |___ *| | | |*| |_) |*| |___     #
#   |  _ < *|  ___|*| | | |*|  __/ *|  ___|    #
#   | | | |*| |___ *| |_| |*| |    *| |___     #
#   |_| \_|*|_____|*|_____|*|_|    *|_____|    #
#                                              #    
#                                              #
#-----------Updated by Mark Ackerley-----------#




import clr
clr.AddReference('ProtoGeometry')
from Autodesk.DesignScript.Geometry import Point

from itertools import chain

pts = sorted( (p.X, p.Y) for p in IN[0])
elev = IN[1]

def pCrs(o, a, b):
	return (a[0] - o[0]) * (b[1] - o[1]) - (a[1] - o[1]) * (b[0] - o[0])

pLen = len(pts)
if pLen < 4 : OUT = pts
else:
	lower, upper = [], []
	
	for i in range(pLen):
		j = pLen - 1 - i
		while len(lower) >= 2 and pCrs(lower[-2], lower[-1], pts[i]) <= 0.000001:
			lower.pop()
		lower.append(pts[i])
		while len(upper) >= 2 and pCrs(upper[-2], upper[-1], pts[j]) <= 0.000001:
			upper.pop()
		upper.append(pts[j])
	
	lower.pop()
	upper.pop()
	
	OUT = [Point.ByCoordinates(p[0], p[1], elev) for p in chain(lower, upper) ]
# ----------------------------------------
points_2 = Output(python_script)  # "points"
