# Dynamo custom node Polygon.2DArea.dyf (Dynamo 3.6.1.9895)
# category: Springs.Geometry.Query
# Returns the planar area of the input polygon(s). Not accurate for self-intersecting polys.

polygon = Input(polygon: var[])
python_script = Python(IN[0]=polygon)  # CPython3
# ---------- python_script.python (44 lines) ----------
#----------------------------------------------#
#                                              #
#      Copyright(c) 2017, Dimitar Venkov       #
#                                              #
# https://github.com/dimven/SpringNodes/issues #
# https://www.reope.com/                       #
#                                              #
#    ____    _____   _____   ____    _____     #
#   |  _ \ *|  ___|*|  _  |*|  _ \ *|  ___|    #
#   | |_) |*| |___ *| | | |*| |_) |*| |___     #
#   |  _ < *|  ___|*| | | |*|  __/ *|  ___|    #
#   | | | |*| |___ *| |_| |*| |    *| |___     #
#   |_| \_|*|_____|*|_____|*|_|    *|_____|    #
#                                              #    
#                                              #
#-----------Updated by Mark Ackerley-----------#

def tolist(obj1):
    if isinstance(obj1, (list, tuple)):
        return obj1
    return [obj1]

#https://stackoverflow.com/questions/2432428/is-there-any-algorithm-for-calculating-area-of-a-shape-given-co-ordinates-that-d

polys = tolist(IN[0])
OUT = []
for p in polys:
	t1 = p.GetType().ToString()
	if 'Polygon' in t1 or 'Rectangle' in t1:
		pts = p.Points
	elif 'PolyCurve' in t1:
		pts = [c.StartPoint for c in p.Curves()]
	else:
		area.append(None)
		continue
	a = 0
	l1 = len(pts)
	for i in range(l1):
		j = i + 1
		if j == l1:
			j = 0
		a += pts[i].X * pts[j].Y
		a -=  pts[i].Y * pts[j].X
	OUT.append(abs(a/2.0) )
# ----------------------------------------
area = Output(python_script)
