# Dynamo custom node Polygon.3DArea.dyf (Dynamo 3.6.1.9895)
# category: Springs.Geometry.Query
# Returns the planar area of the input polygon(s) in euclidean space. Not accurate for self-intersecting polys.

polygon = Input(polygon: var[])
python_script = Python(IN[0]=polygon)  # CPython3
# ---------- python_script.python (48 lines) ----------
#----------------------------------------------#
#                                              #
#      Copyright(c) 2017, Dimitar Venkov       #
#                                              #
# https://github.com/dimven/SpringNodes/issues #
# https://www.reope.com/                       #
#                                              #
#    ____    _____   _____   ____    _____     #
#   |  _ \ *|  ___|*|  _  |*|  _ \ *|  ___|    #
#   | |_) |*| |___ *| | | |*| |_) |*| |___     #
#   |  _ < *|  ___|*| | | |*|  __/ *|  ___|    #
#   | | | |*| |___ *| |_| |*| |    *| |___     #
#   |_| \_|*|_____|*|_____|*|_|    *|_____|    #
#                                              #    
#                                              #
#-----------Updated by Mark Ackerley-----------#

from math import sqrt
import clr
clr.AddReference('ProtoGeometry')
from Autodesk.DesignScript.Geometry import Vector

def tolist(obj1):
    if isinstance(obj1, (list, tuple)):
        return obj1
    return [obj1]
    
polys = tolist(IN[0])
OUT = []
for p in polys:
	t1 = p.GetType().ToString()
	if 'Polygon' in t1 or 'Rectangle' in t1:
		pts = p.Points
	elif 'PolyCurve' in t1:
		pts = [c.StartPoint for c in p.Curves()]
	else:
		pts.append(None)
		continue
	total = Vector.ByCoordinates(0,0,0)
	vec = [p.AsVector() for p in pts]
	l1 = len(pts)
	for i in range(l1):
		j = i + 1
		if j == l1:
			j = 0
		prod = vec[i].Cross(vec[j])
		total = total.Add(prod)
	OUT.append(abs(sqrt(total.Dot(total) ) / 2.0) )
# ----------------------------------------
area = Output(python_script)
