# Dynamo custom node Polygon.ContainmentTest+.dyf (Dynamo 4.0.2.3852)
# category: Springs.Geometry.Query
# A less accurate method that should perform faster than the built-in node for large data sets.

polygon = Input(polygon: var)
points = Input(points: var[])
python_script = Python(IN[0]=polygon, IN[1]=points)  # PythonNet3
# ---------- python_script.python (53 lines) ----------
#-REOPE----------------------------------------#
#                                              #
#      Copyright(c) 2017, Dimitar Venkov       #
#                                              #
# https://github.com/dimven/SpringNodes/issues #
# https://www.reope.com/                       #
#                                              #
#    ____    _____   _____   ____    _____     #
#   |  _ \ *|  ___|*|  _  |*|  _ \ *|  ___|    #
#   | |_) |*| |___ *| | | |*| |_) |*| |___     #
#   |  _ < *|  ___|*| | | |*|  __/ *|  ___|    #
#   | | | |*| |___ *| |_| |*| |    *| |___     #
#   |_| \_|*|_____|*|_____|*|_|    *|_____|    #
#                                              #    
#                                              #
#-Reope-----Updated by Mark Ackerley-----------#

def tolist(obj1):
	if hasattr(obj1,'__iter__'): return obj1
	else: return [obj1]

def containment(poly, pt):
	def testCCW(A,B,C): return (B.X - A.X) * (C.Y - A.Y) > (B.Y - A.Y) * (C.X - A.X)
	
	wn = 0
	ln1 = len(poly)
	for i in range(ln1):
		j = (i+1) % ln1
		isCCW = testCCW(poly[i], poly[j], pt)
		if poly[i].Y <= pt.Y:
			if poly[j].Y > pt.Y and isCCW: wn += 1
		else:
			if poly[j].Y <= pt.Y and not isCCW: wn -= 1
	
	return wn != 0
try:
    poly = IN[0]
    pts = tolist(IN[1])
    t1 = poly.GetType().ToString()
    if 'Polygon' in t1 or 'Rectangle' in t1:
	    poly_pts = poly.Points
    else:
	    poly_pts = [c.StartPoint for c in poly.Curves()]

    OUT = [containment(poly_pts, p) for p in pts]


except Exception as e:
    import traceback
    OUT = "Exception:\n{0}\n\nTraceback:\n{1}".format(
        str(e),
        traceback.format_exc()
    )
# ----------------------------------------
bool = Output(python_script)
