# Dynamo custom node Process.EmptyWorkingSet.dyf (Dynamo 4.0.2.3852)
# category: Springs.Revit.Utility.Actions
# Use at your own risk! Removes as many pages as possible from the working set of the active Revit session.
# packages: PythonNet3 Engine 1.4.8.0

refresh = Input(refresh: bool = true)
python_script = Python(IN[0]=refresh)  # PythonNet3
# ---------- python_script.python (38 lines) ----------
#-Reope----------------------------------------#
#                                              #
#      Copyright(c) 2016, Dimitar Venkov       #
#                                              #
# https://github.com/dimven/SpringNodes/issues #
# https://www.reope.com/                       #
#                                              #
#    ____    _____   _____   ____    _____     #
#   |  _ \ *|  ___|*|  _  |*|  _ \ *|  ___|    #
#   | |_) |*| |___ *| | | |*| |_) |*| |___     #
#   |  _ < *|  ___|*| | | |*|  __/ *|  ___|    #
#   | | | |*| |___ *| |_| |*| |    *| |___     #
#   |_| \_|*|_____|*|_____|*|_|    *|_____|    #
#                                              #
#                                              #
#-Reope-----Updated by Mark Ackerley-----------#

import System
import ctypes
from System.Diagnostics import Process #

if not IN[0]:
    OUT = "Set refresh to True to flush memory"
else:

    try:
        handle = Process.GetCurrentProcess().Handle.ToInt64()
        flush = ctypes.windll.kernel32.K32EmptyWorkingSet
        flush.argtypes = [ctypes.c_void_p]
        result = flush(handle)
        OUT = result != 0

    except Exception as e:
        import traceback
        OUT = "Exception:\n{0}\n\nTraceback:\n{1}".format(
            str(e),
            traceback.format_exc()
        )
# ----------------------------------------
success = Output(python_script)
