# Dynamo custom node Pt2Str.dyf "Springs.Pt2Str" (Dynamo 1.2.1.3083)
# category: Springs.Geometry.Serialization
# Serilize a point to a string. You can use a custom delimier  between the coordinates and apply an optional rounding. Works great with Revit text based parameters or Excel.

point = Input(point:var[])
separator = Input(separator: string = ",")
digits = Input(digits:int = null)
python_script = Python(IN[0]=point, IN[1]=separator, IN[2]=digits)
# ---------- python_script.python (28 lines) ----------
# Copyright(c) 2017, Dimitar Venkov
# @5devene, dimitar.ven@gmail.com
# www.badmonkeys.net

def tolist(x):
	if hasattr(x,'__iter__'): return x
	else : return [x]

def output(x):
	if len(x) == 1: return x[0]
	else : return x

def n2s(n, digits):
	if digits is not None:
		n = round(n, digits)
	s1 = str(n)
	if s1[-2:] == '.0':
		s1 = s1[:-2]
	return s1
def p2s(p, sep=IN[1], digits=IN[2]):
	x = n2s(p.X, digits)
	y = n2s(p.Y, digits)
	z = n2s(p.Z, digits)
	return ''.join( (x, sep, y, sep, z) )

pts = tolist(IN[0])

OUT = output(map(p2s, pts) )
# ----------------------------------------
string = Output(python_script)
