# Dynamo custom node Quads.ByPointMatrix.dyf (Dynamo 4.0.2.3852)
# category: Springs.Geometry.Actions
# Creates a CCW or CW list of quad pairs from a rectangular nested list of points.

points = Input(points: var[][])
CCW = Input(CCW: bool = true)
python_script = Python(IN[0]=points, IN[1]=CCW)  # PythonNet3
# ---------- python_script.python (37 lines) ----------
#-REOPE----------------------------------------#
#                                              #
#      Copyright(c) 2020, Dimitar Venkov       #
#                                              #
# https://github.com/dimven/SpringNodes/issues #
# https://www.reope.com/                       #
#                                              #
#    ____    _____   _____   ____    _____     #
#   |  _ \ *|  ___|*|  _  |*|  _ \ *|  ___|    #
#   | |_) |*| |___ *| | | |*| |_) |*| |___     #
#   |  _ < *|  ___|*| | | |*|  __/ *|  ___|    #
#   | | | |*| |___ *| |_| |*| |    *| |___     #
#   |_| \_|*|_____|*|_____|*|_|    *|_____|    #
#                                              #
#                                              #
#-REOPE-----Updated by Mark Ackerley-----------#



pts, ccw = IN


try:
    OUT = []
    for i in range(len(pts) - 1):
        for j in range(len(pts[0]) - 1):
            if ccw:
                OUT.append([pts[i][j], pts[i][j+1], pts[i+1][j+1], pts[i+1][j]])
            else:
                OUT.append([pts[i][j], pts[i+1][j],    pts[i+1][j+1], pts[i][j+1]])
                
except Exception as e:
    import traceback
    OUT = "Exception:\n{0}\n\nTraceback:\n{1}".format(
        str(e),
        traceback.format_exc()
    )                            
# ----------------------------------------
quads = Output(python_script)
