# Dynamo custom node RelativeLevel.AtHeight.dyf (Dynamo 4.0.2.3852)
# category: Springs.Revit.Utility.Query
# Select the level closest to the input height from the list of input levels

zHeight = Input(zHeight: var[])
elevations = Input(elevations: var[])
levels = Input(levels: var[])
belowOnly = Input(belowOnly: bool = false)
python_script = Python(IN[0]=zHeight, IN[1]=elevations, IN[2]=levels, IN[3]=belowOnly)  # PythonNet3
# ---------- python_script.python (40 lines) ----------
#-Reope----------------------------------------#
#                                              #
#      Copyright(c) 2016, Dimitar Venkov       #
#                                              #
# https://github.com/dimven/SpringNodes/issues #
# https://www.reope.com/                       #
#                                              #
#    ____    _____   _____   ____    _____     #
#   |  _ \ *|  ___|*|  _  |*|  _ \ *|  ___|    #
#   | |_) |*| |___ *| | | |*| |_) |*| |___     #
#   |  _ < *|  ___|*| | | |*|  __/ *|  ___|    #
#   | | | |*| |___ *| |_| |*| |    *| |___     #
#   |_| \_|*|_____|*|_____|*|_|    *|_____|    #
#                                              #
#                                              #
#-Reope-----Updated by Mark Ackerley-----------#






try:
    heights, elevs, names, belowOnly = IN
    BIG_VAL = float('inf')

    def evalHeight(e, z, belowOnly=belowOnly):
        if belowOnly:
            if e > z:
                return BIG_VAL
        return abs(z - e)

    lvl_dict = dict(zip(map(int, elevs), names))
    OUT = [lvl_dict[min(lvl_dict, key=lambda e: evalHeight(e, z))] for z in heights]
except Exception as e:
    import traceback
    OUT = "Exception:\n{0}\n\nTraceback:\n{1}".format(
        str(e),
        traceback.format_exc()
    )
# ----------------------------------------
level = Output(python_script)
