# Dynamo custom node RevitLinkType.DwgGeometryByInstance.dyf (Dynamo 4.0.2.3852)
# category: Springs.Revit
# Retrieves DWG Geometry from an Instance, attempts to parse to Dynamo geometry, where it can't, it returns the original.

linkInstance = Input(linkInstance: Revit.Elements.ImportInstance)
Refresh = Input(Refresh: bool = false)
python_script = Python(IN[0]=linkInstance, IN[1]=Refresh)  # PythonNet3
# ---------- python_script.python (424 lines) ----------
#-Reope----------------------------------------#
#                                              #
#      Copyright(c) 2027, Dimitar Venkov       #
#                                              #
# https://github.com/dimven/SpringNodes/issues #
# https://www.reope.com/                       #
#                                              #
#    ____    _____   _____   ____    _____     #
#   |  _ \ *|  ___|*|  _  |*|  _ \ *|  ___|    #
#   | |_) |*| |___ *| | | |*| |_) |*| |___     #
#   |  _ < *|  ___|*| | | |*|  __/ *|  ___|    #
#   | | | |*| |___ *| |_| |*| |    *| |___     #
#   |_| \_|*|_____|*|_____|*|_|    *|_____|    #
#                                              #
#                                              #
#-Reope----Maintained by Mark Ackerley---------#

import clr
import sys
import System
import traceback
import math

clr.AddReference('ProtoGeometry')
from Autodesk.DesignScript.Geometry import *
import Autodesk.DesignScript.Geometry as DS

clr.AddReference('RevitAPI')
import Autodesk
from Autodesk.Revit.DB import *
import Autodesk.Revit.DB as DB

clr.AddReference('RevitNodes')
import Revit
clr.ImportExtensions(Revit.GeometryConversion)

clr.AddReference('RevitServices')
import RevitServices
from RevitServices.Persistence import DocumentManager

doc = DocumentManager.Instance.CurrentDBDocument


def tolist(obj1):
    if isinstance(obj1, str): return [obj1]
    return obj1 if isinstance(obj1, list) else [obj1]

# ALWAYS RETURN A POINT + ERROR (never None)
def to_ds_point(rpt):
    try:
        return rpt.ToPoint(), None
    except Exception as ex:
        return rpt, "Point conversion error: " + str(ex) + "\n" + traceback.format_exc()

# DEAL WITH THOSE PESKY NESTED LISTS!
def normalize_and_expand(obj):
    # convert .NET IList to Python list if possible
    try:
        obj = list(obj)
    except Exception:
        return obj if not isinstance(obj, (str, bytes)) else obj

    # fully unwrap single-item containers
    while isinstance(obj, list) and len(obj) == 1:
        obj = obj[0]
        try:
            obj = list(obj)
        except Exception:
            break

    # if it's a list of surfaces, return that list; else return single object
    return obj

# GEOMETRY CONVERSION (non-solid types only)
def convert_revit_geom(g):
    ds_geom = None
    errors = []

    try:
        # ---------------- POLYLINE ----------------
        if isinstance(g, DB.PolyLine):
            try:
                coords = list(g.GetCoordinates())
                pts = []
                for p in coords:
                    ds_p, p_err = to_ds_point(p)
                    if p_err:
                        errors.append(p_err)
                    pts.append(ds_p)

                valid_pts = [p for p in pts if isinstance(p, DS.Point)]
                n = len(valid_pts)

                if n >= 3:
                    ds_geom = DS.PolyCurve.ByPoints(valid_pts)
                elif n == 2:
                    ds_geom = DS.Line.ByStartPointEndPoint(valid_pts[0], valid_pts[1])
                else:
                    errors.append("PolyLine has insufficient valid points.")
                    ds_geom = g

            except Exception as ex:
                errors.append("PolyLine conversion error: " + str(ex) + "\n" + traceback.format_exc())
                ds_geom = g

        # ---------------- LINE ----------------
        elif isinstance(g, DB.Line):
            try:
                p0, e0 = to_ds_point(g.GetEndPoint(0))
                p1, e1 = to_ds_point(g.GetEndPoint(1))
                if e0:
                    errors.append(e0)
                if e1:
                    errors.append(e1)

                if isinstance(p0, DS.Point) and isinstance(p1, DS.Point):
                    ds_geom = DS.Line.ByStartPointEndPoint(p0, p1)
                else:
                    errors.append("Line endpoints failed to convert.")
                    ds_geom = g

            except Exception as ex:
                errors.append("Line conversion error: " + str(ex) + "\n" + traceback.format_exc())
                ds_geom = g

        # ---------------- ELLIPSE ----------------
        elif isinstance(g, DB.Ellipse):
            try:
                centre, c_err = to_ds_point(g.Center)
                if c_err:
                    errors.append(c_err)

                if isinstance(centre, DS.Point):
                    ds_geom = DS.Ellipse.ByOriginRadii(centre, g.RadiusX, g.RadiusY)
                else:
                    errors.append("Ellipse center failed to convert.")
                    ds_geom = g

            except Exception as ex:
                errors.append("Ellipse conversion error: " + str(ex) + "\n" + traceback.format_exc())
                ds_geom = g

        # ---------------- ARC ----------------
        elif isinstance(g, DB.Arc):
            try:
                if g.IsCyclic:
                    start = g.Evaluate(0, False)
                    quart = g.Evaluate(math.pi / 2, False)
                    mid   = g.Evaluate(math.pi, False)

                    s, es = to_ds_point(start)
                    q, eq = to_ds_point(quart)
                    m, em = to_ds_point(mid)
                    for e in (es, eq, em):
                        if e:
                            errors.append(e)

                    if all(isinstance(x, DS.Point) for x in (s, q, m)):
                        ds_geom = DS.Circle.ByThreePoints(s, q, m)
                    else:
                        errors.append("Arc cyclic sample points failed.")
                        ds_geom = g

                else:
                    try:
                        center, ce = to_ds_point(g.Center)
                        if ce:
                            errors.append(ce)

                        if isinstance(center, DS.Point):
                            normal = g.Normal
                            normal_vec = DS.Vector.ByCoordinates(normal.X, normal.Y, normal.Z)
                            start_angle = math.degrees(g.GetEndParameter(0))
                            sweep_angle = math.degrees(g.GetEndParameter(1) - g.GetEndParameter(0))
                            ds_geom = DS.Arc.ByCenterPointRadiusAngle(
                                center, g.Radius, start_angle, sweep_angle, normal_vec
                            )
                        else:
                            raise Exception("Center point invalid")

                    except Exception:
                        try:
                            s, es = to_ds_point(g.GetEndPoint(0))
                            m, em = to_ds_point(g.Evaluate(0.5, True))
                            e, ee = to_ds_point(g.GetEndPoint(1))
                            for x in (es, em, ee):
                                if x:
                                    errors.append(x)

                            if all(isinstance(x, DS.Point) for x in (s, m, e)):
                                ds_geom = DS.Arc.ByThreePoints(s, m, e)
                            else:
                                errors.append("Arc fallback points invalid.")
                                ds_geom = g

                        except Exception as ex2:
                            errors.append("Arc conversion fallback error: " + str(ex2) + "\n" + traceback.format_exc())
                            ds_geom = g

            except Exception as ex:
                errors.append("Arc conversion error: " + str(ex) + "\n" + traceback.format_exc())
                ds_geom = g

        # ---------------- DEFAULT ----------------
        else:
            ds_geom = g

    except Exception as ex:
        errors.append("Top-level conversion error: " + str(ex) + "\n" + traceback.format_exc())
        ds_geom = g

    if ds_geom is None:
        ds_geom = g

    return ds_geom, ("\n".join(errors) if errors else None)


# ----------------------------------------------------------------------
# GRAPHICS STYLE RESOLUTION
# ----------------------------------------------------------------------
def get_style_from_face(face):
    try:
        if face.GraphicsStyleId != ElementId.InvalidElementId:
            gStyle = doc.GetElement(face.GraphicsStyleId)
            if gStyle and hasattr(gStyle, "GraphicsStyleCategory"):
                return gStyle.GraphicsStyleCategory.Name
    except Exception:
        pass
    return "no Line Style"


def get_style_from_geom(g):
    try:
        if hasattr(g, "GraphicsStyleId") and g.GraphicsStyleId != ElementId.InvalidElementId:
            gStyle = doc.GetElement(g.GraphicsStyleId)
            if gStyle is not None and hasattr(gStyle, "GraphicsStyleCategory"):
                return gStyle.GraphicsStyleCategory.Name
    except Exception:
        pass
    return "no Line Style"


# ----------------------------------------------------------------------
# MAIN EXTRACTION
# ----------------------------------------------------------------------
def get_CAD_geometry(importinstance):
    curves = []
    solids = []

    opt = Options()
    opt.DetailLevel = ViewDetailLevel.Fine
    opt.IncludeNonVisibleObjects = True

    try:
        geoSet = importinstance.get_Geometry(opt)
    except Exception as e:
        return [], [["Error getting geometry", str(e)]]

    def process_geom(geom_element):
        for geo in geom_element:

            # ---------------- GEOMETRY INSTANCE ----------------
            # Use GetSymbolGeometry() only — GetInstanceGeometry() returns the
            # same objects with transforms applied, causing duplicates
            if isinstance(geo, GeometryInstance):
                try:
                    sym_geom = geo.GetSymbolGeometry()
                    if sym_geom:
                        process_geom(sym_geom)
                except Exception:
                    pass

            # ---------------- SOLID ----------------
            elif isinstance(geo, Solid):
                for face in geo.Faces:
                    proto = face.ToProtoType()

                    try:
                        # Works for DS arrays, .NET IList, Python lists
                        if len(proto) == 1:
                            dsFace = proto[0]      # unwrap
                        else:
                            dsFace = proto         # multi‑surface case
                    except:
                        dsFace = proto             # not sized → already a DS object
                        
                    face_style = get_style_from_face(face)
                    solids.append([dsFace, face_style])     
                                  


            # ---------------- CURVES / OTHER ----------------
            else:
                gstyleName = get_style_from_geom(geo)
                ds_geom, conv_err = convert_revit_geom(geo)
                curves.append([ds_geom, gstyleName])

    process_geom(geoSet)     
    
    flat = []
    for dsFace, layer in solids:
        norm = normalize_and_expand(dsFace)
        if isinstance(norm, list):
            for f in norm:
                flat.append([f, layer])
        else:
            flat.append([norm, layer])
    solids = flat
    
    return curves, solids

# -------------------------
# Explode PolyCurve helper
# -------------------------
def explode_polycurves(curve_rows):
    """
    Input: curve_rows = [[geom, layer], ...]
    Output: new list where PolyCurve entries are exploded into multiple [subcurve, layer]
    Leaves Line/Circle/other single-curve rows unchanged.
    """
    out = []
    for row in curve_rows:
        # defensive unpack
        if not (isinstance(row, (list, tuple)) and len(row) >= 2):
            continue
        geom = row[0]
        layer = row[1]

        # keep None or non-objects as-is
        if geom is None:
            out.append([geom, layer])
            continue

        # detect polycurve-like
        try:
            n = int(getattr(geom, "NumberOfCurves", 0))
        except Exception:
            n = 0

        if n > 0:
            produced = 0
            # call Curves() once
            try:
                curves_coll = geom.Curves()
            except Exception:
                curves_coll = None

            curves_list = []
            if curves_coll is not None:
                # try iteration first
                try:
                    for c in curves_coll:
                        curves_list.append(c)
                except Exception:
                    pass

                # try list() conversion
                if not curves_list:
                    try:
                        curves_list = list(curves_coll)
                    except Exception:
                        pass

                # try index access patterns
                if not curves_list:
                    try:
                        for i in range(n):
                            try:
                                curves_list.append(curves_coll[i])
                            except Exception:
                                try:
                                    curves_list.append(curves_coll.GetItem(i))
                                except Exception:
                                    try:
                                        curves_list.append(curves_coll.Item[i])
                                    except Exception:
                                        pass
                    except Exception:
                        pass

                # enumerator fallback
                if not curves_list:
                    try:
                        enum = curves_coll.GetEnumerator()
                        while enum.MoveNext():
                            curves_list.append(enum.Current)
                    except Exception:
                        pass

            # append only real sub-curves
            for sub in curves_list:
                if sub is None:
                    continue
                out.append([sub, layer])
                produced += 1

            if produced > 0:
                continue
            else:
                # couldn't materialize sub-curves — keep original
                out.append([geom, layer])
                continue

        # not a polycurve — keep original
        out.append([geom, layer])

    return out

try:
    # OUT
    importinstance = UnwrapElement(IN[0])
    curves, solids = get_CAD_geometry(importinstance)

    # explode polycurves in the curves list only
    curves = explode_polycurves(curves)

    OUT = curves, solids

except Exception as e:
    import traceback
    OUT = "Exception:\n{0}\n\nTraceback:\n{1}".format(
        str(e),
        traceback.format_exc()
    )
# ----------------------------------------
code_block = CodeBlock(OUT=python_script) { OUT[0]; OUT[1]; }
lines = Output(code_block.out0)
solidSurfaces = Output(code_block.out1)
