# Dynamo custom node Select Edges.dyf (Dynamo 0.8.2.2392)
# category: SpringNodes.Revit.Selection
# Select multiple edges from inside the Revit UI. Be sure to press "Finish" once done. You can use a Boolean toggle to refresh your selection.

refresh = Input(refresh:bool = true)
python_script = Python(IN[0]=refresh)
# ---------- python_script.python (27 lines) ----------
#select multiple edges in Revit and convert to Dynamo geometry

import clr

clr.AddReference("RevitAPIUI")
from  Autodesk.Revit.UI import *

clr.AddReference("RevitServices")
import RevitServices
from RevitServices.Persistence import DocumentManager
doc = DocumentManager.Instance.CurrentDBDocument
uidoc=DocumentManager.Instance.CurrentUIApplication.ActiveUIDocument

clr.AddReference("RevitNodes")
import Revit
clr.ImportExtensions(Revit.Elements)
clr.ImportExtensions(Revit.GeometryConversion)

sel1 = uidoc.Selection
ot1 = Selection.ObjectType.Edge
refs = sel1.PickObjects(ot1, "Select the desired edges and press Finish")
edges = []
for r in refs:
	el1 = doc.GetElement(r.ElementId)
	edge = el1.GetGeometryObjectFromReference(r)
	edges.append(edge.AsCurve().ToProtoType())
OUT = edges
# ----------------------------------------
edges = Output(python_script)
