# Dynamo custom node SelectEdges.dyf "Springs.SelectEdges" (Dynamo 0.8.2.2392)
# category: Springs.Revit.Selection
# Select multiple edges from inside the Revit UI. Be sure to press "Finish" once done. You can use a Boolean toggle to refresh your selection.

refresh = Input(refresh:bool = true)
python_script = Python(IN[0]=refresh)
# ---------- python_script.python (28 lines) ----------
#Copyright(c) 2016, Dimitar Venkov
# @5devene, dimitar.ven@gmail.com

import clr

clr.AddReference("RevitAPIUI")
from  Autodesk.Revit.UI import *

clr.AddReference("RevitServices")
import RevitServices
from RevitServices.Persistence import DocumentManager
doc = DocumentManager.Instance.CurrentDBDocument
uidoc=DocumentManager.Instance.CurrentUIApplication.ActiveUIDocument

clr.AddReference("RevitNodes")
import Revit
clr.ImportExtensions(Revit.Elements)
clr.ImportExtensions(Revit.GeometryConversion)

sel1 = uidoc.Selection
ot1 = Selection.ObjectType.Edge
refs = sel1.PickObjects(ot1, "Select the desired edges and press Finish")
edges = []
for i in xrange(len(refs)):
	el1 = doc.GetElement(refs[i].ElementId)
	edge = el1.GetGeometryObjectFromReference(refs[i])
	edges.append(edge.AsCurve().ToProtoType())
OUT = edges
# ----------------------------------------
edges = Output(python_script)
