# Dynamo custom node SelectInRevit.dyf (Dynamo 4.0.2.3852)
# category: Springs.Revit.Selection.Actions
# Selects the input elements inside the Revit UI.

element = Input(element: var[])
reset = Input(reset: bool = true)
python_script = Python(IN[0]=element, IN[1]=reset)  # PythonNet3
# ---------- python_script.python (63 lines) ----------
#-Reope----------------------------------------#
#                                              #
#      Copyright(c) 2016, Dimitar Venkov       #
#                                              #
# https://github.com/dimven/SpringNodes/issues #
# https://www.reope.com/                       #
#                                              #
#    ____    _____   _____   ____    _____     #
#   |  _ \ *|  ___|*|  _  |*|  _ \ *|  ___|    #
#   | |_) |*| |___ *| | | |*| |_) |*| |___     #
#   |  _ < *|  ___|*| | | |*|  __/ *|  ___|    #
#   | | | |*| |___ *| |_| |*| |    *| |___     #
#   |_| \_|*|_____|*|_____|*|_|    *|_____|    #
#                                              #
#                                              #
#-Reope-----Updated by Mark Ackerley-----------#

# inspired by Julien Benoit @jbenoit44
# http://aecuandme.wordpress.com/

import clr
clr.AddReference("RevitServices")
import RevitServices
from RevitServices.Persistence import DocumentManager
uidoc = DocumentManager.Instance.CurrentUIApplication.ActiveUIDocument

clr.AddReference("RevitNodes")
import Revit
clr.ImportExtensions(Revit.Elements)

clr.AddReference("RevitAPI")
from Autodesk.Revit.DB import ElementId

clr.AddReference("RevitAPIUI")
from Autodesk.Revit.UI.Selection import *

clr.AddReference("System")
from System.Collections.Generic import List as cList

def tolist(obj1):
    if isinstance(obj1, str): return [obj1]
    return obj1 if isinstance(obj1, list) else [obj1]

try:
    elements = UnwrapElement(tolist(IN[0]))

    ids1 = []
    for e in elements:
        try:
            ids1.append(e.Id)
        except:
            pass

    ids2 = cList[ElementId](ids1)
    uidoc.Selection.SetElementIds(ids2)
    OUT = "%s elements selected in Revit." % ids2.Count

except Exception as e:
    import traceback
    OUT = "Exception:\n{0}\n\nTraceback:\n{1}".format(
        str(e),
        traceback.format_exc()
    )
# ----------------------------------------
success = Output(python_script)  # "success?"
