# Dynamo custom node SelectLinkedElements(ordered).dyf "SelectLinkedElementsInOrder" (Dynamo 4.0.2.3852)
# category: Springs.Revit.Selection.Actions
# Select the linked instance first. Then select multiple elements from the Revit document in the desired order. Hit ESC to stop picking. To refresh the node, connect a boolean switch node.

dialog = Input(dialog: bool = true)
refresh = Input(refresh: bool = true)
python_script = Python(IN[0]=dialog, IN[1]=refresh)  # PythonNet3
# ---------- python_script.python (79 lines) ----------
#-Reope----------------------------------------#
#                                              #
#      Copyright(c) 2017, Dimitar Venkov       #
#                                              #
# https://github.com/dimven/SpringNodes/issues #
# https://www.reope.com/                       #
#                                              #
#    ____    _____   _____   ____    _____     #
#   |  _ \ *|  ___|*|  _  |*|  _ \ *|  ___|    #
#   | |_) |*| |___ *| | | |*| |_) |*| |___     #
#   |  _ < *|  ___|*| | | |*|  __/ *|  ___|    #
#   | | | |*| |___ *| |_| |*| |    *| |___     #
#   |_| \_|*|_____|*|_____|*|_|    *|_____|    #
#                                              #
#                                              #
#-Reope-----Updated by Mark Ackerley-----------#
# inspired by Troy Gates
# https://forums.autodesk.com/t5/revit-api/revit-api-selected-element-set-order/td-p/5597203

import clr
clr.AddReference("RevitAPIUI")
from Autodesk.Revit.UI import *

clr.AddReference("RevitAPI")
from Autodesk.Revit.DB import RevitLinkInstance

clr.AddReference("RevitServices")
import RevitServices
from RevitServices.Persistence import DocumentManager
uidoc = DocumentManager.Instance.CurrentUIApplication.ActiveUIDocument
doc = uidoc.Document

clr.AddReference("RevitNodes")
import Revit
clr.ImportExtensions(Revit.Elements)
clr.ImportExtensions(Revit.GeometryConversion)

try:
    sel1 = uidoc.Selection
    obt1 = Selection.ObjectType.Element
    obt2 = Selection.ObjectType.LinkedElement

    if IN[0]:
        TaskDialog.Show("Spring Nodes", "First select a link instance. Then pick elements from that instance in the desired order. Hit ESC to stop picking.")

    msg1 = 'Pick elements in the desired order, hit ESC to stop picking.'
    li_ref = sel1.PickObject(obt1, "Select a link instance first.")
    link1 = doc.GetElement(li_ref.ElementId)

    if isinstance(link1, RevitLinkInstance):
        linkDoc = link1.GetLinkDocument()

        picked = []
        flag = True
        while flag:
            try:
                el1 = sel1.PickObject(obt2, msg1).LinkedElementId
                if el1.Value != -1:
                    picked.append(el1)
            except:
                flag = False

        elems = []
        for p in picked:
            el1 = linkDoc.GetElement(p)
            if el1 is not None:
                elems.append(el1.ToDSType(True))

        tf1 = link1.GetTotalTransform().ToCoordinateSystem(True)
        OUT = elems, tf1
    else:
        OUT = 'Failed to pick a link instance', None

except Exception as e:
    import traceback
    OUT = "Exception:\n{0}\n\nTraceback:\n{1}".format(
        str(e),
        traceback.format_exc()
    )
# ----------------------------------------
code_block = CodeBlock(r=python_script) { r[0]; r[1]; }
elements = Output(code_block.out0)
transform = Output(code_block.out1)
