# Dynamo custom node SelectLinkedElements.dyf (Dynamo 4.0.2.3852)
# category: Springs.Revit.Selection.Actions
# Select the linked instance first, followed by the elements. To finish the selection, press Finish. If your selection fails, just press escape or Cancel.
# To refresh the node, connect a boolean switch node.

refresh = Input(refresh: bool = true)
python_script = Python(IN[0]=refresh)  # PythonNet3
# ---------- python_script.python (58 lines) ----------
#-Reope----------------------------------------#
#                                              #
#      Copyright(c) 2017, Dimitar Venkov       #
#                                              #
# https://github.com/dimven/SpringNodes/issues #
# https://www.reope.com/                       #
#                                              #
#    ____    _____   _____   ____    _____     #
#   |  _ \ *|  ___|*|  _  |*|  _ \ *|  ___|    #
#   | |_) |*| |___ *| | | |*| |_) |*| |___     #
#   |  _ < *|  ___|*| | | |*|  __/ *|  ___|    #
#   | | | |*| |___ *| |_| |*| |    *| |___     #
#   |_| \_|*|_____|*|_____|*|_|    *|_____|    #
#                                              #
#                                              #
#-Reope-----Updated by Mark Ackerley-----------#

import clr
clr.AddReference("RevitAPIUI")
from Autodesk.Revit.UI import *

clr.AddReference("RevitAPI")
from Autodesk.Revit.DB import RevitLinkInstance

clr.AddReference("RevitServices")
import RevitServices
from RevitServices.Persistence import DocumentManager
uidoc = DocumentManager.Instance.CurrentUIApplication.ActiveUIDocument
doc = uidoc.Document

clr.AddReference("RevitNodes")
import Revit
clr.ImportExtensions(Revit.Elements)
clr.ImportExtensions(Revit.GeometryConversion)

try:
    sel1 = uidoc.Selection
    ot1 = Selection.ObjectType.Element
    ot2 = Selection.ObjectType.LinkedElement

    li_ref = sel1.PickObject(ot1, "Select a link instance first.")
    link1 = doc.GetElement(li_ref.ElementId)

    if isinstance(link1, RevitLinkInstance):
        el_ref = sel1.PickObjects(ot2, "Select the linked elements and press Finish.")
        linkDoc = link1.GetLinkDocument()
        Lel_id = [r1.LinkedElementId for r1 in el_ref]
        tf1 = link1.GetTotalTransform().ToCoordinateSystem(True)
        OUT = [linkDoc.GetElement(id1).ToDSType(True) for id1 in Lel_id], tf1
    else:
        OUT = "Failed to pick a linked instance", None

except Exception as e:
    import traceback
    OUT = "Exception:\n{0}\n\nTraceback:\n{1}".format(
        str(e),
        traceback.format_exc()
    )
# ----------------------------------------
code_block = CodeBlock(r=python_script) { r[0]; r[1]; }
elements = Output(code_block.out0)
transform = Output(code_block.out1)
