# Dynamo custom node SelectLinkedFace.dyf "Springs.SelectLinkedFace" (Dynamo 0.8.2.2392)
# category: Springs.Revit.Selection
# Select the linked instance first, followed by the face. If your selection fails, just press escape.
# To refresh the node, connect a boolean switch node.

refresh = Input(refresh:bool = true)
python_script = Python(IN[0]=refresh)
# ---------- python_script.python (31 lines) ----------
#Copyright(c) 2016, Dimitar Venkov
# @5devene, dimitar.ven@gmail.com

import clr

clr.AddReference("RevitAPIUI")
from  Autodesk.Revit.UI import *

clr.AddReference("RevitServices")
import RevitServices
from RevitServices.Persistence import DocumentManager
doc = DocumentManager.Instance.CurrentDBDocument
uidoc=DocumentManager.Instance.CurrentUIApplication.ActiveUIDocument

clr.AddReference("RevitNodes")
import Revit
clr.ImportExtensions(Revit.Elements)
clr.ImportExtensions(Revit.GeometryConversion)

sel1 = uidoc.Selection
ot1 = Selection.ObjectType.Element
ot2 = Selection.ObjectType.PointOnElement
li_ref = sel1.PickObject(ot1, "Select a link instance first.")
face_ref = sel1.PickObject(ot2, "Pick a face.")
Link1 = doc.GetElement(li_ref.ElementId)
LinkDoc = Link1.GetLinkDocument()
element = LinkDoc.GetElement(face_ref.LinkedElementId)
face_ref2 = face_ref.CreateReferenceInLink()
sf1 = element.GetGeometryObjectFromReference(face_ref2).ToProtoType(True)[0]
sf1.Tags.AddTag("RevitFaceReference", face_ref)
OUT = sf1
# ----------------------------------------
surface = Output(python_script)
