# Dynamo custom node Sheet.Views+.dyf "Springs.Sheet.Views+" (Dynamo 1.0.0.1180)
# category: Springs.Revit.Views
# Extracts all views and schedules (minus the revision schedule) placed on the input sheet (or sheets).
# Will be depreciated once the bult in node works with all plan types.

sheet = Input(sheet:var[])
python_script = Python(IN[0]=sheet)
# ---------- python_script.python (42 lines) ----------
#Copyright(c) 2016, Dimitar Venkov
# @5devene, dimitar.ven@gmail.com
#schedule section inspired by Clockwork
import clr

clr.AddReference("RevitServices")
from RevitServices.Persistence import DocumentManager
doc = DocumentManager.Instance.CurrentDBDocument
app = DocumentManager.Instance.CurrentUIApplication.Application

clr.AddReference("RevitNodes")
import Revit
clr.ImportExtensions(Revit.Elements)

clr.AddReference("RevitAPI")
from Autodesk.Revit.DB import *

def tolist(obj1):
	if hasattr(obj1,"__iter__"): return obj1
	else: return [obj1]

def output1(l1):
	if len(l1) == 1: return l1[0]
	else: return l1

sheets = UnwrapElement(tolist(IN[0]))
sheet_views, sheets_scheds = [], []
rev_str = "<Revision Schedule>"

for i in xrange(len(sheets)):
	if app.VersionName == "Autodesk Revit 2014":
		viewports = [doc.GetElement(v1) for v1 in sheets[i].GetAllViewports()]
		views = [doc.GetElement(v1.ViewId) for v1 in viewports]
	else:
		viewsid = sheets[i].GetAllPlacedViews()
		views = [doc.GetElement(v).ToDSType(True) for v in viewsid]
	sheet_views.append(views)
	fec1 = FilteredElementCollector(doc, sheets[i].Id).OfClass(ScheduleSheetInstance)
	scheds = [doc.GetElement(i.ScheduleId) for i in fec1 if rev_str not in i.Name]
	sheets_scheds.append(scheds)

OUT = output1(sheet_views), output1(sheets_scheds)
# ----------------------------------------
code_block = CodeBlock(o=python_script) { o[0]; o[1]; }
view_s = Output(code_block.out0)  # "view(s)"
schedule_s = Output(code_block.out1)  # "schedule(s)"
