# Dynamo custom node Star.ByCenterRadiusRays.dyf "Springs.Star.ByCenterRadiusRays" (Dynamo 1.2.1.3083)
# category: Springs.Geometry
# Fun little node to create star shapes.

StarOrigin = Input(StarOrigin:Point = Point.Origin())
StarRadius = Input(StarRadius:double = 5)
RayPercentage = Input(RayPercentage:double = 55)
NumberOfRays = Input(NumberOfRays:int = 7)
code_block = CodeBlock(p1=StarOrigin, r1=StarRadius, s=RayPercentage, n=NumberOfRays) { star1(p1,r1,s,n); }
PolyCurve = Output(code_block)
code_block_2 = CodeBlock()
# ---------- code_block_2.designscript (12 lines) ----------
def star1(p1,r1,s,n)
{
c1 = Circle.ByCenterPointRadius(p1,r1);
c2 = Circle.ByCenterPointRadius(p1,r1*(99.9-s)/100);
pts1 = c1.PointAtParameter(0..1..#n+1);
//testR = n % 2 == 0;
pts2a = c2.PointAtParameter(0..1..#n*2+1);
pts2b = DSCore.List.TakeEveryNthItem(pts2a,2,0);
pts3 = Flatten(List.Transpose({pts1,pts2b}));
pts3c = DSCore.List.DropItems(pts3,-1);
return = PolyCurve.ByPoints(pts3c);
};
# ----------------------------------------
