# Dynamo custom node Str2Ln.dyf "Springs.Str2Ln" (Dynamo 1.1.0.2094)
# category: Springs.Geometry.Serialization
# De-serilize a Revit parameter string into a geometric line.

str = Input(str:var)
separator = Input(separator: string = ",")
code_block = CodeBlock(str, separator)
# ---------- code_block.designscript (8 lines) ----------
def Rvt2Ln(par, s1)
{
par1 = String.ToNumber(String.Split(par, s1));
p1 = Point.ByCoordinates(par1[0],par1[1],par1[2]);
p2 = Point.ByCoordinates(par1[3],par1[4],par1[5]);
return = Line.ByStartPointEndPoint(p1,p2);
};
Rvt2Ln(str, s1);
# ----------------------------------------
line_s = Output(code_block)  # "line(s)"
