# Dynamo custom node Str2Pt.dyf "Springs.Str2Pt" (Dynamo 1.1.0.2094)
# category: Springs.Geometry.Serialization
# De-serilize a Revit parameter string into a geometric point.

str = Input(str:var)
separator = Input(separator: string = ",")
code_block = CodeBlock(str, separator)
# ---------- code_block.designscript (6 lines) ----------
def Rvt2Pt(par, s1)
{
par1 = String.ToNumber(String.Split(par,s1));
return = Point.ByCoordinates(par1[0],par1[1],par1[2]);
};
Rvt2Pt(str, s1);
# ----------------------------------------
point_s = Output(code_block)  # "point(s)"
