# Dynamo custom node String.RegEx.dyf (Dynamo 4.0.2.3852)
# category: Springs.Actions
# Returns true if the expression is met

str = Input(str: string)
pattern = Input(pattern: string)
python_script = Python(IN[0]=str, IN[1]=pattern)  # PythonNet3
# ---------- python_script.python (45 lines) ----------
#-Reope----------------------------------------#
#                                              #
#      Copyright(c) 2027, Dimitar Venkov       #
#                                              #
# https://github.com/dimven/SpringNodes/issues #
# https://www.reope.com/                       #
#                                              #
#    ____    _____   _____   ____    _____     #
#   |  _ \ *|  ___|*|  _  |*|  _ \ *|  ___|    #
#   | |_) |*| |___ *| | | |*| |_) |*| |___     #
#   |  _ < *|  ___|*| | | |*|  __/ *|  ___|    #
#   | | | |*| |___ *| |_| |*| |    *| |___     #
#   |_| \_|*|_____|*|_____|*|_|    *|_____|    #
#                                              #
#                                              #
#-Reope----Maintained by Mark Ackerley---------#


import re

def tolist(obj1):
    if isinstance(obj1, str): return [obj1]
    return obj1 if isinstance(obj1, list) else [obj1]


def check(pattern, text):
    try:
        return bool(re.search(pattern, text))
    except re.error as e:
        return "Regex error: {}".format(e)


try:
    texts   = tolist(IN[0])
    pattern = IN[1]
    for t in texts:
        OUT = check(pattern, t)

except Exception as e:
    import traceback
    OUT = "Exception:\n{0}\n\nTraceback:\n{1}".format(
        str(e),
        traceback.format_exc()
    )
    
# ----------------------------------------
boolean = Output(python_script)
