# Dynamo custom node String.ReplaceIllegalChars.dyf (Dynamo 4.0.2.3852)
# category: Springs.Actions
# Replaces all characters in a string that are found in a commonly known list of illegal characters

str = Input(str: var[])
replacement = Input(replacement: string = "_")
otherBadChars = Input(otherBadChars: var[] = DesignScript.Builtin.Dictionary.ByKeysValues([], []))
python_script = Python(IN[0]=str, IN[1]=replacement, IN[2]=otherBadChars)  # PythonNet3
# ---------- python_script.python (47 lines) ----------
#-Reope----------------------------------------#
#                                              #
#      Copyright(c) 2017, Dimitar Venkov       #
#                                              #
# https://github.com/dimven/SpringNodes/issues #
# https://www.reope.com/                       #
#                                              #
#    ____    _____   _____   ____    _____     #
#   |  _ \ *|  ___|*|  _  |*|  _ \ *|  ___|    #
#   | |_) |*| |___ *| | | |*| |_) |*| |___     #
#   |  _ < *|  ___|*| | | |*|  __/ *|  ___|    #
#   | | | |*| |___ *| |_| |*| |    *| |___     #
#   |_| \_|*|_____|*|_____|*|_|    *|_____|    #
#                                              #
#                                              #
#-Reope-----Updated by Mark Ackerley-----------#

import System
from itertools import repeat

def tolist(obj1):
    if isinstance(obj1, str): return [obj1]
    return obj1 if isinstance(obj1, list) else [obj1]

def fixName(n, rep="", badChars=None):
    if badChars is None:
        badChars = set()
    return ''.join(c if c not in badChars else rep for c in str(n))

try:
    is_list = isinstance(IN[0], list)
    names = tolist(IN[0])
    replacement = str(IN[1])
    other = tolist(IN[2]) if IN[2] is not None else []

    badChars = set(System.IO.Path.GetInvalidFileNameChars())
    badChars.update(other)

    result = list(map(fixName, map(str, names), repeat(replacement, len(names)), repeat(badChars, len(names))))
    OUT = result if is_list else result[0]

except Exception as e:
    import traceback
    OUT = "Exception:\n{0}\n\nTraceback:\n{1}".format(
        str(e),
        traceback.format_exc()
    )
# ----------------------------------------
str_2 = Output(python_script)  # "str"
