# Dynamo custom node String.RightSplitOnce.dyf "Springs.String.RightSplitOnce" (Dynamo 1.3.2.2480)
# category: Springs.Core.String
# Gets the tail of a string

str = Input(str:string)
splitChar = Input(splitChar:string)
code_block = CodeBlock(s=str, spl=splitChar) { slen = String.Length(s); lastInd = String.LastIndexOf(s,spl)+1; String.Substring(s, lastInd, slen - lastInd); }
str_2 = Output(code_block.out2)  # "str"
