# Dynamo custom node String.ToPoint.dyf (Dynamo 4.0.2.3852)
# category: Springs.Geometry.Serialization.Actions
# De-serilize a Revit parameter string into a geometric point.

str = Input(str: var)
separator = Input(separator: string = ",")
code_block = CodeBlock(par=str, s1=separator) { par; s1; par1 = String.ToNumber(String.Split(par,s1)); pt = Point.ByCoordinates(par1[0],par1[1],par1[2]); }
point = Output(code_block.pt)
