# Dynamo custom node Surface.OuterPerimeterCurves.dyf (Dynamo 4.0.2.3852)
# category: Springs.Geometry.Actions
# Get only the outer perimeter of a surface, dropping  the inner openings.

surf = Input(surf: var[])
python_script = Python(IN[0]=surf)  # PythonNet3
# ---------- python_script.python (40 lines) ----------
#----------------------------------------------#
#                                              #
#      Copyright(c) 2020, Dimitar Venkov       #
#                                              #
# https://github.com/dimven/SpringNodes/issues #
# https://www.reope.com/                       #
#                                              #
#    ____    _____   _____   ____    _____     #
#   |  _ \ *|  ___|*|  _  |*|  _ \ *|  ___|    #
#   | |_) |*| |___ *| | | |*| |_) |*| |___     #
#   |  _ < *|  ___|*| | | |*|  __/ *|  ___|    #
#   | | | |*| |___ *| |_| |*| |    *| |___     #
#   |_| \_|*|_____|*|_____|*|_|    *|_____|    #
#                                              #
#                                              #
#-----------Updated by Mark Ackerley-----------#

import clr
clr.AddReference('ProtoGeometry')
import Autodesk.DesignScript.Geometry as DS

def tolist(x):
    if hasattr(x,'__iter__'): return x
    return [x]

def dropSurfaceOpenings(srf):
	face = srf.Faces[0]
	extLoop = [lp for lp in srf.Faces[0].Loops if lp.IsExternal][0]
	return [ce.Edge.CurveGeometry for ce in extLoop.CoEdges]

try:        
    surfaces = tolist(IN[0])
    OUT = map(dropSurfaceOpenings, surfaces)

except Exception as e:
    import traceback
    OUT = "Exception:\n{0}\n\nTraceback:\n{1}".format(
        str(e),
        traceback.format_exc()
    )
# ----------------------------------------
curves = Output(python_script)
