# Dynamo custom node Surface.TrimWithLoopsFix.dyf (Dynamo 4.0.2.3852)
# category: Springs.Geometry.Actions
# A temporary replacement for the broken built-in node. For best results, make sure the loops are convex.

surf = Input(surf: var)
loops = Input(loops: var[])
python_script = Python(IN[0]=surf, IN[1]=loops)  # PythonNet3
# ---------- python_script.python (43 lines) ----------
#----------------------------------------------#
#                                              #
#      Copyright(c) 2020, Dimitar Venkov       #
#                                              #
# https://github.com/dimven/SpringNodes/issues #
# https://www.reope.com/                       #
#                                              #
#    ____    _____   _____   ____    _____     #
#   |  _ \ *|  ___|*|  _  |*|  _ \ *|  ___|    #
#   | |_) |*| |___ *| | | |*| |_) |*| |___     #
#   |  _ < *|  ___|*| | | |*|  __/ *|  ___|    #
#   | | | |*| |___ *| |_| |*| |    *| |___     #
#   |_| \_|*|_____|*|_____|*|_|    *|_____|    #
#                                              #
#                                              #
#-----------Updated by Mark Ackerley-----------#

import clr
clr.AddReference('ProtoGeometry')
from Autodesk.DesignScript.Geometry import Point


try:
    surf, trims = IN
    original = True
    for t in trims:
	    bb = t.BoundingBox
	    a, b = bb.MinPoint, bb.MaxPoint
	    c = Point.ByCoordinates((a.X + b.X)/2, (a.Y + b.Y)/2, (a.Z + b.Z)/2)
	    temp = surf.Trim(t, c)[0]
	    if original:
		    original = False
	    else:
		    surf.Dispose()
	    surf = temp
    OUT = surf

except Exception as e:
    import traceback
    OUT = "Exception:\n{0}\n\nTraceback:\n{1}".format(
        str(e),
        traceback.format_exc()
    )
# ----------------------------------------
surface = Output(python_script)
