# Dynamo custom node ToolkitMesh.Merge.dyf "Springs.ToolkitMesh.Merge" (Dynamo 1.3.2.2480)
# category: Springs.Geometry
# Creates a single mesh entity from a list of toolkit meshes.

tkMeshes = Input(tkMeshes:var[])
python_script = Python(IN[0]=tkMeshes)
# ---------- python_script.python (10 lines) ----------
meshes = IN[0]
vertices, indices = [], []
lastInd = 0

for m in meshes:
	vertices.extend(m.Vertices() )
	indices.extend([i + lastInd for i in m.VertexIndicesByTri()])
	lastInd += int(m.VertexCount)

OUT = m.ByVerticesAndIndices(vertices, indices)
# ----------------------------------------
tkMesh = Output(python_script)
