# Dynamo custom node ToolkitMeshToMesh.dyf "Springs.ToolkitMeshToMesh" (Dynamo 1.2.1.3083)
# category: Springs.Geometry
# Attempts to convert a toolkit mesh to a Dynamo mesh. You obviously need to have the appropriate version of the mesh toolkit package downloaded first.

tkMesh = Input(tkMesh:var)
code_block = CodeBlock(tkMesh)
# ---------- code_block.designscript (8 lines) ----------
def Mesh2MeshB(m1){
vp = m1.Vertices();
fi = m1.VertexIndicesByTri();
fi2 = DSCore.List.Transpose(List.Chop(fi,3) );
fi3 = IndexGroup.ByIndices(fi2[0], fi2[1], fi2[2]);
return = DesignScript.Mesh.ByPointsFaceIndices(vp,fi3);
};
Mesh2MeshB(m1);
# ----------------------------------------
mesh = Output(code_block)
