# Dynamo custom node Topography.ToPolySurface.dyf (Dynamo 0.8.2.2392)
# category: SpringNodes.Revit.Topography
# Optimized algorithm for converting topographies into polysurfaces. Tested with topographies containing up to 40 000 points.
# Warning conversions of such mangitudes consume a lot of resources and are sub-optimal. Ensure that you have at least 8GB of ram and plenty of patience before attempting such a conversion, otherwise your Dynamo and Revit instances may crash.

code_block = CodeBlock()
# ---------- code_block.designscript (21 lines) ----------
def transpose1(l1,l2,l3)
{
return = {l1,l2,l3};
};

def Mesh2PS(m1,fn1,n)
{
vp = m1.VertexPositions;
fi = m1.FaceIndices;
ptslist = transpose1(vp[fi.A],vp[fi.B],vp[fi.C]);
sflist = Surface.ByPerimeterPoints(ptslist<1>);
return = [Imperative]
{
while (Count(sflist) > n)
{
sflist = List.Chop(sflist,n);
sflist = __Map(fn1,sflist);
}
return = PolySurface.ByJoinedSurfaces(sflist);
}
};
# ----------------------------------------
topography = Input(topography:Topography)
byJoinedSurfaces = PolySurface.ByJoinedSurfaces()
code_block_2 = CodeBlock(t1=topography, f1=byJoinedSurfaces) { Mesh2PS(t1.Mesh,f1,10); }
polysurface = Output(code_block_2)
