# Dynamo custom node Utility.GetData.dyf (Dynamo 4.0.2.3852)
# category: Springs.Query
# Using the application's app domain, this node will try to fetch any data stored under the specified name. You'll need to first store the data with the `Utility.SetData` node.

key = Input(key: string)
refresh = Input(refresh: bool = true)
python_script = Python(IN[0]=key, IN[1]=refresh)  # PythonNet3
# ---------- python_script.python (31 lines) ----------
#-Reope----------------------------------------#
#                                              #
#      Copyright(c) 2016, Dimitar Venkov       #
#                                              #
# https://github.com/dimven/SpringNodes/issues #
# https://www.reope.com/                       #
#                                              #
#    ____    _____   _____   ____    _____     #
#   |  _ \ *|  ___|*|  _  |*|  _ \ *|  ___|    #
#   | |_) |*| |___ *| | | |*| |_) |*| |___     #
#   |  _ < *|  ___|*| | | |*|  __/ *|  ___|    #
#   | | | |*| |___ *| |_| |*| |    *| |___     #
#   |_| \_|*|_____|*|_____|*|_|    *|_____|    #
#                                              #
#                                              #
#-Reope-----Updated by Mark Ackerley-----------#

import System

try:
    dataKey = IN[0]
    OUT = System.AppDomain.CurrentDomain.GetData("_Dyn_Wireless_%s" % dataKey)
    if OUT is None:
        OUT = "No data found for key: %s" % dataKey

except Exception as e:
    import traceback
    OUT = "Exception:\n{0}\n\nTraceback:\n{1}".format(
        str(e),
        traceback.format_exc()
    )
# ----------------------------------------
data = Output(python_script)
