# Dynamo custom node Utility.SetData.dyf (Dynamo 4.0.2.3852)
# category: Springs.Actions
# Using the application's app domain, this node will store a reference to the input data under the specified name. use the `Utility.GetData` node to retrieve the data somewhere else.
# Try not to store large ammounts of data, because you risk creating a memory leak that will persist till you close down the aplication.

key = Input(key: string)
data = Input(data: var[]..[])
python_script = Python(IN[0]=key, IN[1]=data)  # PythonNet3
# ---------- python_script.python (30 lines) ----------
#-Reope----------------------------------------#
#                                              #
#      Copyright(c) 2016, Dimitar Venkov       #
#                                              #
# https://github.com/dimven/SpringNodes/issues #
# https://www.reope.com/                       #
#                                              #
#    ____    _____   _____   ____    _____     #
#   |  _ \ *|  ___|*|  _  |*|  _ \ *|  ___|    #
#   | |_) |*| |___ *| | | |*| |_) |*| |___     #
#   |  _ < *|  ___|*| | | |*|  __/ *|  ___|    #
#   | | | |*| |___ *| |_| |*| |    *| |___     #
#   |_| \_|*|_____|*|_____|*|_|    *|_____|    #
#                                              #
#                                              #
#-Reope-----Updated by Mark Ackerley-----------#

import System

try:
    dataKey, data = IN
    System.AppDomain.CurrentDomain.SetData("_Dyn_Wireless_%s" % dataKey, data)
    OUT = "Data stored with key: %s" % dataKey

except Exception as e:
    import traceback
    OUT = "Exception:\n{0}\n\nTraceback:\n{1}".format(
        str(e),
        traceback.format_exc()
    )
# ----------------------------------------
