# Dynamo custom node Wall.IsCurtainWall.dyf "Springs.Wall.IsCurtainWall" (Dynamo 1.3.2.2480)
# category: Springs.Revit.Wall
# Returns true if the wall is a curtain wall.

wall = Input(wall:var[])
python_script = Python(IN[0]=wall)
# ---------- python_script.python (11 lines) ----------
# Copyright(c) 2018, Dimitar Venkov
# @5devene, dimitar.ven@gmail.com
# www.badmonkeys.net

def tolist(x):
	if hasattr(x,'__iter__'): return x
	else : return [x]

walls = UnwrapElement(tolist(IN[0]))

OUT = [getattr(w, 'CurtainGrid', None) is not None for w in walls]
# ----------------------------------------
bool = Output(python_script)
