# Dynamo custom node Wall.WallType.dyf (Dynamo 0.8.2.2392)
# category: SpringNodes.Revit.ElementTypes
# Queries the wall type of the input wall. Works for types from linked documents as well.

wall_s = Input()  # "wall(s)"
python_script = Python(IN[0]=wall_s)
# ---------- python_script.python (23 lines) ----------
#Copyright(c) 2015, Dimitar Venkov
# @5devene, dimitar.ven@gmail.com

import clr

def tolist(obj1):
	if hasattr(obj1,"__iter__"):
		return obj1
	else:
		return [obj1]

walls = UnwrapElement(tolist(IN[0]))
wt = []
for w in walls:
	try:
		wt.append(w.WallType)
	except:
		wt.append([])

if len(wt) == 1:
	OUT = wt[0] 
else:
	OUT = wt
# ----------------------------------------
WallType = Output(python_script)
