# Dynamo custom node Watch+.dyf "Springs.Watch+" (Dynamo 1.2.1.3083)
# category: Springs.Core.View.Query
# This node that serializes the input information and presents it in a resizable text window.

input = Input()
addIndexes = Input(addIndexes:bool = true)
reset = Input(reset:bool = true)
python_script = Python(IN[0]=input, IN[1]=addIndexes, IN[2]=reset)
# ---------- python_script.python (119 lines) ----------
# Copyright(c) 2017, Dimitar Venkov
# @5devene, dimitar.ven@gmail.com
# www.badmonkeys.net

import clr

clr.AddReference('System.Windows.Forms')
clr.AddReference('System.Drawing')
from System.Drawing import Point, Color, Font
from System.Windows.Forms import *
from cStringIO import StringIO

str_file = StringIO()
GCL = []
GCint = -1

def isElem(el1):
	return hasattr(el1, "Id")

def tolist(obj1):
	if hasattr(obj1,"__iter__"): return obj1
	else: return [obj1]
	
def isList(obj1):
	return hasattr(obj1,"__iter__")

def write_str(str1, str_file=str_file, GCL=GCL):
	str_file.write(''.join([j for j in GCL]))
	str_file.write(str1)

def list2str(l1, writeInd, GCL=GCL):
	global GCint, height1
	GCint += 1
	GCL.insert(GCint,"")
	for i in xrange(len(l1) ):
		GCL[GCint] = "[%i] " % i if writeInd else " "
		if isElem(l1[i]):
			write_str("%s        %i\n" % (l1[i].ToString(), l1[i].Id) )
		elif isList(l1[i]) and not l1[i]:
			write_str("Empty List\n")
		elif isList(l1[i]):
			list2str(l1[i], writeInd)
		elif l1[i] is None:
			write_str("null\n")
		else:
			write_str("%s\n" % l1[i].ToString())
		height1 += 24
	GCL.pop(GCint)
	GCint -= 1

class WatchBox(Form):
	def __init__(self):
		self.Text = "SpringNodes: Expandable Watch Window"
		self.BackColor = Color.FromArgb(40,40,40)
		self.ControlBox = False
		self.TopMost = True
		self.FormBorderStyle = FormBorderStyle.Sizable
		self.StartPosition = FormStartPosition.CenterScreen
		self.Resize += self.resize1

		self.button1 = Button()
		self.button1.Text = 'Close'
		self.button1.Font = Font("Calibri", 10)
		self.button1.AutoSize = True
		self.button1.Width = 200
		self.button1.ForeColor = Color.FromArgb(234,234,234)
		self.button1.Click += self.save
		self.Controls.Add(self.button1)
		
		self.box1 = RichTextBox()
		self.box1.Multiline = True
		self.box1.Location = Point(5, 5)
		self.box1.Font = Font("Calibri", 12)
		self.box1.BackColor = Color.FromArgb(53,53,53)
		self.box1.ForeColor = Color.FromArgb(234,234,234)
		self.box1.DetectUrls = True
		self.Controls.Add(self.box1)

	def adjust_controls(self, height1, width1):
		if height1 > 800:
			height1 = 800
			self.box1.ScrollBars = RichTextBoxScrollBars.Vertical
		if width1 < 23 : width1 = 23
		if width1 > 88: width1 = 88
		self.Width = 10 + (width1 + 2) * 9 #character width seems to vary between PCs
		self.Height = height1 + 90
		self.box1.Width = self.Width - 17
		self.box1.Height = self.Height - 80
		self.button1.Location = Point(self.Width/2 - 103, self.Height - 70)
	
	def resize1(self, sender, event):
		if self.Width < 210: self.Width = 230
		if self.Height < 120: self.Height = 120
		self.box1.Width = self.Width - 17
		self.box1.Height = self.Height - 80
		self.button1.Location = Point(self.Width/2 - 103, self.Height - 70)
	
	def setTxt(self, t1):
		self.box1.Text = t1
		self.Refresh()
			
	def save(self, sender, event):
		self.text1 = self.box1.Text
		self.Close()

if IN[0] == None: l1 = []
else: l1 = tolist(IN[0])

height1 = 30
list2str(l1, IN[1])
str_content = str_file.getvalue()
width1 = max([len(i) for i in str_content.split('\n')])
form = WatchBox()
form.adjust_controls(height1, width1)
form.setTxt(str_content)
Application.Run(form)
OUT = form.text1
Application.Exit()
str_file.close()
# ----------------------------------------
str = Output(python_script)
