# Dynamo custom node Write Excel Bumblebee.dyf (Dynamo 4.0.2.3852)
# category: Springs.Utility.Excel
# author: Mark Ackerley
# Writes data to an Excel file. Pass a single sheet name and a list of data for one sheet, or a list of sheet names and a matching list of datasets for multiple sheets. TEMPORARY SpringNodes shim — original node from the BumbleBee package by Konrad Sobon and David Mans (archi-lab.net / neoarchaic.net). Will be removed once BumbleBee is updated for PythonNet3 by the author.

filePath = Input(filePath: var = null)
runIt = Input(runIt: bool = false)
byColumn = Input(byColumn: bool = false)
sheetName = Input(sheetName: var)
data = Input(data: var[]..[])
origin = Input(origin: var = null)
overwrite = Input(overwrite: bool = false)
python_script = Python(IN[0]=filePath, IN[1]=runIt, IN[2]=byColumn, IN[3]=sheetName, IN[4]=data, IN[5]=origin, IN[6]=overwrite)  # PythonNet3
# ---------- python_script.python (186 lines) ----------
# Copyright(c) 2016, David Mans, Konrad Sobon

#-Reope----------------------------------------#
#                                              #
#                                              #
# https://github.com/dimven/SpringNodes/issues #
# https://www.reope.com/                       #
#                                              #
#    ____    _____   _____   ____    _____     #
#   |  _ \ *|  ___|*|  _  |*|  _ \ *|  ___|    #
#   | |_) |*| |___ *| | | |*| |_) |*| |___     #
#   |  _ < *|  ___|*| | | |*|  __/ *|  ___|    #
#   | | | |*| |___ *| |_| |*| |    *| |___     #
#   |_| \_|*|_____|*|_____|*|_|    *|_____|    #
#                                              #
#                                              #
#---Replaces node until Bumblebee is updated---#


# Original: BumbleBee > Write Excel
# https://github.com/ksobon/Bumblebee


import clr
import re
import string
import os
import System
from System.Reflection import BindingFlags as _BF
from System.Runtime.InteropServices import Marshal

System.Threading.Thread.CurrentThread.CurrentCulture = System.Globalization.CultureInfo("en-US")
_xlProgType = System.Type.GetTypeFromProgID("Excel.Application")

# COM helpers: InvokeMember routes through IReflect -> IDispatch on __ComObject
_GET  = _BF.GetProperty  | _BF.IgnoreCase
_SET  = _BF.PutDispProperty | _BF.IgnoreCase
_CALL = _BF.InvokeMethod | _BF.IgnoreCase

def _get(obj, name, *idx):
    return obj.GetType().InvokeMember(name, _GET,  None, obj, list(idx) if idx else None)

def _set(obj, name, val):
    obj.GetType().InvokeMember(name, _SET,  None, obj, [val])

def _call(obj, name, *args):
    return obj.GetType().InvokeMember(name, _CALL, None, obj, list(args) if args else None)

filePath  = IN[0]
runIt     = IN[1]
byColumn  = IN[2]
sheetName = IN[3]
data      = IN[4]
origin    = IN[5]
overwrite = IN[6]

if filePath is not None:
    if isinstance(filePath, System.IO.FileInfo):
        filePath = filePath.FullName

def CellIndex(addr):
    def ConvertChar(char):
        num = 0
        for c in char:
            if c in string.ascii_letters:
                num = num * 26 + (ord(c.upper()) - ord('A')) + 1
        return num
    m = re.match(r'([a-z]+)([0-9]+)', addr, re.I)
    if m:
        g = m.groups()
        return [ConvertChar(g[0]), int(g[1])]
    return None

def GetAppendRow(ws):
    try:
        used = _get(ws, 'UsedRange')
        last = _get(used, 'Row') + _get(_get(used, 'Rows'), 'Count') - 1
        if last == 1 and _get(_get(ws, 'Cells', 1, 1), 'Value2') is None:
            return 1
        return last + 1
    except:
        return 1

def LiveStream():
    try:
        xlApp = Marshal.GetActiveObject("Excel.Application")
        _set(xlApp, 'Visible',       True)
        _set(xlApp, 'DisplayAlerts', False)
        return xlApp
    except:
        return None

def SetUp(xlApp):
    _set(xlApp, 'Visible',        False)
    _set(xlApp, 'DisplayAlerts',  False)
    _set(xlApp, 'ScreenUpdating', False)
    return xlApp

def WriteData(ws, data, byColumn, origin, overwrite=False):
    org = CellIndex(origin) if isinstance(origin, str) else origin
    if overwrite:
        ar  = GetAppendRow(ws)
        org = [org[0] if org is not None else 1, ar]
    def FillData(x, y, x1, y1):
        ox  = (org[1] + x) if org is not None else (x + 1)
        oy  = (org[0] + y) if org is not None else (y + 1)
        val = data[x1][y1] if y1 is not None else data[x1]
        _set(_get(ws, 'Cells', ox, oy), 'Value2', val)
    if any(isinstance(item, list) for item in data):
        for i, row in enumerate(data):
            for j, _ in enumerate(row):
                FillData(j, i, i, j) if byColumn else FillData(i, j, i, j)
    else:
        for i in range(len(data)):
            FillData(i, 0, i, None) if byColumn else FillData(0, i, i, None)

def WorksheetExists(wb, name):
    try:
        return _get(wb, 'Sheets', name) is not None
    except:
        return False

def ExitExcel(filePath, xlApp, wb, ws):
    _call(wb,   'SaveAs', str(filePath))
    _call(wb,   'Close',  False)
    _set(xlApp, 'ScreenUpdating', True)
    for obj in [ws, wb, xlApp]:
        try:
            Marshal.ReleaseComObject(obj)
        except:
            pass

# Normalise to lists -- list of sheet names drives multi-sheet mode
if isinstance(sheetName, list):
    sheets  = sheetName
    dataset = data
    origins = origin if isinstance(origin, list) else [origin] * len(sheets)
else:
    sheets  = [sheetName]
    dataset = [data]
    origins = [origin]

if runIt:
    xlApp = None
    try:
        errorReport = None
        if filePath is None:
            xlApp = LiveStream()
            live  = True
            wb    = _get(xlApp, 'ActiveWorkbook')
        else:
            xlApp = SetUp(System.Activator.CreateInstance(_xlProgType))
            live  = False
            if os.path.isfile(str(filePath)):
                _call(_get(xlApp, 'Workbooks'), 'Open', str(filePath))
                wb = _get(xlApp, 'ActiveWorkbook')
            else:
                wb = _call(_get(xlApp, 'Workbooks'), 'Add')
        for name, d, org in zip(sheets, dataset, origins):
            if WorksheetExists(wb, name):
                ws = _get(wb, 'Sheets', name)
            else:
                ws = _call(_get(wb, 'Sheets'), 'Add')
                _set(ws, 'Name', name)
            WriteData(ws, d, byColumn, org, overwrite)
        if not live:
            ExitExcel(filePath, xlApp, wb, ws)
    except Exception as e:
        import traceback
        errorReport = traceback.format_exc()
        if xlApp is not None:
            try:
                _call(xlApp, 'Quit')
            except:
                pass
            try:
                Marshal.ReleaseComObject(xlApp)
            except:
                pass
else:
    errorReport = "Set RunMe to True."

if errorReport is None:
    OUT = "Success!"
else:
    OUT = errorReport
# ----------------------------------------
OUT = Output(python_script)
