# Dynamo custom node Mesh.ToToolkitMeshQuad - Copy.dyf "Mesh.ToTkMesh" (Dynamo 3.6.1.9895)
# category: Springs.Geometry.Actions
# Converts a Dynamo mesh to a toolkit mesh. You obviously need to have the appropriate version of the mesh toolkit package downloaded first.

mesh = Input(mesh: var)
code_block = CodeBlock(mesh=mesh)
# ---------- code_block.designscript (11 lines) ----------
indices = mesh.FaceIndices;

vrtx_positions = mesh.VertexPositions;
vrtx_positions_flat = DSCore.List.Flatten(vrtx_positions, 1);

indices_flat = DSCore.List.Flatten(indices, 2);
indices_new_list = [indices_flat.A,indices_flat.B,indices_flat.C];
indices_transposed = DSCore.List.Transpose(indices_new_list);

tkMesh = Dynamo.Mesh.ByVerticesAndIndices(vrtx_positions_flat, indices_transposed);
tkMesh_Flat = DSCore.List.Flatten(tkMesh, 1);
# ----------------------------------------
tkMesh = Output(code_block.tkMesh_Flat)
