# Dynamo custom node dsString.FromList.dyf "Springs.dsString.FromList" (Dynamo 1.3.2.2480)
# category: Springs.Core.String
# Serializes a (nested) list of basic object into a valid design script syntax string. Multiline input is prefered by default.

list = Input(list:var[]..[])
multiline = Input(multiline:bool = true)
python_script = Python(IN[0]=list, IN[1]=multiline)
# ---------- python_script.python (27 lines) ----------
import re
from itertools import izip_longest

def tolist(x):
	if hasattr(x,'__iter__'): return x
	else : return [x]

rep = {"'" : "\"",
	   "[" : "{\n",
	   "]" : "\n}",
	   "None" : "null",
	   "True" : "true",
	   "False" : "false",
	   ", " : ",\n"}

if not IN[1]:
	rep["["] = "{"
	rep["]"] = "}"
	del rep[", "]

rep = dict((re.escape(k), v) for k, v in rep.iteritems())
pattern = re.compile("|".join(rep.keys()))
s1 = str(tolist(IN[0]) )

body, strings = re.split("'[^/']+'", s1), re.findall("'([^/']+)'", s1)
body = (pattern.sub(lambda m: rep[re.escape(m.group(0))], b) for b in body)
OUT = ''.join('%s"%s"' % (b, s) if s else b for b, s in izip_longest(body, strings) )
# ----------------------------------------
str = Output(python_script)
