# Dynamo graph AC_flower_field.dyn (Dynamo 0.8.2.2392)

code_block = CodeBlock()
# ---------- code_block.designscript (18 lines) ----------
//original code by EP Roca
def QuadsFromNet(Pts:var[][])
{
U1=Count(Pts)-2;
U2=Count(Pts[0])-2;

return=QuadAtPointIndices(Pts,(0..U1)<1>,(0..U2)<2>);
};

def QuadAtPointIndices(NetPts: var[][],N1,N2)
{
Pt1=NetPts[N1][N2];
Pt2=NetPts[N1][N2+1];
Pt3=NetPts[N1+1][N2];
Pt4=NetPts[N1+1][N2+1];

return={Pt1,Pt2,Pt3,Pt4};
};
# ----------------------------------------
select_faces = SelectFaces()  # 2 picked in the model
flatten = Flatten(select_faces)
code_block_2 = CodeBlock { 0..1..#6; 0..1..#10; }
pointAtParameter = Surface.PointAtParameter(surface=flatten, u=code_block_2.out0, v=code_block_2.out1, lacing=CrossProduct)
code_block_3 = CodeBlock(PtsList=pointAtParameter) { pts = QuadsFromNet(PtsList); l1 = List.Flatten(pts[1],1); l2 = List.Flatten(pts[0],1); Flatten(Transpose({l1,l2})<1>); }
code_block_4 = CodeBlock()
# ---------- code_block_4.designscript (4 lines) ----------
Point.ByCoordinates(0,0,
{0,1000,700});
{100,700,1000};
11;
# ----------------------------------------
byCenterRadiusRays = Custom[Star.ByCenterRadiusRays](NumberOfRays=code_block_4.out2, StarOrigin=code_block_4.out0, StarRadius=code_block_4.out1, RayPercentage=code_block_4.out2)  # Fun little node to create star shapes.
code_block_5 = CodeBlock(byCenterRadiusRays)
# ---------- code_block_5.designscript (6 lines) ----------
t1 = t2.Curves();
t3 = List.Transpose(t1);
t4 = t3.Explode();
t5 = Flatten(t4<1L>);
t6 = Surface.ByRuledLoft(t5);
t7 = PolySurface.ByJoinedSurfaces(t6);
# ----------------------------------------
file_path = Filename("C:\ProgramData\Autodesk\RVT 2016\Family Templates\English\Metric Generic Model Adaptive.rft")
code_block_6 = CodeBlock { "AC_Flower"; "Glass"; }
byFacetedGeometry = Custom[AdaptiveFamily.ByFacetedGeometry](geometry=code_block_5.t7, family_template_path=file_path, family_name=code_block_6.out0, material_name=code_block_6.out1)
byPoints = AdaptiveComponent.ByPoints(code_block_3.out3, byFacetedGeometry.type)
watch = Watch(byPoints)
code_block_7 = CodeBlock()  # //the file path to a Revit 2016 adaptive family template
code_block_8 = CodeBlock()  # //now just be patient :)
