# Dynamo graph Beams.FixExtents.dyn (Dynamo 0.8.2.2392)

categories = Categories("StructuralFraming")
all_elements_of_category = ElementsOfCategory(categories)
code_block = CodeBlock { 600; }
fixExtents = Custom[Beams.FixExtents](beams=all_elements_of_category, margin=code_block)  # Detects all beams from the input list with broken extents(actual length - cut length < margin) and attemts to correct them.
