# Dynamo graph CurveLoop.Simplify sample.dyn (Dynamo 0.8.2.2392)

code_block = CodeBlock { r1 = Rectangle.ByWidthLength(6000,3500).Fillet(500,false); }
code_block_2 = CodeBlock(r1=code_block) { r2 = r1.Translate(Vector.ByCoordinates(7000,0,0)).DivideEqually(50); }
simplify = Custom[CurveLoop.Simplify](curve_loop=code_block_2)  # Attempts to simplify an open or a closed curve loop by connecting straight separate line segments into a single line.
watch = Watch(simplify)
watch_2 = Watch(code_block_2)
code_block_3 = CodeBlock { "Line"; }
removeIfNot = RemoveIfNot(simplify, code_block_3)
watch_3 = Watch(removeIfNot)
code_block_4 = CodeBlock()
# ---------- code_block_4.designscript (2 lines) ----------
//we successfully reduced the continuous
//straight segmentcurves to just 4 lines
# ----------------------------------------
