# Dynamo graph DirectShape Chain sample.dyn (Dynamo 0.8.2.2392)

select_model_element = DSModelElementSelection()  # 1 picked in the model
curves = Element.Curves(select_model_element)
firstItem = List.FirstItem(curves)
watch = Watch(firstItem)
code_block = CodeBlock()
# ---------- code_block.designscript (7 lines) ----------
r1 = Rectangle.ByWidthLength(100,168).Fillet(30,false);
pl1 = r1.PlaneAtParameter(0..0.995..#10);
c1 = Circle.ByPlaneRadius(pl1,10);
c2 = c1.Rotate(pl1,0..180..#10);
profs = Polygon.RegularPolygon(c2,6);
s1 = Solid.ByLoft(profs, r1);
name = "Chain Link 1";
# ----------------------------------------
byGeometry = Custom[DirectShape.ByGeometry](geometry=code_block.s1, name=code_block.name)  # Convert the input geometry to DirectShape element inside the Revit document. It supports solids or surfaces.It is based on an alternative process that uses a SAT import and can produce smooth surfaces. Each created DS will have a unique type. Make sure that each input geometry has a unique name. You can either feed a single category for all geometries or a unique category for each geometry - the node's lacing is set to longest by default.
code_block_2 = CodeBlock(c=firstItem) { 0..#c.Length/140..140; }
coordinateSystemAtDistance = Curve.CoordinateSystemAtDistance(firstItem, code_block_2)
ZXPlane = CoordinateSystem.ZXPlane(coordinateSystemAtDistance)
code_block_3 = CodeBlock(l1=coordinateSystemAtDistance)
# ---------- code_block_3.designscript (2 lines) ----------
List.Cycle({0,90}
,Count(l1)/2);
# ----------------------------------------
rotate = CoordinateSystem.Rotate(coordinateSystemAtDistance, ZXPlane, code_block_3)
transform = Custom[DirectShape.Transform](direct_shape=byGeometry, CoordSystem_s=rotate)  # Transforms the typed DirectShape element from the identity coordinate system to the input coordinate system(s), in a manner similar to Dynamo's Geometry.Transform node.
watch_2 = Watch(transform)
