# Dynamo graph DirectShape.ByGeometry sample.dyn (Dynamo 0.8.2.2392)

code_block = CodeBlock { a = 0..#5..6000; b = 0..#5..8000; }
byCoordinates = Vector.ByCoordinates(x=code_block.a, y=code_block.b, lacing=CrossProduct)
flatten = Flatten(byCoordinates)
asPoint = Vector.AsPoint(flatten)
code_block_2 = CodeBlock()
# ---------- code_block_2.designscript (10 lines) ----------
r1 = Rectangle.ByWidthLength(3000,4000);
pts1 = r1.Points;
cpt = r1.Center();
s1 = Sphere.ByCenterPointRadius(pts1,800);
s2 = Sphere.ByCenterPointRadius(cpt,1700).
Translate(Vector.ByCoordinates(0,0,500));
s3 = s2.Scale(Plane.XY(),1,2,0.8);
c1 = Cuboid.ByLengths(2500,2000,1500).
Translate(Vector.ByCoordinates(0,1000,1500));
solid = s3.UnionAll(Flatten({s1,c1}));
# ----------------------------------------
identity = Object.Identity(code_block_2.solid)
categories = Categories("GenericModel")
code_block_3 = CodeBlock { "My car"; }
byGeometry = Custom[DirectShape.ByGeometry](geometry=identity, category=categories, name=code_block_3)  # Attempts to create a DirectShape element inside the Revit document. It is based on an alternative process that uses a SAT inport and can produce smooth surfaces.
code_block_4 = CodeBlock { "Comments"; "This is my car!"; }
setParameterByName = Element.SetParameterByName(element=byGeometry, parameterName=code_block_4.out0, value=code_block_4.out1)
code_block_5 = CodeBlock()
# ---------- code_block_5.designscript (3 lines) ----------
/* DS elements have categories and thus
can store parameters, graphic overrides,
can be scheduled and more */;
# ----------------------------------------
code_block_6 = CodeBlock()
# ---------- code_block_6.designscript (4 lines) ----------
/* This is a fast way of creating
duplicate DS elements. Create vectors,
just like the ones used for
Geometry.Translate */;
# ----------------------------------------
end = Revit.Transaction.Transaction.End(byGeometry)
restOfItems = List.RestOfItems(flatten)
translate = Custom[DirectShape.Translate](direct_shape=end, vector_s=restOfItems)  # Copy the input DirectShape element with the help of a translation vector, similarly to the Geometry.Translate node. This method should prove more efficient than Element.Copy
