# Dynamo graph FamilyInsance.ByFacePoints sample.dyn (Dynamo 0.8.2.2392)

# group: if you'd like to place on multiple surfaces, you'll need to use "List.Combine"
family_types = FamilyTypes("Family1:Family1")
byFacePoints = Custom[FamilyInsance.ByFacePoints](type=family_types)  # Places instances on the input face oriented to the face's U tangent and the global Z axis.
select_faces = SelectFaces()  # 4 picked in the model
watch = Watch(select_faces)
code_block = CodeBlock { 0.5; }
pointAtParameter = Surface.PointAtParameter(surface=select_faces, u=code_block, v=code_block)
combine = List.Combine(byFacePoints, watch, pointAtParameter)
watch_2 = Watch(combine)

# group: By default the node works with a single surface and multiple points
select_face = DSFaceSelection()  # 1 picked in the model
family_types_2 = FamilyTypes("Family1:Family1")
code_block_2 = CodeBlock { 0.2..0.8..#3; 0.5; }

pointAtParameter_2 = Surface.PointAtParameter(surface=select_face, u=code_block_2.out0, v=code_block_2.out1, lacing=CrossProduct)
flatten = Flatten(pointAtParameter_2)

# group (continued): By default the node works with a single surface and multiple points
byFacePoints_2 = Custom[FamilyInsance.ByFacePoints](face=select_face, type=family_types_2, point_s=flatten)
watch_3 = Watch(byFacePoints_2)
