# Dynamo graph FloorOpening.ByCurves sample.dyn (Dynamo 0.8.2.2392)

code_block = CodeBlock()
# ---------- code_block.designscript (2 lines) ----------
//group curves from the
//archi-lab.net package
# ----------------------------------------
code_block_2 = CodeBlock()
# ---------- code_block_2.designscript (10 lines) ----------
/* Have a look at the result inside Revit.
Try playing with the curves on the left side,
or adding new boundaries.Don't forget to
re-run the graph. In Dynamo 0.82, the built-in
"Floor.ByOutlineTypeAndLevel" node does not
support Automatic Run mode.

Remember, each floor boundary needs at least one
opening, for it to be identified as a floor
*/;
# ----------------------------------------
byCurves = Custom[FloorOpening.ByCurves]()  # Create hosted floor opeinngs through the input floors. The second input is a list of sub-lists of the boundary curves.
categories = Categories("Lines")
all_elements_of_category = ElementsOfCategory(categories)
group_curves = Custom[Group Curves]()  # This node will take any input of flat list of curves and group them into sublists containing "joinable" curves that is continous curves. They might form closed curves or open curves. Use PolyCurve.ByJoinedCurves to convert output groups of curves into single PolyCurves
code_block_3 = CodeBlock(cl1=all_elements_of_category, f1=group_curves)
# ---------- code_block_3.designscript (21 lines) ----------
//this code block sorts the lines into floors and openings
//each "floor" boundary must have at least 1 "opening"
//boundary for it to be identified as a floor
//it has a lot of limitations, so bear with me
cl2 = Flatten(cl1.Curves);
cl3 = __Apply(f1,cl2);
pc1 = PolyCurve.ByJoinedCurves(cl3);
bb1 = pc1.BoundingBox;
centroids = pc1.Patch().PointAtParameter(0.5,0.5);
centroids1 = List.Flatten(List.RemoveItemAtIndex(centroids,
GetKeys(centroids)<1><2>),1);
test1 = bb1<1>.Contains(centroids1<1><2>);
test2 = AllFalse(test1<1>);
floors = List.FilterByBoolMask(pc1,test2)["out"];
holes = List.FilterByBoolMask(pc1,test2)["in"];
Fbb = floors.BoundingBox;
Hbb = holes.BoundingBox;
test3 = Fbb<1>.Intersects(Hbb<2>);
Hind = List.AllIndicesOf(test3<1>,true);
holes2 = List.GetItemAtIndex(holes,Hind<1>);
holes3 = holes2.Curves();
# ----------------------------------------
floor_types = FloorTypes("Generic 300mm")
levels = Levels("Level 2")
byOutlineTypeAndLevel = Floor.ByOutlineTypeAndLevel(floorType=floor_types, level=levels)
map = List.Map(list=code_block_3.floors, f_x=byOutlineTypeAndLevel)
end = Revit.Transaction.Transaction.End(map)
combine = List.Combine(byCurves, end, code_block_3.holes3)
watch = Watch(combine)
