# Dynamo graph Form.ByGeometry sample.dyn (Dynamo 0.8.2.2392)

code_block = CodeBlock()
# ---------- code_block.designscript (15 lines) ----------
r1 = Rectangle.ByWidthLength(3000,4000);
pts1 = r1.Points;
cpt = r1.Center();
s1 = Sphere.ByCenterPointRadius(pts1,800);
s2 = Sphere.ByCenterPointRadius(cpt,1700).
Translate(Vector.ByCoordinates(0,0,500));
s3 = s2.Scale(Plane.XY(),1,2,0.8);
c1 = Cuboid.ByLengths(2500,2000,1500).
Translate(Vector.ByCoordinates(0,1000,1500));
solid1 = s3.UnionAll(Flatten({s1,c1}));
//let's make a copy of the car
solid2 = solid1.Translate(Vector.
ByCoordinates(-1600,-900,-1200));
{solid1, solid2};
{false,true};
# ----------------------------------------
identity = Object.Identity(code_block.solid1)
code_block_2 = CodeBlock()
# ---------- code_block_2.designscript (3 lines) ----------
/* make sure you're inside a family document for
example, try the Conceptual Mass environment. Unlike
a DirectShape, it's easy to change a form's material */;
# ----------------------------------------
byGeometry = Custom[Form.ByGeometry](geometry=code_block.out9, isVoid=code_block.out10)  # Attempts to convert the input geometry to a Revit Form object. Forms can exist only in the family environment. You can convert complicated solids or surfaces directly into forms. Solids can be converted into voids. Provide either one true boolean to convert everything into voids or a unique boolean for each geometry object.
watch = Watch(byGeometry)
code_block_3 = CodeBlock()
# ---------- code_block_3.designscript (3 lines) ----------
/* The second form was defined as a void
try to cut it out from the solid form
inside the Revit intefrace */;
# ----------------------------------------
firstItem = List.FirstItem(byGeometry)
code_block_4 = CodeBlock { "Material"; Material.ByName("Glass"); }
setParameterByName = Element.SetParameterByName(element=firstItem, parameterName=code_block_4.out0, value=code_block_4.out1)
