# Dynamo graph Geometry.SplitRecursively sample.dyn (Dynamo 0.8.2.2392)

code_block = CodeBlock()
# ---------- code_block.designscript (7 lines) ----------
a = 0..90..10;
pts = Point.ByCoordinates(a<1>,a<2>);
z1 = List.Chop(Math.RandomList(100)*6,10);
v1 = Vector.ByCoordinates(0,0,z1);
pts1 = pts.Add(v1);
NurbsSurface.ByPoints(pts1);
Plane.XZ().Translate(Vector.ByCoordinates(0,a));
# ----------------------------------------
splitRecursively = Custom[Geometry.SplitRecursively](geometry=code_block.out5, tools=code_block.out6)  # Splits a surface or a solid recursively, using the resulting reduced geometry for every next split.
number_slider = DoubleSlider(5, range=0..8 step 1)
code_block_2 = CodeBlock(s=splitRecursively, x=number_slider) { s[x]; }
code_block_3 = CodeBlock { c1 = Cuboid.ByLengths(100,100,10); c1.Translate(Vector.ByCoordinates(150,50)); }
splitRecursively_2 = Custom[Geometry.SplitRecursively](geometry=code_block_3.out1, tools=code_block.out6)
code_block_4 = CodeBlock(s=splitRecursively_2, x=number_slider) { s[x]; }
