# Dynamo graph Group&FixCorners sample.dyn (Dynamo 1.1.0.2094)

code_block = CodeBlock()
# ---------- code_block.designscript (2 lines) ----------
//don't be too generous
//with the margin
# ----------------------------------------
code_block_2 = CodeBlock()
# ---------- code_block_2.designscript (2 lines) ----------
//I guess this is a sample for
//Element.SetLocation as well :)
# ----------------------------------------
code_block_3 = CodeBlock()  # //from the clockwork package
categories = Categories("Walls")
all_elements_of_category = ElementsOfCategory(categories)
location = Custom[Element.Location](element=all_elements_of_category)  # Returns the location of an element as an XYZ (or if it's line-based the start and end point of the line), along with some booleans to help filtering the results. Use this for some element types (e.g. walls or lines) that do not work with the built-in Get Family Instance Location node.
code_block_4 = CodeBlock { 1500; }
groupByDistance = Custom[Springs.Geometry.GroupByDistance](geometry=location.curves, margin=code_block_4)  # Splits the list of curves into groups if the distance between them is lesser than the provided margin.
merge = Custom[Springs.LineLoop.Merge](lines=groupByDistance, margin=code_block_4)  # Attempts to join lines into a single chain of joined curves. The node returns the new lines as a chain and with the original order. The success outputs returns the success of the execution as a true/false boolean.
if_ = If(test=merge.success, true=merge.ordered, false=groupByDistance)
flatten = Flatten(if_)
setLocation = Custom[Element.SetLocation](element=all_elements_of_category, location=flatten)  # "Springs.Element.SetLocation"; Attempts to modify the location of the input element. This can effectively add as a move comand in Revit. Works for both line based and point based elements.
watch = Watch(setLocation)
