# Dynamo graph HostedInstance sample.dyn (Dynamo 1.3.1.1736)

# group: multiple windows on multiple walls example; i.e. multiple walls, multiple windows per wall
select_model_elements = DSModelElementsSelection()  # 2 picked in the model
code_block = CodeBlock { 1; }
# note: Very important, you have to chop each wall into a separate list
chop = List.Chop(list=select_model_elements, lengths=code_block)
watch = Watch(chop)
family_types = FamilyTypes("M_Window-Square Opening:0900 x 1800mm")
getLocation = Element.GetLocation(select_model_elements)
code_block_2 = CodeBlock { {0.3..0.9..0.2,{0.4,0.6}}; }
pointAtParameter = Curve.PointAtParameter(curve=getLocation, param=code_block_2, lacing=Longest)
byPoints = Custom[HostedInstance.ByPoints](host=chop, type=family_types, point=pointAtParameter)  # "Springs.HostedInstance.ByPoints"; Creates hosted family instances(doors/windows) at the specified points. You can feed either a single family type or a unique type for each instance.
code_block_3 = CodeBlock { "Sill Height"; 800; }
setParameterByName = Element.SetParameterByName(element=byPoints, parameterName=code_block_3.out0, value=code_block_3.out1)
watch_2 = Watch(setParameterByName)

# group: multiple windows on a single wall example; i.e. one wall, multiple points
select_model_element = DSModelElementSelection()  # 1 picked in the model
watch_3 = Watch(select_model_element)
family_types_2 = FamilyTypes("M_Window-Square Opening:0900 x 1800mm")
getLocation_2 = Element.GetLocation(select_model_element)
code_block_4 = CodeBlock { 0.3..0.9..0.2; }
pointAtParameter_2 = Curve.PointAtParameter(curve=getLocation_2, param=code_block_4, lacing=Longest)
byPoints_2 = Custom[HostedInstance.ByPoints](host=select_model_element, type=family_types_2, point=pointAtParameter_2)  # "Springs.HostedInstance.ByPoints"
code_block_5 = CodeBlock { "Sill Height"; 800; }
setParameterByName_2 = Element.SetParameterByName(element=byPoints_2, parameterName=code_block_5.out0, value=code_block_5.out1)
watch_4 = Watch(setParameterByName_2)

# group: multiple windows on multiple walls example; i.e. multiple walls, one window per wall
select_model_elements_2 = DSModelElementsSelection()  # 2 picked in the model
watch_5 = Watch(select_model_elements_2)
family_types_3 = FamilyTypes("M_Window-Square Opening:0900 x 1800mm")
getLocation_3 = Element.GetLocation(select_model_elements_2)
code_block_6 = CodeBlock { 0.15; }
pointAtParameter_3 = Curve.PointAtParameter(curve=getLocation_3, param=code_block_6, lacing=Longest)
byPoints_3 = Custom[HostedInstance.ByPoints](host=select_model_elements_2, type=family_types_3, point=pointAtParameter_3)  # "Springs.HostedInstance.ByPoints"
code_block_7 = CodeBlock { "Sill Height"; 800; }
setParameterByName_3 = Element.SetParameterByName(element=byPoints_3, parameterName=code_block_7.out0, value=code_block_7.out1)
watch_6 = Watch(setParameterByName_3)
