# Dynamo graph Lines.Group&FixCorners sample.dyn (Dynamo 0.8.2.2392)

code_block = CodeBlock()
# ---------- code_block.designscript (2 lines) ----------
//don't be too generous
//with the margin
# ----------------------------------------
categories = Categories("Walls")
all_elements_of_category = ElementsOfCategory(categories)
location = Custom[Element.Location](Element_s=all_elements_of_category)  # Returns the location of an element as an XYZ (or if it's line-based the start and end point of the line), along with some booleans to help filtering the results. Use this for some element types (e.g. walls or lines) that do not work with the built-in Get Family Instance Location node.
code_block_2 = CodeBlock { 1500; }
lines_group_fixcorners = Custom[Lines.Group&FixCorners](lines=location.Curves, margin=code_block_2)  # Groups unconnected lines into sub-lists by margin(the maximum distance between endpoints) and attempts to create clean corner connections between them. Built on top of the Group curves node found in archi-lab.net.
setLocation = Custom[Element.SetLocation](element_s=all_elements_of_category, location_s=lines_group_fixcorners)  # Attempts to modify the location of the input element. This can effectively add as a move comand in Revit. Works for both line based and point based elements.
code_block_3 = CodeBlock()
# ---------- code_block_3.designscript (2 lines) ----------
//I guess this is a sample for
//Element.SetLocation as well :)
# ----------------------------------------
code_block_4 = CodeBlock()  # //from the clockwork package
