# Dynamo graph List.Randomize&Divide sample.dyn (Dynamo 0.8.2.2392)

code_block = CodeBlock { 1..10; 3/10; 5; }
lunchbox_random_split_list = Custom[LunchBox Random Split List](List=code_block.out0, Ratio=code_block.out1, Seed=code_block.out2)  # Randomly splits a list of objects into two separate lists.
watch = Watch(lunchbox_random_split_list.ListA)
watch_2 = Watch(lunchbox_random_split_list.ListB)
code_block_2 = CodeBlock()
# ---------- code_block_2.designscript (6 lines) ----------
/* the number of out lists will depend on
the number of provided ratios. If your
ratios do not add up to 1, the last ratio
will be calculated automatically. If your
ratios are greater than 1, everything
greater than 1 will be ignored */;
# ----------------------------------------
code_block_3 = CodeBlock { 1..20; 0.3; }
number_slider = DoubleSlider(17.8, range=0..100 step 0.1)
list_randomise_divide = Custom[List.Randomise&Divide](list=code_block_3.out0, ratios=code_block_3.out1, seed=number_slider)  # Shiffles the input list and divides it into sub-lists based on ratios(1/4 + 1/2 + 1/4 will give you three lists split accordingly) The smalest ratio will always be 1 / the list length and the largest ratio will be 1. A seed input can shuffle the list further.
watch_3 = Watch(list_randomise_divide)
code_block_4 = CodeBlock { {1/6,1/6,7/8,5}; }
list_randomise_divide_2 = Custom[List.Randomise&Divide](list=code_block_3.out0, ratios=code_block_4, seed=number_slider)
watch_4 = Watch(list_randomise_divide_2)
