# Dynamo graph Shaft.ByCurves sample.dyn (Dynamo 0.8.2.2392)

categories = Categories("StructuralColumns")
all_elements_of_category = ElementsOfCategory(categories)
geometry = Element.Geometry(all_elements_of_category)
flatten = Flatten(geometry)
code_block = CodeBlock { 600; }
byCoordinates = Point.ByCoordinates(z=code_block)
byOriginNormal = Plane.ByOriginNormal(origin=byCoordinates)
intersect = Geometry.Intersect(geometry=flatten, other=byOriginNormal)
flatten_2 = Flatten(intersect)
perimeterCurves = Surface.PerimeterCurves(flatten_2)
code_block_2 = CodeBlock { "Base Level"; "Top Level"; }
getParameterValueByName = Element.GetParameterValueByName(element=all_elements_of_category, parameterName=code_block_2.out0)
getParameterValueByName_2 = Element.GetParameterValueByName(element=all_elements_of_category, parameterName=code_block_2.out1)
byCurves = Custom[Shaft.ByCurves](CurveSublists=perimeterCurves, base_level_s=getParameterValueByName, top_level_s=getParameterValueByName_2)  # Creates a shaft opening. The top level MUST be higher than the base level for a successful execution. You can either provide one base and top level for all shafts or have unique levels for each shaft instance.
code_block_3 = CodeBlock()
# ---------- code_block_3.designscript (3 lines) ----------
/* This work-flow creates shafts through every column.
This is not the reccomended use, but is a good
demonstration of the Shaft.ByCurves node */;
# ----------------------------------------
