# Dynamo graph Void Cuts sample.dyn (Dynamo 0.8.2.2392)

# group: Let's generate some cutters and some elements to be cut
n2015 = Filename("C:\ProgramData\Autodesk\RVT 2015\Family Templates\English\Metric Generic Model.rft")  # "2015"
code_block = CodeBlock()
# ---------- code_block.designscript (4 lines) ----------
Cuboid.ByLengths(11000,6000,200).
Translate(Vector.ByCoordinates(0,0,{2800,3200}));
Sphere.ByCenterPointRadius(Point.
ByCoordinates(-3000..3000..1000,0,3000),500);
# ----------------------------------------
# note: Default template locations
join = List.Join(code_block.out0, code_block.out1)
n2016 = Filename("C:\ProgramData\Autodesk\RVT 2016\Family Templates\English\Metric Generic Model.rft")  # "2016"
code_block_2 = CodeBlock(l=join) { "Family " + (1..Count(l)); {false,false,true}; }
byGeometry = Custom[FamilyInstance.ByGeometry](geometry=join, family_template_path=n2016, family_name=code_block_2.out0, isVoid=code_block_2.out1)  # You must provide a valid family template path that will be used for all input geometry objects. The project units(and not the templates) will be used to determine the size of the output geometry. The provided category will be used only if the family template supports it. If not, the default template category will be used instead. Likewise, the family material(provided as a string) will be set only if a material with that name exists in the template. If not, the default material will be used instead ("By Category"). For void cuts, the material settings will be ignored. The output is the resulting family and an instance aligned according to the project document's origin. The node expects a unique family name for each geometry object. The rest of the input lists will be processed as if the node lacing is set to longest.
n2014 = Filename("C:\ProgramData\Autodesk\RVT 2014\Family Templates\English\Metric Generic Model.rft")  # "2014"

code_block_3 = CodeBlock { 2; }
# note: separate the voids
split = Custom[List.Split](list=byGeometry.instance, amount=code_block_3)  # Splits a list after the specified amount of items

# group: cuts all the instances with all the voids
addVoidCut = Custom[Element.AddVoidCut](element_s_ToBeCut=split.list1, cuttingElement_s=split.list2, lacing=code_block_3)  # Accepts single or list inputs. If an element that can be cut and a family that can act as a void cutting entity are provided, the element will be cut. Please make sure that the geometries of the elements actually cut. Otherwise an empty cut will be created that may impede the performance of your file. Add void cuts sparcely because they affect the size of your project.
watch = Watch(addVoidCut)

wait = Custom[Input.Wait](WaitForMe=addVoidCut, Output=split.list1)  # Waits for all inputs to be completed before continuing the execution process.Part of the SmartCopyMon workflow.
code_block_4 = CodeBlock(i=wait, c=split.list2) { i[0]; c[0..5]; }

# group: remove all but 1 of the cuts from the bottom slab
removeVoidCut = Custom[Element.RemoveVoidCut](element_s_BeingCut=code_block_4.out0, cuttingElement_s=code_block_4.out1)  # Removes the void cut between the input elements, if such exists.
watch_2 = Watch(removeVoidCut)

wait_2 = Custom[Input.Wait](WaitForMe=removeVoidCut, Output=wait)

# group: Tests if the elements are being cut
isCut = Custom[Element.IsCut](element_s=wait_2)  # Tests if the element is being cut by any void instances. If any cuts exist all cutting elements will be provided.
watch_3 = Watch(isCut.bool)
watch_4 = Watch(isCut.cuts)

wait_3 = Custom[Input.Wait](WaitForMe=removeVoidCut, Output=split.list2)

# group: Checks if the elements are cutting something.
isCutting = Custom[Element.IsCutting](element_s=wait_3)  # Tests if the input element (or elements) is a void cut and if it is cutting any elements. In such cases, the cut elements will be provided.
watch_5 = Watch(isCutting.bool)
watch_6 = Watch(isCutting.cut_elements)
