# Dynamo custom node Lines.Group&FixCorners.dyf (Dynamo 0.8.2.2392)
# category: SpringNodes.Geometry
# Groups unconnected lines into sub-lists by margin(the maximum distance between endpoints) and attempts to create clean corner connections between them. Built on top of the Group curves node found in archi-lab.net.

lines = Input(lines:var[])
margin = Input(margin:var)
python_script = Python(IN[0]=lines, IN[1]=margin)
# ---------- python_script.python (94 lines) ----------
#Copyright(c) 2016, Dimitar Venkov
# @5devene, dimitar.ven@gmail.com
#Inspired from the "Group Curves" node by Konrad Sobon
# @arch_laboratory, http://archi-lab.net

import clr

clr.AddReference('ProtoGeometry')
from Autodesk.DesignScript.Geometry import *

inputCurves = IN[0]
original = inputCurves[:]
margin = IN[1]

#join/group curves function
def groupCurves(cl1,ignore_dist):
	def ends(l1): return l1.StartPoint, l1.EndPoint
	Grouped_Lines, Queue = [], set()
	while cl1:
		Shape = []
		Queue.add(cl1.pop()) # Move a line from the cl1 to our queue
		while Queue:
			l1 = Queue.pop()
			Shape.append(l1)
			for i in xrange(len(cl1) ):
				dist1 = [p1.DistanceTo(p2) for p2 in ends(l1)\
				for p1 in ends(cl1[i])]
				if any(d <= ignore_dist for d in dist1):
					Queue.add(cl1[i])
			cl1 = [i for i in cl1 if i not in Queue]
		Grouped_Lines.append(Shape)
	return Grouped_Lines

def CountTrue(l1):
	n = 0
	for i in l1: n += 1 if i else 0
	return n
	
def OrderCurves(cl0,cl1):
	xr1 =  xrange(len(cl1))
	test1 = [[cl1[i].DoesIntersect(cl1[j]) for j in xr1 if j != i] for i in xr1]
	countT = map(CountTrue, test1)
	if 1 in countT and countT[0] != 1 :
		n = countT.index(1)
		cl0[0],cl0[n] = cl0[n],cl0[0]
		cl1[0],cl1[n] = cl1[n],cl1[0]
	return cl0,cl1

def FarPt(l1, p1):
	pts = (l1.StartPoint,l1.EndPoint)
	return max(pts, key = p1.DistanceTo)

def ClosedCase(cl0,cl1):
	pts = [cl1[i-1].Intersect(cl1[i])[0] for i in xrange(len(cl1) )]
	return PolyCurve.ByPoints(pts,True).Curves()

def OpenCase(cl0,cl1):
	pts = [cl1[i].Intersect(cl1[i+1])[0] for i in xrange(len(cl1) -1)]
	pts.append(FarPt(cl0[-1],pts[-1]))
	pts.insert(0,FarPt(cl0[0],pts[0]))
	return PolyCurve.ByPoints(pts).Curves()

def joinCurves(Clist1,th1):
	if len(Clist1) < 2 : return Clist1
	else:
		Clist2 = [c.ExtendStart(th1).ExtendEnd(th1) for c in Clist1]
		Clist1, Clist2 = OrderCurves(Clist1,Clist2)
		isClosed = Clist2[0].DoesIntersect(Clist2[-1]) and len(Clist2) > 2
		fn1 = ClosedCase if isClosed else OpenCase
		try : return fn1(Clist1,Clist2)
		except : return Clist1
		
def ReorderCurves(orig, new):
	reordered = []
	app1, pop1, PaP = reordered.append, new.pop, Curve.PointAtParameter
	for i in xrange(len(orig) ):
		p1 = PaP(orig[i],0.5)
		p2 = [PaP(new[i],0.5) for i in xrange(len(new) )]
		ind1 = p2.index(min(p2, key = p1.DistanceTo) )
		app1(pop1(ind1) )
	return reordered

def Flatten(x):
    if hasattr(x, "__iter__"):
        return [a for i in x for a in Flatten(i)]
    else : return [x]

def output1(l1):
	if len(l1) == 1: return l1[0]
	else: return l1

_grouped = groupCurves(inputCurves,margin)
out1 = output1([joinCurves(gc, margin) for gc in _grouped])
OUT = ReorderCurves(original,Flatten(out1)), out1
# ----------------------------------------
code_block = CodeBlock(l=python_script) { l[0]; l[1]; }
lines_original_order = Output(code_block.out0)  # "lines(original order)"
lines_grouped = Output(code_block.out1)  # "lines(grouped)"
