# Dynamo custom node List.EveryOther.dyf (Dynamo 0.8.2.2392)
# category: SpringNodes.Lists
# Useful for when you want to combine an item on the list with every other item on the list. For example in list {1,2,3} , "2" will be paired up only with "1" and "3" and will not be paired up with itself.

list = Input(list:var[])
removeItemAtIndex = List.RemoveItemAtIndex(list=list)
code_block = CodeBlock(fn1=removeItemAtIndex, l1=list) { __Map(fn1,GetKeys(l1)); }
lists = Output(code_block)
