# Dynamo custom node PolyCurve.Chamfer.dyf (Dynamo 0.8.2.2392)
# category: SpringNodes.Geometry
# Symmetrically chamfers the corners of the polycurve by the designated distance

polycurve = Input(polycurve:var)
distance = Input(distance:var)
code_block = CodeBlock(polycurve, distance)
# ---------- code_block.designscript (9 lines) ----------
def shorten1(c,d1){
d2 = c.Length - d1;
return = c.PointAtDistance({d1,d2});
};
def chamfer1(pc,d1){
return = PolyCurve.ByPoints(Flatten(
shorten1(pc.Curves(),d1)), pc.IsClosed);
};
chamfer1(c1,d1);
# ----------------------------------------
polycurve_2 = Output(code_block)  # "polycurve"
