# Dynamo custom node Excel.ImportFirstWorksheet.dyf (Dynamo 0.7.6.4256)
# category: SpringNodes.Excel

file = Input()
readExcelFile = Excel.ReadExcelFile(file)
getWorksheetsFromExcelWorkbook = Excel.GetWorksheetsFromExcelWorkbook(readExcelFile)
firstItem = List.FirstItem(getWorksheetsFromExcelWorkbook)
getDataFromExcelWorksheet = Excel.GetDataFromExcelWorksheet(firstItem)
data = Output(getDataFromExcelWorksheet)
