# Dynamo custom node Planetoid.ByCenterRadius.dyf (Dynamo 0.8.0.950)
# category: SpringNodes.Geometry
# Creates a randomly shaped spherical planetoid with a radius between 1 and 1000.

mul = _ * _
create = List.Create()
center_point = Input()
radius_1_to_1000 = Input()
dropLast = Custom[List.DropLast]()  # Removes the last value of the list.
code_block = CodeBlock(p1=center_point, r=radius_1_to_1000, f1=dropLast)
# ---------- code_block.designscript (8 lines) ----------
s1 = Sphere.ByCenterPointRadius(p1,r);
r1 = Math.Ceiling(MapTo(1,1000,r,5,15));
s2 = s1.Explode()[0];
cl1 = s2.GetIsoline(1,0.01..0.99..#r1);
pl1 = cl1<1>.PointAtParameter((0..1..#r1)<2>);
pl2 = __Map(f1,pl1);
q = cl1.Length/(2*r1*Math.PI);
v1 = Math.RandomList(r1-1)/(r1*0.1);
# ----------------------------------------
getOdd = Custom[List.GetOdd](code_block.v1)  # Gets the odd indices from the list.
getEven = Custom[List.GetEven](list=code_block.v1)  # Gets even indices from the list.
formula = Formula("x*(-1)", x=getEven)
combine = List.Combine(create, getOdd, formula)
code_block_2 = CodeBlock(v1=combine, r1=code_block.r1) { l2 = RemoveNulls(Flatten(v1)); l3 = List.ShiftIndices(l2,1..r1); }
combine_2 = List.Combine(mul, code_block_2.l3, code_block.q)
code_block_3 = CodeBlock(l2=combine_2, pts=code_block.pl1) { v1 = Vector.ByCoordinates(l2,List.Reverse(l2)); npts = pts.Add(v1); NurbsCurve.ByPoints(npts,true); }
code_block_4 = CodeBlock(nc1=code_block_3.out2) { Solid.ByLoft(nc1); }
Solid = Output(code_block_4)
