# Dynamo custom node SawCurve.dyf (Dynamo 0.7.6.4064)
# category: SpringNodes.Geometry
# Divides a curve into horizontal and vertical segments.

create = List.Create()
curve = Input()
tooth_size = Input()
code_block = CodeBlock(cr1=curve, d1=tooth_size)
# ---------- code_block.designscript (10 lines) ----------
n = cr1.Length/d1;
pts = Flatten(cr1.PointAtParameter((0..1..#n)<1><2>));
lines = Line.ByStartPointDirectionLength(pts,Vector.YAxis(),2*d1);
pts2 = List.ShiftIndices(pts,-1);
v1 ={Vector.XAxis(),Vector.XAxis().Reverse()};
pts3 = Flatten(pts2.Project(lines,v1<1><2>));
lines2 = Line.ByStartPointDirectionLength(pts,Vector.YAxis().Reverse(),2*d1);
pts3a = Flatten(pts2.Project(lines2,v1<1><2>));
( List.IsEmpty(pts3) ? pts3a : pts3);
lastpt = List.LastItem(pts);
# ----------------------------------------
laceShortest = List.LaceShortest(create, code_block.pts, code_block.out8)
code_block_2 = CodeBlock(pts4=laceShortest, last=code_block.lastpt) { l1 = Flatten(pts4); l2 = List.AddItemToEnd(last,l1); curves = PolyCurve.ByPoints(l2).Curves(); }
Curves = Output(code_block_2.curves)
