# Dynamo custom node Mesh.ToToolkitMesh - Copy.dyf "Mesh.ToTkMesh" (Dynamo 3.3.0.6316)
# category: Springs.Geometry.Actions
# Converts a Dynamo mesh to a toolkit mesh. You obviously need to have the appropriate version of the mesh toolkit package downloaded first.

mesh = Input(mesh: var)
code_block = CodeBlock(m1=mesh) { mesh = m1; fi = mesh.FaceIndices; quads = DSCore.List.Flatten(fi.D != null); }
code_block_2 = CodeBlock(m1=code_block.mesh)
# ---------- code_block_2.designscript (29 lines) ----------
fi = m1.FaceIndices;
vp =DSCore.List.Flatten(m1.VertexPositions);
fis = DSCore.List.Flatten(fi);
// mesh vertiex positions are points
// we need to convert 1 list of 4 points into
// 2 lists of 3 points, this translation should work
vp1 = List.GetItemAtIndex(vp@L2<1>, 0);
vp2 = List.GetItemAtIndex(vp@L2<1>, 1);
vp3 = List.GetItemAtIndex(vp@L2<1>, 2);
vps1 = [vp1, vp2, vp3];
vp4 = List.GetItemAtIndex(vp@L2<1>, 0);
vp5 = List.GetItemAtIndex(vp@L2<1>, 2);
vp6 = List.GetItemAtIndex(vp@L2<1>, 3);
vps2 = [vp4, vp5, vp6];
// we transpose to give us the points for each mesh
// in their own sub list
vpt1 = List.Transpose(vps1);
vpt2= List.Transpose(vps2);
// these are now the 2 tri-meshes from the quad
vpLots = [vpt1, vpt2];
// face indices are the number we want to place
// tk meshes are only tri-face, so we don't want
// a list containing 4... we just need as many lists
// of 3 as we are providing points for.
// the translation from 4 to 3 is primarily governed by
// the point positions
fif = List.Flatten(fi, -1);
fifT = List.Transpose([fif.A, fif.B, fif.C]);
tkMesh = Dynamo.Mesh.ByVerticesAndIndices(vpLots,fifT);
# ----------------------------------------
code_block_3 = CodeBlock(m1=code_block.quads)
# ---------- code_block_3.designscript (5 lines) ----------
fi = m1.FaceIndices;
vp = m1.VertexPositions;
s1 = DSCore.List.Transpose([fi.A,fi.B,fi.C]);
fi2 = DSCore.List.Flatten(s1);
tkMesh = Dynamo.Mesh.ByVerticesAndIndices(vp,fi2);
# ----------------------------------------
if_ = RefactoredIf(test=code_block.quads, true=code_block_2.tkMesh, false=code_block_3.tkMesh)
tkMesh = Output(if_)
QuadMesh = Output(code_block.quads)
