# Dynamo graph MeshToTk.dyn (Dynamo 4.0.2.3852)

# note: Quad Mesh
plane = Mesh.Plane()
volumeArea = Custom[Mesh.VolumeArea](mesh=plane)  # Gets the volume and the area of a mesh. Works with both built in meshes and toolkit meshes. Based on math from geometry3sharp. Note that if triangles don't define closed region, volume is probably nonsense.
watch = Watch(volumeArea.volume)
# note: Tri Mesh
cuboid = Mesh.Cuboid()
volumeArea_2 = Custom[Mesh.VolumeArea](mesh=cuboid)
watch_2 = Watch(volumeArea_2.volume)
watch_3 = Watch(volumeArea_2.area)
watch_4 = Watch(volumeArea.area)
