# Dynamo graph MeshToTk_Quad.dyn (Dynamo 4.0.2.3852)
# packages: MeshToolkit 5.1.0

code_block = CodeBlock { 5; }
byWidthLength = Rectangle.ByWidthLength(width=code_block, length=code_block)
explode = Geometry.Explode(geometry=byWidthLength)
endPoint = Curve.EndPoint(curve=explode)
code_block_2 = CodeBlock { 0; 1; 2; 3; }
byIndices = IndexGroup.ByIndices(a=code_block_2.out0, b=code_block_2.out1, c=code_block_2.out2, d=code_block_2.out3)
byPointsIndexGroups = Mesh.ByPointsIndexGroups(points=endPoint, indexGroups=byIndices)
code_block_3 = CodeBlock { 8; }
byOrigin = CoordinateSystem.ByOrigin(x=code_block_3, y=code_block_3)
code_block_4 = CodeBlock { 5; }
byWidthLength_2 = Rectangle.ByWidthLength(coordinateSystem=byOrigin, width=code_block_4, length=code_block_4)
explode_2 = Geometry.Explode(geometry=byWidthLength_2)
endPoint_2 = Curve.EndPoint(curve=explode_2)
code_block_5 = CodeBlock { 0; 1; 2; 3; }
byIndices_2 = IndexGroup.ByIndices(a=code_block_5.out0, b=code_block_5.out1, c=code_block_5.out2, d=code_block_5.out3)
byPointsIndexGroups_2 = Mesh.ByPointsIndexGroups(points=endPoint_2, indexGroups=byIndices_2)
list_create = List.Create(item0=byPointsIndexGroups, item1=byPointsIndexGroups_2, item2=byPointsIndexGroups_2)
watch_3d = Watch3D(list_create)
code_block_6 = CodeBlock(x=watch_3d) { x[0]; }
toTkMesh = Custom[Mesh.ToTkMesh](mesh=code_block_6)  # Converts a Dynamo mesh to a toolkit mesh. You obviously need to have the appropriate version of the mesh toolkit package downloaded first.
watch = Watch(toTkMesh)
code_block_7 = CodeBlock()  # frozen; unwired: mesh
# ---------- code_block_7.designscript (53 lines) ----------
// function to convert a quad (4 points) into two tri-meshes
def QuadToTrianglesVP(vp)
{
    // mesh vertex positions are points
    // we need to convert 1 list of 4 points into
    // 2 lists of 3 points, this translation should work
    vps = List.GetItemAtIndex(vp@L2<1>, 0);
    // so for each mesh passed in, we get it's points and reorder
    // we return lists of the 0 points, 1 points etc.
    vp1 = List.GetItemAtIndex(vps@L2<1>, 0);
    vp2 = List.GetItemAtIndex(vps@L2<1>, 1);
    vp3 = List.GetItemAtIndex(vps@L2<1>, 2);
    vps1 = [vp1, vp2, vp3];

    vp4 = List.GetItemAtIndex(vp@L2<1>, 0);
    vp5 = List.GetItemAtIndex(vp@L2<1>, 2);
    vp6 = List.GetItemAtIndex(vp@L2<1>, 3);
    vps2 = [vp4, vp5, vp6];

    // we transpose to give us the points for each mesh
    // in their own sub list
    vpt1 = List.Flatten(List.Transpose(vps1));
    vpt2 = List.Flatten(List.Transpose(vps2));

    // these are now the 2 tri-meshes from the quad
    vpLots = [vpt1, vpt2];

    return vps1;
};

def QuadToTrianglesFi(fi)
{
    // face indices are the number we want to place
    // tk meshes are only tri-face, so we don't want
    // a list containing 4... we just need as many lists
    // of 3 as we are providing points for.
    // the translation from 4 to 3 is primarily governed by
    // the point position
    fif = List.Flatten(fi,1);
    fifT = List.Transpose([fif.A, fif.B, fif.C]);
    return fifT;
};
// simple function to deal with 3 points, returning consitantly
// with the other function

vp = mesh.VertexPositions;
fi = DSCore.List.Flatten(mesh.FaceIndices);
// if it's a quad it's not a straight translation
// we'll need to break it down
hasQuad = fi.D != null;
verts = QuadToTrianglesVP(vp);
inds  = List.Flatten(QuadToTrianglesFi(fi),1);
tkMesh = Dynamo.Mesh.ByVerticesAndIndices(verts@L2<1>, inds@L2<1>);
# ----------------------------------------
watch_3d_2 = Watch3D(toTkMesh)
watch_2 = Watch()  # unwired: arg0
watch_3 = Watch()  # unwired: arg0
watch_3d_3 = Watch3D()  # unwired: arg0
watch_3d_4 = Watch3D()  # unwired: arg0
code_block_8 = CodeBlock(x=code_block_6) { x[0]; }
code_block_9 = CodeBlock(m1=code_block_8)
# ---------- code_block_9.designscript (8 lines) ----------
m = List.GetItemAtIndex(m1, 0);
fi = List.GetItemAtIndex(List.GetItemAtIndex(m.FaceIndices, 0), 0);
vp = m.VertexPositions;

tri1 = [fi.A, fi.B, fi.C];
tri2 = [fi.A, fi.C, fi.D];

tkMesh = Dynamo.Mesh.ByVerticesAndIndices(vp, [tri1, tri2]);
# ----------------------------------------
watch_4 = Watch(code_block_9.m)
watch_5 = Watch(code_block_9.fi)
watch_6 = Watch(code_block_9.tri2)
watch_7 = Watch(code_block_9.tri1)
watch_8 = Watch(code_block_9.tkMesh)
watch_9 = Watch(code_block_9.vp)
byPointsIndexGroups_3 = Mesh.ByPointsIndexGroups()  # unwired: points, indexGroups
byVerticesAndIndices = Autodesk.Dynamo.MeshToolkit.Mesh.ByVerticesAndIndices()  # unwired: vertices, indices
