# Dynamo graph ExportPyScripts.dyn (Dynamo 2.0.3.8810)

string = StringInput("C:\Users\dev-dt\AppData\Roaming\Dynamo\Dynamo Revit\2.0\packages\spring nodes\dyf")
directory_from_path = DirectoryObject(path=string)
string_2 = StringInput("*.dyf")
getDirectoryContents = FileSystem.GetDirectoryContents(directory=directory_from_path, searchString=string_2)
properties = Custom[CustomNode.Properties](path=getDirectoryContents.files)  # Extracts information from a custom node.
isEmpty = List.IsEmpty(list=properties.PythonScripts, lacing=Longest)
not_ = Not(x=isEmpty)
filterByBoolMask = List.FilterByBoolMask(list=properties.Name, mask=not_)
code_block = CodeBlock { " "; }
ꟿ_string_rightsplitonce = Custom[ꟿ String.RightSplitOnce](str=filterByBoolMask.in, splitChar=code_block)  # Gets the tail of a string
code_block_2 = CodeBlock(name=ꟿ_string_rightsplitonce) { name + ".py"; }
string_3 = StringInput("E:\GitHub\SpringNodes\py")
combinePath = FileSystem.CombinePath(path0=string_3)  # unwired: path1
map = List.Map(list=code_block_2, f_x=combinePath)
filterByBoolMask_2 = List.FilterByBoolMask(list=properties.PythonScripts, mask=not_)
firstItem = List.FirstItem(list=filterByBoolMask_2.in, lacing=Longest)
writeText = FileSystem.WriteText(filePath=map, text=firstItem, lacing=Longest)
