# Dynamo graph ExtractPythonScripts.dyn (Dynamo 4.0.0.3277)
# packages: Clockwork for Dynamo 2.x 2.12.2

# group: Extract Python Scripts
# note: This graph parses each *.dyf file in a given directory and extracts all Python scripts within that file into a subdirectory. Previous Pythons script files in that directory will be deleted.
# I am using this in order to keep the Python documentation of my custom nodes more accessible.

# group: INPUTS
directory_path = Directory("C:\Me\CODE\Github\SpringNodes\py")  # graph input
directory_path_2 = Directory("C:\Me\CODE\Github\SpringNodes\Nodes")  # graph input

# group: Delete previous *.py files
file_extension = CodeBlock { "*.py"; }
getDirectoryContents = FileSystem.GetDirectoryContents(directory=directory_path, searchString=file_extension)
deleteFile = FileSystem.DeleteFile(path=getDirectoryContents.files)
passthrough = Custom[Passthrough](passThrough=directory_path, waitFor=deleteFile)  # package Clockwork for Dynamo 2.x; Forces a sequential order of execution. The node wired into the output of the Passthrough node will be executed *after* the node wired into the waitFor input (e.g. important for some Revit operations). The value of the passThrough input will be passed on to the node wired into the output port of the Passthrough node.

# group: Browse directory
fromPath = DirectoryObject(path=directory_path_2)  # "Directory.FromPath"
file_extension_2 = CodeBlock { "*.dyf"; }
getDirectoryContents_2 = FileSystem.GetDirectoryContents(directory=fromPath, searchString=file_extension_2)

# group: Extract Python scripts
info = Custom[CustomNode.Info](path=getDirectoryContents_2.files)  # package Clockwork for Dynamo 2.x; Extracts information from a custom node.
isNotEmpty = Custom[List.IsNotEmpty](seq=info.PythonScripts@L2)  # package Clockwork for Dynamo 2.x; Just the inversion of the built-in Is Empty List node.
filterByBoolMask = List.FilterByBoolMask(list=info.PythonScripts, mask=isNotEmpty)
# note: If a custom node contains more than one Python script, concatenate them with a custom delimiter
string = StringInput("\n\n##### NEXT PYTHON NODE #####\n\n")  # graph input
join = String.Join(separator=string)  # unwired: string0
map = List.Map(list=filterByBoolMask.in, function=join)
flatten = List.Flatten(list=map)

# group: Create new *.py files
# note: Filter out all files that do not contain Python scripts
filterByBoolMask_2 = List.FilterByBoolMask(list=getDirectoryContents_2.files, mask=isNotEmpty)
boolean = BoolSelector(false)  # graph input
fileName = FileSystem.FileName(path=filterByBoolMask_2.in, withExtension=boolean)
code_block = CodeBlock(dir=passthrough, filename=fileName) { dir + "\\" + filename + ".py"; }
writeText = FileSystem.WriteText(filePath=code_block, text=flatten)
