# Dynamo custom node FloorType.Duplicate.dyf (Dynamo 0.8.2.2392)
# category: SpringNodes.Revit.ElementTypes
# Attemts to create duplicate floor types. If the floor type exists, it is appended to the end. Sets only the structural width of the floor. The width must be in feet.

floor_type = Input()
name_s = Input()  # "name(s)"
width_s_InFeet = Input()  # "width(s)InFeet"
python_script = Python(IN[0]=floor_type, IN[1]=name_s, IN[2]=width_s_InFeet)
# ---------- python_script.python (46 lines) ----------
#Copyright(c) 2016, Dimitar Venkov
# @5devene, dimitar.ven@gmail.com

import clr
clr.AddReference('ProtoGeometry')
from Autodesk.DesignScript.Geometry import *

clr.AddReference("RevitServices")
import RevitServices
from RevitServices.Persistence import DocumentManager
from RevitServices.Transactions import TransactionManager
doc = DocumentManager.Instance.CurrentDBDocument

clr.AddReference("RevitNodes")
import Revit
clr.ImportExtensions(Revit.Elements)

def tolist(obj1):
	if hasattr(obj1,"__iter__"): return obj1
	else: return [obj1]

def output1(l1):
	if len(l1) == 1: return l1[0]
	else: return l1

fs = UnwrapElement(IN[0])
names = tolist(IN[1])
width = tolist(IN[2])
nfs = []

TransactionManager.Instance.EnsureInTransaction(doc)
for i in xrange(len(names)):
	try:
		try:
			x = fs.Duplicate(str(names[i]))
			cs = x.GetCompoundStructure()
			ind = cs.StructuralMaterialIndex
			cs.SetLayerWidth(ind,width[i])
			x.SetCompoundStructure(cs)
			nfs.append(x.ToDSType(False))
		except:
			nfs.append(Revit.Elements.FloorType.ByName(str(names[i])))
	except:
		nfs.append(None)
TransactionManager.Instance.TransactionTaskDone()
OUT = output1(nfs)
# ----------------------------------------
FloorType = Output(python_script)
