# Dynamo custom node Input.Wait.dyf (Dynamo 0.8.2.2392)
# category: SpringNodes.SmartCopyMon
# Waits for all inputs to be completed before continuing the execution process.Part of the SmartCopyMon workflow.

WaitForMe = Input()
identity = Object.Identity(WaitForMe)
Output = Input()
identity_2 = Object.Identity(Output)
Output_2 = Output(identity_2)  # "Output"
