# Dynamo custom node List.DropLast.dyf (Dynamo 0.8.2.2392)
# category: SpringNodes.Lists
# Removes the last value of the list.

list = Input(list:var[])
code_block = CodeBlock(l1=list) { List.DropItems(l1,-1); }
list_2 = Output(code_block)  # "list"
