# Dynamo custom node Object.Class.dyf (Dynamo 0.8.2.2392)
# category: SpringNodes.Core
# Gets the input object's class name. Can process lists.

obj = Input()
python_script = Python(IN[0]=obj)
# ---------- python_script.python (14 lines) ----------
#Copyright(c) 2016, Dimitar Venkov
# @5devene, dimitar.ven@gmail.com

import clr

item = IN[0]
if hasattr(item, "__iter__"):
	out1 = [item[i].GetType().ToString() for i in xrange(len(item)) if item[i] != None]
	OUT = out1, item.GetType().ToString()
else:
	if item != None:
		OUT = item.GetType().ToString(), "N/A"
	else:
		OUT = None, "N/A"
# ----------------------------------------
code_block = CodeBlock(c=python_script) { c[0]; c[1]; }
class_str = Output(code_block.out0)  # "class(str)"
container = Output(code_block.out1)
