# Dynamo custom node DirectShape.ByGeometry(SAT).dyf (Dynamo 0.8.2.2392)
# category: SpringNodes.Revit.DirectShape
# Attempts to create a DirectShape element inside the Revit document.  It is based on an alternative process that uses a SAT inport and can produce smooth surfaces. Each created DS will have a unique type. Make sure that each input geometry has a unique name. You can either feed a single category for all geometries or a unique category for each geometry. This node works in millimeters.

geometry = Input()
category = Input()
name = Input()
python_script = Python(IN[0]=geometry, IN[1]=category, IN[2]=name)
# ---------- python_script.python (87 lines) ----------
#Copyright(c) 2015, Dimitar Venkov
# @5devene, dimitar.ven@gmail.com

import clr
import System
from System.Collections.Generic import *

clr.AddReference('ProtoGeometry')
from Autodesk.DesignScript.Geometry import *

clr.AddReference("RevitServices")
import RevitServices
from RevitServices.Persistence import DocumentManager
from RevitServices.Transactions import TransactionManager
doc = DocumentManager.Instance.CurrentDBDocument

clr.AddReference("RevitNodes")
import Revit
clr.ImportExtensions(Revit.Elements)
clr.ImportExtensions(Revit.GeometryConversion)

clr.AddReference("RevitAPI")
from Autodesk.Revit.DB import *

def tolist(obj1):
	if hasattr(obj1,"__iter__"): return obj1
	else: return [obj1]

def output1(l1):
	if len(l1) == 1: return out1[0]
	else: return l1

def NewDS(s1,cat,name1):
	message = None
	temp_path = System.IO.Path.GetTempPath()
	sat_path = temp_path + name1 + ".sat"
	try: sat1 = Geometry.ExportToSAT(s1, sat_path, 1000)
	except: message = "No write access to temp folder"
	satOpt = SATImportOptions()
	satOpt.Placement = ImportPlacement.Origin
	satOpt.Unit = ImportUnit.Millimeter
	try: satId = doc.Import(sat1, satOpt, doc.ActiveView)
	except: message = "Please switch to a model view"
	opt1 = Options()
	opt1.ComputeReferences = True
	el1 = doc.GetElement(satId)
	geom1 = el1.get_Geometry(opt1)
	enum = geom1.GetEnumerator()
	enum.MoveNext()
	geom2 = enum.Current.GetInstanceGeometry()
	enum2 = geom2.GetEnumerator()
	enum2.MoveNext()
	s1 = enum2.Current
	doc.Delete(satId)
	System.IO.File.Delete(sat_path)
	if message == None:
		try:
			dsType1 = DirectShapeType.Create(doc, name1, cat.Id)
			dsType1.SetShape([s1])
			dsLib = DirectShapeLibrary.GetDirectShapeLibrary(doc)
			dsType1_LibId = dsType1.Id.ToString()
			dsLib.AddDefinitionType(dsType1_LibId, dsType1.Id)
			tf1 = Transform.Identity
			ds1 =  DirectShape.CreateElementInstance(doc, dsType1.Id, cat.Id, dsType1_LibId, tf1, "Dynamo","")
			ds1.SetTypeId(dsType1.Id)
			return ds1.ToDSType(False)
		except:
			return []
	else:
		return message

solids = tolist(IN[0])
cat = UnwrapElement(tolist(IN[1]))
names = tolist(IN[2])

if len(solids) == len(cat) == len(names):
	TransactionManager.Instance.EnsureInTransaction(doc)
	out1 = map(NewDS,solids,cat,names)
	OUT = output1(out1)
	TransactionManager.Instance.TransactionTaskDone()
elif len(cat) == 1 and len(solids) == len(names) > 1:
	TransactionManager.Instance.EnsureInTransaction(doc)
	out1 = [NewDS(s, cat[0], n) for s, n in zip(solids, names)]
	OUT = output1(out1)
	TransactionManager.Instance.TransactionTaskDone()
else:
	OUT = "Please provide a unique name\nfor each geometry object"
# ----------------------------------------
DirectShape = Output(python_script)
