# Dynamo custom node 270915_DirectShape.ByGeometry.dyf "DirectShape.ByGeometry" (Dynamo 0.8.2.2392)
# category: SpringNodes.Revit.DirectShape
# Attempts to create a DirectShape element inside the Revit document. It is based on an alternative process that uses a SAT inport and can produce smooth surfaces.

geometry = Input()
category = Input(category:Category)
name = Input(name:string = "Dynamo object")
python_script = Python(IN[0]=geometry, IN[1]=category, IN[2]=name)
# ---------- python_script.python (52 lines) ----------
#Copyright(c) 2015, Dimitar Venkov
# @5devene, dimitar.ven@gmail.com

import clr

clr.AddReference("RevitServices")
import RevitServices
from RevitServices.Persistence import DocumentManager
from RevitServices.Transactions import TransactionManager
doc = DocumentManager.Instance.CurrentDBDocument

clr.AddReference("RevitNodes")
import Revit
clr.ImportExtensions(Revit.Elements)
clr.ImportExtensions(Revit.GeometryConversion)

clr.AddReference("RevitAPI")
#import Autodesk
from Autodesk.Revit.DB import *

clr.AddReference("System")
import System
from System.Collections.Generic import *

_solid_ = IN[0]
cat = UnwrapElement(IN[1])
name1 = IN[2]
el1 = UnwrapElement(Revit.Elements.ImportInstance.ByGeometry(_solid_))
TransactionManager.Instance.EnsureInTransaction(doc)
trans = SubTransaction(doc)
trans.Start()
opt1 = Options()
opt1.ComputeReferences = True
geom1 = el1.get_Geometry(opt1)
enum = geom1.GetEnumerator()
enum.MoveNext()
geom2 = enum.Current.GetInstanceGeometry()
enum2 = geom2.GetEnumerator()
enum2.MoveNext()
s1 = enum2.Current
ds1 = DirectShape.CreateElement(doc,cat.Id,"Dynamo","")
if ds1.IsValidGeometry(s1):
	dsType1 = DirectShapeType.Create(doc, "Type %s" %name1, cat.Id)
	ds1.SetShape([s1])
	ds1.SetName(name1)
	ds1.SetTypeId(dsType1.Id)
	OUT = ds1.ToDSType(False)
trans.Commit()
trans.Start()
doc.Delete(el1.Id)
trans.Commit()
TransactionManager.Instance.TransactionTaskDone()
# ----------------------------------------
DirectShape = Output(python_script)
