# Dynamo custom node FamilyInstance.ByGeometry_82.6.1.dyf "FamilyInstance.ByGeometry" (Dynamo 0.8.2.2392)
# category: SpringNodes.BETA
# You must provide a valid family template path that will be used for all input geometry objects. The project units(and not the templates) will be used to determine the size of the output geometry.
# The provided category will be used only if the family template supports it. If not, the default template category will be used instead.
# Likewise, the family material(provided as a string) will be set only if a material with that name exists in the template. If not, the default material will be used instead ("By Category").
# For void cuts, the material settings will be ignored.
# The output is the resulting family and an instance aligned according to the project document's origin.
# The node expects a unique family name for each geometry object. The rest of the input lists will be processed as if the node lacing is set to longest.

geometry = Input()
family_template_path = Input()
family_name = Input()
category = Input(category:var[]..[] = Category.ByName("OST_GenericModel"))
material_name = Input(material_name:var[]..[] = "None")
isVoid = Input(isVoid:var[]..[] = false)
python_script = Python(IN[0]=geometry, IN[1]=family_template_path, IN[2]=family_name, IN[3]=category, IN[4]=material_name, IN[5]=isVoid)
# ---------- python_script.python (256 lines) ----------
#Copyright(c) 2015, Dimitar Venkov
# @5devene, dimitar.ven@gmail.com

import clr
import System
from System.Collections.Generic import *

pf_path = System.Environment.GetFolderPath(System.Environment.SpecialFolder.ProgramFilesX86)
import sys
sys.path.append("%s\IronPython 2.7\Lib" %pf_path)
import traceback

clr.AddReference('ProtoGeometry')
from Autodesk.DesignScript.Geometry import *

clr.AddReference("RevitServices")
import RevitServices
from RevitServices.Persistence import DocumentManager
from RevitServices.Transactions import TransactionManager
doc = DocumentManager.Instance.CurrentDBDocument
app = DocumentManager.Instance.CurrentUIApplication.Application

clr.AddReference("RevitAPI")
from Autodesk.Revit.DB import *
from Autodesk.Revit.DB.Structure import StructuralType

clr.AddReference("RevitNodes")
import Revit
clr.ImportExtensions(Revit.Elements)
clr.ImportExtensions(Revit.GeometryConversion)

def tolist(obj1):
	if hasattr(obj1,"__iter__"): return obj1
	else: return [obj1]

def output1(l1):
	if len(l1) == 1: return l1[0]
	else: return l1

def PadLists(lists):
	len1 = max([len(l) for l in lists])
	for i in xrange(len(lists)):
		if len(lists[i]) == len1:
			continue
		else:
			len2 = len1 - len(lists[i])
			for j in xrange(len2):
				lists[i].append(lists[i][-1])
	return lists

class FamOpt1(IFamilyLoadOptions):
	def __init__(self):
		pass
	def OnFamilyFound(self,familyInUse, overwriteParameterValues):
		return True
	def OnSharedFamilyFound(self,familyInUse, source, overwriteParameterValues):
		return True

geom = tolist(IN[0])
fam_path = IN[1]
names = tolist(IN[2])
category = tolist(IN[3])
material = tolist(IN[4])
isVoid = tolist(IN[5])

isRvt2014 = False
if app.VersionName == "Autodesk Revit 2014": isRvt2014 = True
units = doc.GetUnits().GetFormatOptions(UnitType.UT_Length).DisplayUnits
factor = UnitUtils.ConvertToInternalUnits(1,units)
acceptable_views = ["ThreeD", "FloorPlan", "EngineeringPlan", "CeilingPlan", "Elevation", "Section"]
origin = XYZ(0,0,0)
str_typ = StructuralType.NonStructural

def NewForm_background(s1, name1, cat1, isVoid1, mat1):
	t1 = TransactionManager.Instance
	TransactionManager.ForceCloseTransaction(t1)
	famdoc = doc.Application.NewFamilyDocument(fam_path)
	message = None
	temp_path = System.IO.Path.GetTempPath()
	sat_path = "%s%s.sat" % (temp_path, name1)
	try:
		if factor != 1:
			s1 = s1.Scale(factor)
		sat1 = Geometry.ExportToSAT(s1, sat_path)
		satOpt = SATImportOptions()
		satOpt.Placement = ImportPlacement.Origin
		satOpt.Unit = ImportUnit.Foot
		view_fec = FilteredElementCollector(famdoc).OfClass(View)
		view1 = None
		for v in view_fec:
			if str(v.ViewType) in acceptable_views:
				view1 = v
				break
		t1.EnsureInTransaction(famdoc)
		satId = famdoc.Import(sat1, satOpt, view1)
		opt1 = Options()
		opt1.ComputeReferences = True
		el1 = famdoc.GetElement(satId)
		geom1 = el1.get_Geometry(opt1)
		enum = geom1.GetEnumerator()
		enum.MoveNext()
		geom2 = enum.Current.GetInstanceGeometry()
		enum2 = geom2.GetEnumerator()
		enum2.MoveNext()
		s1 = enum2.Current
		famdoc.Delete(satId)
		TransactionManager.ForceCloseTransaction(t1)
		System.IO.File.Delete(sat_path)
	except:
		message = traceback.format_exc()
		pass
	if message == None:
		try:
			save_path = "%s%s.rfa" % (temp_path, name1)
			SaveAsOpt = SaveAsOptions()
			SaveAsOpt.OverwriteExistingFile = True
			t1.EnsureInTransaction(famdoc)
			#set the category
			try:
				fam_cat = famdoc.Settings.Categories.get_Item(cat1.Name)
				famdoc.OwnerFamily.FamilyCategory = fam_cat
			except: pass
			s2 = FreeFormElement.Create(famdoc,s1)
			if isVoid1:
				void_par = s2.get_Parameter("Solid/Void")
				void_par.Set(1)
				void_par2 = famdoc.OwnerFamily.get_Parameter("Cut with Voids When Loaded")
				void_par2.Set(1)
			else: #voids do not have a material value
				try:
					mat_fec = FilteredElementCollector(famdoc).OfClass(Material)
					for m in mat_fec:
						if m.Name == mat1:
							fam_mat = m
							break
					mat_par = s2.get_Parameter("Material")
					mat_par.Set(fam_mat.Id)
				except: pass
			TransactionManager.ForceCloseTransaction(t1)
			famdoc.SaveAs(save_path, SaveAsOpt)
			family1 =  famdoc.LoadFamily(doc, FamOpt1())
			famdoc.Close(False)
			System.IO.File.Delete(save_path)
			symbols = family1.Symbols.GetEnumerator()
			symbols.MoveNext()
			symbol1 = symbols.Current
			t1.EnsureInTransaction(doc)
			if not symbol1.IsActive: symbol1.Activate()
			inst1 = doc.Create.NewFamilyInstance(origin, symbol1, str_typ)
			TransactionManager.ForceCloseTransaction(t1)
			return inst1.ToDSType(False), family1.ToDSType(False)
		except:
			message = traceback.format_exc()
			return message
	else:
		return message

def NewForm_background_R16(s1, name1, cat1, isVoid1, mat1):
	t1 = TransactionManager.Instance
	TransactionManager.ForceCloseTransaction(t1)
	famdoc = doc.Application.NewFamilyDocument(fam_path)
	message = None
	temp_path = System.IO.Path.GetTempPath()
	sat_path = "%s%s.sat" % (temp_path, name1)
	try:
		if factor != 1:
			s1 = s1.Scale(factor)
		sat1 = Geometry.ExportToSAT(s1, sat_path)
		satOpt = SATImportOptions()
		satOpt.Placement = ImportPlacement.Origin
		satOpt.Unit = ImportUnit.Foot
		view_fec = FilteredElementCollector(famdoc).OfClass(View)
		view1 = None
		for v in view_fec:
			if str(v.ViewType) in acceptable_views:
				view1 = v
				break
		t1.EnsureInTransaction(famdoc)
		satId = famdoc.Import(sat1, satOpt, view1)
		opt1 = Options()
		opt1.ComputeReferences = True
		el1 = famdoc.GetElement(satId)
		geom1 = el1.get_Geometry(opt1)
		enum = geom1.GetEnumerator()
		enum.MoveNext()
		geom2 = enum.Current.GetInstanceGeometry()
		enum2 = geom2.GetEnumerator()
		enum2.MoveNext()
		s1 = enum2.Current
		famdoc.Delete(satId)
		TransactionManager.ForceCloseTransaction(t1)
		System.IO.File.Delete(sat_path)
	except:
		message = traceback.format_exc()
		pass
	if message == None:
		try:
			save_path = "%s%s.rfa" % (temp_path, name1)
			SaveAsOpt = SaveAsOptions()
			SaveAsOpt.OverwriteExistingFile = True
			t1.EnsureInTransaction(famdoc)
			#set the category
			try:
				fam_cat = famdoc.Settings.Categories.get_Item(cat1.Name)
				famdoc.OwnerFamily.FamilyCategory = fam_cat
			except: pass
			s2 = FreeFormElement.Create(famdoc,s1)
			if isVoid1:
				void_par = s2.LookupParameter("Solid/Void")
				void_par.Set(1)
				void_par2 = famdoc.OwnerFamily.LookupParameter("Cut with Voids When Loaded")
				void_par2.Set(1)
			else: #voids do not have a material value
				try:
					mat_fec = FilteredElementCollector(famdoc).OfClass(Material)
					for m in mat_fec:
						if m.Name == mat1:
							fam_mat = m
							break
					mat_par = s2.LookupParameter("Material")
					mat_par.Set(fam_mat.Id)
				except: pass
			TransactionManager.ForceCloseTransaction(t1)
			famdoc.SaveAs(save_path, SaveAsOpt)
			family1 =  famdoc.LoadFamily(doc, FamOpt1())
			famdoc.Close(False)
			System.IO.File.Delete(save_path)
			symbols = family1.GetFamilySymbolIds().GetEnumerator()
			symbols.MoveNext()
			symbol1 = doc.GetElement(symbols.Current)
			t1.EnsureInTransaction(doc)
			if not symbol1.IsActive: symbol1.Activate()
			inst1 = doc.Create.NewFamilyInstance(origin, symbol1, str_typ)
			TransactionManager.ForceCloseTransaction(t1)
			return inst1.ToDSType(False), family1.ToDSType(False)
		except:
			message = traceback.format_exc()
			return message
	else:
		return message

if len(geom) == len(names) == len(category) == len(isVoid) == len(material):
	if isRvt2014:
		OUT = output1(map(NewForm_background, geom, names, category, isVoid, material))
	else:
		OUT = output1(map(NewForm_background_R16, geom, names, category, isVoid, material))
elif len(geom) == len(names):
	padded = PadLists((geom, category, isVoid, material))
	p_category = padded[1]
	p_isVoid = padded[2]
	p_material = padded[3]
	if isRvt2014:
		OUT = output1(map(NewForm_background, geom, names, p_category, p_isVoid, p_material))
	else:
		OUT = output1(map(NewForm_background_R16, geom, names, p_category, p_isVoid, p_material))
else: OUT = "Make sure that each geometry\nobject has a unique family name."
# ----------------------------------------
code_block = CodeBlock(res=python_script) { inst = List.FirstItem(res<1>); fam = secondItem(res); }
instance = Output(code_block.inst)
family = Output(code_block.fam)
code_block_2 = CodeBlock()
# ---------- code_block_2.designscript (3 lines) ----------
def secondItem(l1:var[]){
return = l1[1];
};
# ----------------------------------------
