# Dynamo custom node LevelAbove.dyf (Dynamo 0.7.6.4256)
# category: SpringNodes.Revit.Levels
# Selects the level lying directly above the input level

categories = Categories("Levels")
all_elements_of_category = ElementsOfCategory(categories)
elevation = Level.Elevation()
level = Input()
code_block = CodeBlock(ll=all_elements_of_category, key1=elevation, ilevel=level)
# ---------- code_block.designscript (5 lines) ----------
levels1 = SortByKey(ll,key1);
le1 = levels1.Elevation;
ind = ilevel.Elevation;
ind2 = IndexOf(le1,ind) + 1;
List.GetItemAtIndex(levels1,ind2);
# ----------------------------------------
level_above = Output(code_block.out4)
