# Dynamo custom node Wall.IsFlipped.dyf (Dynamo 0.7.6.4190)
# category: SpringNodes.Revit.Walls
# Checks if the wall was flipped.

Walls = Input()
code_block = CodeBlock(w=Walls) { Flatten({w}); }
python_script = Python(IN[0]=code_block)
# ---------- python_script.python (5 lines) ----------
walls = UnwrapElement(IN[0])
res = []
for w in walls:
	res.append(w.Flipped)
OUT = res
# ----------------------------------------
Bool = Output(python_script)
