# Dynamo custom node ConnectLooseCurves.dyf (Dynamo 0.8.3.2256)
# category: SpringNodes.Geometry
# Orders and connects a list of disconnected curves lying on the XY plane into a PolyCurve

curve_list = Input()
threshold = Input()
code_block = CodeBlock(cr1=curve_list, th1=threshold) { result = process(cr1,th1); List.GetItemAtIndex(result<1>,0); List.GetItemAtIndex(result<1>,1); }
ordered_curves = Output(code_block.out1)
code_block_2 = CodeBlock()
# ---------- code_block_2.designscript (7 lines) ----------
def FarEnd(l1,p1)
{
lpts = {l1.StartPoint,l1.EndPoint};
dist = p1.DistanceTo(lpts);
ind1 = IndexOf(dist,List.MaximumItem(dist));
return = lpts[ind1];
};
# ----------------------------------------
code_block_3 = CodeBlock()
# ---------- code_block_3.designscript (11 lines) ----------
def ClosedCase(cr1:var[])
{
sortedc = OrderCurves(cr1);
cl1 = List.AddItemToEnd(sortedc[0],sortedc);
cl2 = List.Sublists(cl1,0..1,1);
cl3 = List.DropItems(cl2,-1);
cl4 = List.Transpose(cl3);
ptl1 = Flatten(cl4[0].Intersect(cl4[1]));
pc1 = PolyCurve.ByPoints(ptl1,true);
return = pc1.Curves();
};
# ----------------------------------------
code_block_4 = CodeBlock()
# ---------- code_block_4.designscript (26 lines) ----------
def OrderCurves(s1:var[])
{
return = [Imperative]
{
list1 = {s1[0]};
s1 = List.RestOfItems(s1);
i = 0;
while (Count(s1) > 1)
{
mask = list1[i].DoesIntersect(s1);
i = i + 1;
x1 = List.FilterByBoolMask(s1,mask)["in"];
if (List.IsEmpty(x1))
{
break;
}
list1[i] = x1[0];
s1 = List.FilterByBoolMask(s1,mask)["out"];
if (x1[1] != null)
{
s1 = List.AddItemToEnd(x1[1],s1);
}
}
return = List.AddItemToEnd(s1[0],list1);
}
};
# ----------------------------------------
code_block_5 = CodeBlock()
# ---------- code_block_5.designscript (9 lines) ----------
def Reorder1(l1:var[],l2:var[])
{
m1 = l1.PointAtParameter(0.5);
m2 = l2.PointAtParameter(0.5);
dist1 = m2<1>.DistanceTo(m1<2>);
minval = List.MinimumItem(dist1<1>);
newind = IndexOf(dist1<1>,minval<1>);
return = Reorder(l1,newind);
};
# ----------------------------------------
code_block_6 = CodeBlock()
# ---------- code_block_6.designscript (13 lines) ----------
def OpenCase(cl1:var[],th1)
{
sortedc = OrderCurves(cl1);
pts1 = Flatten(sortedc<1>.Intersect(sortedc<2>));
pts2 = RemoveIfNot(pts1,"Point");
pts3 = Point.PruneDuplicates(pts2,0.0001);
origcr = sortedc.ExtendStart(-th1).ExtendEnd(-th1);
fpt = FarEnd(origcr[0],pts3[0]);
lpt = FarEnd(origcr[-1], pts3[-1]);
pts4 = Flatten({fpt,pts3,lpt});
pc1 = PolyCurve.ByPoints(pts4);
return = pc1.Curves();
};
# ----------------------------------------
code_block_7 = CodeBlock()
# ---------- code_block_7.designscript (16 lines) ----------
def oldif(test,
iftrue:var[]..[],
iffalse:var[]..[])
{
return = [Imperative]
{
if (test)
{
return = iftrue;
}
else
{
return = iffalse;
}
}
};
# ----------------------------------------
code_block_8 = CodeBlock()
# ---------- code_block_8.designscript (17 lines) ----------
def process(cr1:var[],th1)
{
cr2 = cr1.ExtendStart(th1).ExtendEnd(th1);
int1 = cr2<1>.DoesIntersect(cr2<2>);
check1 = CountTrue(int1<1>);
startind0 = IndexOf(check1,2);
isclosed = startind0 == -1 ? true : false;
startind = isclosed ? 0 : startind0;
cr3 = List.ShiftIndices(cr2,-startind);
result = oldif(isclosed, ClosedCase(cr3),
OpenCase(cr3,th1));
outtest = Count(cr1) > 1 && Count(cr1) ==
Count(result) && AllTrue(result != null);
out1 = oldif(outtest, result, cr1);
out2 = Reorder1(out1,cr1);
return = {out1,out2};
};
# ----------------------------------------
preserved_order = Output(code_block.out2)
