# Dynamo graph DS_test all categories(dangerous).dyn (Dynamo 0.8.2.2392)

python_script = Python()
# ---------- python_script.python (24 lines) ----------
#Copyright(c) 2015, Dimitar Venkov
# @5devene, dimitar.ven@gmail.com

import clr

clr.AddReference("RevitServices")
import RevitServices
from RevitServices.Persistence import DocumentManager
doc = DocumentManager.Instance.CurrentDBDocument

clr.AddReference("RevitNodes")
import Revit
clr.ImportExtensions(Revit.Elements)

out1 = []

all_cats = doc.Settings.Categories
names = [c.Name for c in all_cats]
names = sorted(names)
names1 = [("OST_" + n).replace(" ", "") for n in names]
for n in names1:
	try: out1.append(Revit.Elements.Category.ByName(n))
	except: pass
OUT = out1
# ----------------------------------------
name = Category.Name(python_script)
code_block = CodeBlock(cat=python_script) { v1 = Vector.ByCoordinates(3500 * GetKeys(cat),0); c1 = Cuboid.ByLengths(3000,3000,3000); c1.Translate(v1); }
byGeometry = Custom[DirectShape.ByGeometry](category=python_script, name=name, geometry=code_block.out2)  # Attempts to create a DirectShape element inside the Revit document. It is based on an alternative process that uses a SAT inport and can produce smooth surfaces. Each created DS will have a unique type. Make sure that each input geometry has a unique name. You can either feed a single category for all geometries or a unique category for each geometry.
watch = Watch(byGeometry)
code_block_2 = CodeBlock()  # //all document categories
categories = Categories("GenericModel")
