# Dynamo custom node TessellatedShape.ByGeometryMaterial.dyf "TessellatedDirectShape.ByGeometryMaterial" (Dynamo 0.8.3.2564)
# category: SpringNodes.Revit.DirectShape
# Creates a tessellated DirectShape element inside the Revit document.

Solid = Input()
Category = Input()
Name = Input()
Material = Input()
python_script = Python(IN[0]=Solid, IN[1]=Category, IN[2]=Name, IN[3]=Material)
# ---------- python_script.python (73 lines) ----------
import clr

clr.AddReference("RevitServices")
import RevitServices
from RevitServices.Persistence import DocumentManager
from RevitServices.Transactions import TransactionManager
doc = DocumentManager.Instance.CurrentDBDocument

clr.AddReference("RevitNodes")
import Revit
clr.ImportExtensions(Revit.Elements)
clr.ImportExtensions(Revit.GeometryConversion)

clr.AddReference("RevitAPI")
import Autodesk
from Autodesk.Revit.DB import DirectShape, PlanarFace, TessellatedFace, TessellatedShapeBuilder, XYZ, ElementId

clr.AddReference("System")
import System
from System.Collections.Generic import *

_solid_ = UnwrapElement(IN[0])
cat = UnwrapElement(IN[1])
name1 = IN[2]
mat = UnwrapElement(IN[3])

TransactionManager.Instance.EnsureInTransaction(doc)
el1 = UnwrapElement(Revit.Elements.ImportInstance.ByGeometry(_solid_))
trans = Autodesk.Revit.DB.SubTransaction(doc)
trans.Start()
opt1 = Autodesk.Revit.DB.Options()
opt1.ComputeReferences = True
geom1 = el1.get_Geometry(opt1)
enum = geom1.GetEnumerator()
enum.MoveNext()
geom2 = enum.Current.GetInstanceGeometry()
enum2 = geom2.GetEnumerator()
enum2.MoveNext()
s1 = enum2.Current
sf1 = s1.Faces
sf2 = []
for s in sf1:
	m1 = s.Triangulate(1)
	n = m1.NumTriangles
	for i in range(n):
		t1 = m1.Triangle[i]
		t2 = List[XYZ]()
		t2.Add(t1.Vertex[0])
		t2.Add(t1.Vertex[1])
		t2.Add(t1.Vertex[2])
		sf2.append(t2)
ts1 = TessellatedShapeBuilder()
ts1.OpenConnectedFaceSet(True)
for i in range(len(sf2)):
	t3 = TessellatedFace(sf2[i], mat.Id)
	if t3.IsValidObject:
		ts1.AddFace(t3)
ts1.CloseConnectedFaceSet()
target = Autodesk.Revit.DB.TessellatedShapeBuilderTarget.Solid
fall = Autodesk.Revit.DB.TessellatedShapeBuilderFallback.Abort
result = ts1.Build(target, fall, ElementId.InvalidElementId)
ts1.Clear()
s2 = result.GetGeometricalObjects()
ds1 = DirectShape.CreateElement(doc,cat.Id,"Dynamo","")
if ds1.IsValidGeometry(s2[0]):
	ds1.SetShape(s2)
	ds1.SetName(name1)
	OUT = ds1.ToDSType(False)
trans.Commit()
trans.Start()
doc.Delete(el1.Id)
trans.Commit()
TransactionManager.Instance.TransactionTaskDone()
# ----------------------------------------
DirectShape = Output(python_script)
