# Dynamo graph DictionaryByKeysValues.dyn (Dynamo 4.0.2.3852)

# group: Make a Dictionary
# note: We can use strings and numbers for Keys
code_block = CodeBlock { ["Key",20,"Hello World"]; }
byCoordinates = Point.ByCoordinates()
# note: We can use many different 'Value' data types
code_block_2 = CodeBlock(y=byCoordinates) { ["Value", y, [123]]; }

# group: Retrieve these keys
code_block_3 = CodeBlock { ["Key",20,"DeliberateFail"]; }

# group: Default Value
# What to use if there is a key requested that doesn't have a value in the dictionary
code_block_4 = CodeBlock { -1; }

byKeysValues = Custom[Dictionary.ByKeysValues](keys=code_block, values=code_block_2, searchKeys=code_block_3, defaultValue=code_block_4)  # Dictionaries are an incredibly powerful tool for making associative sets between two equal length lists. The first list must be of unique strings (or numbers) and will be the key and the second list will be the matching values (it can be made up of geometry, elements, even other lists) The search keys list will provide the corresponding value to the input key.
watch = Watch(byKeysValues)
