# Dynamo graph WatchDialogue.dyn (Dynamo 4.0.2.3852)

file_path = Filename(".\test_txt.txt")
file_from_path = FileObject(path=file_path)
readText = FileSystem.ReadText(file=file_from_path)
code_block = CodeBlock { "Calibri"; }
boolean = BoolSelector(false)
boolean_2 = BoolSelector(true)
watchDialog = Custom[WatchDialog](input=readText, font_name=code_block, reset=boolean, addIndexes=boolean_2)  # This node that serializes the input information and presents it in a resizable text window. It can handle all sorts of different data types, like dictionaries and elements (anything with an Id), also different plan values like numbers, booleans and of course strings.
watch = Watch(watchDialog)
