# Dynamo graph FilePathCanWriteTo.dyn (Dynamo 4.0.2.3852)

file_path = Filename("..\..\..\..\..\..\..\Users\Public\Documents\Autodesk\test.txt")
canWriteTo = Custom[FilePath.CanWriteTo](path=file_path)  # Checks if the user and application has write access to the specified path's directory
watch = Watch(canWriteTo)
file_path_2 = Filename("..\..\..\..\..\..\..\test.txt")
canWriteTo_2 = Custom[FilePath.CanWriteTo](path=file_path_2)
watch_2 = Watch(canWriteTo_2)
