# Dynamo graph FilePathSize.dyn (Dynamo 4.0.2.3852)

file_path = Filename("C:\test.txt")
size = Custom[FilePath.Size](path=file_path)  # Outputs the the file size in kilobytes or megabytes. Provide a file path as a string. Set kbOnly to true for a consistent output.
watch = Watch(size)
