# Dynamo graph LineLoopMerge.dyn (Dynamo 3.3.0.6316)

byCoordinates = Point.ByCoordinates()
code_block = CodeBlock { 5; }  # frozen
byCoordinates_2 = Point.ByCoordinates(x=code_block)
byStartPointEndPoint = Line.ByStartPointEndPoint(startPoint=byCoordinates, endPoint=byCoordinates_2)
code_block_2 = CodeBlock { 0..1..#3; }
splitByParameter = Curve.SplitByParameter(curve=byStartPointEndPoint, parameters=code_block_2)
watch = Watch(splitByParameter)
code_block_3 = CodeBlock { 0; }
merge = Custom[LineLoop.Merge](lines=watch, margin=code_block_3)  # Attempts to join lines into a single chain of joined curves. The node returns the new lines as a chain and with the original order. The success outputs returns the success of the execution as a true/false boolean.
watch_2 = Watch(merge.success)
code_block_4 = CodeBlock(x=watch) { x[0]; }
watch_3d = Watch3D(code_block_4)
watch_3 = Watch(merge.ordered)
getEvenOdd = Custom[List.GetEvenOdd](list=watch)  # Gets the even and odd indices from the list.
watch_4 = Watch(merge.lines)
byCoordinates_3 = Point.ByCoordinates()
code_block_5 = CodeBlock { 5; }  # frozen
byCoordinates_4 = Point.ByCoordinates(x=code_block_5)
byStartPointEndPoint_2 = Line.ByStartPointEndPoint(startPoint=byCoordinates_3, endPoint=byCoordinates_4)
code_block_6 = CodeBlock { 0..1..#4; }
splitByParameter_2 = Curve.SplitByParameter(curve=byStartPointEndPoint_2, parameters=code_block_6)
watch_5 = Watch(splitByParameter_2)
getEvenOdd_2 = Custom[List.GetEvenOdd](list=watch_5)
code_block_7 = CodeBlock(x=getEvenOdd_2.even) { x; }
watch_3d_2 = Watch3D(code_block_7)
code_block_8 = CodeBlock { 4; }
merge_2 = Custom[LineLoop.Merge](lines=getEvenOdd_2.even, margin=code_block_8)
watch_6 = Watch(merge_2.success)
watch_7 = Watch(merge_2.ordered)
watch_8 = Watch(merge_2.lines)
watch_9 = Watch(getEvenOdd_2.even)
code_block_9 = CodeBlock { 5; }
byWidthLength = Rectangle.ByWidthLength(width=code_block_9, length=code_block_9)
explode = Geometry.Explode(geometry=byWidthLength)
code_block_10 = CodeBlock { 0..1..#4; }
splitByParameter_3 = Curve.SplitByParameter(curve=explode, parameters=code_block_10)
watch_10 = Watch(splitByParameter_3)
flatten = List.Flatten(list=watch_10)
getEvenOdd_3 = Custom[List.GetEvenOdd](list=flatten)
code_block_11 = CodeBlock(x=getEvenOdd_3.even) { x; }
watch_3d_3 = Watch3D(code_block_11)
code_block_12 = CodeBlock { 4; }
merge_3 = Custom[LineLoop.Merge](lines=getEvenOdd_3.even, margin=code_block_12)
watch_11 = Watch(merge_3.success)
watch_12 = Watch(merge_3.ordered)
watch_13 = Watch()  # unwired: arg0
watch_3d_4 = Watch3D(merge_3.lines)
