# Dynamo graph BoundingBox2DRectangle.dyn (Dynamo 3.3.0.6316)

byLengths = Cuboid.ByLengths()
byGeometry = BoundingBox.ByGeometry(geom=byLengths)
code_block = CodeBlock { 2; }
n2dRectangle = Custom[BoundingBox.2dRectangle](boundingBox=byGeometry, elevation=code_block)  # Returns a 2d rectangle from a bounding box
watch = Watch(n2dRectangle)
