# Dynamo graph BoundingBoxByDistance.dyn (Dynamo 3.3.0.6316)

byLengths = Cuboid.ByLengths()
byGeometry = BoundingBox.ByGeometry(geom=byLengths)
code_block = CodeBlock { 7; }
scaleByDistance = Custom[BoundingBox.ScaleByDistance](boundingBox=byGeometry, distance=code_block)  # Scales the bounding box by a fixed distance.
watch = Watch(scaleByDistance)
