# Dynamo graph BoundingBoxMidPoint.dyn (Dynamo 4.0.2.3852)

byLengths = Cuboid.ByLengths()
byGeometry = BoundingBox.ByGeometry(geom=byLengths)
midPoint = Custom[BoundingBox.MidPoint](boundingBox=byGeometry)  # Fetches the mid point of the bounding box.
watch = Watch(midPoint)
