# Dynamo graph BoundingBoxScale.dyn (Dynamo 3.3.0.6316)

byLengths = Cuboid.ByLengths()
byGeometry = BoundingBox.ByGeometry(geom=byLengths)
code_block = CodeBlock { 1.5; }
scale = Custom[BoundingBox.Scale](boundingBox=byGeometry, xAmmount=code_block, yAmmount=code_block, zAmmount=code_block)  # Scales the bounding box in three dimensions according to it's center.
watch = Watch(scale)
