# Dynamo graph ClosedCurveOffset.dyn (Dynamo 4.0.2.3852)

byWidthLength = Rectangle.ByWidthLength()
number_slider = DoubleSlider(0.24, range=0..1 step 0.01)
offset = Custom[ClosedCurve.Offset+](curve=byWidthLength, distance=number_slider)  # Offsets a curve both ways and correctly differenciates the external and internal offset. If an offset goes beyond the curve's bounds, the result will fail and a null value will be appended instead. Also works for convex curves like arcs.
watch_3d = Watch3D(offset.internal_offset)
watch_3d_2 = Watch3D(offset.external_offset)
