# Dynamo graph CurveOffset.dyn (Dynamo 4.0.2.3852)

byCoordinates = Point.ByCoordinates()
code_block = CodeBlock { 2; }
byCoordinates_2 = Point.ByCoordinates(x=code_block, y=code_block)
byStartPointEndPoint = Line.ByStartPointEndPoint(startPoint=byCoordinates, endPoint=byCoordinates_2)
code_block_2 = CodeBlock { 0.3; }
code_block_3 = CodeBlock { 1; }
byCoordinates_3 = Point.ByCoordinates(x=code_block_3)
offset = Custom[Curve.Offset+](curve=byStartPointEndPoint, distance=code_block_2, point=byCoordinates_3)  # Offsets a curve towards the specified point
watch = Watch(offset)
