# Dynamo graph CurveLoopSimplify.dyn (Dynamo 4.0.2.3852)

byWidthLength = Rectangle.ByWidthLength()
code_block = CodeBlock { 0..0.99..0.01; }
splitByParameter = Curve.SplitByParameter(curve=byWidthLength, parameters=code_block)
simplify = Custom[CurveLoop.Simplify](curveLoop=splitByParameter)  # Attempts to simplify an open or a closed curve loop by connecting straight separate line segments into a single line.
code_block_2 = CodeBlock(X=simplify) { X[0]; }
watch_3d = Watch3D(code_block_2)
byJoinedCurves = PolyCurve.ByJoinedCurves(curves=simplify)
code_block_3 = CodeBlock(X=splitByParameter) { X[0]; }
watch_3d_2 = Watch3D(code_block_3)
