# Dynamo graph Delaunay2DByPoints.dyn (Dynamo 4.0.2.3852)

code_block = CodeBlock { 0..5..0.1; }
byCoordinates = Point.ByCoordinates(x=code_block, y=code_block, lacing=CrossProduct)
flatten = List.Flatten(list=byCoordinates)
byPoints = Custom[Delaunay2D.ByPoints](points=flatten)  # Create a delaunay triangulation of a set of planar points. You can get the result as points or as lines.
