# Dynamo graph BoxedDistanceTo.dyn (Dynamo 3.3.0.6316)

byLengths = Cuboid.ByLengths()
code_block = CodeBlock { 5; }
byCoordinates = Vector.ByCoordinates(x=code_block, y=code_block)
translate = Geometry.Translate(geometry=byLengths, direction=byCoordinates)
boxedDistanceTo = Custom[Geometry.BoxedDistanceTo](geometry=byLengths, other=translate)  # Computes the minimal distance between the axis-aligned bounding boxes of two geometry elements. Works directly with a bounding box input.
watch = Watch(boxedDistanceTo)
