# Dynamo graph Extents.dyn (Dynamo 4.0.2.3852)

byLengths = Cuboid.ByLengths()
extents = Custom[Geometry.Extents](geometry=byLengths)  # Gets the dimensions of the geometry's bounding box.
watch = Watch(extents.width)
watch_2 = Watch(extents.height)
watch_3 = Watch(extents.length)
