# Dynamo graph GroupByDistance.dyn (Dynamo 3.3.0.6316)

code_block = CodeBlock { 10; }
randomList = Math.RandomList(amount=code_block)
code_block_2 = CodeBlock(x=randomList) { x*10; }
byCoordinates = Point.ByCoordinates(x=code_block_2, y=code_block_2, z=code_block_2, lacing=CrossProduct)
flatten = List.Flatten(list=byCoordinates)
code_block_3 = CodeBlock { 1; }
groupByDistance = Custom[Geometry.GroupByDistance](geometry=flatten, margin=code_block_3)  # Splits the list of geometry elements into groups if the distance between them is less than the provided margin.
code_block_4 = CodeBlock(x=groupByDistance) { x[1]; }
watch_3d = Watch3D(code_block_4)
