# Dynamo graph IndexByDistance.dyn (Dynamo 4.0.2.3852)

code_block = CodeBlock { 10; }
randomList = Math.RandomList(amount=code_block)
code_block_2 = CodeBlock(x=randomList) { x*10; }
byCoordinates = Point.ByCoordinates(x=code_block_2, y=code_block_2, z=code_block_2, lacing=CrossProduct)
flatten = List.Flatten(list=byCoordinates)
randomList_2 = Math.RandomList(amount=code_block)
code_block_3 = CodeBlock(x=randomList_2) { x*10; }
byCoordinates_2 = Point.ByCoordinates(x=code_block_3, y=code_block_3, z=code_block_3, lacing=CrossProduct)
flatten_2 = List.Flatten(list=byCoordinates_2)
boolean = BoolSelector(false)
indexByDistance = Custom[Geometry.IndexByDistance](geometry=flatten, other=flatten_2, isClosest=boolean)  # Provides the index of the closest or farthest geometry. Should prove faster than getting the geometry and finding its index in two separate operations.
watch = Watch(indexByDistance.index)
watch_2 = Watch(indexByDistance.distance)
