# Dynamo graph SplitRecursively.dyn (Dynamo 4.0.2.3852)

code_block = CodeBlock { 10; }
byWidthLength = Rectangle.ByWidthLength(width=code_block)
patch = Curve.Patch(curve=byWidthLength)
code_block_2 = CodeBlock { 0..1..#10; }
pointAtParameter = Curve.PointAtParameter(curve=byWidthLength, param=code_block_2)
pruneDuplicates = Point.PruneDuplicates(points=pointAtParameter)
getEvenOdd = Custom[List.GetEvenOdd](list=pruneDuplicates)  # Gets the even and odd indices from the list.
byStartPointEndPoint = Line.ByStartPointEndPoint(startPoint=getEvenOdd.even, endPoint=getEvenOdd.odd, lacing=CrossProduct)
flatten = List.Flatten(list=byStartPointEndPoint)
code_block_3 = CodeBlock { 0.1; }
pointAtParameter_2 = Surface.PointAtParameter(surface=patch, u=code_block_3, v=code_block_3)
splitRecursively = Custom[Geometry.SplitRecursively](geometry=patch, tools=flatten, pickPoint=pointAtParameter_2)  # Splits a surface or a solid recursively, using the resulting reduced geometry for every consecutive split. Select a point or another geometry to control the direction of the split.
watch = Watch(splitRecursively)
code_block_4 = CodeBlock(x=watch) { x[0]; }
watch_3d = Watch3D(code_block_4)
code_block_5 = CodeBlock()  # unwired: face, planes, dir1
# ---------- code_block_5.designscript (23 lines) ----------
face;
planes;
dir1;
geom = [Imperative]{
outp = [];
i = 0;
for (p in planes){
	s1 = face.Split(p);
	if(Count(s1) < 2){
		face = s1[0];
		continue;
	}
	ind1 = SortIndexByValue(
		dir1.DistanceTo(s1) );
	s1 = Reorder(s1,ind1);
	face = s1[0];
	s2 = s1[1];
	outp[i] = s1[1];
	i = i + 1;
}
outp[i] = face;
return = outp;
};
# ----------------------------------------
