# Dynamo graph WriteTag_ReadTag.dyn (Dynamo 4.0.2.3852)

byCoordinates = Point.ByCoordinates(lacing=CrossProduct)
code_block = CodeBlock { "Name"; "PointyMcPointFace"; }
boolean = BoolSelector(true)
writeTag = Custom[Geometry.WriteTag](geometry=byCoordinates, tagName=code_block.out0, value=code_block.out1, override=boolean)  # Design script geometry can store a <string, object> dictionary for the duration of the active graph. You can store a name/value pair and retrieve it further down the graph.
code_block_2 = CodeBlock { "Name"; }
readTag = Custom[Geometry.ReadTag](geometry=writeTag.geometry, tagName=code_block_2)  # Design script geometry can store a <string, object> dictionary for the duration of the active graph. If no parameter with the active name is found, a null value will be returned instead.
watch = Watch(readTag)
watch_2 = Watch(writeTag.setPreviously)
