# Dynamo graph LineIsInPlane.dyn (Dynamo 3.3.0.6316)

ZAxis = Vector.ZAxis()
byOriginNormal = Plane.ByOriginNormal(normal=ZAxis)
byCoordinates = Point.ByCoordinates()
code_block = CodeBlock { 10; [0,1]; }
byCoordinates_2 = Point.ByCoordinates(x=code_block.out0, z=code_block.out1)
byStartPointEndPoint = Line.ByStartPointEndPoint(startPoint=byCoordinates, endPoint=byCoordinates_2)
isInPlane = Custom[Line.IsInPlane](plane=byOriginNormal, line=byStartPointEndPoint)  # Checks if a line lies in a given plane
watch = Watch(isInPlane)
watch_2 = Watch(byStartPointEndPoint)
