# Dynamo graph LineStraightenXY.dyn (Dynamo 3.3.0.6316)

byCoordinates = Point.ByCoordinates()
code_block = CodeBlock { 10000; }
code_block_2 = CodeBlock { 0.2; }
byCoordinates_2 = Point.ByCoordinates(x=code_block, y=code_block_2)
byStartPointEndPoint = Line.ByStartPointEndPoint(startPoint=byCoordinates, endPoint=byCoordinates_2)
code_block_3 = CodeBlock { 1; }
boolean = BoolSelector(false)
straightenXY = Custom[Line.StraightenXY](line=byStartPointEndPoint, margin=code_block_3, isRatio=boolean)  # Checks a line's end points for irregularities and corrects them if they are at or below the specified margin. The default margin is 1/5000 of the curve length, which is conservative.
watch = Watch(straightenXY)
watch_3d = Watch3D(straightenXY)
