# Dynamo graph LineStraightenZ.dyn (Dynamo 3.3.0.6316)

byCoordinates = Point.ByCoordinates()
code_block = CodeBlock { 10; 0.5; }
byCoordinates_2 = Point.ByCoordinates(x=code_block.out0, z=code_block.out1)
byStartPointEndPoint = Line.ByStartPointEndPoint(startPoint=byCoordinates, endPoint=byCoordinates_2)
code_block_2 = CodeBlock { 0.5; }
straightenZ = Custom[Line.StraightenZ](line=byStartPointEndPoint, margin=code_block_2)  # Checks a line's end points for irregularities in the Z axis and corrects them if they are at or below the specified margin. The default margin is 1/5000 of the curve length, which is conservative.
watch_3d = Watch3D(straightenZ)
