# Dynamo graph LineXYOffset.dyn (Dynamo 4.0.2.3852)

byCoordinates = Point.ByCoordinates()
code_block = CodeBlock { 10; }
byCoordinates_2 = Point.ByCoordinates(x=code_block)
byStartPointEndPoint = Line.ByStartPointEndPoint(startPoint=byCoordinates, endPoint=byCoordinates_2)
code_block_2 = CodeBlock { 0.5; }
code_block_3 = CodeBlock { 2; }
byCoordinates_3 = Point.ByCoordinates(y=code_block_3)
XYOffset = Custom[Line.XYOffset](line=byStartPointEndPoint, distance=code_block_2, point=byCoordinates_3)  # Offsets a line in the XY plane toards the specified point
watch_3d = Watch3D(XYOffset)
