# Dynamo graph Merge.dyn (Dynamo 4.0.2.3852)

byWidthLength = Rectangle.ByWidthLength()
explode = Geometry.Explode(geometry=byWidthLength)
merge = Custom[LineLoop.Merge](lines=explode)  # Attempts to join lines into a single chain of joined curves. The node returns the new lines as a chain and with the original order. The success outputs returns the success of the execution as a true/false boolean.
watch = Watch(merge.lines)
watch_2 = Watch(merge.success)
watch_3 = Watch(merge.ordered)
