# Dynamo graph MeshBoundingBox.dyn (Dynamo 4.0.2.3852)

cuboid = Mesh.Cuboid()
boundingBox = Custom[Mesh.BoundingBox](mesh=cuboid)  # Get the bounding box of a mesh. Works with both built-in meshes and toolkit meshes
watch = Watch(boundingBox)
