# Dynamo graph MeshToPolySurface.dyn (Dynamo 4.0.2.3852)

code_block = CodeBlock { 5; }
byWidthLength = Rectangle.ByWidthLength(width=code_block, length=code_block)
explode = Geometry.Explode(geometry=byWidthLength)
code_block_2 = CodeBlock { 0..1..#4; }
pointAtParameter = Curve.PointAtParameter(curve=explode, param=code_block_2@L1)
code_block_3 = CodeBlock { 0..2; 2..0; 1; }
byIndices = IndexGroup.ByIndices(a=code_block_3.out0, b=code_block_3.out1, c=code_block_3.out2)
byPointsIndexGroups = Mesh.ByPointsIndexGroups(points=pointAtParameter, indexGroups=byIndices)
code_block_4 = CodeBlock(x=byPointsIndexGroups) { x[1]; }
watch_3d = Watch3D(code_block_4)
code_block_5 = CodeBlock(x=byPointsIndexGroups) { x[3]; }
watch_3d_2 = Watch3D(code_block_5)
code_block_6 = CodeBlock(x=byPointsIndexGroups) { x[0]; }
watch_3d_3 = Watch3D(code_block_6)
boolean = BoolSelector(false)
toPolySurface = Custom[Mesh.ToPolySurface](mesh=code_block_6, useQuads=boolean)  # Converts a Dynamo mesh to a polysurface. By default the node is single threaded, but if you specify a higher number of threads in the `NUMTHREAD` input, the node will run multi-threaded to speed up the conversion. *WARNING* Using multi-threaded code with Dynamo's geometry kernel may crash Revit in some cases.
watch_3d_4 = Watch3D(toPolySurface)
code_block_7 = CodeBlock { 5; }
byWidthLength_2 = Rectangle.ByWidthLength(width=code_block_7, length=code_block_7)
explode_2 = Geometry.Explode(geometry=byWidthLength_2)
endPoint = Curve.EndPoint(curve=explode_2)
code_block_8 = CodeBlock { 0; 1; 2; 3; }
byIndices_2 = IndexGroup.ByIndices(a=code_block_8.out0, b=code_block_8.out1, c=code_block_8.out2, d=code_block_8.out3)
byPointsIndexGroups_2 = Mesh.ByPointsIndexGroups(points=endPoint, indexGroups=byIndices_2)
watch_3d_5 = Watch3D(byPointsIndexGroups_2)
boolean_2 = BoolSelector(true)
toPolySurface_2 = Custom[Mesh.ToPolySurface](mesh=watch_3d_5, useQuads=boolean_2)
watch_3d_6 = Watch3D(toPolySurface_2)
code_block_9 = CodeBlock(x=byPointsIndexGroups) { x; }
watch_3d_7 = Watch3D(code_block_9)
boolean_3 = BoolSelector(true)
boolean_4 = BoolSelector(false)
toPolySurface_3 = Custom[Mesh.ToPolySurface](mesh=watch_3d_7, mergeAll=boolean_3, useQuads=boolean_4)
watch_3d_8 = Watch3D(toPolySurface_3)
watch = Watch(toPolySurface_3)
