# Dynamo graph MeshToTk_Tri.dyn (Dynamo 4.0.2.3852)

code_block = CodeBlock { 0; 5; }
byCoordinates = Point.ByCoordinates(x=code_block.out0, y=code_block.out0)
byCoordinates_2 = Point.ByCoordinates(x=code_block.out0, y=code_block.out1)
byCoordinates_3 = Point.ByCoordinates(x=code_block.out1, y=code_block.out1)
list_create = List.Create(item0=byCoordinates, item1=byCoordinates_2, item2=byCoordinates_3)
code_block_2 = CodeBlock { 0; 1; 2; }
byIndices = IndexGroup.ByIndices(a=code_block_2.out0, b=code_block_2.out1, c=code_block_2.out2)
byPointsIndexGroups = Mesh.ByPointsIndexGroups(points=list_create, indexGroups=byIndices)
code_block_3 = CodeBlock { 12; 8; }
byCoordinates_4 = Point.ByCoordinates(x=code_block_3.out0, y=code_block_3.out0)
byCoordinates_5 = Point.ByCoordinates(x=code_block_3.out0, y=code_block_3.out1)
byCoordinates_6 = Point.ByCoordinates(x=code_block_3.out1, y=code_block_3.out1)
list_create_2 = List.Create(item0=byCoordinates_4, item1=byCoordinates_5, item2=byCoordinates_6)
code_block_4 = CodeBlock { 0; 1; 2; }
byIndices_2 = IndexGroup.ByIndices(a=code_block_4.out0, b=code_block_4.out1, c=code_block_4.out2)
byPointsIndexGroups_2 = Mesh.ByPointsIndexGroups(points=list_create_2, indexGroups=byIndices_2)
list_create_3 = List.Create(item0=byPointsIndexGroups, item1=byPointsIndexGroups_2, item2=byPointsIndexGroups_2)
watch_3d = Watch3D(list_create_3)
# note: Install the mesh tookit package
toTkMesh = Custom[Mesh.ToTkMesh](mesh=watch_3d)  # Converts a Dynamo mesh to a toolkit mesh. You obviously need to have the appropriate version of the mesh toolkit package downloaded first.
watch_3d_2 = Watch3D(toTkMesh)
watch = Watch(toTkMesh)
