# Dynamo graph MeshVolumeArea.dyn "MeshToTk_Tri" (Dynamo 3.6.1.9895)

cuboid = Mesh.Cuboid()
python2 = Custom[Mesh.VolumeArea.Python2](mesh=cuboid)  # Gets the volume and the area of a mesh. Works with both built in meshes and toolkit meshes. Based on math from geometry3sharp. Note that if triangles don't define closed region, volume is probably nonsense.
watch = Watch(python2.volume)
watch_2 = Watch(python2.area)
