# Dynamo graph ByOriginVector.dyn (Dynamo 3.6.1.9895)

byCoordinates = Point.ByCoordinates()
XAxis = Vector.XAxis()
code_block = CodeBlock { 9; }
code_block_2 = CodeBlock { 4; }
n_hedron_byoriginvector = Custom[N-hedron.ByOriginVector](origin=byCoordinates, axis=XAxis, sides=code_block, length=code_block_2, height=code_block_2)  # Creates a multi-sided poyhedron with defined side length and total height.
watch = Watch(n_hedron_byoriginvector)
