# Dynamo graph FixDomain.dyn (Dynamo 3.6.1.9895)

byWidthLength = Rectangle.ByWidthLength()
patch = Curve.Patch(curve=byWidthLength)
fixDomain = Custom[PlanarFace.FixDomain](surf=patch)  # Corrects the surface domain of a 3 or 4 point planar face extracted from Revit.
watch = Watch(fixDomain)
