# Dynamo graph PointBoxedDistanceTo.dyn (Dynamo 3.6.1.9895)

code_block = CodeBlock { 5; }
byCoordinates = Point.ByCoordinates(z=code_block)
byLengths = Cuboid.ByLengths()
boxedDistanceTo = Custom[Point.BoxedDistanceTo](point=byCoordinates, geometry=byLengths)  # Computes the minimal distance between a point and the axis-aligned bounding boxe of a geometry element. Works directly with a bounding box input for the geometry.
watch = Watch(boxedDistanceTo)
