# Dynamo graph PointPullOntoPlane.dyn (Dynamo 3.6.1.9895)

code_block = CodeBlock { 5; }
byCoordinates = Point.ByCoordinates(z=code_block)
byCoordinates_2 = Point.ByCoordinates()
ZAxis = Vector.ZAxis()
byOriginNormal = Plane.ByOriginNormal(origin=byCoordinates_2, normal=ZAxis)
pullOntoPlane = Custom[Point.PullOntoPlane](point=byCoordinates, plane=byOriginNormal)  # Pulls (projects) the point onto the input plane, following the plane normal.
watch = Watch(pullOntoPlane)
watch_3d = Watch3D(pullOntoPlane)
watch_3d_2 = Watch3D(byCoordinates)
