# Dynamo graph ConvexHull2D.dyn (Dynamo 3.6.1.9895)

code_block = CodeBlock { 50; 1; 3; 4; }
randomList = Math.RandomList(amount=code_block.out0, value1=code_block.out1, value2=code_block.out2, seed=code_block.out3)
shuffle = List.Shuffle(list=randomList)
randomList_2 = Math.RandomList(amount=code_block.out0, value1=code_block.out1, value2=code_block.out2, seed=code_block.out3)
shuffle_2 = List.Shuffle(list=randomList_2)
byCoordinates = Point.ByCoordinates(x=shuffle, y=shuffle_2)
watch = Watch(byCoordinates)
code_block_2 = CodeBlock { 3; }
convexHull2D = Custom[Points.ConvexHull2D](points=watch, elevation=code_block_2)  # Computes the XY convex hull of a given set of points based on the monotone chain algorithm.
watch_3d = Watch3D(convexHull2D)
watch_2 = Watch(convexHull2D)
