# Dynamo graph MinAreaRectangle.dyn (Dynamo 3.6.1.9895)

code_block = CodeBlock { 50; 1; 3; 4; }
randomList = Math.RandomList(amount=code_block.out0, value1=code_block.out1, value2=code_block.out2, seed=code_block.out3)
shuffle = List.Shuffle(list=randomList)
randomList_2 = Math.RandomList(amount=code_block.out0, value1=code_block.out1, value2=code_block.out2, seed=code_block.out3)
shuffle_2 = List.Shuffle(list=randomList_2)
byCoordinates = Point.ByCoordinates(x=shuffle, y=shuffle_2)
code_block_2 = CodeBlock { 0; }
minAreaRectangle = Custom[Points.MinAreaRectangle](points=byCoordinates, elevation=code_block_2)  # Computes the minimum area rectangle in xy space for a set of points using a linear time algorithm
watch = Watch(minAreaRectangle.angle)
watch_3d = Watch3D(minAreaRectangle.hullPoints)
watch_2 = Watch(minAreaRectangle.rectangle)
