# Dynamo graph PruneDuplicates.dyn (Dynamo 3.6.1.9895)

code_block = CodeBlock { 50; 1; 3; 4; }
randomList = Math.RandomList(amount=code_block.out0, value1=code_block.out1, value2=code_block.out2, seed=code_block.out3)
shuffle = List.Shuffle(list=randomList)
randomList_2 = Math.RandomList(amount=code_block.out0, value1=code_block.out1, value2=code_block.out2, seed=code_block.out3)
shuffle_2 = List.Shuffle(list=randomList_2)
shuffle_3 = List.Shuffle(list=randomList_2)
byCoordinates = Point.ByCoordinates(x=shuffle, y=shuffle_2, z=shuffle_3)
join = List.Join(list0=byCoordinates, list1=byCoordinates)
watch = Watch(join)
boolean = BoolSelector(true)
pruneDuplicates = Custom[Points.PruneDuplicates+](points=watch, keepDuplicateZ=boolean)  # An alternative to the built in node, that performs faster at the price of loosing the order of the points. All floating point valies are rounded to the nearest 4 decimal points. You can optionally remove duplicate Z values by setting "keepDuplicateZ" to false.
watch_3d = Watch3D(pruneDuplicates)
count = List.Count(list=join)
watch_2 = Watch(count)
watch_3 = Watch(pruneDuplicates)
count_2 = List.Count(list=watch_3)
watch_4 = Watch(count_2)
