# Dynamo graph PolyCurveArcChamfer.dyn (Dynamo 3.6.1.9895)

code_block = CodeBlock { 5; }
byWidthLength = Rectangle.ByWidthLength(width=code_block, length=code_block)
code_block_2 = CodeBlock { 0.1; }
boolean = BoolSelector(true)
arcChamfer = Custom[PolyCurve.ArcChamfer](polycurve=byWidthLength, distance=code_block_2, flip=boolean)  # Symmetrically chamfers the corners of the polycurve by the designated distance and close with tangent arcs.
watch_3d = Watch3D(arcChamfer)
watch = Watch(arcChamfer)
watch_3d_2 = Watch3D(byWidthLength)
