# Dynamo graph PolyCurvePoints.dyn (Dynamo 3.6.1.9895)

code_block = CodeBlock { 5; }
byWidthLength = Rectangle.ByWidthLength(width=code_block, length=code_block)
points = Custom[PolyCurve.Points](polyCurve=byWidthLength)  # Gets all the unique start and end points of the underlying curves in a sorted list.
watch = Watch(points)
watch_3d = Watch3D(points)
