# Dynamo graph PolyCurveChamfer.dyn (Dynamo 3.6.1.9895)

code_block = CodeBlock { 5; }
byWidthLength = Rectangle.ByWidthLength(width=code_block, length=code_block)
code_block_2 = CodeBlock { 0.5; }
chamfer = Custom[PolyCurve.Chamfer](polycurve=byWidthLength, distance=code_block_2)  # Symmetrically chamfers the corners of the polycurve by the designated distance
watch = Watch(chamfer)
watch_3d = Watch3D(byWidthLength)
watch_3d_2 = Watch3D(chamfer)
