# Dynamo graph PolyCurveFillet+.dyn (Dynamo 3.6.1.9895)

code_block = CodeBlock { 5; }
byWidthLength = Rectangle.ByWidthLength(width=code_block, length=code_block)
code_block_2 = CodeBlock { 0.5; }
fillet = Custom[PolyCurve.Fillet+](polycurve=byWidthLength, radius=code_block_2)  # Fillet a polycurve in its plane. Unlike the built in node, this works in both in the CW and the CCW direction.
watch = Watch(fillet)
watch_3d = Watch3D(byWidthLength)
watch_3d_2 = Watch3D(fillet)
