# Dynamo graph Polygon2DArea.dyn (Dynamo 3.6.1.9895)

code_block = CodeBlock { 5; }
byWidthLength = Rectangle.ByWidthLength(width=code_block, length=code_block)
n2DArea = Custom[Polygon.2DArea](polygon=byWidthLength)  # Returns the planar area of the input polygon(s). Not accurate for self-intersecting polys.
watch = Watch(n2DArea)
