# Dynamo graph Polygon3DArea.dyn (Dynamo 3.6.1.9895)

code_block = CodeBlock()
# ---------- code_block.designscript (4 lines) ----------
point1 = Point.ByCoordinates(0, 0, 0);
point2 = Point.ByCoordinates(0, 5, 0);
point3 = Point.ByCoordinates(5, 5, 5);
point4 = Point.ByCoordinates(5, 0, 5);
# ----------------------------------------
byCornerPoints = Rectangle.ByCornerPoints(p1=code_block.point1, p2=code_block.point2, p3=code_block.point3, p4=code_block.point4)
n2DArea = Custom[Polygon.2DArea](polygon=byCornerPoints)  # Returns the planar area of the input polygon(s). Not accurate for self-intersecting polys.
watch = Watch(n2DArea)
n3DArea = Custom[Polygon.3DArea](polygon=byCornerPoints)  # Returns the planar area of the input polygon(s) in euclidean space. Not accurate for self-intersecting polys.
watch_2 = Watch(n3DArea)
