# Dynamo graph PolygonContainment.dyn (Dynamo 4.0.2.3852)

code_block = CodeBlock { 0..10; }
byCoordinates = Point.ByCoordinates(x=code_block, y=code_block, lacing=CrossProduct)
code_block_2 = CodeBlock(x=byCoordinates) { x[5][5]; 3; }
byCenterPointRadius = Circle.ByCenterPointRadius(centerPoint=code_block_2.out0, radius=code_block_2.out1)
regularPolygon = Polygon.RegularPolygon(circle=byCenterPointRadius)
flatten = List.Flatten(list=byCoordinates)
containmentTest = Custom[Polygon.ContainmentTest+](polygon=regularPolygon, points=flatten)  # A less accurate method that should perform faster than the built-in node for large data sets.
watch = Watch(containmentTest)
