# Dynamo graph PolygonIsRectangular.dyn (Dynamo 4.0.2.3852)

byCenterPointRadius = Circle.ByCenterPointRadius()
regularPolygon = Polygon.RegularPolygon(circle=byCenterPointRadius)
isRectangular = Custom[Polygon.IsRectangular](poly=regularPolygon)  # Determines if a polygon (or a polycurve) is rectangular or square. If you want to differenciate between square and rectangular polys, use the XOR output.
watch = Watch(isRectangular.isRectangle)
watch_2 = Watch(isRectangular.isSquare)
watch_3 = Watch(isRectangular.XOR)
byWidthLength = Rectangle.ByWidthLength()
isRectangular_2 = Custom[Polygon.IsRectangular](poly=byWidthLength)
watch_4 = Watch(isRectangular_2.isSquare)
watch_5 = Watch(isRectangular_2.isRectangle)
watch_6 = Watch(isRectangular_2.XOR)
