# Dynamo graph QuadsByPointMatrix.dyn (Dynamo 4.0.2.3852)

code_block = CodeBlock { 0..10; }
byOrigin = CoordinateSystem.ByOrigin(x=code_block, y=code_block, lacing=CrossProduct)
byWidthLength = Rectangle.ByWidthLength(coordinateSystem=byOrigin)
flatten = List.Flatten(list=byWidthLength)
explode = Geometry.Explode(geometry=flatten)
endPoint = Curve.EndPoint(curve=explode)
boolean = BoolSelector(false)
byPointMatrix = Custom[Quads.ByPointMatrix](points=endPoint, CCW=boolean)  # Creates a CCW or CW list of quad pairs from a rectangular nested list of points.
watch = Watch(byPointMatrix)
