# Dynamo graph SerialisationStringToLine.dyn (Dynamo 4.0.2.3852)

code_block = CodeBlock { 0..1; }
byCoordinates = Point.ByCoordinates(x=code_block, y=code_block, lacing=CrossProduct)
firstItem = List.FirstItem(list=byCoordinates)
lastItem = List.LastItem(list=byCoordinates)
byStartPointEndPoint = Line.ByStartPointEndPoint(startPoint=firstItem, endPoint=lastItem)
toString = Custom[Line.ToString](line=byStartPointEndPoint)  # Serilize a line to a string. You can use a custom delimier between the coordinates and apply an optional rounding. Works great with Revit text based parameters or Excel.
watch = Watch(toString)
toLine = Custom[String.ToLine](str=watch)  # De-serilize a Revit parameter string into a geometric line.
watch_2 = Watch(toLine)
