# Dynamo graph SerialisationStringToPoint.dyn (Dynamo 4.0.2.3852)

code_block = CodeBlock { 0..1; }
byCoordinates = Point.ByCoordinates(x=code_block, y=code_block, lacing=CrossProduct)
toString = Custom[Point.ToString](point=byCoordinates)  # Serilize a point to a string. You can use a custom delimier between the coordinates and apply an optional rounding. Works great with Revit text based parameters or Excel.
watch = Watch(toString)
toPoint = Custom[String.ToPoint](str=watch)  # De-serilize a Revit parameter string into a geometric point.
watch_2 = Watch(toPoint)
