# Dynamo graph OuterPerimeterCurves.dyn (Dynamo 4.0.2.3852)

code_block = CodeBlock { [5, 1]; }
byWidthLength = Rectangle.ByWidthLength(width=code_block, length=code_block)
byPatch = Surface.ByPatch(closedCurve=byWidthLength)
code_block_2 = CodeBlock(x=byPatch) { x[0]; x[1]; }
difference = Surface.Difference(surface=code_block_2.out0, others=code_block_2.out1)
outerPerimeterCurves = Custom[Surface.OuterPerimeterCurves](surf=difference)  # Get only the outer perimeter of a surface, dropping the inner openings.
watch = Watch(outerPerimeterCurves)
