# Dynamo graph TrimWithLoops.dyn (Dynamo 4.0.2.3852)

code_block = CodeBlock { [5, 1]; }
byWidthLength = Rectangle.ByWidthLength(width=code_block, length=code_block)
code_block_2 = CodeBlock(x=byWidthLength) { x[0]; x[1]; }
byPatch = Surface.ByPatch(closedCurve=code_block_2.out0)
trimWithLoopsFix = Custom[Surface.TrimWithLoopsFix](surf=byPatch, loops=code_block_2.out1)  # A temporary replacement for the broken built-in node. For best results, make sure the loops are convex.
watch = Watch(trimWithLoopsFix)
