# Dynamo graph Voroni2DByPoints.dyn (Dynamo 4.0.2.3852)
# packages: PythonNet3 Engine 1.4.8.0

string = StringInput("""import math

pts = []
for i in range(50):
    angle = i * 137.5 * (math.pi / 180)  # golden angle
    r = math.sqrt(i) * 2
    x = r * math.cos(angle)
    y = r * math.sin(angle)
    pts.append((round(x, 3), round(y, 3)))

OUT = [p for p in pts]""")
python_script_from_string = PythonStringNode(script=string)  # PythonNet3
firstItem = List.FirstItem(list=python_script_from_string@L2)
lastItem = List.LastItem(list=python_script_from_string@L2)
byCoordinates = Point.ByCoordinates(x=firstItem, y=lastItem)
byPoints = Custom[Voronoi2D.ByPoints](points=byCoordinates)  # Create a voronoi tessellation of a set of planar points. The cell lines will be culled to the bounding extent of the points.
