# Dynamo graph DifferentiateDisplay.dyn (Dynamo 4.0.2.3852)

code_block = CodeBlock { 0..10..2; }
byCoordinates = Point.ByCoordinates(x=code_block, y=code_block, lacing=CrossProduct)
byLengths = Cuboid.ByLengths(origin=byCoordinates)
differentiateDisplay = Custom[Geometry.DifferentiateDisplay](geo=byLengths)  # Paints the input geometry using the default color range. Also works well with lists of geometry.
watch = Watch(differentiateDisplay)
