# Dynamo graph DragDropReorder.dyn (Dynamo 4.0.0.3277)

code_block = CodeBlock { "T" + (0..50); "NewSpringsItemName"; "SpringsReorderDialog"; }
boolean = BoolSelector(true)
dragDropReorder = Custom[List.DragDropReorder](list=code_block.out0, names=code_block.out1, customMsg=code_block.out2, reset=boolean)  # Press and hold on an item to move it up or down the list. To confirm and close the window, select "Save Order". The optional names input will override the object representation.
watch = Watch(dragDropReorder)
