# Dynamo graph DropDown.dyn (Dynamo 4.0.2.3852)

code_block = CodeBlock { "T" + (0..50); "NewSpringsItemName"; "SpringsDropDownDialog"; true; }
dropDown = Custom[List.DropDown](list=code_block.out0, names=code_block.out1, customMsg=code_block.out2, reset=code_block.out3)  # Selects one list item by a drop-down combo box. The optional names input will override the object representation.
watch = Watch(dropDown)
