# Dynamo graph DropFirstLast.dyn (Dynamo 4.0.2.3852)

code_block = CodeBlock { 0..10; }
dropFirstLast = Custom[List.DropFirstLast](list=code_block)  # Removes the first and last items from the list
watch = Watch(dropFirstLast.F_L)
watch_2 = Watch(dropFirstLast.rest)
