# Dynamo graph EveryOther.dyn (Dynamo 4.0.2.3852)

code_block = CodeBlock { 0..3; }
everyOther = Custom[List.EveryOther](list=code_block)  # Useful for when you want to combine an item on the list with every other item on the list. For example in list {1,2,3} , "2" will be paired up only with "1" and "3" and will not be paired up with itself.
watch = Watch(everyOther)
