# Dynamo graph FilterByCategoryName.dyn (Dynamo 4.0.2.3852)

select_model_elements = DSModelElementsSelection()  # 7 picked in the model
code_block = CodeBlock { null; 2; }
insert = List.Insert(list=select_model_elements, element=code_block.out0, index=code_block.out1)
code_block_2 = CodeBlock { "Wall"; }
filterByCategoryName = Custom[List.FilterByCategoryName](element=insert, categoryName=code_block_2)  # Filters the input elements by their category name. You can input multiple category names.
watch = Watch(filterByCategoryName.in)
watch_2 = Watch(filterByCategoryName.out)
watch_3 = Watch(filterByCategoryName.nulls)
