# Dynamo graph FilterByClassName.dyn (Dynamo 4.0.2.3852)

select_model_elements = DSModelElementsSelection()  # 12 picked in the model
code_block = CodeBlock { "FamilyInstance"; }
filterByClassName = Custom[List.FilterByClassName](object=select_model_elements, className=code_block)  # Filters a list of objects by the object's class name. Note that Dynamo elements belong to different classes than their Revit counterparts. Use the Object.Class node to check an object's class.
watch = Watch(filterByClassName)
element_classes = ElementTypes("FamilyInstance")
all_elements_of_class = ElementsOfType(element_class=element_classes)
getCategory = Element.GetCategory(element=all_elements_of_class)
code_block_2 = CodeBlock { "Doors"; }
filterByClassName_2 = Custom[List.FilterByClassName](object=all_elements_of_class, optionalName=getCategory, className=code_block_2)
watch_2 = Watch(filterByClassName_2)
select_model_elements_2 = DSModelElementsSelection()  # 12 picked in the model
type = Object.Type(object=select_model_elements_2)
code_block_3 = CodeBlock(e=select_model_elements_2) { e.Class; }
watch_3 = Watch(code_block_3)
