# Dynamo graph FilterBySelection.dyn (Dynamo 4.0.2.3852)

select_model_elements = DSModelElementsSelection()  # 20 picked in the model
code_block = CodeBlock { ["elem1"]; "Go Springs!"; }
boolean = BoolSelector(false)
filterBySelection = Custom[List.FilterBySelection](list=select_model_elements, names=code_block.out0, customMsg=code_block.out1, reset=boolean)  # Check the items that you'd like to filter in. Unchecked items will be sent to the out list. The optional names input will override the object representation.
watch = Watch(filterBySelection)
