# Dynamo graph FirstLast.dyn (Dynamo 4.0.2.3852)

select_model_elements = DSModelElementsSelection()  # 12 picked in the model
firstLast = Custom[List.FirstLast](list=select_model_elements)  # Simple utility node to get both the first and last items of a list as separate outputs. This avoids the unnecessary sublist when using the List.Deconstruct node.
watch = Watch(firstLast.first)
watch_2 = Watch(firstLast.combined)
watch_3 = Watch(firstLast.last)
