# Dynamo graph GetEvenOdd.dyn (Dynamo 4.0.2.3852)

select_model_elements = DSModelElementsSelection()  # 12 picked in the model
getEvenOdd = Custom[List.GetEvenOdd](list=select_model_elements)  # Gets the even and odd indices from the list.
watch = Watch(getEvenOdd.even)
watch_2 = Watch(getEvenOdd.odd)
