# Dynamo graph ItemAtIndex+.dyn (Dynamo 4.0.2.3852)

select_model_elements = DSModelElementsSelection()  # 12 picked in the model
code_block = CodeBlock { -1; }
itemAtIndex = Custom[List.ItemAtIndex+](list=select_model_elements, index=code_block)  # Identical to the built in node but works with negative indices
watch = Watch(itemAtIndex)
watch_2 = Watch(itemAtIndex)
