# Dynamo graph ListSplit.dyn (Dynamo 4.0.2.3852)

watch = Watch()  # unwired: arg0
code_block = CodeBlock { [null, 6, 5, null, 2, 3, 4, 1, 0, null]; }
code_block_2 = CodeBlock { 3; }
split = Custom[List.Split](list=code_block, amount=code_block_2)  # Splits a list at the desired length
watch_2 = Watch(split.list2)
watch_3 = Watch(split.list1)
