# Dynamo graph ListToString.dyn (Dynamo 4.0.2.3852)

code_block = CodeBlock { 0..50; true; }
toString = Custom[List.ToString](list=code_block.out0, multiline=code_block.out1)  # Serializes a (nested) list or dictionary of basic objects into a valid design script syntax string.
watch = Watch(toString)
