# Dynamo graph MaxIndex.dyn (Dynamo 4.0.2.3852)

watch = Watch()  # unwired: arg0
code_block = CodeBlock { 5; }
randomList = Math.RandomList(amount=code_block)
maxIndex = Custom[List.MaxIndex](list=randomList)  # Gets the maximum index of a list. Good for use with floating point values
watch_2 = Watch(maxIndex.val)
watch_3 = Watch(maxIndex.idx)
