# Dynamo graph MergeByBoolMask.dyn "DifferentiateDisplay" (Dynamo 4.0.2.3852)

code_block = CodeBlock { 0..4; "A".."D"; [true, false, true, false, false, true, true, false]; }
mergeByBoolMask = Custom[List.MergeByBoolMask](In=code_block.out0, Out=code_block.out1, mask=code_block.out2)  # Merge two lists by a boolean mask list. The true count in the mask should be the same as the length of the true list and vice versa for the false list.
watch = Watch(mergeByBoolMask)
