# Dynamo graph MinIndex.dyn (Dynamo 4.0.2.3852)

watch = Watch()  # unwired: arg0
code_block = CodeBlock { 5; }
randomList = Math.RandomList(amount=code_block)
minIndex = Custom[List.MinIndex](list=randomList)  # Gets the minimum index of a list. Good for use with floating point values
watch_2 = Watch(minIndex.val)
watch_3 = Watch(minIndex.idx)
