# Dynamo graph NullAllIndexOf.dyn (Dynamo 4.0.2.3852)

watch = Watch()  # unwired: arg0
code_block = CodeBlock { [null, 0, 1, null, 1, 1, 1, 3, 4, null]; }
code_block_2 = CodeBlock { 1; }
nullIndexOf = Custom[List.NullIndexOf](list=code_block, element=code_block_2)  # Similar to the bult-in node but provides a null value instead of -1 of failure. Part of the SmartCopyMonitor workflow.
watch_2 = Watch(nullIndexOf)
