# Dynamo graph NullAllIndicesOf.dyn (Dynamo 4.0.2.3852)

watch = Watch()  # unwired: arg0
code_block = CodeBlock { [null, 0, 1, null, 1, 1, 1, 3, 4, null]; }
code_block_2 = CodeBlock { 1; }
nullAllIndicesOf = Custom[List.NullAllIndicesOf](list=code_block, value=code_block_2)  # list all of the indices of a list that match the specified value. Capable of handling null values, part of the SmartCopyMonitor workflow.
watch_2 = Watch(nullAllIndicesOf)
