# Dynamo graph NullReorder.dyn (Dynamo 4.0.2.3852)

watch = Watch()  # unwired: arg0
code_block = CodeBlock { "A".."I"; }
code_block_2 = CodeBlock { [null, 6, 5, null, 2, 3, 4, 1, 0, null]; }
nullReorder = Custom[List.NullReorder](list=code_block, indices=code_block_2)  # Simiar to the built-in function with the difference that it can handle null indices. Part of the SmartCopyMonitor workflow.
watch_2 = Watch(nullReorder)
