# Dynamo graph NullSetDifference.dyn (Dynamo 4.0.2.3852)

watch = Watch()  # unwired: arg0
code_block = CodeBlock { [null, 6, 5, null, 2, 3, 4, 1, 0, null]; }
code_block_2 = CodeBlock { [2, 3, 4, 1, 0, null]; }
nullSetDifference = Custom[List.NullSetDifference](list1=code_block, list2=code_block_2)  # Similar to the built in node, with a built-in safety for null values. Part of the SmartCopyMonitor workflow.
watch_2 = Watch(nullSetDifference)
