# Dynamo graph RandomDivide.dyn (Dynamo 4.0.2.3852)

code_block = CodeBlock { 0..50; [0.6, 0.4]; 7; }
randomiseDivide = Custom[List.RandomiseDivide](list=code_block.out0, ratios=code_block.out1, seed=code_block.out2)  # Shiffles the input list and divides it into sub-lists based on ratios(1/4 + 1/2 + 1/4 will give you three lists split accordingly) The smalest ratio will always be 1 / the list length and the largest ratio will be 1. A seed input can shuffle the list further.
watch = Watch(randomiseDivide)
