# Dynamo graph SubPairs.dyn (Dynamo 4.0.2.3852)

watch = Watch()  # unwired: arg0
code_block = CodeBlock { [null, 6, 5, null, 2, 3, 4, 1, 0]; }
subpairs = Custom[List.Subpairs](list=code_block)  # Pair up each list item with the next one.
watch_2 = Watch(subpairs)
