# Dynamo graph SubPairsWrapped.dyn (Dynamo 4.0.2.3852)

watch = Watch()  # unwired: arg0
code_block = CodeBlock { [null, 6, 5, null, 2, 3, 4, 1, 0]; }
subpairsWrapped = Custom[List.SubpairsWrapped](list=code_block)  # Wrap the list and pair up each list item with the next one.
watch_2 = Watch(subpairsWrapped)
