# Dynamo graph Median.dyn (Dynamo 4.0.2.3852)

watch = Watch()  # unwired: arg0
code_block = CodeBlock { [6, 5, 2, 3, 4, 1, 0]; }
median = Custom[Math.Median](list=code_block)  # Calculate a median value from a list of numbers
watch_2 = Watch(median)
