# Dynamo graph AlmostEqual.dyn (Dynamo 4.0.2.3852)

watch = Watch()  # unwired: arg0
code_block = CodeBlock { 2.04..4.80..#10; }
code_block_2 = CodeBlock { 3; 0.4; }
almostEqual = Custom[Number.AlmostEqual](a=code_block, b=code_block_2.out0, tolerance=code_block_2.out1)  # Checks if a number is almost equal to a value with a specified tollerance.
watch_2 = Watch(almostEqual)
