# Dynamo graph ToString.dyn (Dynamo 4.0.2.3852)

watch = Watch()  # unwired: arg0
code_block = CodeBlock { 6; }
randomList = Math.RandomList(amount=code_block)
code_block_2 = CodeBlock { 3; }
toString = Custom[Number.ToString](num=randomList, digits=code_block_2)  # Converts the input number(s) to string. You can optionally limit the number of digits.
watch_2 = Watch(toString)
