# Dynamo graph OpenViews.dyn (Dynamo 4.0.2.3852)

watch = Watch()  # unwired: arg0
boolean = BoolSelector(true)
openViews = Custom[Application.OpenViews](refresh=boolean)  # Lists all views currently open inside the Revit UI
watch_2 = Watch(openViews)
