# Dynamo graph AreaPlan.dyn (Dynamo 4.0.2.3852)

watch = Watch()  # unwired: arg0
levels = Levels("Level 0")
code_block = CodeBlock { "SpringsGreatAreaPlan"; "Rentable"; }
byLevelName = Custom[AreaPlan.ByLevelName](level=levels, name=code_block.out0, schemeName=code_block.out1)  # Creates an area plan at the designated levels. Each new view needs a name. An area scheme must first be activated before it can be used. To activate a scheme, place one view of that type in the project(you can then delete it). If a view with the same scheme and name exists, you'll get a null instead.
watch_2 = Watch(byLevelName)
