# Dynamo graph BrepShapeByGeometry.dyn (Dynamo 4.0.2.3852)

watch = Watch()  # unwired: arg0
byLengths = Cuboid.ByLengths()
categories = Categories("OST_Windows")
code_block = CodeBlock { "SpringsGreatWindow"; }
code_block_2 = CodeBlock { "Default"; }
byName = Material.ByName(name=code_block_2)
byGeometry = Custom[BrepShape.ByGeometry](geometry=byLengths, category=categories, name=code_block, material=byName)  # Convert the input geometry to DirectShape element inside the Revit document. Works only in Revit 2017 and later. Uses the more advanced BrepBuilder. It supports solids or surfaces, however periodic faces like spheres, cylinders and cones are not supported. Each created DS will have a unique type. Make sure that each input geometry has a unique name. You can either feed a single category and material for all geometries or a unique one for each geometry - the node's lacing is set to longest by default. The default category is Generic Model.
watch_2 = Watch(byGeometry)
