# Dynamo graph DecimalToColor.dyn (Dynamo 4.0.2.3852)

watch = Watch()  # unwired: arg0
code_block = CodeBlock { 5; 200; 100; }
byARGB = Color.ByARGB(red=code_block.out0, green=code_block.out1, blue=code_block.out2)
toDecimal = Custom[Color.ToDecimal](color=byARGB)  # Converts a Dynamo colour its Revit equivalent decimal value.
watch_2 = Watch(toDecimal)
toColor = Custom[Decimal.ToColor](decimal=watch_2)  # Converts a revit colour decimal value to its Dynamo equivalent.
watch_3 = Watch(toColor)
