# Dynamo graph DirectShapeByGeometry.dyn (Dynamo 4.0.2.3852)

byLengths = Cuboid.ByLengths()
categories = Categories("OST_Doors")
code_block = CodeBlock { "ExcellentSpringsDoor"; }
byGeometry = Custom[DirectShape.ByGeometry](geometry=byLengths, category=categories, name=code_block)  # Convert the input geometry to DirectShape element inside the Revit document. It supports solids or surfaces. It is based on an alternative process that uses a SAT import and can produce smooth surfaces. Each created DS will have a unique type. Make sure that each input geometry has a unique name. You can either feed a single category for all geometries or a unique category for each geometry - the node's lacing is set to longest by default. The default category is Generic Models.
watch = Watch(byGeometry)
code_block_2 = CodeBlock { 10; }
byOrigin = CoordinateSystem.ByOrigin(x=code_block_2, y=code_block_2)
transform = Custom[DirectShape.Transform](directShape=watch, coordSystem=byOrigin)  # Transforms the typed DirectShape element from the identity coordinate system to the input coordinate system(s), in a manner similar to Dynamo's Geometry.Transform node.
watch_2 = Watch(transform)
code_block_3 = CodeBlock { 40; }
byCoordinates = Vector.ByCoordinates(x=code_block_3, y=code_block_3, z=code_block_3)
translate = Custom[DirectShape.Translate](directShape=watch_2, vector=byCoordinates)  # Copy the input DirectShape element with the help of a translation vector, similarly to the Geometry.Translate node. This method should prove more efficient than Element.Copy
