# Dynamo graph ActiveView.dyn (Dynamo 4.0.2.3852)

boolean = BoolSelector(true)
activeView = Custom[Document.ActiveView](refresh=boolean)  # Selects the current document's active view. Supports more view types than the built-in option. Will be depreciated once the bult in node works with all plan types.
watch = Watch(activeView)
