# Dynamo graph CentralPath.dyn (Dynamo 4.0.2.3852)

boolean = BoolSelector(false)
centralPath = Custom[Document.CentralPath](refresh=boolean)  # If the document is workshared, the node returns the path to the central document as a string. Otherwise a null value will be returned.
watch = Watch(centralPath)
