# Dynamo graph CopyFromLinkInstance.dyn (Dynamo 4.0.2.3852)

select_model_element = DSModelElementSelection()  # 1 picked in the model
categories = Categories("OST_Walls")
allElementsOfCategory = LinkInstance.AllElementsOfCategory(linkInstance=select_model_element, category=categories)
copyFromLinkInstance = Custom[Document.CopyFromLinkInstance](linkInstance=select_model_element, element=allElementsOfCategory)  # The node will use the total transformation of the link instance to copy the input elements into the local document.
watch = Watch(copyFromLinkInstance)
