# Dynamo graph CopyFromViewToView.dyn (Dynamo 4.0.2.3852)

views = Views("Level 0")
views_2 = Views("Level 1")
categories = Categories("OST_TextNotes")
all_elements_of_category_in_view = ElementsOfCategoryInView(Category=categories, View=views)
copyFromViewToView = Custom[Document.CopyFromViewToView](sourceView=views, destView=views_2, elements=all_elements_of_category_in_view)  # The node will copy the input (view based) elements from the source view into the destination view.
watch = Watch(copyFromViewToView)
