# Dynamo graph DeleteElements.dyn (Dynamo 4.0.2.3852)

categories = Categories("OST_TextNotes")
views = Views("Level 1")
all_elements_of_category_in_view = ElementsOfCategoryInView(Category=categories, View=views)
boolean = BoolSelector(true)
deleteElements = Custom[Document.DeleteElements](element=all_elements_of_category_in_view, confirm=boolean)  # Attempts to delete the input list of elements from the active Revit document.The node returns the number of successfully deleted elements and their Ids as a string. Carefully observe the deleted elements count. It may be greater than the input list because hosted elements or tags will be deleted as well. If an element in the list can not be deleted (for example last revision or last view), the whole list will fail to be deleted.
watch = Watch(deleteElements.deletedIds_str)
watch_2 = Watch(deleteElements.count)
watch_3 = Watch(deleteElements.failedIds_str)
