# Dynamo graph AdaptiveBySimpleGeometry.dyn (Dynamo 4.0.2.3852)

byLengths = Cuboid.ByLengths()
file_path = Filename("..\..\..\..\..\..\..\..\ProgramData\Autodesk\RVT 2027\Family Templates\English\Metric Generic Model Adaptive.rft")
code_block = CodeBlock { "SpringsAwesomeAdaptiveFamily"; }
adaptiveBySimpleGeometry = Custom[ElementType.AdaptiveBySimpleGeometry](geometry=byLengths, familyTemplatePath=file_path, familyName=code_block)  # Genearate a new eight point adaptive component family type from any solid or polysurface consisting of planar faces. Faces with openigs are not supported.
watch = Watch(adaptiveBySimpleGeometry.family)
watch_2 = Watch(adaptiveBySimpleGeometry.type)
