# Dynamo graph TypeDuplicate.dyn (Dynamo 4.0.2.3852)

family_types = FamilyTypes("Windows_Sgl_Plain:910x910mm")
code_block = CodeBlock { "SpringsAwesomeWindowType"; }
duplicate = Custom[ElementType.Duplicate](elementType=family_types, newName=code_block)  # Create duplicate element types. If the type exists, it will be appended instead.
watch = Watch(duplicate)
