# Dynamo graph TypeInstances.dyn (Dynamo 4.0.2.3852)

select_face = DSFaceSelection()  # 1 picked in the model
family_types = FamilyTypes("Family10:Family10")
select_model_element = DSModelElementSelection()  # 1 picked in the model
boundingBox = Element.BoundingBox(element=select_model_element)
maxPoint = BoundingBox.MaxPoint(boundingBox=boundingBox)
python_script = Python(IN[0]=select_face, IN[1]=family_types, IN[2]=maxPoint)  # PythonNet3
# ---------- python_script.python (89 lines) ----------
#-Reope----------------------------------------#
#                                              #
#      Copyright(c) 2018, Dimitar Venkov       #
#                                              #
# https://github.com/dimven/SpringNodes/issues #
# https://www.reope.com/                       #
#                                              #
#-Reope-----Updated by Mark Ackerley-----------#

import clr

clr.AddReference('ProtoGeometry')
from Autodesk.DesignScript.Geometry import *

clr.AddReference('RevitServices')
from RevitServices.Persistence import DocumentManager
from RevitServices.Transactions import TransactionManager
doc = DocumentManager.Instance.CurrentDBDocument

clr.AddReference('RevitAPI')
import Autodesk.Revit.DB as DB


def tolist(x):
    if isinstance(x, str): return [x]
    return x if isinstance(x, list) else [x]

def first(x):
    return x[0] if isinstance(x, list) else x

def ds_point_to_xyz(pt):
    """Explicit conversion: DS Point → DB.XYZ"""
    return DB.XYZ(pt.X, pt.Y, pt.Z)

def ds_vector_to_xyz(v):
    """Explicit conversion: DS Vector → DB.XYZ"""
    return DB.XYZ(v.X, v.Y, v.Z)


try:
    host = first(IN[0])
    ftype = UnwrapElement(tolist(IN[1]))
    pts = tolist(IN[2])

    OUT = []
    ftp_len = len(ftype) == 1
    ref1 = host.Tags.LookupTag("RevitFaceReference")

    TransactionManager.Instance.EnsureInTransaction(doc)

    for i, p in enumerate(pts):
        j = 0 if ftp_len else i

        if not ftype[j].IsActive:
            ftype[j].Activate()

        faceNor = host.NormalAtPoint(p)
        up = Vector.ZAxis()

        # horizontal?
        if abs(faceNor.Dot(up)) > 0.9999:
            dir1 = DB.XYZ.BasisX
        else:
            cross = faceNor.Cross(up)
            dir1 = ds_vector_to_xyz(cross)
            
        xf = host.GetTransform()
        pXyz = ds_point_to_xyz(p)
        p_transform = xf.OfPoint(pXyz)    

        try:
            inst1 = doc.Create.NewFamilyInstance(
                ref1,
                p_transform,   # <-- EXPLICIT
                dir1,                 # <-- EXPLICIT
                ftype[j]
            )
            OUT.append(inst1.ToDSType(False))
        except Exception as ex:
            OUT.append(str(ex))

    TransactionManager.Instance.TransactionTaskDone()

except Exception as e:
    import traceback
    OUT = "Exception:\n{0}\n\nTraceback:\n{1}".format(
        str(e),
        traceback.format_exc()
    )
# ----------------------------------------
watch = Watch(python_script)
byFaceAndPoint = Custom[FamilyInstance.ByFaceAndPoint]()  # Places instances on the input face oriented to the face's U tangent and the global Z axis.; unwired: face, type, point
code_block = CodeBlock { 0.5; }
pointAtParameter = Surface.PointAtParameter(surface=select_face, u=code_block, v=code_block)
getLocation = Element.GetLocation(element=select_model_element)
endPoint = Curve.EndPoint(curve=getLocation)
