# Dynamo graph GetParameterUnitValue.dyn (Dynamo 4.0.2.3852)

select_model_element = DSModelElementSelection()  # 1 picked in the model
code_block = CodeBlock { "Length"; }
getParameterUnitValue = Custom[Element.GetParameterUnitValue](element=select_model_element, paramName=code_block)  # Converts from internal units to the currently set Revit display units. Useful only for parameters with numeric values. If no Value is found, will return a blank string.
watch = Watch(getParameterUnitValue)
