# Dynamo graph IsCut.dyn (Dynamo 4.0.2.3852)

select_model_element = DSModelElementSelection()  # 1 picked in the model
isCut = Custom[Element.IsCut](element=select_model_element)  # Tests if the element is being cut by any void instances. If any cuts exist all cutting elements will be provided.
watch = Watch(isCut.bool)
watch_2 = Watch(isCut.cutter)
