# Dynamo graph IsCutting.dyn (Dynamo 4.0.2.3852)

select_model_element = DSModelElementSelection()  # 1 picked in the model
isCutting = Custom[Element.IsCutting](element=select_model_element)  # Tests if the input element (or elements) is a void cut and if it is cutting any elements. In such cases, the cut elements will be provided.
watch = Watch(isCutting.bool)
watch_2 = Watch(isCutting.cutElements)
