# Dynamo graph MeshGeometry.dyn (Dynamo 4.0.2.3852)

select_model_element = DSModelElementSelection()  # 1 picked in the model
meshGeometry = Custom[Element.MeshGeometry](element=select_model_element)  # Reads an element's geometry and converts it to either a Dynamo mesh or a toolkit mesh representation. The node will return Dynamo meshes by default. The LOD input represents the triangulation factor. Its range is from 0 to 1. 0 is the lowest level of detail and 1 is the highest. It's set to 0 by default.
watch = Watch(meshGeometry)
