# Dynamo graph RemoveVoidCut.dyn (Dynamo 4.0.2.3852)

select_model_element = DSModelElementSelection()  # 1 picked in the model
categories = Categories("OST_GenericModel")
all_elements_of_category = ElementsOfCategory(Category=categories)
removeVoidCut = Custom[Element.RemoveVoidCut](elementBeingCut=select_model_element, cuttingElement=all_elements_of_category)  # Removes the void cut between the input elements, if such exists.
watch = Watch(removeVoidCut)
