# Dynamo graph SetLocation.dyn (Dynamo 4.0.2.3852)

select_model_element = DSModelElementSelection()  # 1 picked in the model
code_block = CodeBlock { 0; 2000; }
byCoordinates = Point.ByCoordinates(x=code_block.out0, y=code_block.out0)
byCoordinates_2 = Point.ByCoordinates(x=code_block.out0, y=code_block.out1)
byStartPointEndPoint = Line.ByStartPointEndPoint(startPoint=byCoordinates, endPoint=byCoordinates_2)
setLocation = Custom[Element.SetLocation](element=select_model_element, location=byStartPointEndPoint)  # Attempts to modify the location of the input element. This can effectively add as a move comand in Revit. Works for both line based and point based elements.
watch = Watch(setLocation)
