# Dynamo graph SetParameterToNone.dyn (Dynamo 4.0.2.3852)

select_model_element = DSModelElementSelection()  # 1 picked in the model
code_block = CodeBlock { "Top Constraint"; }
setParameterToNone = Custom[Element.SetParameterToNone](element=select_model_element, paramName=code_block)  # Used to set parameters such as View Template, Phase Demolished or Top Constraint to None / Unconstrained.
watch = Watch(setParameterToNone)
