# Dynamo graph Unjoin.dyn (Dynamo 4.0.2.3852)

select_model_element = DSModelElementSelection()  # 1 picked in the model
select_model_element_2 = DSModelElementSelection()  # 1 picked in the model
unjoin = Custom[Element.Unjoin](firstElement=select_model_element, secondElement=select_model_element_2)  # Unjoins the element(s) in the second list from the primary input element.
watch = Watch(unjoin)
