# Dynamo graph Instance.ByFaceAndPoint.dyn (Dynamo 4.0.2.3852)

select_face = DSFaceSelection()  # 1 picked in the model
family_types = FamilyTypes("Family10:Family10")
byGeometry = BoundingBox.ByGeometry(geom=select_face)
midPoint = Custom[BoundingBox.MidPoint](boundingBox=byGeometry)  # Fetches the mid point of the bounding box.
byFaceAndPoint = Custom[FamilyInstance.ByFaceAndPoint](face=select_face, type=family_types, point=midPoint)  # Places instances on the input face oriented to the face's U tangent and the global Z axis.
watch = Watch(byFaceAndPoint)
