# Dynamo graph Instance.ByGeometry.dyn (Dynamo 4.0.2.3852)

code_block = CodeBlock { 2000; }
byLengths = Cuboid.ByLengths(width=code_block)
list_create = List.Create(item0=byLengths, item1=byLengths)
byLengths_2 = Cuboid.ByLengths(length=code_block)
list_create_2 = List.Create(item0=byLengths_2)
byLengths_3 = Cuboid.ByLengths(height=code_block)
list_create_3 = List.Create(item0=byLengths_3, item1=byLengths_3, item2=byLengths_3)
byLengths_4 = Cuboid.ByLengths(length=code_block)
list_create_4 = List.Create(item0=byLengths_4)
byLengths_5 = Cuboid.ByLengths(length=code_block)
list_create_5 = List.Create(item0=byLengths_5)
list_create_6 = List.Create(item0=list_create, item1=list_create_2, item2=list_create_3, item3=list_create_4, item4=list_create_5)
isEmpty = List.IsEmpty(list=list_create_6@L2)
filterByBoolMask = List.FilterByBoolMask(list=list_create_6, mask=isEmpty)
watch = Watch(filterByBoolMask.out)
file_path = Filename("..\..\..\ProgramData\Autodesk\RVT 2025\Family Templates\English\Metric Generic Model.rft")
count = List.Count(list=watch)
code_block_2 = CodeBlock(x=count) { "Super-Families" + (1..x); }
watch_2 = Watch(code_block_2)
byGeometry = Custom[FamilyInstance.ByGeometry](geometry=watch@L2, familyTemplatePath=file_path, familyName=watch_2@L1)  # You must provide a valid family template path that will be used for all input geometry objects. The project units(and not the templates) will be used to determine the size of the output geometry. The provided category will be used only if the family template supports it. If not, the default template category will be used instead. Likewise, the family material(provided as a string) will be set only if a material with that name exists in the template. If not, the default material will be used instead ("By Category"). For void cuts, the material settings will be ignored. The Subcategory name is an optional input. If you'd like to skip assigning a Subcategory to any new instance, simply use null. The node expects a unique family name for each geometry object. The rest of the input lists will be processed as if the node lacing is set to longest.
watch_3 = Watch(byGeometry.instance)
watch_4 = Watch(byGeometry.family)
code_block_3 = CodeBlock { 1000; }
byLengths_6 = Cuboid.ByLengths(width=code_block_3, length=code_block_3, height=code_block_3)
file_path_2 = Filename("..\..\..\ProgramData\Autodesk\RVT 2025\Family Templates\English\Metric Generic Model.rft")
code_block_4 = CodeBlock { "Simple-Family"; }
byGeometry_2 = Custom[FamilyInstance.ByGeometry](geometry=byLengths_6, familyTemplatePath=file_path_2, familyName=code_block_4)
watch_5 = Watch(byGeometry_2.instance)
watch_6 = Watch(byGeometry_2.family)
code_block_5 = CodeBlock { [500,1000]; }
byLengths_7 = Cuboid.ByLengths(width=code_block_5, length=code_block_5, height=code_block_5, lacing=Longest)
file_path_3 = Filename("..\..\..\ProgramData\Autodesk\RVT 2025\Family Templates\English\Metric Generic Model.rft")
count_2 = List.Count(list=byLengths_7)
code_block_6 = CodeBlock(x=count_2) { "Simple-Families" + (1..x); }
byGeometry_3 = Custom[FamilyInstance.ByGeometry](geometry=byLengths_7, familyTemplatePath=file_path_3, familyName=code_block_6)
watch_7 = Watch(byGeometry_3.family)
watch_8 = Watch(byGeometry_3.instance)
code_block_7 = CodeBlock { 1000; }
byLengths_8 = Cuboid.ByLengths(width=code_block_7, length=code_block_7, height=code_block_7)
file_path_4 = Filename("..\..\..\..\..\..\..\..\ProgramData\Autodesk\RVT 2027\Family Templates\English\materialParameterTest.rft")
code_block_8 = CodeBlock { "Material-Family"; "materialParameterTest"; }
byGeometry_4 = Custom[FamilyInstance.ByGeometry](geometry=byLengths_8, familyTemplatePath=file_path_4, familyName=code_block_8.out0, materialParameterName=code_block_8.out1)
watch_9 = Watch(byGeometry_4.family)
watch_10 = Watch(byGeometry_4.instance)
