# Dynamo graph InstanceByHostAndPoint.dyn (Dynamo 4.0.2.3852)

select_model_element = DSModelElementSelection()  # 1 picked in the model
family_types = FamilyTypes("Windows_Sgl_Plain:910x1210mm")
boundingBox = Element.BoundingBox(element=select_model_element)
midPoint = Custom[BoundingBox.MidPoint](boundingBox=boundingBox)  # Fetches the mid point of the bounding box.
byHostAndPoint = Custom[FamilyInstance.ByHostAndPoint](host=select_model_element, type=family_types, point=midPoint)  # Creates hosted family instances(doors/windows) at the specified points. You can feed either a single family type or a unique type for each instance.
watch = Watch(byHostAndPoint)
