# Dynamo graph InstanceByPointsAndLevelBatch.dyn (Dynamo 4.0.2.3852)

code_block = CodeBlock { 0..20000..#10; }
byCoordinates = Point.ByCoordinates(x=code_block, y=code_block, lacing=CrossProduct)
family_types = FamilyTypes("Furniture_Desk:1525x762mm")
levels = Levels("Level 0")
byPointsLevelsBatch = Custom[FamilyInstance.ByPointsLevelsBatch](points=byCoordinates, type=family_types, level=levels)  # This node batch ceates level hosted family instances. You can feed either a single type/level that will be used for all instances or a unique type/level for each instance. Set track to false if you'd like to place instances on every run.
watch = Watch(byPointsLevelsBatch)
