# Dynamo graph FilledRegionByCurves.dyn (Dynamo 4.0.2.3852)

views = Views("Level 0")
select_filled_region_type = FilledRegionTypes("Solid_Black")
code_block = CodeBlock { 1000; }
byWidthLength = Rectangle.ByWidthLength(width=code_block, length=code_block)
code_block_2 = CodeBlock(x=byWidthLength) { [x]; }
explode = Geometry.Explode(geometry=code_block_2)
byCurves = Custom[FilledRegion.ByCurves+](view=views, type=select_filled_region_type, curveLoops=explode)  # Fully utilizes the FilledRegion.Create api method, unlike the OOTB node. You must provide a list with sublist of curve loops.
watch = Watch(byCurves)
