# Dynamo graph FormByGeometry.dyn (Dynamo 4.0.2.3852)

byLengths = Cuboid.ByLengths()
byGeometry = Custom[Form.ByGeometry](geometry=byLengths)  # Convert the input geometry to a Revit Form object. Forms can exist only in the family environment. You can convert complicated solids or surfaces directly into forms. A form can act as a void. Provide either one true boolean value to convert a form into a void. The node's lacing is set to longest by default.
watch = Watch(byGeometry)
