# Dynamo graph DwgGeometryByInstance.dyn (Dynamo 4.0.2.3852)

# group: Select DWG Link Instance
select_model_element = DSModelElementSelection()  # 1 picked in the model

boolean = BoolSelector(false)

# group: Get DWG geometry
dwgGeometryByInstance = Custom[RevitLinkType.DwgGeometryByInstance](linkInstance=select_model_element, Refresh=boolean)  # Retrieves DWG Geometry from an Instance, attempts to parse to Dynamo geometry, where it can't, it returns the original.

# group: Split out solids
# note: So, this is super fun.
# All of the various solids in the dwg related to the chambers get mashed into 1 solid. also, the surfaces of the titleblock do as well!
# So, once we isolate the chamber surfaces from the topo surface using the layer key text, we are left with a flat list of surfaces to reconstruct.
# So once we've tidied up our list structure, we run code that finds shared edges and groups surfaces accordingly,
# Then we attempt to union them back together.
# Now we have relatively few polysurfaces to clash against the line end points to see if the point should shift because it is the bottom rather than the top of the pipe.
# note: And another thing!  If the surfaces are on multiple layers, they appear to be merged onto 1 layer
restOfItems = List.RestOfItems(list=dwgGeometryByInstance.solidSurfaces)

watch = Watch(restOfItems)
watch_2 = Watch(dwgGeometryByInstance.lines)
