# Dynamo graph IsLoaded.dyn (Dynamo 4.0.2.3852)

element_classes = ElementTypes("RevitLinkType")
all_elements_of_class = ElementsOfType(element_class=element_classes)
isLoaded = Custom[RevitLinkType.IsLoaded](linkType=all_elements_of_class)  # Checks if a rvt link is loaded
watch = Watch(isLoaded)
