# Dynamo graph OpeningInFloorByCurves.dyn (Dynamo 4.0.2.3852)

select_model_element = DSModelElementSelection()  # 1 picked in the model
code_block = CodeBlock { 1000; }
byWidthLength = Rectangle.ByWidthLength(width=code_block, length=code_block)
explode = Geometry.Explode(geometry=byWidthLength)
code_block_2 = CodeBlock(x=explode) { [x]; }
inFloorByCurves = Custom[Opening.InFloorByCurves](host=select_model_element, curves=code_block_2)  # Create hosted floor opeinngs through the input floors. The second input is a list of sub-lists of the boundary curves.
watch = Watch(inFloorByCurves)
