# Dynamo graph ShaftByCurves.dyn (Dynamo 4.0.2.3852)

code_block = CodeBlock { 1000; }
byWidthLength = Rectangle.ByWidthLength(width=code_block, length=code_block)
explode = Geometry.Explode(geometry=byWidthLength)
code_block_2 = CodeBlock(x=explode) { [x]; }
levels = Levels("Level 0")
levels_2 = Levels("Level 1")
shaftByCurves = Custom[Opening.ShaftByCurves](curves=code_block_2, baseLevel=levels, topLevel=levels_2)  # Creates a shaft opening. The top level MUST be higher than the base level for a successful execution. You can either provide one base and top level for all shafts or have unique levels for each shaft instance.
watch = Watch(shaftByCurves)
