# Dynamo graph ScopeBoxGeometry.dyn (Dynamo 4.0.2.3852)

select_model_element = DSModelElementSelection()  # 1 picked in the model
geometry = Custom[ScopeBox.Geometry](scopeBox=select_model_element)  # Fetches the base curve and solid representation of a scope box element.
watch = Watch(geometry.polyCurve)
watch_2 = Watch(geometry.solid)
