# Dynamo graph AllElementsOf.dyn (Dynamo 4.0.2.3852)

categories = Categories("OST_Doors")
boolean = BoolSelector(true)
allElementsOf = Custom[Collect.AllElementsOf](CategoryOrClass=categories, refresh=boolean)  # Works with either categories or types and uses multi-filters to get multiple groups with a single query. Can be applied as a function. No ties to the Document.Changed event.
watch = Watch(allElementsOf)
