# Dynamo graph AllTypesOf.dyn (Dynamo 4.0.2.3852)

categories = Categories("OST_Doors")
boolean = BoolSelector(true)
allTypesOf = Custom[Collect.AllTypesOf](CategoryOrClass=categories, refresh=boolean)  # Works with either categories, element types or revit classes and uses multi-filters to get multiple groups with a single query. Can be applied as a function. No ties to the Document.Changed event.
watch = Watch(allTypesOf)
