# Dynamo graph CurrentSelection.dyn (Dynamo 4.0.2.3852)

boolean = BoolSelector(true)
currentSelection = Custom[Collect.CurrentSelection](refresh=boolean)  # Gets the currently selected elements. Connect a boolean switch to refresh the selection.
watch = Watch(currentSelection)
