# Dynamo graph ElementSketch.dyn (Dynamo 4.0.2.3852)

select_model_element = DSModelElementSelection()  # 1 picked in the model
boolean = BoolSelector(true)
boolean_2 = BoolSelector(true)
elementSketch = Custom[Collect.ElementSketch](element=select_model_element, fetchModelCurves=boolean, refresh=boolean_2)  # Get the actual sketch lines of a sketch based element (floor, ceiling, modified wall, etc.) . You can optionally fetch the matching model curves, however this might prove comptationally heavy on larger data sets. Does not work with elements from linked files.
watch = Watch(elementSketch.curves)
watch_2 = Watch(elementSketch.model_curves)
