# Dynamo graph ElementsInView.dyn (Dynamo 4.0.2.3852)

views = Views("Level 0")
categories = Categories("OST_Windows")
boolean = BoolSelector(true)
elementsInView = Custom[Collect.ElementsInView](view=views, category=categories, refresh=boolean)  # Selects all elements visible in the input view.
watch = Watch(elementsInView)
