# Dynamo graph LinkedInstanceElements.dyn (Dynamo 4.0.2.3852)

select_model_element = DSModelElementSelection()  # 1 picked in the model
categories = Categories("OST_Walls")
boolean = BoolSelector(true)
linkedInstanceElements = Custom[Collect.LinkedInstanceElements](linkInstance=select_model_element, CategoryOrClass=categories, refresh=boolean)  # Extract elements by category from the selected linked instances. The transform CS can be used to get the exact location of the elements in the host file. If an error occurs or the linked document is unloaded, an error will be returned in the elements output and the appropriate transform will be a null. You can use those nulls to filter out the errors.
watch = Watch(linkedInstanceElements.transform)
watch_2 = Watch(linkedInstanceElements.elements)
