# Dynamo graph Revisions.dyn (Dynamo 4.0.2.3852)

code_block = CodeBlock { "06/06/2026"; }
boolean = BoolSelector(true)
revisions = Custom[Collect.Revisions](date=code_block, refresh=boolean)  # Collects all revision clouds from a specific date.
watch = Watch(revisions.matched)
watch_2 = Watch(revisions.all_revisions)
watch_3 = Watch()  # unwired: arg0
