# Dynamo graph Sheets.dyn (Dynamo 4.0.2.3852)

code_block = CodeBlock { "A102"; }
boolean = BoolSelector(false)
boolean_2 = BoolSelector(true)
sheets = Custom[Collect.Sheets](searchFor=code_block, NameOrNumber=boolean, refresh=boolean_2)  # Search for sheets by either their name or their number. Use a false boolean switch to search by number.
watch = Watch(sheets.exact_match)
watch_2 = Watch(sheets.partial_match)
watch_3 = Watch()  # unwired: arg0
