# Dynamo graph View3dTemplates.dyn (Dynamo 4.0.2.3852)

boolean = BoolSelector(true)
view3DTemplates = Custom[Collect.View3DTemplates](refresh=boolean)  # Gets all 3d view templates and returns them to Dynamo as generic Elements
watch = Watch(view3DTemplates)
watch_2 = Watch()  # unwired: arg0
