# Dynamo graph Views.dyn (Dynamo 4.0.2.3852)

code_block = CodeBlock { "Level 0"; }
boolean = BoolSelector(true)
boolean_2 = BoolSelector(false)
views = Custom[Collect.Views](name=code_block, IncludeSchedules=boolean, refresh=boolean_2)  # Search for views based on naming. You can choose to either include or exclude schedules. Use the sheet collector for sheets.
watch = Watch(views.exact_match)
watch_2 = Watch(views.partial_match)
