# Dynamo graph SelectElementsInOrder.dyn (Dynamo 4.0.2.3852)

boolean = BoolSelector(true)
selectElementsInOrder = Custom[SelectElementsInOrder](refresh=boolean)  # Select multiple elements from the Revit document in the desired order. Hit ESC to stop picking. To refresh the node, connect a boolean switch node.
watch = Watch(selectElementsInOrder)
