# Dynamo graph SelectFaces+.dyn (Dynamo 4.0.2.3852)

boolean = BoolSelector(true)
selectFaces = Custom[SelectFaces+](refresh=boolean)  # Select multiple faces from inside the Revit UI. Be sure to press "Finish" once done. Unlike the built-in node, face references of instances will be added sucessfully and you'l get the pick points. You can use a Boolean toggle to refresh your selection.
watch = Watch(selectFaces.faces)
watch_2 = Watch(selectFaces.pickPoints)
