# Dynamo graph SelectInRevit.dyn (Dynamo 4.0.2.3852)

select_model_element = DSModelElementSelection()  # 1 picked in the model
boolean = BoolSelector(true)
selectInRevit = Custom[SelectInRevit](element=select_model_element, reset=boolean)  # Selects the input elements inside the Revit UI.
watch = Watch(selectInRevit)
