# Dynamo graph SelectLinkedElement.dyn (Dynamo 4.0.2.3852)

boolean = BoolSelector(true)
selectLinkedElement = Custom[SelectLinkedElement](refresh=boolean)  # Select the linked instance first, followed by the element. If your selection fails, just press escape. To refresh the node, connect a boolean switch node.
watch = Watch(selectLinkedElement.element)
watch_2 = Watch(selectLinkedElement.transform)
