# Dynamo graph SelectLinkedElements.dyn (Dynamo 4.0.2.3852)

boolean = BoolSelector(true)
selectLinkedElements = Custom[SelectLinkedElements](refresh=boolean)  # Select the linked instance first, followed by the elements. To finish the selection, press Finish. If your selection fails, just press escape or Cancel. To refresh the node, connect a boolean switch node.
watch = Watch(selectLinkedElements.transform)
watch_2 = Watch(selectLinkedElements.elements)
