# Dynamo graph SelectLinkedElementsInOrder.dyn (Dynamo 4.0.2.3852)

boolean = BoolSelector(true)
selectLinkedElementsInOrder = Custom[SelectLinkedElementsInOrder](refresh=boolean)  # Select the linked instance first. Then select multiple elements from the Revit document in the desired order. Hit ESC to stop picking. To refresh the node, connect a boolean switch node.
watch = Watch(selectLinkedElementsInOrder.transform)
watch_2 = Watch(selectLinkedElementsInOrder.elements)
