# Dynamo graph SelectLinkedFace.dyn (Dynamo 4.0.2.3852)

boolean = BoolSelector(true)
selectLinkedFace = Custom[SelectLinkedFace](refresh=boolean)  # Select the linked instance first, followed by the face. The face will be transformed to the host file's coordinate system. If your selection fails, just press escape. To refresh the node, connect a boolean switch node.
watch = Watch(selectLinkedFace.pickPoint)
watch_2 = Watch(selectLinkedFace.surface)
