# Dynamo graph SheetViews+.dyn (Dynamo 4.0.2.3852)

sheets = Sheets("Sheet")
views = Custom[Sheet.Views+](sheet=sheets)  # Extracts all views and schedules (minus the revision schedule) placed on the input sheet (or sheets). Will be depreciated once the bult in node works with all plan types.
watch = Watch(views.view_s)
watch_2 = Watch(views.schedule_s)
