# Dynamo graph TextNoteByPoint.dyn (Dynamo 4.0.2.3852)

views = Views("Level 0")
code_block = CodeBlock { 5000; }
byCoordinates = Point.ByCoordinates(x=code_block, y=code_block)
string = StringInput("Amazing Springs Text Note")
byPoint = Custom[TextNote.ByPoint](view=views, point=byCoordinates, content=string)  # Places a text note at a given point in the view. View, text type and content can either be a single item for all points or the same length as the number of points. Set track to false if you'd like to place notes on every run.
watch = Watch(byPoint)
