# Dynamo graph BeamsFixExtents.dyn (Dynamo 4.0.2.3852)

select_model_elements = DSModelElementsSelection()  # 5 picked in the model
code_block = CodeBlock { 250; }
boolean = BoolSelector(false)
fixExtents = Custom[Beams.FixExtents](beams=select_model_elements, margin=code_block, refresh=boolean)  # Detects all beams from the input list with broken extents(actual length - cut length < margin) and attemts to correct them.
watch = Watch(fixExtents)
code_block_2 = CodeBlock {  }
