# Dynamo graph GroupByDistance.dyn (Dynamo 4.0.2.3852)

select_model_elements = DSModelElementsSelection()  # 7 picked in the model
location = FamilyInstance.Location(familyInstance=select_model_elements)
isNull = Object.IsNull(object=location)
filterByBoolMask = List.FilterByBoolMask(list=select_model_elements, mask=isNull)
filterByBoolMask_2 = List.FilterByBoolMask(list=location, mask=isNull)
code_block = CodeBlock { 3000; }
groupByDistance = Custom[Elements.GroupByDistance](elements=filterByBoolMask.out, geometry=filterByBoolMask_2.out, margin=code_block)  # You'll need two equal length lists of geometry objects and elements. Splits the list of elements into groups if the distance between the coresponding geometry is less than the provided margin.
watch = Watch(groupByDistance.elements)
watch_2 = Watch(groupByDistance.points)
