# Dynamo graph CommonPaths.dyn (Dynamo 4.0.2.3852)

commonPaths = Custom[FamilyTemplatePaths.CommonPaths]()  # Fetches the default family template paths
watch = Watch(commonPaths.FamilyTemplateFolder)
watch_2 = Watch(commonPaths.GenericModelTemplate)
watch_3 = Watch(commonPaths.MassFamilyTemplate)
