# Dynamo graph ParseErrorReport.dyn (Dynamo 4.0.2.3852)

file_path = Filename("..\ParseErrorReport\LinkingTestFile_Error Report.html")
file_from_path = FileObject(path=file_path)
errorReport = Custom[Parse.ErrorReport](report=file_from_path)  # Process a Revit error report (HTML file) and extract the error types, all affected elements and the total number of errors. If you are executing from a document different than the one the error report belongs to, be sure to set "fetch_elements" to false.
watch = Watch(errorReport.error_messages)
watch_2 = Watch(errorReport.affected_elements)
watch_3 = Watch(errorReport.unique_errors)
watch_4 = Watch(errorReport.number_of_errors)
