# Dynamo graph ParseInterferanceReport.dyn (Dynamo 4.0.2.3852)

file_path = Filename("..\ParseInterferenceReport\LinkingTestFile.html")
file_from_path = FileObject(path=file_path)
interferenceCheck = Custom[Parse.InterferenceCheck](report=file_from_path)  # Process a Revit interference check (HTML file) and extract the interference categories, all affected elements and the total number of clashes. If you are executing from a document different than the one the error report belongs to, be sure to set "fetch_elements" to false.
watch = Watch(interferenceCheck.clash_categories)
watch_2 = Watch(interferenceCheck.affected_elements)
watch_3 = Watch(interferenceCheck.unique_cases)
watch_4 = Watch(interferenceCheck.number_of_clashes)
