# Dynamo graph EmptyWorkingSet.dyn (Dynamo 4.0.2.3852)

boolean = BoolSelector(true)
emptyWorkingSet = Custom[Process.EmptyWorkingSet](refresh=boolean)  # Use at your own risk! Removes as many pages as possible from the working set of the active Revit session.
watch = Watch(emptyWorkingSet)
