# Dynamo graph RelativeLevel.dyn (Dynamo 4.0.2.3852)

code_block = CodeBlock { [100, 3900]; }
code_block_2 = CodeBlock { [0, 4000]; }
code_block_3 = CodeBlock { ["Level 0", "Level 1"]; }
boolean = BoolSelector(false)
atHeight = Custom[RelativeLevel.AtHeight](zHeight=code_block, elevations=code_block_2, levels=code_block_3, belowOnly=boolean)  # Select the level closest to the input height from the list of input levels
watch = Watch(atHeight)
