# Dynamo graph ByViewsName.dyn (Dynamo 4.0.2.3852)

views = Views("Level 0")
views_2 = Views("Level 1")
list_create = List.Create(item0=views, item1=views_2)
code_block = CodeBlock { "SpringsAwesomeViewSet"; }
boolean = BoolSelector(false)
byViewsName = Custom[ViewSet.ByViewsName](views=list_create, setName=code_block, Overwrite=boolean)  # Creates a set of views(or sheets) for printing. If the set exists, set Overwrite to true to replace it.
watch = Watch(byViewsName)
