# Dynamo graph IsCurtainWall.dyn (Dynamo 4.0.2.3852)

categories = Categories("OST_Walls")
all_elements_of_category = ElementsOfCategory(Category=categories)
isCurtainWall = Custom[Wall.IsCurtainWall](wall=all_elements_of_category)  # Returns true if the wall is a curtain wall.
watch = Watch(isCurtainWall)
