# Dynamo graph RegEx.dyn (Dynamo 4.0.2.3852)

code_block = CodeBlock()
# ---------- code_block.designscript (3 lines) ----------
["Room_Copy12_Level03_Area_45.6", "Room_Copy7_Level12_Area_10.0",
"Room_Main_Level01_Area_32.4", "Room_Copy105_Level02_Area_5.25",
"Room_Test_Level99_Area_100.0"];
# ----------------------------------------
string = StringInput("Copy\d+")
regEx = Custom[String.RegEx](str=code_block, pattern=string)  # Returns true if the expression is met
watch = Watch(regEx)
code_block_2 = CodeBlock { "Room_Copy12_Level03_Area_45.6"; }
regEx_2 = Custom[String.RegEx](str=code_block_2, pattern=string)
watch_2 = Watch(regEx_2)
