# Dynamo graph ReplaceIllegalCharacters.dyn (Dynamo 4.0.2.3852)

watch = Watch()  # unwired: arg0
code_block = CodeBlock { "A B C D E * ?"; }
code_block_2 = CodeBlock { "NoNo"; "D"; }
replaceIllegalChars = Custom[String.ReplaceIllegalChars](str=code_block, replacement=code_block_2.out0, otherBadChars=code_block_2.out1)  # Replaces all characters in a string that are found in a commonly known list of illegal characters
watch_2 = Watch(replaceIllegalChars)
