# Dynamo graph RightSplitOnce.dyn (Dynamo 4.0.2.3852)

watch = Watch()  # unwired: arg0
code_block = CodeBlock { "A B A C D E * ?"; "A"; }
rightSplitOnce = Custom[String.RightSplitOnce](str=code_block.out0, splitChar=code_block.out1)  # Gets the tail of a string
watch_2 = Watch(rightSplitOnce)
