# Dynamo graph Feet.dyn (Dynamo 4.0.2.3852)

code_block = CodeBlock { 123.321; }
toFraction = Custom[Feet.ToFraction](number=code_block)  # Converts a decimal foot value to a fractional foot/inch string.
watch = Watch(toFraction)
