# Dynamo graph Feet_Debug.dyn (Dynamo 4.0.2.3852)

code_block = CodeBlock { number: var; }  # unwired: number
code_block_2 = CodeBlock { 123.123; }
toString = Custom[Number.ToString]()  # Converts the input number(s) to string. You can optionally limit the number of digits.; unwired: num
code_block_3 = CodeBlock(x=code_block_2, f1=toString)
# ---------- code_block_3.designscript (23 lines) ----------
sign = _x < 0 ? "-" : "";
x = Math.Abs(_x);
frac = Math.Pow(2, 1..8);
ft1 = Math.Floor(x);
in1 = (x - ft1) * 12;
in2 = Math.Floor(in1);
fr1 = (in1 - in2) * frac;
fr2 = Math.Round(fr1);
v1 = Math.Abs(fr1 - fr2);
ind1 = DSCore.List.FirstIndexOf(v1, DSCore.List.MinimumItem(v1));
fr3 = (__Apply(f1,fr2[ind1]) + "/" + __Apply(f1,frac[ind1]) )[0];
t0 = String.Substring(fr3, 0, 1) == String.Substring(fr3, -1, 1);
in3 = t0 ? (in2 + 1) : in2;
ft1s = __Apply(f1,ft1)[0] + "'";
in3s = __Apply(f1,in3)[0];
ft1str = ft1s == "0'" ? "" : ft1s;
t1 = in3 == 0;
t2 = fr3 == "0/2";
in2s = t1 ? "" : in3s;
fr3s = t2 || t0 ? "" : fr3;
mid = t1 || t2 || t0 ? "" : " ";
end = t1 && t2 ? "" : "\"";
sign+ft1str+in2s+mid+fr3s+end;
# ----------------------------------------
code_block_4 = CodeBlock(str=code_block_3.out22) { fraction(str); }  # frozen
code_block_5 = CodeBlock { _x = 123.123; }
code_block_6 = CodeBlock(x=code_block_5) { sign = _x < 0 ? "-" : ""; }
code_block_7 = CodeBlock(sign=code_block_6) { sign; }
code_block_8 = CodeBlock(sign=code_block_7) { sign; }
toString_2 = Custom[Number.ToString]()  # unwired: num
code_block_9 = CodeBlock(x=code_block_5) { x = Math.Abs(_x); }
code_block_10 = CodeBlock(x=code_block_9) { ft1 = Math.Floor(x); }
code_block_11 = CodeBlock(ft1=code_block_10) { ft1; }
code_block_12 = CodeBlock(ft1=code_block_11) { ft1; }
code_block_13 = CodeBlock(f1=toString_2, ft1=code_block_12) { ft1s = __Apply(f1,ft1)[0] + "'"; }
code_block_14 = CodeBlock(ft1s=code_block_13) { ft1str = ft1s == "0'" ? "" : ft1s; }
toString_3 = Custom[Number.ToString]()  # unwired: num
code_block_15 = CodeBlock(x=code_block_9, ft1=code_block_10) { in1 = (x - ft1) * 12; }
code_block_16 = CodeBlock(in1=code_block_15) { in2 = Math.Floor(in1); }
code_block_17 = CodeBlock { frac = Math.Pow(2, 1..8); }
code_block_18 = CodeBlock(in1=code_block_15, in2=code_block_16, frac=code_block_17) { fr1 = (in1 - in2) * frac; }
code_block_19 = CodeBlock(fr1=code_block_18) { fr2 = Math.Round(fr1); }
code_block_20 = CodeBlock(fr2=code_block_19) { fr2; }
code_block_21 = CodeBlock(fr1=code_block_18, fr2=code_block_19) { v1 = Math.Abs(fr1 - fr2); }
code_block_22 = CodeBlock(v1=code_block_21) { ind1 = DSCore.List.FirstIndexOf(v1, DSCore.List.MinimumItem(v1)); }
code_block_23 = CodeBlock(f1=toString_3, fr2=code_block_20, ind1=code_block_22) { __Apply(f1,fr2[ind1]); }
code_block_24 = CodeBlock { "/"; }
code_block_25 = CodeBlock(frac=code_block_17) { frac; }
code_block_26 = CodeBlock(f1=toString_3, frac=code_block_25, ind1=code_block_22) { __Apply(f1,frac[ind1]); }
code_block_27 = CodeBlock(x=code_block_23, y=code_block_24, z=code_block_26) { x + y + z; }
code_block_28 = CodeBlock(x=code_block_27) { fr3 = x[0]; }
code_block_29 = CodeBlock(fr3=code_block_28) { t0 = String.Substring(fr3, 0, 1) == String.Substring(fr3, -1, 1); }
code_block_30 = CodeBlock(in2=code_block_16) { in2; }
code_block_31 = CodeBlock(in2=code_block_30) { in2; }
code_block_32 = CodeBlock(t0=code_block_29, in2=code_block_31) { in3 = t0 ? (in2 + 1) : in2; }
code_block_33 = CodeBlock(in3=code_block_32) { t1 = in3 == 0; }
toString_4 = Custom[Number.ToString]()  # unwired: num
code_block_34 = CodeBlock(f1=toString_4, in3=code_block_32) { in3s = __Apply(f1,in3)[0]; }
code_block_35 = CodeBlock(t1=code_block_33, in3s=code_block_34) { in2s = t1 ? "" : in3s; }
code_block_36 = CodeBlock(fr3=code_block_28) { fr3; }
code_block_37 = CodeBlock(fr3=code_block_36) { fr3; }
code_block_38 = CodeBlock(fr3=code_block_37) { t2 = fr3 == "0/2"; }
code_block_39 = CodeBlock(t0=code_block_29) { t0; }
code_block_40 = CodeBlock(t0=code_block_39) { t0; }
code_block_41 = CodeBlock(t1=code_block_33, t2=code_block_38, t0=code_block_40) { mid = t1 || t2 || t0 ? "" : " "; }
code_block_42 = CodeBlock(t2=code_block_38, t0=code_block_40, fr3=code_block_37) { fr3s = t2 || t0 ? "" : fr3; }
code_block_43 = CodeBlock(t1=code_block_33, t2=code_block_38) { end = t1 && t2 ? "" : "\""; }
code_block_44 = CodeBlock(sign=code_block_8, ft1str=code_block_14, in2s=code_block_35, mid=code_block_41, fr3s=code_block_42, end=code_block_43) { sign+ft1str+in2s+mid+fr3s+end; }
code_block_45 = CodeBlock(str=code_block_44) { fraction(str); }  # frozen
code_block_46 = CodeBlock()  # // if less than 0 return empty string (invisible output)
code_block_47 = CodeBlock()
# ---------- code_block_47.designscript (2 lines) ----------
// if false return empty string (invisible output),
// if true return a space, (invisible output)
# ----------------------------------------
code_block_48 = CodeBlock()
# ---------- code_block_48.designscript (2 lines) ----------
// if false return empty string (invisible output),
// if true return a "
# ----------------------------------------
code_block_49 = CodeBlock()  # // not sure why 'fraction' is in there?
watch = Watch(code_block_44)
watch_2 = Watch(code_block_3.out22)
code_block_50 = CodeBlock { 123.321; }
toFraction = Custom[Feet.ToFraction](number=code_block_50)  # Converts a decimal foot value to a fractional foot/inch string.
watch_3 = Watch(toFraction)
code_block_51 = CodeBlock()  # // not sure why 'fraction' is in there?
