# Dynamo graph Fraction.dyn (Dynamo 4.0.2.3852)

string = StringInput("10'-3 1/2")
toFeet = Custom[Fraction.ToFeet](fraction=string)  # Converts a fractioned feet /inch string value into a decimal foot value.
watch = Watch(toFeet)
