# Dynamo graph Announce.dyn (Dynamo 4.0.2.3852)

string = StringInput("SomeTask")
code_block = CodeBlock { "SpringsTaskDone"; }
announce = Custom[Utility.Announce](passThrough=string, message=code_block)  # Uses the standard windows speech synthesiser to make an announcement when the note gets executed. Useful when placed after a long running task.
watch = Watch(announce)
