# Dynamo graph WriteExcel.dyn (Dynamo 4.0.2.3852)

file_path = Filename("E:\Github\SpringNodes\_tests\Utility\Excel\WriteExcel\TestOutput.xlsx")
boolean = BoolSelector(true)
code_block = CodeBlock { "SpringsTest"; }
code_block_2 = CodeBlock()
# ---------- code_block_2.designscript (4 lines) ----------
[["Name","Value","Notes"],
["Item A",100,"First row"],
["Item B",200,"Second row"],
["Item C",300,"Third row"]];
# ----------------------------------------

# group: Overwrite ignores the origin and puts the data after the last populated row
boolean_2 = BoolSelector(true)

write_excel_bumblebee = Custom[Write Excel Bumblebee](filePath=file_path, runIt=boolean, sheetName=code_block, data=code_block_2, overwrite=boolean_2)  # Writes data to an Excel file. Pass a single sheet name and a list of data for one sheet, or a list of sheet names and a matching list of datasets for multiple sheets. TEMPORARY SpringNodes shim — original node from the BumbleBee package by Konrad Sobon and David Mans (archi-lab.net / neoarchaic.net). Will be removed once BumbleBee is updated for PythonNet3 by the author.
watch = Watch(write_excel_bumblebee)
