# Dynamo graph GetData.dyn (Dynamo 4.0.2.3852)

code_block = CodeBlock { "FilteredWalls"; }
boolean = BoolSelector(true)
getData = Custom[Utility.GetData](key=code_block, refresh=boolean)  # Using the application's app domain, this node will try to fetch any data stored under the specified name. You'll need to first store the data with the `Utility.SetData` node.
watch = Watch(getData)
