# Dynamo graph SetData.dyn (Dynamo 4.0.2.3852)

code_block = CodeBlock { "FilteredWalls"; [000, 001, 002]; }
setData = Custom[Utility.SetData](key=code_block.out0, data=code_block.out1)  # Using the application's app domain, this node will store a reference to the input data under the specified name. use the `Utility.GetData` node to retrieve the data somewhere else. Try not to store large ammounts of data, because you risk creating a memory leak that will persist till you close down the aplication.
watch = Watch(setData)
