# Dynamo graph springs2_TestSuite_A.dyn (Dynamo 4.1.0.4676)
# packages: spring nodes 210.1.1

string = StringInput("""Dictionary.ByKeysValues
List.MergeByBoolMask
List.ToString
List.DropFirstLast
List.EveryOther
List.FilterByClassName
List.FirstLast
List.GetEvenOdd
List.ItemAtIndex+
List.NullAllIndicesOf
List.NullIndexOf
List.NullReorder
List.NullSetDifference
List.Split
List.Subpairs
List.RandomiseDivide""")
code_block = CodeBlock(names=string) { allNames = String.Split(names, "\n"); }

# group: List
code_block_2 = CodeBlock { "A".."D"; 0..3; [1, 3, 5]; }
# note: The list length check breaks backwads compatibility
byKeysValues = Custom[Dictionary.ByKeysValues](keys=code_block_2.out1, values=code_block_2.out0, searchKeys=code_block_2.out2)  # package spring nodes; Dictionaries are an incredibly powerful tool for making associative sets between two equal length lists. The first list must be of unique strings (or numbers) and will be the key and the second list will be the matching values (it can be made up of geometry, elements, even other lists) The search keys list will provide the corresponding value to the input key.
code_block_3 = CodeBlock { ["B", "D", null]; }
equals = List.Equals(object=byKeysValues, otherObject=code_block_3)
code_block_4 = CodeBlock { x = 0..5; x % 2 == 0; }
filterByBoolMask = List.FilterByBoolMask(list=code_block_4.x, mask=code_block_4.out1)
springs_list_mergebyboolmask = Custom[[springs] List.MergeByBoolMask](In=filterByBoolMask.in, Out=filterByBoolMask.out, mask=code_block_4.out1)  # package spring nodes; Merge two lists by a boolean mask list. The true count in the mask should be the same as the length of the true list and vice versa for the false list.
equals_2 = List.Equals(object=code_block_4.x, otherObject=springs_list_mergebyboolmask)
code_block_5 = CodeBlock { [[1, [2.3], "123"], true, null, {"1": 0, "2" : {"0" : 1}}]; 0; }
springs_list_tostring = Custom[[springs] List.ToString](list=code_block_5.out0)  # package spring nodes; Serializes a (nested) list or dictionary of basic objects into a valid design script syntax string.
code_block_6 = CodeBlock(s=springs_list_tostring) { "[[1, [2.3], \"123\"], true, null, {\"1\": 0, \"2\": {\"0\": 1}}]" == s; }
code_block_7 = CodeBlock { 1..3; }
springs_list_dropfirstlast = Custom[[springs] List.DropFirstLast](list=code_block_7)  # package spring nodes; Removes the first and last items from the list
code_block_8 = CodeBlock { [2]; [1, 3]; }
equals_3 = List.Equals(object=springs_list_dropfirstlast.rest, otherObject=code_block_8.out0)
equals_4 = List.Equals(object=springs_list_dropfirstlast.F_L, otherObject=code_block_8.out1)
and_ = equals_3 && equals_4
code_block_9 = CodeBlock { 1..3; }
springs_list_everyother = Custom[[springs] List.EveryOther](list=code_block_9)  # package spring nodes; Useful for when you want to combine an item on the list with every other item on the list. For example in list {1,2,3} , "2" will be paired up only with "1" and "3" and will not be paired up with itself.
code_block_10 = CodeBlock { [[2, 3], [1, 3], [1, 2]]; }
equals_5 = List.Equals(object=springs_list_everyother, otherObject=code_block_10)
code_block_11 = CodeBlock { [1, 2.3, "a", null]; "str"; }
filterByClassName = Custom[List.FilterByClassName](object=code_block_11.out0, className=code_block_11.out1)  # package spring nodes; Filters a list of objects by the object's class name. Note that Dynamo elements belong to different classes than their Revit counterparts. Use the Object.Class node to check an object's class.
filterByBoolMask_2 = List.FilterByBoolMask(list=code_block_11.out0, mask=filterByClassName)
code_block_12 = CodeBlock { ["a"]; }
equals_6 = List.Equals(object=filterByBoolMask_2.in, otherObject=code_block_12)
code_block_13 = CodeBlock { 1..5; }
springs_list_firstlast = Custom[[springs] List.FirstLast](list=code_block_13)  # package spring nodes; Simple utility node to get both the first and last items of a list as separate outputs. This avoids the unnecessary sublist when using the List.Deconstruct node.
code_block_14 = CodeBlock { [1,5]; }
equals_7 = List.Equals(object=springs_list_firstlast.combined, otherObject=code_block_14)
code_block_15 = CodeBlock(f=springs_list_firstlast.first, l=springs_list_firstlast.last, combined=equals_7) { f == 1 && l == 5 && combined; }
code_block_16 = CodeBlock { 0..10; }
getEvenOdd = Custom[List.GetEvenOdd](list=code_block_16)  # package spring nodes; Gets the even and odd indices from the list.
code_block_17 = CodeBlock { [0, 2, 4, 6, 8, 10]; [1, 3, 5, 7, 9]; }
equals_8 = List.Equals(object=getEvenOdd.even, otherObject=code_block_17.out0)
equals_9 = List.Equals(object=getEvenOdd.odd, otherObject=code_block_17.out1)
and_2 = equals_8 && equals_9
code_block_18 = CodeBlock { 0..10; -3; }
springs_list_itematindex = Custom[[springs] List.ItemAtIndex+](list=code_block_18.out0, index=code_block_18.out1)  # package spring nodes; Identical to the built in node but works with negative indices
code_block_19 = CodeBlock(x=springs_list_itematindex) { x[0] == 8; }
code_block_20 = CodeBlock { [null, 1, 2, 1, 0, null]; 1; }
springs_list_nullallindicesof = Custom[[springs] List.NullAllIndicesOf](list=code_block_20.out0, value=code_block_20.out1)  # package spring nodes; list all of the indices of a list that match the specified value. Capable of handling null values, part of the SmartCopyMonitor workflow.
code_block_21 = CodeBlock { [1, 3]; }
equals_10 = List.Equals(object=springs_list_nullallindicesof, otherObject=code_block_21)
code_block_22 = CodeBlock { 1..3; 0; }
springs_list_nullindexof = Custom[[springs] List.NullIndexOf](list=code_block_22.out0, element=code_block_22.out1)  # package spring nodes; Similar to the bult-in node but provides a null value instead of -1 of failure. Part of the SmartCopyMonitor workflow.
code_block_23 = CodeBlock(x=springs_list_nullindexof) { null == x; }
code_block_24 = CodeBlock { [null, 1, 2, 1, 0, null]; [1, 0, 2, null, 3]; }
springs_list_nullreorder = Custom[[springs] List.NullReorder](list=code_block_24.out0, indices=code_block_24.out1)  # package spring nodes; Simiar to the built-in function with the difference that it can handle null indices. Part of the SmartCopyMonitor workflow.
code_block_25 = CodeBlock { [1, null, 2, 0]; }
equals_11 = List.Equals(object=springs_list_nullreorder, otherObject=code_block_25)
code_block_26 = CodeBlock { 1..3; null; }
springs_list_nullsetdifference = Custom[[springs] List.NullSetDifference](list1=code_block_26.out0, list2=code_block_26.out1)  # package spring nodes; Similar to the built in node, with a built-in safety for null values. Part of the SmartCopyMonitor workflow.
code_block_27 = CodeBlock { 1..3; }
equals_12 = List.Equals(object=springs_list_nullsetdifference, otherObject=code_block_27)
code_block_28 = CodeBlock { 1..5; 2; }
springs_list_split = Custom[[springs] List.Split](list=code_block_28.out0, amount=code_block_28.out1)  # package spring nodes; Splits a list at the desired length
code_block_29 = CodeBlock { 1..2; 3..5; }
equals_13 = List.Equals(object=springs_list_split.list1, otherObject=code_block_29.out0)
equals_14 = List.Equals(object=springs_list_split.list2, otherObject=code_block_29.out1)
and_3 = equals_13 && equals_14
code_block_30 = CodeBlock { 1..4; }
springs_list_subpairs = Custom[[springs] List.Subpairs](list=code_block_30)  # package spring nodes; Pair up each list item with the next one.
code_block_31 = CodeBlock { [[1,2],[2,3],[3,4]]; }
equals_15 = List.Equals(object=springs_list_subpairs, otherObject=code_block_31)
code_block_32 = CodeBlock { 1..10; [1/2, 0.25]; }
randomiseDivide = Custom[List.RandomiseDivide](list=code_block_32.out0, ratios=code_block_32.out1)  # package spring nodes; Shiffles the input list and divides it into sub-lists based on ratios(1/4 + 1/2 + 1/4 will give you three lists split accordingly) The smalest ratio will always be 1 / the list length and the largest ratio will be 1. A seed input can shuffle the list further.
code_block_33 = CodeBlock { [[5, 2, 9, 8, 6], [10, 7], [4, 1], [3]]; }
equals_16 = List.Equals(object=randomiseDivide, otherObject=code_block_33)
watch = Watch(code_block_32.out0)

list_create = List.Create(item0=equals, item1=equals_2, item2=code_block_6, item3=and_, item4=equals_5, item5=equals_6, item6=code_block_15, item7=and_2, item8=code_block_19, item9=equals_10, item10=code_block_23, item11=equals_11, item12=equals_12, item13=and_3, item14=equals_15, item15=equals_16)
list_create_2 = List.Create(item0=code_block, item1=list_create)
code_block_34 = CodeBlock()
# ---------- code_block_34.designscript (7 lines) ----------
[
"Number.ToString",
"Number.AlmostEqual",
"String.ReplaceIllegalChars",
"String.RightSplitOnce",
"Fractions"
];
# ----------------------------------------

# group: Number
code_block_35 = CodeBlock { [1, 2.0, 3.333, 4.500]; }
toString = Custom[Number.ToString](num=code_block_35)  # package spring nodes; Converts the input number(s) to string. You can optionally limit the number of digits.
code_block_36 = CodeBlock { ["1", "2", "3.333", "4.5"]; }
equals_17 = List.Equals(object=toString, otherObject=code_block_36)
code_block_37 = CodeBlock { 3.51; 3.5099; }
springs_number_almostequal = Custom[[springs] Number.AlmostEqual](a=code_block_37.out0, b=code_block_37.out1)  # package spring nodes; Checks if a number is almost equal to a value with a specified tollerance.
code_block_38 = CodeBlock(x=springs_number_almostequal) { x; }

# group: String
code_block_39 = CodeBlock { "abc<!>#^'; \""; "<>"; }
springs_string = Custom[[springs] String.ReplaceIllegalChars](str=code_block_39.out0, otherBadChars=code_block_39.out1)  # package spring nodes; Replaces all characters in a string that are found in a commonly known list of illegal characters
string_2 = StringInput("abc_!_#^';__")
code_block_40 = CodeBlock(x=springs_string, s=string_2) { x[0] == s; }
code_block_41 = CodeBlock { "aa-bb-cc-dd"; "-"; }
springs_string_rightsplitonce = Custom[[springs] String.RightSplitOnce](str=code_block_41.out0, splitChar=code_block_41.out1)  # package spring nodes; Gets the tail of a string
code_block_42 = CodeBlock(x=springs_string_rightsplitonce) { x == "dd"; }

# group: Fraction
code_block_43 = CodeBlock { [-11.53, 2.6553, 5]; }
springs_feet_tofraction = Custom[[springs] Feet.ToFraction](number=code_block_43)  # package spring nodes; Converts a decimal foot value to a fractional foot/inch string.
springs_fraction_tofeet = Custom[[springs] Fraction.ToFeet](fraction=springs_feet_tofraction)  # package spring nodes; Converts a fractioned feet /inch string value into a decimal foot value.
code_block_44 = CodeBlock { 0.1; }
springs_number_almostequal_2 = Custom[[springs] Number.AlmostEqual](a=code_block_43, b=springs_fraction_tofeet, tolerance=code_block_44)
allTrue = List.AllTrue(list=springs_number_almostequal_2)

list_create_3 = List.Create(item0=equals_17, item1=code_block_38, item2=code_block_40, item3=code_block_42, item4=allTrue)
list_create_4 = List.Create(item0=code_block_34, item1=list_create_3)
string_3 = StringInput("""Point Serialization
Line Serialization
BoundingBox.2dRectangle
BoundingBox.Scale
BoundingBox.MidPoint
ClosedCurve.Offset+
Curve.Offset+
CurveLoop.Simplify
Geometry.GroupByDistance
Geometry.IndexByDistance
Geometry.Write/ReadTag
Geometry.SplitRecursively
Geometry.BoxedDistanceTo
Geometry.Extents
Line.StraightenXY/Z
LineLoop.Merge""")
code_block_45 = CodeBlock(names=string_3) { allNames = String.Split(names, "\n"); }

# group: Serialization
code_block_46 = CodeBlock { x = [20, 50, 50, 20]; y = [0, 0, 30, 30]; Point.ByCoordinates(x, y); }
springs_point_tostring = Custom[[springs] Point.ToString](point=code_block_46.out2)  # package spring nodes; Serilize a point to a string. You can use a custom delimier between the coordinates and apply an optional rounding. Works great with Revit text based parameters or Excel.
springs_string_topoint = Custom[[springs] String.ToPoint](str=springs_point_tostring)  # package spring nodes; De-serilize a Revit parameter string into a geometric point.
isAlmostEqualTo = Geometry.IsAlmostEqualTo(geometry=springs_string_topoint, other=code_block_46.out2)
allTrue_2 = List.AllTrue(list=isAlmostEqualTo)
code_block_47 = CodeBlock { 1; }
shiftIndices = List.ShiftIndices(list=code_block_46.out2, amount=code_block_47)
byStartPointEndPoint = Line.ByStartPointEndPoint(startPoint=code_block_46.out2, endPoint=shiftIndices)
springs_line_tostring = Custom[[springs] Line.ToString](line=byStartPointEndPoint)  # package spring nodes; Serilize a line to a string. You can use a custom delimier between the coordinates and apply an optional rounding. Works great with Revit text based parameters or Excel.
springs_string_toline = Custom[[springs] String.ToLine](str=springs_line_tostring)  # package spring nodes; De-serilize a Revit parameter string into a geometric line.
isAlmostEqualTo_2 = Geometry.IsAlmostEqualTo(geometry=byStartPointEndPoint, other=springs_string_toline)
allTrue_3 = List.AllTrue(list=isAlmostEqualTo_2)

# group: BoundingBox
code_block_48 = CodeBlock { Point.ByCoordinates(-10,-10,0); Point.ByCoordinates(10, 10, 15); }
byCorners = BoundingBox.ByCorners(min=code_block_48.out0, max=code_block_48.out1)
springs_boundingbox_2drectangle = Custom[[springs] BoundingBox.2dRectangle](boundingBox=byCorners)  # package spring nodes; Returns a 2d rectangle from a bounding box
points = Polygon.Points(polygon=springs_boundingbox_2drectangle)
code_block_49 = CodeBlock { Rectangle.ByWidthLength(20, 20); }
points_2 = Polygon.Points(polygon=code_block_49)
code_block_50 = CodeBlock { 1; }
shiftIndices_2 = List.ShiftIndices(list=points_2, amount=code_block_50)
isAlmostEqualTo_3 = Geometry.IsAlmostEqualTo(geometry=points, other=shiftIndices_2)
allTrue_4 = List.AllTrue(list=isAlmostEqualTo_3)
code_block_51 = CodeBlock()
# ---------- code_block_51.designscript (4 lines) ----------
[
Point.ByCoordinates(-15, -20, -2.625),
Point.ByCoordinates(15, 20, 17.625)
];
# ----------------------------------------
code_block_52 = CodeBlock { 1.5; -2; 1.35; }
scale = Custom[BoundingBox.Scale](boundingBox=byCorners, xAmmount=code_block_52.out0, yAmmount=code_block_52.out1, zAmmount=code_block_52.out2)  # package spring nodes; Scales the bounding box in three dimensions according to it's center.
minPoint = BoundingBox.MinPoint(boundingBox=scale)
maxPoint = BoundingBox.MaxPoint(boundingBox=scale)
list_create_5 = List.Create(item0=minPoint, item1=maxPoint)
isAlmostEqualTo_4 = Geometry.IsAlmostEqualTo(geometry=code_block_51, other=list_create_5)
allTrue_5 = List.AllTrue(list=isAlmostEqualTo_4)
midPoint = Custom[BoundingBox.MidPoint](boundingBox=scale)  # package spring nodes; Fetches the mid point of the bounding box.
code_block_53 = CodeBlock { Point.ByCoordinates(0, 0, 7.5); }
isAlmostEqualTo_5 = Geometry.IsAlmostEqualTo(geometry=midPoint, other=code_block_53)

# group: Curve Offset
code_block_54 = CodeBlock { x = [20, 50, 50, 20]; y = [0, 0, 30, 30]; Point.ByCoordinates(x, y); }
byControlPoints = NurbsCurve.ByControlPoints(points=code_block_54.out2)
code_block_55 = CodeBlock { -1; }
offset = Curve.Offset(curve=byControlPoints, distance=code_block_55)
code_block_56 = CodeBlock { 1; }
offset_2 = Custom[ClosedCurve.Offset+](curve=byControlPoints, distance=code_block_56)  # package spring nodes; Offsets a curve both ways and correctly differenciates the external and internal offset. If an offset goes beyond the curve's bounds, the result will fail and a null value will be appended instead. Also works for convex curves like arcs.
isAlmostEqualTo_6 = Geometry.IsAlmostEqualTo(geometry=offset, other=offset_2.internal_offset)
code_block_57 = CodeBlock(x=byControlPoints) { x; }
code_block_58 = CodeBlock { 1; }
offset_3 = Curve.Offset(curve=code_block_57, distance=code_block_58)
isAlmostEqualTo_7 = Geometry.IsAlmostEqualTo(geometry=offset_3, other=offset_2.external_offset)
and_4 = isAlmostEqualTo_6 && isAlmostEqualTo_7
code_block_59 = CodeBlock(p=code_block_54.out2) { 1; p[1]; }
offset_4 = Custom[Curve.Offset+](curve=byControlPoints, distance=code_block_59.out0, point=code_block_59.out1)  # package spring nodes; Offsets a curve towards the specified point
isAlmostEqualTo_8 = Geometry.IsAlmostEqualTo(geometry=offset_3, other=offset_4)

# group: Geometry methods
code_block_60 = CodeBlock()
# ---------- code_block_60.designscript (3 lines) ----------
r = Rectangle.ByWidthLength(30, 30).Translate
	(Vector.ByCoordinates(70, 15, 0));
curves = r.SplitByParameter(0..1..#10);
# ----------------------------------------
code_block_61 = CodeBlock(c=code_block_60.curves) { PolyCurve.ByJoinedCurves(c).Curves(); }
simplify = Custom[CurveLoop.Simplify](curveLoop=code_block_61)  # package spring nodes; Attempts to simplify an open or a closed curve loop by connecting straight separate line segments into a single line.
code_block_62 = CodeBlock(c=simplify) { List.Count(c) == 4; }
code_block_63 = CodeBlock { Point.ByCoordinates(0..10..2, 50); Point.ByCoordinates(15..25..2, 50); }
join = List.Join(list0=code_block_63.out0, list1=code_block_63.out1)
shuffle = List.Shuffle(list=join)
code_block_64 = CodeBlock { 3; }
springs_geometry_groupbydistance = Custom[[springs] Geometry.GroupByDistance](geometry=shuffle, margin=code_block_64)  # package spring nodes; Splits the list of geometry elements into groups if the distance between them is less than the provided margin.
code_block_65 = CodeBlock(c=springs_geometry_groupbydistance) { List.Count(c) == 2; }
code_block_66 = CodeBlock { Point.ByCoordinates(15, 49); }
indexByDistance = Custom[Geometry.IndexByDistance](geometry=code_block_66, other=join)  # package spring nodes; Provides the index of the closest or farthest geometry. Should prove faster than getting the geometry and finding its index in two separate operations.
code_block_67 = CodeBlock(ind=indexByDistance.index) { ind[0] == 6; }
springs_list_firstlast_2 = Custom[[springs] List.FirstLast](list=code_block_63.out1)
byStartPointEndPoint_2 = Line.ByStartPointEndPoint(startPoint=springs_list_firstlast_2.first, endPoint=springs_list_firstlast_2.last)
code_block_68 = CodeBlock(pts=code_block_63.out1) { "sort"; 1..List.Count(pts); }
writeTag = Custom[Geometry.WriteTag](geometry=code_block_63.out1, tagName=code_block_68.out0, value=code_block_68.out1)  # package spring nodes; Design script geometry can store a <string, object> dictionary for the duration of the active graph. You can store a name/value pair and retrieve it further down the graph.
shuffle_2 = List.Shuffle(list=writeTag.geometry)
readTag = Custom[Geometry.ReadTag](geometry=shuffle_2, tagName=code_block_68.out0)  # package spring nodes; Design script geometry can store a <string, object> dictionary for the duration of the active graph. If no parameter with the active name is found, a null value will be returned instead.
sortByKey = List.SortByKey(list=shuffle_2, keys=readTag)
springs_list_firstlast_3 = Custom[[springs] List.FirstLast](list=sortByKey.sortedList)
byStartPointEndPoint_3 = Line.ByStartPointEndPoint(startPoint=springs_list_firstlast_3.first, endPoint=springs_list_firstlast_3.last)
isAlmostEqualTo_9 = Geometry.IsAlmostEqualTo(geometry=byStartPointEndPoint_2, other=byStartPointEndPoint_3)
code_block_69 = CodeBlock { 17; }
byLengths = Cuboid.ByLengths(length=code_block_69)
XZ = Plane.XZ()
code_block_70 = CodeBlock { -3..-8; }
offset_5 = Plane.Offset(plane=XZ, dist=code_block_70)
lastItem = List.LastItem(list=offset_5)
origin = Plane.Origin(plane=lastItem)
splitRecursively = Custom[Geometry.SplitRecursively](geometry=byLengths, tools=offset_5, pickPoint=origin)  # package spring nodes; Splits a surface or a solid recursively, using the resulting reduced geometry for every consecutive split. Select a point or another geometry to control the direction of the split.
code_block_71 = CodeBlock(c=splitRecursively) { List.Count(c) == 7; }
code_block_72 = CodeBlock { Point.ByCoordinates([0, 10]); }
code_block_73 = CodeBlock { 1; }
springs_n_hedron_byoriginvector = Custom[[springs] N-hedron.ByOriginVector](origin=code_block_72, length=code_block_73, height=code_block_73)  # package spring nodes; Creates a multi-sided poyhedron with defined side length and total height.
springs_list_firstlast_4 = Custom[[springs] List.FirstLast](list=springs_n_hedron_byoriginvector)
springs_geometry_boxeddistanceto = Custom[[springs] Geometry.BoxedDistanceTo](geometry=springs_list_firstlast_4.first, other=springs_list_firstlast_4.last)  # package spring nodes; Computes the minimal distance between the axis-aligned bounding boxes of two geometry elements. Works directly with a bounding box input.
code_block_74 = CodeBlock { 9.133; 0.001; }
springs_number_almostequal_3 = Custom[[springs] Number.AlmostEqual](a=springs_geometry_boxeddistanceto, b=code_block_74.out0, tolerance=code_block_74.out1)
extents = Custom[Geometry.Extents](geometry=springs_list_firstlast_4.first)  # package spring nodes; Gets the dimensions of the geometry's bounding box.
list_create_6 = List.Create(item0=extents.width, item1=extents.length, item2=extents.height)
code_block_75 = CodeBlock { [0.866, 1, 1]; 0.001; }
springs_number_almostequal_4 = Custom[[springs] Number.AlmostEqual](a=list_create_6, b=code_block_75.out0, tolerance=code_block_75.out1)
allTrue_6 = List.AllTrue(list=springs_number_almostequal_4)

# group: Lines Straighten, Merge
code_block_76 = CodeBlock()
# ---------- code_block_76.designscript (3 lines) ----------
Line.ByStartPointEndPoint(
  Point.ByCoordinates(100,0,0),
  Point.ByCoordinates(100.01,100,0.01));
# ----------------------------------------
springs_line_straightenxy = Custom[[springs] Line.StraightenXY](line=code_block_76)  # package spring nodes; Checks a line's end points for irregularities and corrects them if they are at or below the specified margin. The default margin is 1/5000 of the curve length, which is conservative.
springs_line_straightenz = Custom[[springs] Line.StraightenZ](line=springs_line_straightenxy)  # package spring nodes; Checks a line's end points for irregularities in the Z axis and corrects them if they are at or below the specified margin. The default margin is 1/5000 of the curve length, which is conservative.
code_block_77 = CodeBlock()
# ---------- code_block_77.designscript (3 lines) ----------
Line.ByStartPointEndPoint(
  Point.ByCoordinates(100,0,0),
  Point.ByCoordinates(100,100,0));
# ----------------------------------------
isAlmostEqualTo_10 = Geometry.IsAlmostEqualTo(geometry=springs_line_straightenz, other=code_block_77)
code_block_78 = CodeBlock()
# ---------- code_block_78.designscript (5 lines) ----------
[
"-4.883,-61.833,0,61.178,-61.833,0",
"-3.558,-64.414,0,4.667,-17.765,0",
"-1.886,-16.609,0,57.692,-59.895,0"
];
# ----------------------------------------
springs_string_toline_2 = Custom[[springs] String.ToLine](str=code_block_78)
code_block_79 = CodeBlock { 5; }
merge = Custom[LineLoop.Merge](lines=springs_string_toline_2, margin=code_block_79)  # package spring nodes; Attempts to join lines into a single chain of joined curves. The node returns the new lines as a chain and with the original order. The success outputs returns the success of the execution as a true/false boolean.
byJoinedCurves = PolyCurve.ByJoinedCurves(curves=merge.lines)
byPatch = Surface.ByPatch(closedCurve=byJoinedCurves)
area = Surface.Area(surface=byPatch)
code_block_80 = CodeBlock { 1296.927; 0.001; }
springs_number_almostequal_5 = Custom[[springs] Number.AlmostEqual](a=area, b=code_block_80.out0, tolerance=code_block_80.out1)

list_create_7 = List.Create(item0=allTrue_2, item1=allTrue_3, item2=allTrue_4, item3=allTrue_5, item4=isAlmostEqualTo_5, item5=and_4, item6=isAlmostEqualTo_8, item7=code_block_62, item8=code_block_65, item9=code_block_67, item10=isAlmostEqualTo_9, item11=code_block_71, item12=springs_number_almostequal_3, item13=allTrue_6, item14=isAlmostEqualTo_10, item15=springs_number_almostequal_5)
list_create_8 = List.Create(item0=code_block_45, item1=list_create_7)
string_4 = StringInput("""Point.PullOntoPlane
Point.BoxedDistanceTo
Points.ConvexHull2D
Points.PruneDuplicates+
Points.MinAreaRectangle
Polygon.IsRectangular
Polygon.2D/3DArea
Polygon.ContainmentTest+
Star.ByCenterRadiusRays
PolyCurve.ArcChamfer
PolyCurve.Chamfer
PolyCurve.Fillet+
PolyCurve.Points
Quads.ByPointMatrix
Surface.TrimWithLoopsFix
N-hedron.ByOriginVector
Mesh.ToPolySurface
Mesh.Merge
Mesh.DifferentiateDisplay
Mesh.VolumeArea
Mesh.Flatten
Mesh.Thicken
Mesh.Merge""")
code_block_81 = CodeBlock(names=string_4) { allNames = String.Split(names, "\n"); }

# group: Point and Polygon Methods
code_block_82 = CodeBlock { Point.ByCoordinates(0..10..2, 60); }
code_block_83 = CodeBlock { Point.ByCoordinates(15, 60, 10); Vector.ByCoordinates(1, 1, 1); }
byOriginNormal = Plane.ByOriginNormal(origin=code_block_83.out0, normal=code_block_83.out1)
distanceTo = Geometry.DistanceTo(geometry=code_block_82, entity=byOriginNormal)
code_block_84 = CodeBlock { Point.ByCoordinates(0..10..2, 60); }
springs_point_pullontoplane = Custom[[springs] Point.PullOntoPlane](point=code_block_84, plane=byOriginNormal)  # package spring nodes; Pulls (projects) the point onto the input plane, following the plane normal.
distanceTo_2 = Geometry.DistanceTo(geometry=code_block_82, entity=springs_point_pullontoplane)
springs_number_almostequal_6 = Custom[[springs] Number.AlmostEqual](a=distanceTo, b=distanceTo_2)
allTrue_7 = List.AllTrue(list=springs_number_almostequal_6)
code_block_85 = CodeBlock { Point.ByCoordinates(0..10..2, 60); }
lastItem_2 = List.LastItem(list=code_block_85)
code_block_86 = CodeBlock { Vector.ByCoordinates(1,0,0); }
byOriginNormal_2 = Plane.ByOriginNormal(origin=lastItem_2, normal=code_block_86)
springs_point_boxeddistanceto = Custom[[springs] Point.BoxedDistanceTo](point=code_block_85, geometry=byOriginNormal_2)  # package spring nodes; Computes the minimal distance between a point and the axis-aligned bounding boxe of a geometry element. Works directly with a bounding box input for the geometry.
code_block_87 = CodeBlock(d=springs_point_boxeddistanceto) { d == 10..0..-2; }
allTrue_8 = List.AllTrue(list=code_block_87)
code_block_88 = CodeBlock { Point.ByCoordinates(0..10..2, 60); }
join_2 = List.Join(list0=code_block_88, list1=springs_point_pullontoplane)
springs_points_convexhull2d = Custom[[springs] Points.ConvexHull2D](points=join_2)  # package spring nodes; Computes the XY convex hull of a given set of points based on the monotone chain algorithm.
join_3 = List.Join(list0=join_2, list1=springs_points_convexhull2d)
springs_points_pruneduplicates = Custom[[springs] Points.PruneDuplicates+](points=join_3)  # package spring nodes; An alternative to the built in node, that performs faster at the price of loosing the order of the points. All floating point valies are rounded to the nearest 4 decimal points. You can optionally remove duplicate Z values by setting "keepDuplicateZ" to false.
code_block_89 = CodeBlock(end=springs_points_pruneduplicates, start=join_3) { List.Count(end) < List.Count(start); }
code_block_90 = CodeBlock(x=springs_points_convexhull2d) { List.Count(x) == 4; }
springs_points_minarearectangle = Custom[[springs] Points.MinAreaRectangle](points=join_2)  # package spring nodes; Computes the minimum area rectangle in xy space for a set of points using a linear time algorithm
type = Object.Type(object=springs_points_minarearectangle.rectangle)
code_block_91 = CodeBlock(t=type) { t == "Autodesk.DesignScript.Geometry.Rectangle"; }
code_block_92 = CodeBlock(r=springs_points_minarearectangle.rectangle) { Polygon.ByPoints(r.Points); }
springs_polygon_isrectangular = Custom[[springs] Polygon.IsRectangular](poly=code_block_92)  # package spring nodes; Determines if a polygon (or a polycurve) is rectangular or square. If you want to differenciate between square and rectangular polys, use the XOR output.
firstItem = List.FirstItem(list=springs_polygon_isrectangular.isRectangle)
springs_polygon_2darea = Custom[[springs] Polygon.2DArea](polygon=springs_points_minarearectangle.rectangle)  # package spring nodes; Returns the planar area of the input polygon(s). Not accurate for self-intersecting polys.
springs_polygon_3darea = Custom[[springs] Polygon.3DArea](polygon=springs_points_minarearectangle.rectangle)  # package spring nodes; Returns the planar area of the input polygon(s) in euclidean space. Not accurate for self-intersecting polys.
code_block_93 = CodeBlock(a=springs_polygon_2darea, b=springs_polygon_3darea) { a[0] == b[0] == 100; }
byPoints = Polygon.ByPoints(points=springs_points_convexhull2d)
code_block_94 = CodeBlock { Point.ByCoordinates(0..10..2, 60); }
springs_polygon_containmenttest = Custom[[springs] Polygon.ContainmentTest+](polygon=byPoints, points=code_block_94)  # package spring nodes; A less accurate method that should perform faster than the built-in node for large data sets.
code_block_95 = CodeBlock(p=springs_polygon_containmenttest) { List.CountTrue(p) == 4; }

# group: Polycurve methods
code_block_96 = CodeBlock { Point.ByCoordinates(150, 50); 5; }
springs_star_bycenterradiusrays = Custom[[springs] Star.ByCenterRadiusRays](StarOrigin=code_block_96.out0, StarRadius=code_block_96.out1)  # package spring nodes; Fun little node to create star shapes.
type_2 = Object.Type(object=springs_star_bycenterradiusrays)
code_block_97 = CodeBlock(t=type_2, pc=springs_star_bycenterradiusrays)
# ---------- code_block_97.designscript (2 lines) ----------
t == "Autodesk.DesignScript.Geometry.PolyCurve"
  && pc.NumberOfCurves == 14;
# ----------------------------------------
code_block_98 = CodeBlock { 1; }
springs_polycurve_arcchamfer = Custom[[springs] PolyCurve.ArcChamfer](polycurve=springs_star_bycenterradiusrays, distance=code_block_98, flip=code_block_98)  # package spring nodes; Symmetrically chamfers the corners of the polycurve by the designated distance and close with tangent arcs.
type_3 = Object.Type(object=springs_polycurve_arcchamfer)
code_block_99 = CodeBlock(t=type_3, pc=springs_polycurve_arcchamfer, old=springs_star_bycenterradiusrays)
# ---------- code_block_99.designscript (3 lines) ----------
t == "Autodesk.DesignScript.Geometry.PolyCurve"
  && pc.NumberOfCurves == 28
  && old.Length > pc.Length;
# ----------------------------------------
springs_polycurve_chamfer = Custom[[springs] PolyCurve.Chamfer](polycurve=springs_star_bycenterradiusrays, distance=code_block_98)  # package spring nodes; Symmetrically chamfers the corners of the polycurve by the designated distance
type_4 = Object.Type(object=springs_polycurve_chamfer)
code_block_100 = CodeBlock(t=type_4, pc=springs_polycurve_chamfer, old=springs_star_bycenterradiusrays)  # same code as code_block_99
code_block_101 = CodeBlock { 0.5; }
springs_polycurve_fillet = Custom[[springs] PolyCurve.Fillet+](polycurve=springs_star_bycenterradiusrays, radius=code_block_101)  # package spring nodes; Fillet a polycurve in its plane. Unlike the built in node, this works in both in the CW and the CCW direction.
type_5 = Object.Type(object=springs_polycurve_fillet)
code_block_102 = CodeBlock(t=type_5, pc=springs_polycurve_fillet, old=springs_star_bycenterradiusrays)  # same code as code_block_99
springs_polycurve_points = Custom[[springs] PolyCurve.Points](polyCurve=springs_star_bycenterradiusrays)  # package spring nodes; Gets all the unique start and end points of the underlying curves in a sorted list.
code_block_103 = CodeBlock(p=springs_polycurve_points) { List.Count(p) == 14; }

# group: Misc.
code_block_104 = CodeBlock { n = 0..100..#8; Point.ByCoordinates(n<1> + 120, 100, n<2>); }
springs_quads_bypointmatrix = Custom[[springs] Quads.ByPointMatrix](points=code_block_104.out1)  # package spring nodes; Creates a CCW or CW list of quad pairs from a rectangular nested list of points.
byCornerPoints = Rectangle.ByCornerPoints(points=springs_quads_bypointmatrix)
code_block_105 = CodeBlock(x=byCornerPoints) { List.Count(List.Clean(x, 0)) == 49; }
code_block_106 = CodeBlock()
# ---------- code_block_106.designscript (2 lines) ----------
Point.ByCoordinates([120,220,220,120]
  , 100, [0, 0, 100, 100]);
# ----------------------------------------
byPerimeterPoints = Surface.ByPerimeterPoints(points=code_block_106)
code_block_107 = CodeBlock { -5; }
offset_6 = Curve.Offset(curve=byCornerPoints, distance=code_block_107)
springs_surface_trimwithloopsfix = Custom[[springs] Surface.TrimWithLoopsFix](surf=byPerimeterPoints, loops=offset_6)  # package spring nodes; A temporary replacement for the broken built-in node. For best results, make sure the loops are convex.
area_2 = Surface.Area(surface=springs_surface_trimwithloopsfix)
code_block_108 = CodeBlock(a=area_2) { a == 9100; }
code_block_109 = CodeBlock { Point.ByCoordinates(80,80); }
springs_n_hedron_byoriginvector_2 = Custom[[springs] N-hedron.ByOriginVector](origin=code_block_109)
type_6 = Object.Type(object=springs_n_hedron_byoriginvector_2)
code_block_110 = CodeBlock(t=type_6) { t == "Autodesk.DesignScript.Geometry.Solid"; }

# group: Meshes
file_path = Filename(".\sample_mesh.ply")
importFile = Mesh.ImportFile(fileName=file_path)
toPolySurface = Custom[Mesh.ToPolySurface](mesh=importFile)  # package spring nodes; Converts a Dynamo mesh to a polysurface. By default the node is single threaded, but if you specify a higher number of threads in the `NUMTHREAD` input, the node will run multi-threaded to speed up the conversion. *WARNING* Using multi-threaded code with Dynamo's geometry kernel may crash Revit in some cases.
type_7 = Object.Type(object=toPolySurface)
code_block_111 = CodeBlock(t=type_7) { t[0] == "Autodesk.DesignScript.Geometry.PolySurface"; }
code_block_112 = CodeBlock { Vector.ByCoordinates(5000,5000); }
translate = Mesh.Translate(mesh=importFile, vector=code_block_112)
join_4 = List.Join(list0=importFile, list1=translate)
merge_2 = Custom[Mesh.Merge](meshes=join_4)  # package spring nodes; Creates a single mesh entity from a list of meshes.
type_8 = Object.Type(object=merge_2)
code_block_113 = CodeBlock(t=type_8) { t == "Autodesk.DesignScript.Geometry.Mesh"; }
differentiateDisplay = Custom[Mesh.DifferentiateDisplay](geo=join_4)  # package spring nodes; Paints the input meshes using the default color range. Works well with lists of meshes.
isNull = Object.IsNull(object=differentiateDisplay)
not_ = Not(x=isNull)
allTrue_9 = List.AllTrue(list=not_)
volumeArea = Custom[Mesh.VolumeArea](mesh=importFile)  # package spring nodes; Gets the volume and the area of a mesh. Works with both built in meshes and toolkit meshes. Based on math from geometry3sharp. Note that if triangles don't define closed region, volume is probably nonsense.
join_5 = List.Join(list0=volumeArea.volume, list1=volumeArea.area)
code_block_114 = CodeBlock()
# ---------- code_block_114.designscript (3 lines) ----------
[-678901255254.5,
3611300911.6];
0.1;
# ----------------------------------------
almostEqual = Custom[Number.AlmostEqual](a=join_5, b=code_block_114.out0, tolerance=code_block_114.out1)  # package spring nodes; Checks if a number is almost equal to a value with a specified tollerance.
allTrue_10 = List.AllTrue(list=almostEqual)
code_block_115 = CodeBlock { -5000; }
flatten = Custom[Mesh.Flatten](mesh=importFile, newZ=code_block_115)  # package spring nodes; Sets the Z coordinate of each vertex of the mesh to the desired value.
boundingBox = Mesh.BoundingBox(mesh=flatten)
firstItem_2 = List.FirstItem(list=boundingBox)
code_block_116 = CodeBlock(bb=firstItem_2, z=code_block_115) { bb.MinPoint.Z == bb.MaxPoint.Z == z; }
code_block_117 = CodeBlock { Vector.ByCoordinates(0, 0, -1); 10000; }
thicken = Custom[Mesh.Thicken](mesh=flatten, direction=code_block_117.out0, distance=code_block_117.out1)  # package spring nodes; Thickens a surface mesh in the provided direction and by the supplied distance.
type_9 = Object.Type(object=thicken)
code_block_118 = CodeBlock(t=type_9) { t[0] == "Autodesk.DesignScript.Geometry.Mesh"; }
code_block_119 = CodeBlock()
# ---------- code_block_119.designscript (3 lines) ----------
Plane.ByOriginNormal(
  Point.ByCoordinates(0, 25, 0),
  Vector.ZAxis());
# ----------------------------------------
byWidthLength = Rectangle.ByWidthLength(plane=code_block_119)
byPolygon = Custom[Mesh.ByPolygon](poly=byWidthLength)  # package spring nodes; Converts a closed polygon into a mesh using an ear-clipping division
type_10 = Object.Type(object=byPolygon)
code_block_120 = CodeBlock(t=type_10) { t[0] == "Autodesk.DesignScript.Geometry.Mesh"; }

list_create_9 = List.Create(item0=allTrue_7, item1=allTrue_8, item2=code_block_89, item3=code_block_90, item4=code_block_91, item5=firstItem, item6=code_block_93, item7=code_block_95, item8=code_block_97, item9=code_block_99, item10=code_block_100, item11=code_block_102, item12=code_block_103, item13=code_block_105, item14=code_block_108, item15=code_block_110, item16=code_block_111, item17=code_block_113, item18=allTrue_9, item19=allTrue_10, item20=code_block_116, item21=code_block_118, item22=code_block_120)
list_create_10 = List.Create(item0=code_block_81, item1=list_create_9)
list_create_11 = List.Create(item0=list_create_2, item1=list_create_4, item2=list_create_8, item3=list_create_10)
transpose = List.Transpose(lists=list_create_11)
flatten_2 = List.Flatten(list=transpose, lacing=Longest)
code_block_121 = CodeBlock(r=flatten_2) { r[0]; r[1]; }
not_2 = Not(x=code_block_121.out1)
filterByBoolMask_3 = List.FilterByBoolMask(list=code_block_121.out0, mask=not_2)
countTrue = List.CountTrue(list=code_block_121.out1)
countFalse = List.CountFalse(list=code_block_121.out1)

# group: Result
list_of_failed_nodes = Watch(filterByBoolMask_3.in)
passing = Watch(countTrue)
failed = Watch(countFalse)

toFraction = Custom[Feet.ToFraction]()  # package spring nodes; Converts a decimal foot value to a fractional foot/inch string.; unwired: number
