# Dynamo graph springs2_TestSuite_B.dyn (Dynamo 4.0.2.3852)
# packages: spring nodes 210.1.1

# group: Copy from Link Instance
springs_document = Custom[[springs] Document.CopyFromLinkInstance]()  # package spring nodes; The node will use the total transformation of the link instance to copy the input elements into the local document.; unwired: linkInstance, element

# group: Color to decimal and Decimal to color
code_block = CodeBlock { Color.ByARGB(255, 1, 2, 3); }
springs_color_todecimal = Custom[[springs] Color.ToDecimal](color=code_block)  # package spring nodes; Converts a Dynamo colour its Revit equivalent decimal value.
springs_decimal_tocolor = Custom[[springs] Decimal.ToColor](decimal=springs_color_todecimal)  # package spring nodes; Converts a revit colour decimal value to its Dynamo equivalent.
equals = List.Equals(object=code_block, otherObject=springs_decimal_tocolor)

# group: Area Plan by Level Name
levels = Levels("Level 0")
code_block_2 = CodeBlock { "test"; "Gross Building"; }
springs_areaplan_bylevelname = Custom[[springs] AreaPlan.ByLevelName](level=levels, name=code_block_2.out0, schemeName=code_block_2.out1)  # package spring nodes; Creates an area plan at the designated levels. Each new view needs a name. An area scheme must first be activated before it can be used. To activate a scheme, place one view of that type in the project(you can then delete it). If a view with the same scheme and name exists, you'll get a null instead.
type = Object.Type(object=springs_areaplan_bylevelname)
code_block_3 = CodeBlock(t=type, e=springs_areaplan_bylevelname, n=code_block_2.out0)
# ---------- code_block_3.designscript (2 lines) ----------
t[0] == "Revit.Elements.Views.AreaPlanView"
  && e[0].Name == n;
# ----------------------------------------

# group: BREP by geometry, Directshape translate, Directshape transform, Directshape by geometry
code_block_4 = CodeBlock { 1000; }
byLengths = Cuboid.ByLengths(width=code_block_4, length=code_block_4, height=code_block_4)
code_block_5 = CodeBlock { "ds1"; }
springs_directshape_bygeometry = Custom[[springs] DirectShape.ByGeometry](geometry=byLengths, name=code_block_5)  # package spring nodes; Convert the input geometry to DirectShape element inside the Revit document. It supports solids or surfaces. It is based on an alternative process that uses a SAT import and can produce smooth surfaces. Each created DS will have a unique type. Make sure that each input geometry has a unique name. You can either feed a single category for all geometries or a unique category for each geometry - the node's lacing is set to longest by default. The default category is Generic Models.
code_block_6 = CodeBlock { Vector.ByCoordinates(1500); }
translate = Geometry.Translate(geometry=byLengths, direction=code_block_6)
code_block_7 = CodeBlock { "ds2"; }
code_block_8 = CodeBlock { Material.ByName("Glass"); }
springs_brepshape_bygeometry = Custom[[springs] BrepShape.ByGeometry](geometry=translate, name=code_block_7, material=code_block_8)  # package spring nodes; Convert the input geometry to DirectShape element inside the Revit document. Works only in Revit 2017 and later. Uses the more advanced BrepBuilder. It supports solids or surfaces, however periodic faces like spheres, cylinders and cones are not supported. Each created DS will have a unique type. Make sure that each input geometry has a unique name. You can either feed a single category and material for all geometries or a unique one for each geometry - the node's lacing is set to longest by default. The default category is Generic Model.
firstItem = List.FirstItem(list=springs_brepshape_bygeometry)
code_block_9 = CodeBlock { Vector.ByCoordinates(1500); }
springs_directshape_translate = Custom[[springs] DirectShape.Translate](directShape=firstItem, vector=code_block_9)  # package spring nodes; Copy the input DirectShape element with the help of a translation vector, similarly to the Geometry.Translate node. This method should prove more efficient than Element.Copy
firstItem_2 = List.FirstItem(list=springs_directshape_translate)
code_block_10 = CodeBlock { CoordinateSystem.ByOrigin(3000,0,0); }
springs_directshape_transform = Custom[[springs] DirectShape.Transform](directShape=firstItem_2, coordSystem=code_block_10)  # package spring nodes; Transforms the typed DirectShape element from the identity coordinate system to the input coordinate system(s), in a manner similar to Dynamo's Geometry.Transform node.
firstItem_3 = List.FirstItem(list=springs_directshape_transform)
code_block_11 = CodeBlock(ds1=springs_directshape_bygeometry, ds2=springs_brepshape_bygeometry, ds3=firstItem_2, ds4=firstItem_3)
# ---------- code_block_11.designscript (4 lines) ----------
ds1[0] != null &&
ds2[0] != null &&
ds3 != null &&
ds4 != null;
# ----------------------------------------

# group: Active View, Sheet Views, Copy View to View, Delete Elements
springs_document_activeview = Custom[[springs] Document.ActiveView]()  # package spring nodes; Selects the current document's active view. Supports more view types than the built-in option. Will be depreciated once the bult in node works with all plan types.
code_block_12 = CodeBlock(active_view=springs_document_activeview) { active_view; }
views = Custom[Sheet.Views+](sheet=springs_document_activeview)  # package spring nodes; Extracts all views and schedules (minus the revision schedule) placed on the input sheet (or sheets). Will be depreciated once the bult in node works with all plan types.
code_block_13 = CodeBlock(s=views.schedule_s) { s[0][0]; }
springs_document_2 = Custom[[springs] Document.CopyFromViewToView](sourceView=code_block_12, destView=code_block_12, elements=code_block_13)  # package spring nodes; The node will copy the input (view based) elements from the source view into the destination view.
code_block_14 = CodeBlock(sched=springs_document_2) { sched[0] != 0; }
code_block_15 = CodeBlock { 1; }
springs_document_deleteelements = Custom[[springs] Document.DeleteElements](element=springs_document_2, confirm=code_block_15)  # package spring nodes; Attempts to delete the input list of elements from the active Revit document.The node returns the number of successfully deleted elements and their Ids as a string. Carefully observe the deleted elements count. It may be greater than the input list because hosted elements or tags will be deleted as well. If an element in the list can not be deleted (for example last revision or last view), the whole list will fail to be deleted.
code_block_16 = CodeBlock(x=springs_document_deleteelements.count) { x == 1; }

# group: Doc central path
centralPath = Custom[Document.CentralPath]()  # package spring nodes; If the document is workshared, the node returns the path to the central document as a string. Otherwise a null value will be returned.

# group: Form by geometry
byGeometry = Custom[Form.ByGeometry]()  # package spring nodes; Convert the input geometry to a Revit Form object. Forms can exist only in the family environment. You can convert complicated solids or surfaces directly into forms. A form can act as a void. Provide either one true boolean value to convert a form into a void. The node's lacing is set to longest by default.; unwired: geometry

# group: Is Cutting
isCutting = Custom[Element.IsCutting]()  # package spring nodes; Tests if the input element (or elements) is a void cut and if it is cutting any elements. In such cases, the cut elements will be provided.; unwired: element

# group: Is Cut
isCut = Custom[Element.IsCut]()  # package spring nodes; Tests if the element is being cut by any void instances. If any cuts exist all cutting elements will be provided.; unwired: element
