# Dynamo custom node Beams.FixExtents.dyf (Dynamo 4.0.2.3852)
# category: Springs.Revit.Utility.Actions
# Detects all beams from the input list with broken extents(actual length - cut length <  margin) and attemts to correct them.

beams = Input(beams: var[])
code_block = CodeBlock { "framing"; }
byClassName = Custom[Filter.ByClassName](object=beams, className=code_block)  # Filters a list of objects by the object's class name. Note that Dynamo elements belong to different classes than their Revit counterparts. Use the Object.Class node to check an object's class.
filterByBoolMask = List.FilterByBoolMask(list=beams, mask=byClassName)
margin = Input(margin: double = 250)
code_block_2 = CodeBlock(str1=filterByBoolMask.in, margin=margin)
# ---------- code_block_2.designscript (5 lines) ----------
la = str1.GetParameterValueByName("Length");
lb = str1.GetParameterValueByName("Cut Length");
laN = la == "" ? 0 : la;
mask1  = Math.Abs(laN - lb) > margin;
DSCore.List.FilterByBoolMask(str1,mask1)["in"];
# ----------------------------------------
python_script = Python(IN[0]=code_block_2.out4)  # PythonNet3
# ---------- python_script.python (62 lines) ----------
#-Reope----------------------------------------#
#                                              #
#      Copyright(c) 2015, Dimitar Venkov       #
#                                              #
# https://github.com/dimven/SpringNodes/issues #
# https://www.reope.com/                       #
#                                              #
#    ____    _____   _____   ____    _____     #
#   |  _ \ *|  ___|*|  _  |*|  _ \ *|  ___|    #
#   | |_) |*| |___ *| | | |*| |_) |*| |___     #
#   |  _ < *|  ___|*| | | |*|  __/ *|  ___|    #
#   | | | |*| |___ *| |_| |*| |    *| |___     #
#   |_| \_|*|_____|*|_____|*|_|    *|_____|    #
#                                              #
#                                              #
#-Reope-----Updated by Mark Ackerley-----------#

import clr
clr.AddReference("RevitServices")
import RevitServices
from RevitServices.Persistence import DocumentManager
from RevitServices.Transactions import TransactionManager
doc = DocumentManager.Instance.CurrentDBDocument
uidoc = DocumentManager.Instance.CurrentUIApplication.ActiveUIDocument

clr.AddReference("RevitNodes")
import Revit
clr.ImportExtensions(Revit.Elements)

clr.AddReference("RevitAPI")
from Autodesk.Revit.DB import ElementId
from Autodesk.Revit.DB.Structure import StructuralFramingUtils

clr.AddReference("System")
from System.Collections.Generic import List as cList

def tolist(obj1):
    if isinstance(obj1, str): return [obj1]
    return obj1 if isinstance(obj1, list) else [obj1]

try:
    beams = UnwrapElement(tolist(IN[0]))

    TransactionManager.Instance.EnsureInTransaction(doc)
    for b in beams:
        try:
            StructuralFramingUtils.DisallowJoinAtEnd(b, 0)
            StructuralFramingUtils.DisallowJoinAtEnd(b, 1)
        except:
            pass

    ids2 = cList[ElementId]([e.Id for e in beams])
    uidoc.Selection.SetElementIds(ids2)
    OUT = "%s beams corrected in Revit." % ids2.Count
    TransactionManager.Instance.TransactionTaskDone()

except Exception as e:
    import traceback
    OUT = "Exception:\n{0}\n\nTraceback:\n{1}".format(
        str(e),
        traceback.format_exc()
    )
# ----------------------------------------
result = Output(python_script)
refresh = Input(refresh: bool = false)
