# Dynamo custom node BoundingBox.ScaleByDistance.dyf (Dynamo 3.3.0.6316)
# category: Springs.Geometry.Actions
# Scales the bounding box by a fixed distance.

distance = Input(distance: double)
boundingBox = Input(boundingBox: Autodesk.DesignScript.Geometry.BoundingBox)
code_block = CodeBlock(s=distance, box=boundingBox)
# ---------- code_block.designscript (4 lines) ----------
v = Autodesk.Vector.ByCoordinates(s, s, s);
a = box.MinPoint.Subtract(v);
b = box.MaxPoint.Add(v);
newBox = BoundingBox.ByCorners(a, b);
# ----------------------------------------
boundingBox_2 = Output(code_block.newBox)  # "boundingBox"
