# Dynamo custom node Collect.AllTypesOf.dyf (Dynamo 4.0.2.3852)
# category: Springs.Revit.Selection.Actions
# Works with either categories, element types or revit classes and uses multi-filters to get multiple groups with a single query. Can be applied as a function. No ties to the Document.Changed event.

CategoryOrClass = Input(CategoryOrClass: var[])
refresh = Input(refresh: bool = true)
python_script = Python(IN[0]=CategoryOrClass, IN[1]=refresh)  # PythonNet3
# ---------- python_script.python (64 lines) ----------
#-Reope----------------------------------------#
#                                              #
#      Copyright(c) 2016, Dimitar Venkov       #
#                                              #
# https://github.com/dimven/SpringNodes/issues #
# https://www.reope.com/                       #
#                                              #
#    ____    _____   _____   ____    _____     #
#   |  _ \ *|  ___|*|  _  |*|  _ \ *|  ___|    #
#   | |_) |*| |___ *| | | |*| |_) |*| |___     #
#   |  _ < *|  ___|*| | | |*|  __/ *|  ___|    #
#   | | | |*| |___ *| |_| |*| |    *| |___     #
#   |_| \_|*|_____|*|_____|*|_|    *|_____|    #
#                                              #
#                                              #
#-Reope-----Updated by Mark Ackerley-----------#

import System
import clr
clr.AddReference('RevitAPI')
import Autodesk.Revit.DB as DB

clr.AddReference("RevitServices")
import RevitServices
from RevitServices.Persistence import DocumentManager
doc = DocumentManager.Instance.CurrentDBDocument

clr.AddReference('RevitNodes')
import Revit
clr.ImportExtensions(Revit.Elements)

from System.Collections.Generic import List

def tolist(obj1):
    if isinstance(obj1, str): return [obj1]
    return obj1 if isinstance(obj1, list) else [obj1]

try:
    x = UnwrapElement(tolist(IN[0]))

    fec = DB.FilteredElementCollector(doc).WhereElementIsElementType()

    if isinstance(x[0], DB.Category):
        catId = List[DB.ElementId](c.Id for c in x)
        filter = DB.ElementMulticategoryFilter(catId)
    elif isinstance(x[0], DB.ElementType):
        types = List[System.Type](t.GetType() for t in x)
        filter = DB.ElementMulticlassFilter(types)
    else:
        types = List[System.Type](x)
        filter = DB.ElementMulticlassFilter(types)

    fec.WherePasses(filter)
    OUT = [e.ToDSType(True) for e in fec]

    fec.Dispose()
    filter.Dispose()

except Exception as e:
    import traceback
    OUT = "Exception:\n{0}\n\nTraceback:\n{1}".format(
        str(e),
        traceback.format_exc()
    )
# ----------------------------------------
types = Output(python_script)
