# Dynamo custom node Collect.CurrentSelection.dyf (Dynamo 4.0.2.3852)
# category: Springs.Revit.Selection.Actions
# Gets the currently selected elements. Connect a boolean switch to refresh the selection.

refresh = Input(refresh: bool = true)
python_script = Python(IN[0]=refresh)  # PythonNet3
# ---------- python_script.python (39 lines) ----------
#-Reope----------------------------------------#
#                                              #
#      Copyright(c) 2016, Dimitar Venkov       #
#                                              #
# https://github.com/dimven/SpringNodes/issues #
# https://www.reope.com/                       #
#                                              #
#    ____    _____   _____   ____    _____     #
#   |  _ \ *|  ___|*|  _  |*|  _ \ *|  ___|    #
#   | |_) |*| |___ *| | | |*| |_) |*| |___     #
#   |  _ < *|  ___|*| | | |*|  __/ *|  ___|    #
#   | | | |*| |___ *| |_| |*| |    *| |___     #
#   |_| \_|*|_____|*|_____|*|_|    *|_____|    #
#                                              #
#                                              #
#-Reope-----Updated by Mark Ackerley-----------#

import clr
clr.AddReference("RevitNodes")
import Revit
clr.ImportExtensions(Revit.Elements)

clr.AddReference("RevitServices")
import RevitServices
from RevitServices.Persistence import DocumentManager
uidoc = DocumentManager.Instance.CurrentUIApplication.ActiveUIDocument
doc = uidoc.Document

try:
    selid = uidoc.Selection.GetElementIds()
    result = [doc.GetElement(id).ToDSType(True) for id in selid]
    OUT = result[0] if len(result) == 1 else result

except Exception as e:
    import traceback
    OUT = "Exception:\n{0}\n\nTraceback:\n{1}".format(
        str(e),
        traceback.format_exc()
    )
# ----------------------------------------
element_s = Output(python_script)  # "element(s)"
