# Dynamo custom node Collect.ElementsInView.dyf (Dynamo 4.0.2.3852)
# category: Springs.Revit.Selection.Actions
# Selects all elements visible in the input view.

view = Input(view: var[])
category = Input(category: var[] = null)
refresh = Input(refresh: bool = true)
python_script = Python(IN[0]=view, IN[1]=category, IN[2]=refresh)  # PythonNet3
# ---------- python_script.python (81 lines) ----------
#-Reope----------------------------------------#
#                                              #
#      Copyright(c) 2018, Dimitar Venkov       #
#                                              #
# https://github.com/dimven/SpringNodes/issues #
# https://www.reope.com/                       #
#                                              #
#    ____    _____   _____   ____    _____     #
#   |  _ \ *|  ___|*|  _  |*|  _ \ *|  ___|    #
#   | |_) |*| |___ *| | | |*| |_) |*| |___     #
#   |  _ < *|  ___|*| | | |*|  __/ *|  ___|    #
#   | | | |*| |___ *| |_| |*| |    *| |___     #
#   |_| \_|*|_____|*|_____|*|_|    *|_____|    #
#                                              #
#                                              #
#-Reope-----Updated by Mark Ackerley-----------#

import clr
clr.AddReference("RevitServices")
from RevitServices.Persistence import DocumentManager
doc = DocumentManager.Instance.CurrentDBDocument

clr.AddReference("RevitAPI")
from Autodesk.Revit.DB import FilteredElementCollector, ElementMulticategoryFilter, ElementId

clr.AddReference("RevitNodes")
import Revit
clr.ImportExtensions(Revit.Elements)

from System.Collections.Generic import List

def tolist(obj1):
    if isinstance(obj1, str): return [obj1]
    return obj1 if isinstance(obj1, list) else [obj1]

try:
    is_list = isinstance(IN[0], list)
    views = UnwrapElement(tolist(IN[0]))
    cat = UnwrapElement(IN[1]) if IN[1] is not None else None

    ueWrapper = None
    wrappers = clr.GetClrType(Revit.Elements.ElementWrapper).GetMethods()
    for w in wrappers:
        if w.ToString().startswith("Revit.Elements.UnknownElement"):
            ueWrapper = w
            break

    if cat is not None:
        catId = List[ElementId]()
        for c in tolist(cat):
            catId.Add(c.Id)
        catFil = ElementMulticategoryFilter(catId)
    else:
        catFil = None

    OUT = []
    for v in views:
        fec = FilteredElementCollector(doc, v.Id).WhereElementIsNotElementType()
        if catFil is not None:
            fec = fec.WherePasses(catFil)
        viewEl = []
        for e in fec:
            try:
                viewEl.append(e.ToDSType(True))
            except:
                if ueWrapper:
                    viewEl.append(ueWrapper.Invoke(None, (e, True)))
        OUT.append(viewEl)
        fec.Dispose()

    if catFil is not None:
        catFil.Dispose()

    OUT = OUT if is_list else OUT[0]

except Exception as e:
    import traceback
    OUT = "Exception:\n{0}\n\nTraceback:\n{1}".format(
        str(e),
        traceback.format_exc()
    )
# ----------------------------------------
elements = Output(python_script)
