# Dynamo custom node Color.ToDecimal.dyf (Dynamo 4.0.2.3852)
# category: Springs.Revit.Actions
# Converts a Dynamo colour its Revit equivalent  decimal value.

color = Input(color: DSCore.Color)
code_block = CodeBlock(c=color) { r = c.Red; g = c.Green; b = c.Blue; d = b*256*256 + g*256 + r; }
decimal = Output(code_block.d)
