# Dynamo custom node Dictionary.ByKeysValues.dyf (Dynamo 4.0.2.3852)
# category: Springs.Actions
# Dictionaries are an incredibly powerful tool for making associative sets between two equal length lists. The first list must be of unique strings (or numbers) and will be the key and the second list will be the matching values (it can be made up of geometry, elements, even other lists)
# The search keys list will provide the corresponding value to the input key.

keys = Input(keys: var[])
values = Input(values: var[]..[])
searchKeys = Input(searchKeys: var[])
defaultValue = Input(defaultValue: var[]..[] = null)
python_script = Python(IN[0]=keys, IN[1]=values, IN[2]=searchKeys, IN[3]=defaultValue)  # PythonNet3
# ---------- python_script.python (39 lines) ----------
#-Reope----------------------------------------#
#                                              #
#      Copyright(c) 2020, Dimitar Venkov       #
#                                              #
# https://github.com/dimven/SpringNodes/issues #
# https://www.reope.com/                       #
#                                              #
#    ____    _____   _____   ____    _____     #
#   |  _ \ *|  ___|*|  _  |*|  _ \ *|  ___|    #
#   | |_) |*| |___ *| | | |*| |_) |*| |___     #
#   |  _ < *|  ___|*| | | |*|  __/ *|  ___|    #
#   | | | |*| |___ *| |_| |*| |    *| |___     #
#   |_| \_|*|_____|*|_____|*|_|    *|_____|    #
#                                              #
#                                              #
#-Reope-----Updated by Mark Ackerley-----------#

def tolist(obj1):
    return obj1 if isinstance(obj1, list) else [obj1]

try:
    keys = tolist(IN[0])
    elements = tolist(IN[1])
    searchVals = tolist(IN[2])

    if len(keys) != len(elements):
        raise ValueError("keys and elements must be the same length")


    dict1 = dict(zip(keys,elements) )
    
    OUT = [dict1.get(sv, IN[3]) for sv in searchVals]

except Exception as e:
    import traceback
    OUT = "Exception:\n{0}\n\nTraceback:\n{1}".format(
        str(e),
        traceback.format_exc()
    )
# ----------------------------------------
result = Output(python_script)
