# Dynamo custom node Element.IsCutting.dyf (Dynamo 4.0.2.3852)
# category: Springs.Revit.Query
# Tests if the input element (or elements) is a void cut and if it is cutting any elements. In such cases, the cut elements will be provided.

element = Input(element: var[])
python_script = Python(IN[0]=element)  # PythonNet3
# ---------- python_script.python (70 lines) ----------
#-Reope----------------------------------------#
#                                              #
#      Copyright(c) 2019, Dimitar Venkov       #
#                                              #
# https://github.com/dimven/SpringNodes/issues #
# https://www.reope.com/                       #
#                                              #
#    ____    _____   _____   ____    _____     #
#   |  _ \ *|  ___|*|  _  |*|  _ \ *|  ___|    #
#   | |_) |*| |___ *| | | |*| |_) |*| |___     #
#   |  _ < *|  ___|*| | | |*|  __/ *|  ___|    #
#   | | | |*| |___ *| |_| |*| |    *| |___     #
#   |_| \_|*|_____|*|_____|*|_|    *|_____|    #
#                                              #
#                                              #
#-Reope-----Updated by Mark Ackerley-----------#

import clr
clr.AddReference("RevitServices")
import RevitServices
from RevitServices.Persistence import DocumentManager
doc = DocumentManager.Instance.CurrentDBDocument

clr.AddReference("RevitAPI")
from Autodesk.Revit.DB import *

clr.AddReference("RevitNodes")
import Revit
clr.ImportExtensions(Revit.Elements)

def tolist(obj1):
    if isinstance(obj1, str): return [obj1]
    return obj1 if isinstance(obj1, list) else [obj1]

try:
    is_list = isinstance(IN[0], list)
    elements = UnwrapElement(tolist(IN[0]))

    out1 = []
    cut_el = []
    cutU = InstanceVoidCutUtils

    for e in elements:
        try:
            if cutU.IsVoidInstanceCuttingElement(e):
                cut1 = cutU.GetElementsBeingCut(e)
                if cut1.Count != 0:
                    cut1 = [doc.GetElement(id).ToDSType(True) for id in cut1]
                else:
                    cut1 = []
                out1.append(True)
                cut_el.append(cut1)
            else:
                out1.append(False)
                cut_el.append([])
        except:
            out1.append(False)
            cut_el.append([])

    if is_list:
        OUT = out1, cut_el
    else:
        OUT = out1[0], cut_el[0]

except Exception as e:
    import traceback
    OUT = "Exception:\n{0}\n\nTraceback:\n{1}".format(
        str(e),
        traceback.format_exc()
    )
# ----------------------------------------
code_block = CodeBlock(res=python_script) { res[0]; res[1]; }
bool = Output(code_block.out0)
cutElements = Output(code_block.out1)
