# Dynamo custom node FamilyInstance.ByFaceAndPoint.dyf (Dynamo 4.0.2.3852)
# category: Springs.Revit.Create
# Places instances on the input face oriented to the face's U tangent and the global Z axis.

face = Input(face: var)
type = Input(type: var[])
point = Input(point: var[])
python_script = Python(IN[0]=face, IN[1]=type, IN[2]=point)  # PythonNet3
# ---------- python_script.python (95 lines) ----------
#-Reope----------------------------------------#
#                                              #
#      Copyright(c) 2018, Dimitar Venkov       #
#                                              #
# https://github.com/dimven/SpringNodes/issues #
# https://www.reope.com/                       #
#                                              #
#    ____    _____   _____   ____    _____     #
#   |  _ \ *|  ___|*|  _  |*|  _ \ *|  ___|    #
#   | |_) |*| |___ *| | | |*| |_) |*| |___     #
#   |  _ < *|  ___|*| | | |*|  __/ *|  ___|    #
#   | | | |*| |___ *| |_| |*| |    *| |___     #
#   |_| \_|*|_____|*|_____|*|_|    *|_____|    #
#                                              #
#                                              #
#-Reope-----Updated by Mark Ackerley-----------#

import clr

clr.AddReference('ProtoGeometry')
from Autodesk.DesignScript.Geometry import *

clr.AddReference('RevitServices')
from RevitServices.Persistence import DocumentManager
from RevitServices.Transactions import TransactionManager
doc = DocumentManager.Instance.CurrentDBDocument

clr.AddReference('RevitNodes')
import Revit
clr.ImportExtensions(Revit.GeometryConversion)

clr.AddReference('RevitAPI')
import Autodesk.Revit.DB as DB


def tolist(x):
    if isinstance(x, str): return [x]
    return x if isinstance(x, list) else [x]

def first(x):
    return x[0] if isinstance(x, list) else x

def ds_point_to_xyz(pt):
    return pt.ToXyz(True)

def ds_vector_to_xyz(v):
    return DB.XYZ(v.X, v.Y, v.Z)


try:
    host = first(IN[0])
    ftype = UnwrapElement(tolist(IN[1]))
    pts = tolist(IN[2])

    OUT = []
    ftp_len = len(ftype) == 1
    ref1 = host.Tags.LookupTag("RevitFaceReference")

    TransactionManager.Instance.EnsureInTransaction(doc)

    for i, p in enumerate(pts):
        j = 0 if ftp_len else i

        if not ftype[j].IsActive:
            ftype[j].Activate()

        faceNor = host.NormalAtPoint(p)
        up = Vector.ZAxis()

        # horizontal?
        if abs(faceNor.Dot(up)) > 0.9999:
            dir1 = DB.XYZ.BasisX
        else:
            cross = faceNor.Cross(up)
            dir1 = ds_vector_to_xyz(cross)

        try:
            inst1 = doc.Create.NewFamilyInstance(
                ref1,
                ds_point_to_xyz(p),   # <-- EXPLICIT
                dir1,                 # <-- EXPLICIT
                ftype[j]
            )
            OUT.append(inst1.ToDSType(False))
        except Exception as ex:
            OUT.append(str(ex))

    TransactionManager.Instance.TransactionTaskDone()

except Exception as e:
    import traceback
    OUT = "Exception:\n{0}\n\nTraceback:\n{1}".format(
        str(e),
        traceback.format_exc()
    )
# ----------------------------------------
familyInstance = Output(python_script)
