# Dynamo custom node FamilyTemplatePaths.dyf "FamilyTemplatePaths.CommonPaths" (Dynamo 4.0.2.3852)
# category: Springs.Revit.Utility.Query
# Fetches the default family template paths

familyTemplatePath = Python()  # PythonNet3; graph input
# ---------- familyTemplatePath.python (33 lines) ----------
#-Reope----------------------------------------#
#                                              #
#      Copyright(c) 2017, Dimitar Venkov       #
#                                              #
# https://github.com/dimven/SpringNodes/issues #
# https://www.reope.com/                       #
#                                              #
#    ____    _____   _____   ____    _____     #
#   |  _ \ *|  ___|*|  _  |*|  _ \ *|  ___|    #
#   | |_) |*| |___ *| | | |*| |_) |*| |___     #
#   |  _ < *|  ___|*| | | |*|  __/ *|  ___|    #
#   | | | |*| |___ *| |_| |*| |    *| |___     #
#   |_| \_|*|_____|*|_____|*|_|    *|_____|    #
#                                              #
#                                              #
#-Reope-----Updated by Mark Ackerley-----------#

import clr

clr.AddReference('RevitServices')
from RevitServices.Persistence import DocumentManager

try:
    app = DocumentManager.Instance.CurrentUIApplication.Application
    ver = int(app.VersionNumber)
    OUT = app.FamilyTemplatePath
    
except Exception as e:
    import traceback
    OUT = "Exception:\n{0}\n\nTraceback:\n{1}".format(
        str(e),
        traceback.format_exc()
    )
# ----------------------------------------
FamilyTemplateFolder = Output(familyTemplatePath)
fromPath = DirectoryObject(path=familyTemplatePath)  # "Directory.FromPath"
getDirectoryContents = FileSystem.GetDirectoryContents(directory=fromPath)
fileName = FileSystem.FileName(path=getDirectoryContents.files)
string = StringInput("Generic Model.rft")  # graph input
contains = String.Contains(string=fileName, searchFor=string)
filterByBoolMask = List.FilterByBoolMask(list=getDirectoryContents.files, mask=contains)
firstItem = List.FirstItem(list=filterByBoolMask.in)
GenericModelTemplate = Output(firstItem)
fileName_2 = FileSystem.FileName(path=getDirectoryContents.directories)
string_2 = StringInput("Conceptual Mass")  # graph input
contains_2 = String.Contains(string=fileName_2, searchFor=string_2)
filterByBoolMask_2 = List.FilterByBoolMask(list=getDirectoryContents.directories, mask=contains_2)
firstItem_2 = List.FirstItem(list=filterByBoolMask_2.in)
fromPath_2 = DirectoryObject(path=firstItem_2)  # "Directory.FromPath"
getDirectoryContents_2 = FileSystem.GetDirectoryContents(directory=fromPath_2)
firstItem_3 = List.FirstItem(list=getDirectoryContents_2.files)
MassFamilyTemplate = Output(firstItem_3)
