# Dynamo custom node FilledRegion.ByCurves+.dyf (Dynamo 4.0.2.3852)
# category: Springs.Revit.Create
# Fully utilizes the FilledRegion.Create api method, unlike the OOTB node. You must provide a list with sublist of curve loops.

view = Input(view: Revit.Elements.Element)
type = Input(type: Revit.Elements.Element)
curveLoops = Input(curveLoops: var[][])
python_script = Python(IN[0]=view, IN[1]=type, IN[2]=curveLoops)  # PythonNet3
# ---------- python_script.python (60 lines) ----------
#-Reope----------------------------------------#
#                                              #
#      Copyright(c) 2019, Dimitar Venkov       #
#                                              #
# https://github.com/dimven/SpringNodes/issues #
# https://www.reope.com/                       #
#                                              #
#    ____    _____   _____   ____    _____     #
#   |  _ \ *|  ___|*|  _  |*|  _ \ *|  ___|    #
#   | |_) |*| |___ *| | | |*| |_) |*| |___     #
#   |  _ < *|  ___|*| | | |*|  __/ *|  ___|    #
#   | | | |*| |___ *| |_| |*| |    *| |___     #
#   |_| \_|*|_____|*|_____|*|_|    *|_____|    #
#                                              #
#                                              #
#-Reope-----Updated by Mark Ackerley-----------#

import clr
clr.AddReference('RevitAPI')
import Autodesk.Revit.DB as DB

clr.AddReference('RevitServices')
from RevitServices.Persistence import DocumentManager
from RevitServices.Transactions import TransactionManager
doc = DocumentManager.Instance.CurrentDBDocument

clr.AddReference('RevitNodes')
import Revit
clr.ImportExtensions(Revit.Elements)
clr.ImportExtensions(Revit.GeometryConversion)

clr.AddReference('System')
from System.Collections.Generic import List

def tolist(obj1):
    if isinstance(obj1, str): return [obj1]
    return obj1 if isinstance(obj1, list) else [obj1]

try:
    view = UnwrapElement(tolist(IN[0])[0])
    frType = UnwrapElement(tolist(IN[1])[0])
    dynLoops = IN[2]

    rvtLoops = List[DB.CurveLoop]()
    for crvs in tolist(dynLoops):
        loop = DB.CurveLoop.Create([c.ToRevitType() for c in tolist(crvs)])
        rvtLoops.Add(loop)

    TransactionManager.Instance.EnsureInTransaction(doc)
    fr = DB.FilledRegion.Create(doc, frType.Id, view.Id, rvtLoops)
    TransactionManager.Instance.TransactionTaskDone()

    OUT = fr.ToDSType(False)

except Exception as e:
    import traceback
    OUT = "Exception:\n{0}\n\nTraceback:\n{1}".format(
        str(e),
        traceback.format_exc()
    )
# ----------------------------------------
filledRegion = Output(python_script)
