# Dynamo custom node Form.ByGeometry.dyf (Dynamo 4.0.2.3852)
# category: Springs.Revit.Create
# Convert the input geometry to a Revit Form object. Forms can exist only in the family environment. You can convert complicated solids or surfaces directly into forms. A form can act as a void. Provide either one true boolean value to convert a form into a void. The node's lacing is set to longest by default.

geometry = Input(geometry: var[])
isVoid = Input(isVoid: var[] = false)
python_script = Python(IN[0]=geometry, IN[1]=isVoid)  # PythonNet3
# ---------- python_script.python (123 lines) ----------
#-Reope----------------------------------------#
#                                              #
#      Copyright(c) 2016, Dimitar Venkov       #
#                                              #
# https://github.com/dimven/SpringNodes/issues #
# https://www.reope.com/                       #
#                                              #
#    ____    _____   _____   ____    _____     #
#   |  _ \ *|  ___|*|  _  |*|  _ \ *|  ___|    #
#   | |_) |*| |___ *| | | |*| |_) |*| |___     #
#   |  _ < *|  ___|*| | | |*|  __/ *|  ___|    #
#   | | | |*| |___ *| |_| |*| |    *| |___     #
#   |_| \_|*|_____|*|_____|*|_|    *|_____|    #
#                                              #
#                                              #
#-Reope-----Updated by Mark Ackerley-----------#

import clr
import System
from System.Collections.Generic import *
from itertools import repeat
import traceback

clr.AddReference('ProtoGeometry')
from Autodesk.DesignScript.Geometry import *

clr.AddReference("RevitServices")
import RevitServices
from RevitServices.Persistence import DocumentManager
from RevitServices.Transactions import TransactionManager
doc = DocumentManager.Instance.CurrentDBDocument

clr.AddReference("RevitNodes")
import Revit
clr.ImportExtensions(Revit.Elements)
clr.ImportExtensions(Revit.GeometryConversion)

clr.AddReference("RevitAPI")
from Autodesk.Revit.DB import *

def tolist(obj1):
    if isinstance(obj1, str): return [obj1]
    return obj1 if isinstance(obj1, list) else [obj1]

def PadLists(lists):
    len1 = len(lists[0])
    for i in range(1, len(lists)):
        len2 = len(lists[i])
        if len2 == len1: continue
        elif len2 > len1: lists[i] = lists[i][:len1]
        else: lists[i].extend(repeat(lists[i][-1], len1 - len2))
    return lists

def NewForm(s1, isVoid1):
    message = None
    temp_path = System.IO.Path.GetTempPath()
    rand_name = System.Guid.NewGuid().ToString()
    sat_path = "%s%s.sat" % (temp_path, rand_name)
    try:
        if factor != 1:
            s1 = s1.Scale(factor)
        sat1 = Geometry.ExportToSAT([s1], sat_path)
        satOpt = SATImportOptions()
        satOpt.Placement = ImportPlacement.Origin
        satOpt.Unit = ImportUnit.Foot
        satId = doc.Import(sat1, satOpt, view1)
        opt1 = Options()
        opt1.ComputeReferences = True
        el1 = doc.GetElement(satId)
        geom1 = el1.get_Geometry(opt1)
        enum = geom1.GetEnumerator()
        enum.MoveNext()
        geom2 = enum.Current.GetInstanceGeometry()
        enum2 = geom2.GetEnumerator()
        enum2.MoveNext()
        s1 = enum2.Current
        doc.Delete(List[ElementId]([satId]))
        System.IO.File.Delete(sat_path)
    except:
        message = traceback.format_exc()

    if message is None:
        try:
            s2 = FreeFormElement.Create(doc, s1)
            if isVoid1:
                void_par = s2.get_Parameter(BuiltInParameter.ELEMENT_IS_CUTTING)
                void_par.Set(1)
            return s2.ToDSType(False)
        except:
            return traceback.format_exc()
    else:
        return message

try:
    geom = tolist(IN[0])
    isVoid = tolist(IN[1])

    acceptable_views = ("ThreeD", "FloorPlan", "EngineeringPlan", "CeilingPlan", "Elevation", "Section")
    view_fec = FilteredElementCollector(doc).OfClass(View)
    view1 = None
    for v in view_fec:
        if str(v.ViewType) in acceptable_views and not v.IsTemplate:
            view1 = v
            break

    units = doc.GetUnits().GetFormatOptions(SpecTypeId.Length).GetUnitTypeId()
    factor = UnitUtils.ConvertToInternalUnits(1, units)

    if doc.IsFamilyDocument:
        if len(geom) != len(isVoid):
            padded = PadLists([geom, isVoid])
            isVoid = padded[1]
        TransactionManager.Instance.EnsureInTransaction(doc)
        OUT = list(map(NewForm, geom, isVoid))
        TransactionManager.Instance.TransactionTaskDone()
    else:
        OUT = "Forms can only exist in family documents"

except Exception as e:
    OUT = "Exception:\n{0}\n\nTraceback:\n{1}".format(
        str(e),
        traceback.format_exc()
    )
# ----------------------------------------
Form = Output(python_script)
