# Dynamo custom node Geometry.ReadTag.dyf (Dynamo 3.3.0.6316)
# category: Springs.Geometry.Actions
# Design script geometry can store a <string, object> dictionary for the duration of the active graph. If no parameter with the active name is found, a null value will be returned instead.

geometry = Input(geometry: var)
tagName = Input(tagName: string)
python_script = Python(IN[0]=geometry, IN[1]=tagName)  # PythonNet3
# ---------- python_script.python (18 lines) ----------
#-Reope----------------------------------------#
#                                              #
#      Copyright(c) 2020, Dimitar Venkov       #
#                                              #
# https://github.com/dimven/SpringNodes/issues #
# https://www.reope.com/                       #
#                                              #
#    ____    _____   _____   ____    _____     #
#   |  _ \ *|  ___|*|  _  |*|  _ \ *|  ___|    #
#   | |_) |*| |___ *| | | |*| |_) |*| |___     #
#   |  _ < *|  ___|*| | | |*|  __/ *|  ___|    #
#   | | | |*| |___ *| |_| |*| |    *| |___     #
#   |_| \_|*|_____|*|_____|*|_|    *|_____|    #
#                                              #
#                                              #
#-Reope-----Updated by Mark Ackerley-----------#

OUT = IN[0].Tags.LookupTag(IN[1])
# ----------------------------------------
value = Output(python_script)
