# Dynamo custom node Line.StraightenXY.dyf (Dynamo 3.3.0.6316)
# category: Springs.Geometry.Actions
# Checks a line's end points for irregularities and corrects them if they are at or below the specified margin. The default margin is 1/5000 of the curve length, which is conservative.

line = Input(line: var)
margin = Input(margin: double = 5000)
isRatio = Input(isRatio: bool = true)
code_block = CodeBlock(c=line, x=margin, b=isRatio)
# ---------- code_block.designscript (28 lines) ----------
c;
x;
b;

straightened = [Imperative]{

m = c.Length / x;

if(!b){
m = x;
}

cS = c.StartPoint;
cE = c.EndPoint;
dX = DSCore.Math.Abs(cS.X - cE.X);
dY = DSCore.Math.Abs(cS.Y - cE.Y);
if (dX <= m){
	return = DesignScript.Line.ByStartPointEndPoint(
	cS,DesignScript.Point.ByCoordinates(cS.X, cE.Y, cE.Z));
}
elseif (dY <= m){
	return = DesignScript.Line.ByStartPointEndPoint(
	cS,DesignScript.Point.ByCoordinates(cE.X, cS.Y, cE.Z));
}
else{
	return = c;
}
};
# ----------------------------------------
line_2 = Output(code_block.out3)  # "line"
