# Dynamo custom node List.DropFirstLast.dyf (Dynamo 4.0.2.3852)
# category: Springs.Actions
# Removes the first and last items from the list

list = Input(list: var[]..[])
code_block = CodeBlock(l1=list) { DSCore.List.DropItems(DSCore.List.DropItems(l1,1),-1); l1[[0,-1]]; }
rest = Output(code_block.out0)
F_L = Output(code_block.out1)  # "F&L"
