# Dynamo custom node List.GetEvenOdd.dyf (Dynamo 3.3.0.6316)
# category: Springs.Actions
# Gets the even and odd indices from the list.

list = Input(list: var[]..[])
code_block = CodeBlock(l1=list) { DSCore.List.TakeEveryNthItem(l1,2,0); DSCore.List.DropEveryNthItem(l1,2,0); }
even = Output(code_block.out1)
odd = Output(code_block.out0)
