# Dynamo custom node List.SubpairsWrapped.dyf (Dynamo 4.0.2.3852)
# category: Springs.Actions
# Wrap the list and pair up each list item with the next one.

list = Input(list: var[]..[])
code_block = CodeBlock(l1=list)
# ---------- code_block.designscript (3 lines) ----------
DSCore.List.DropItems(DSCore.
  List.Sublists(List.AddItemToEnd(l1[0],
  l1),0..1,1),-1);
# ----------------------------------------
lists = Output(code_block)
