# Dynamo custom node List.ToString.dyf (Dynamo 4.0.2.3852)
# category: Springs.Create
# Serializes a (nested) list or dictionary of basic objects into a valid design script syntax string.

list = Input(list: var[]..[])
multiline = Input(multiline: bool = false)
python_script = Python(IN[0]=list, IN[1]=multiline)  # PythonNet3
# ---------- python_script.python (69 lines) ----------
#-Reope----------------------------------------#
#                                              #
#      Copyright(c) 2020, Dimitar Venkov       #
#                                              #
# https://github.com/dimven/SpringNodes/issues #
# https://www.reope.com/                       #
#                                              #
#    ____    _____   _____   ____    _____     #
#   |  _ \ *|  ___|*|  _  |*|  _ \ *|  ___|    #
#   | |_) |*| |___ *| | | |*| |_) |*| |___     #
#   |  _ < *|  ___|*| | | |*|  __/ *|  ___|    #
#   | | | |*| |___ *| |_| |*| |    *| |___     #
#   |_| \_|*|_____|*|_____|*|_|    *|_____|    #
#                                              #
#                                              #
#-Reope-----Updated by Mark Ackerley-----------#

import re

import clr
clr.AddReference('DesignScriptBuiltin')
from DesignScript.Builtin import Dictionary as dsDict

from itertools import zip_longest

from System import Int64

def tolist(obj1):
    return obj1 if isinstance(obj1, list) else [obj1]

def replaceDict(x):
    if isinstance(x, list): return list(map(replaceDict, x))
    if isinstance(x, dsDict): return dict(zip(x.Keys, replaceDict(x.Values)))
    if isinstance(x, Int64): return int(x)
    return x

try:
    rep = {"'" : "\"",
	   "[" : "[\n",
	   "]" : "\n]",
	   "None" : "null",
	   "True" : "true",
	   "False" : "false",
	   ", " : ",\n",
	   "{" : "{\n",
	   "}" : "\n}"
	  }

    if not IN[1]:
        del rep["["]
        del rep["]"]
        del rep[", "]
        del rep["{"]
        del rep["}"]

    rep = dict((re.escape(k), v) for k, v in rep.items())
    pattern = re.compile("|".join(rep.keys()))
    s1 = str(replaceDict(tolist(IN[0])))

    body, strings = re.split("'[^/']+'", s1), re.findall("'([^/']+)'", s1)
    body = (pattern.sub(lambda m: rep[re.escape(m.group(0))], b) for b in body)
    OUT = ''.join('%s"%s"' % (b, s) if s else b for b, s in zip_longest(body, strings))

except Exception as e:
    import traceback
    OUT = "Exception:\n{0}\n\nTraceback:\n{1}".format(
        str(e),
        traceback.format_exc()
    )
# ----------------------------------------
str = Output(python_script)
