# Dynamo custom node Mesh.DifferentiateDisplay.dyf (Dynamo 4.1.0.4676)
# category: Springs.Geometry.Actions
# Paints the input meshes using the default color range. Works well with lists of meshes.

randomCol = Input(randomCol: bool = false)
geo = Input(geo: var[]..[])
code_block = CodeBlock(rand=randomCol, geo=geo)
# ---------- code_block.designscript (22 lines) ----------
def col1(x){
r = Math.Random(0, 255);
g = Math.Random(0, 255);
b = Math.Random(0, 255);
return = DSCore.Color.ByARGB(255, r, g, b);
};

rand;
col = [Imperative]{
if (rand)
{
	return = col1(GetKeys(geo));
}
else
{
	dcr = ColorRange1D.Default();
	return = ColorRange1D.GetColorAtParameter
	  (dcr, 0..1..#(Count(geo)));
}
}

GeometryColor.ByMeshColors(geo, List.Chop(col, 1));
# ----------------------------------------
meshDisplay = Output(code_block.out2)
