# Dynamo custom node Number.AlmostEqual.dyf (Dynamo 4.0.2.3852)
# category: Springs.Query
# Checks if a number is almost equal to a value with a specified tollerance.

a = Input(a: var)
b = Input(b: var)
tolerance = Input(tolerance: double = 0.0001)
code_block = CodeBlock(a=a, b=b, tol=tolerance) { Math.Abs(a - b) <= tol; }
bool = Output(code_block)
