# Dynamo custom node Opening.InFloorByCurves.dyf (Dynamo 4.0.2.3852)
# category: Springs.Revit.Create
# Create hosted floor opeinngs through the input floors. The second input is a list of sub-lists of the boundary curves.

host = Input(host: var[])
curves = Input(curves: var[][])
python_script = Python(IN[0]=host, IN[1]=curves)  # PythonNet3
# ---------- python_script.python (79 lines) ----------
#-Reope----------------------------------------#
#                                              #
#      Copyright(c) 2016, Dimitar Venkov       #
#                                              #
# https://github.com/dimven/SpringNodes/issues #
# https://www.reope.com/                       #
#                                              #
#    ____    _____   _____   ____    _____     #
#   |  _ \ *|  ___|*|  _  |*|  _ \ *|  ___|    #
#   | |_) |*| |___ *| | | |*| |_) |*| |___     #
#   |  _ < *|  ___|*| | | |*|  __/ *|  ___|    #
#   | | | |*| |___ *| |_| |*| |    *| |___     #
#   |_| \_|*|_____|*|_____|*|_|    *|_____|    #
#                                              #
#                                              #
#-Reope-----Updated by Mark Ackerley-----------#

import clr
clr.AddReference("RevitAPI")
from Autodesk.Revit.DB import *

clr.AddReference("RevitServices")
import RevitServices
from RevitServices.Persistence import DocumentManager
from RevitServices.Transactions import TransactionManager
doc = DocumentManager.Instance.CurrentDBDocument

clr.AddReference("RevitNodes")
import Revit
clr.ImportExtensions(Revit.Elements)
clr.ImportExtensions(Revit.GeometryConversion)

def tolist(obj1):
    if isinstance(obj1, str): return [obj1]
    return obj1 if isinstance(obj1, list) else [obj1]

try:
    is_list = isinstance(IN[0], list)
    flr = UnwrapElement(tolist(IN[0]))
    hole = IN[1]

    if not any(hasattr(h, "__iter__") for h in tolist(hole)):
        hole = [hole]
    else:
        hole = tolist(hole)

    newhl = []
    for h in hole:
        z = CurveArray()
        for j in h:
            z.Append(j.ToRevitType())
        newhl.append(z)

    openings = []
    TransactionManager.Instance.EnsureInTransaction(doc)
    if len(flr) == 1:
        for h in newhl:
            try:
                x = doc.Create.NewOpening(flr[0], h, True)
                openings.append(x.ToDSType(False))
            except:
                openings.append(None)
    else:
        for f, h in zip(flr, newhl):
            try:
                x = doc.Create.NewOpening(f, h, True)
                openings.append(x.ToDSType(False))
            except:
                openings.append(None)
    TransactionManager.Instance.TransactionTaskDone()

    OUT = openings if is_list else openings[0]

except Exception as e:
    import traceback
    OUT = "Exception:\n{0}\n\nTraceback:\n{1}".format(
        str(e),
        traceback.format_exc()
    )
# ----------------------------------------
opening = Output(python_script)
