# Dynamo custom node Parse.InterferenceCheck.dyf (Dynamo 4.0.2.3852)
# category: Springs.Revit.Utility.Actions
# Process a Revit interference check (HTML file) and extract the interference categories, all affected elements and the total number of clashes. If you are executing from a document different than the one the error report belongs to, be sure to set "fetch_elements" to false.

report = Input(report: var)
fetch_elements = Input(fetch_elements: bool = true)
python_script = Python(IN[0]=report, IN[1]=fetch_elements)  # PythonNet3
# ---------- python_script.python (119 lines) ----------
#-Reope----------------------------------------#
#                                              #
#      Copyright(c) 2016, Dimitar Venkov       #
#                                              #
# https://github.com/dimven/SpringNodes/issues #
# https://www.reope.com/                       #
#                                              #
#    ____    _____   _____   ____    _____     #
#   |  _ \ *|  ___|*|  _  |*|  _ \ *|  ___|    #
#   | |_) |*| |___ *| | | |*| |_) |*| |___     #
#   |  _ < *|  ___|*| | | |*|  __/ *|  ___|    #
#   | | | |*| |___ *| |_| |*| |    *| |___     #
#   |_| \_|*|_____|*|_____|*|_|    *|_____|    #
#                                              #
#                                              #
#-Reope-----Updated by Mark Ackerley-----------#

import clr
import System
from collections import Counter
from html.parser import HTMLParser

class ReportParser(HTMLParser):
    def __init__(self):
        super().__init__()
        self.data1 = []
        self.temp_data = []

    def handle_data(self, data):
        if data != "\n" and data not in known_errors:
            self.temp_data.append(data)

    def handle_starttag(self, tag, attrs):
        if tag == "tr":
            self.data1.append(self.temp_data)
            self.temp_data = []

interference_cats = {
    "Structural Columns", "Air Terminals", "Assemblies", "Cable Tray Fittings",
    "Cable Tray Runs", "Cable Trays", "Casework", "Ceilings", "Columns",
    "Conduit Fittings", "Conduit Runs", "Conduits", "Curtain Panels",
    "Curtain Systems", "Curtain Wall Mullions", "Doors", "Ducts",
    "Duct Accessories", "Duct Fittings", "Duct Insulations", "Duct Linings",
    "Duct Placeholders", "Duct Systems", "Electrical Circuits",
    "Electrical Equipment", "Electrical Fixtures", "Fabrication Parts",
    "Flex Ducts", "Flex Pipes", "Floors", "Furniture", "Furniture Systems",
    "Generic Models", "Gutters", "Lighting Devices", "Lighting Fixtures",
    "Mass Floors", "Mass", "Mechanical Equipment", "Pads", "Parts",
    "Pipe Accessories", "Pipe Fittings", "Pipe Insulations",
    "Pipe Placeholders", "Pipes", "Piping Systems", "Plumbing Fixtures",
    "Railings", "Ramps", "Roofs", "Roof Soffits", "Shaft Openings",
    "Slab Edges", "Specialty Equipment", "Sprinklers", "Stairs",
    "Structural Connections", "Structural Foundations", "Structural Framing",
    "Structural Trusses", "Wall Sweeps", "Walls", "Windows", "Wires"
}

def getElement(i):
    try:
        return doc.GetElement(ElementId(i)).ToDSType(True)
    except:
        return i

def fetchCat(items, interference_cats=interference_cats):
    for i in items:
        if i in interference_cats:
            return i

try:
    report1, fetch_elements = IN

    if fetch_elements:
        clr.AddReference("RevitServices")
        from RevitServices.Persistence import DocumentManager
        doc = DocumentManager.Instance.CurrentDBDocument
        clr.AddReference("RevitAPI")
        from Autodesk.Revit.DB import ElementId
        clr.AddReference('RevitNodes')
        import Revit
        clr.ImportExtensions(Revit.Elements)

    known_errors = {"  ", "td>  "}
    parser = ReportParser()

    with System.IO.File.OpenText(report1.FullName) as f:
        while not f.EndOfStream:
            parser.feed(f.ReadLine().replace("&", ""))

    parser.data1.append(parser.temp_data)
    report_data = parser.data1[2:]
    parser.close()
    parser = None

    cases, elements = [], []
    for d in report_data:
        left = list(map(str.strip, d[1].split(" : ")))
        right = list(map(str.strip, d[2].split(" : ")))
        leftId = int(''.join(filter(str.isdigit, left[-1])))
        rightId = int(''.join(filter(str.isdigit, right[-1])))
        if fetch_elements:
            leftId, rightId = getElement(leftId), getElement(rightId)
        elements.append((leftId, rightId))
        leftCat, rightCat = fetchCat(left), fetchCat(right)
        case = "%s - %s" % (leftCat, rightCat) if leftCat is not None and rightCat is not None else "Unidentified"
        cases.append(case)

    group_cases = Counter(cases).most_common()
    unique_cases, sum_cases = zip(*group_cases)
    unique_cases = list(unique_cases)
    sum_cases = list(sum_cases)
    sum_cases.append("Total interferences : %s" % sum(sum_cases))

    OUT = cases, elements, unique_cases, sum_cases

except Exception as e:
    import traceback
    OUT = "Exception:\n{0}\n\nTraceback:\n{1}".format(
        str(e),
        traceback.format_exc()
    )
# ----------------------------------------
code_block = CodeBlock(res=python_script) { res[0]; res[1]; res[2]; res[3]; }
clash_categories = Output(code_block.out0)
affected_elements = Output(code_block.out1)
unique_cases = Output(code_block.out2)
number_of_clashes = Output(code_block.out3)
