# Dynamo custom node PlanarFace.FixDomain.dyf (Dynamo 3.6.1.9895)
# category: Springs.Geometry.Actions
# Corrects the surface domain of a 3 or 4 point planar face extracted from Revit.

surf = Input(surf: var)
code_block = CodeBlock(sf1=surf)
# ---------- code_block.designscript (2 lines) ----------
DesignScript.Geometry.Surface.ByLoft(sf1.
  PerimeterCurves()[[0,2]]);
# ----------------------------------------
surface = Output(code_block)
