# Dynamo custom node SelectFaces+.dyf (Dynamo 4.0.2.3852)
# category: Springs.Revit.Selection.Actions
# Select multiple faces from inside the Revit UI. Be sure to press "Finish" once done. Unlike the built-in node, face references of instances will be added sucessfully and you'l get the pick points. You can use a Boolean toggle to refresh your selection.

refresh = Input(refresh: bool = true)
python_script = Python(IN[0]=refresh)  # PythonNet3
# ---------- python_script.python (66 lines) ----------
#-Reope----------------------------------------#
#                                              #
#      Copyright(c) 2016, Dimitar Venkov       #
#                                              #
# https://github.com/dimven/SpringNodes/issues #
# https://www.reope.com/                       #
#                                              #
#    ____    _____   _____   ____    _____     #
#   |  _ \ *|  ___|*|  _  |*|  _ \ *|  ___|    #
#   | |_) |*| |___ *| | | |*| |_) |*| |___     #
#   |  _ < *|  ___|*| | | |*|  __/ *|  ___|    #
#   | | | |*| |___ *| |_| |*| |    *| |___     #
#   |_| \_|*|_____|*|_____|*|_|    *|_____|    #
#                                              #
#                                              #
#-Reope-----Updated by Mark Ackerley-----------#

import clr
clr.AddReference("RevitAPIUI")
from Autodesk.Revit.UI import *

clr.AddReference("RevitServices")
import RevitServices
from RevitServices.Persistence import DocumentManager
uidoc = DocumentManager.Instance.CurrentUIApplication.ActiveUIDocument
doc = uidoc.Document

clr.AddReference("RevitNodes")
import Revit
clr.ImportExtensions(Revit.Elements)
clr.ImportExtensions(Revit.GeometryConversion)

clr.AddReference('RevitAPI')
from Autodesk.Revit.DB import *

def output1(x):
    if len(x) == 1: return x[0]
    else: return x

try:
    surfaces, gpoints = [], []
    sel1 = uidoc.Selection
    ot1 = Selection.ObjectType.Face
    ref_list = sel1.PickObjects(ot1, "Select the faces and press Finish.")

    for ref in ref_list:
        el1 = doc.GetElement(ref.ElementId)
        sf0 = el1.GetGeometryObjectFromReference(ref)
        if isinstance(el1, FamilyInstance):
            tf1 = el1.GetTransform().ToCoordinateSystem()
            sf1 = list(sf0.Convert(ref, tf1))
        else:
            sf1 = list(sf0.ToProtoType(True))
        for i in sf1:
            i.Tags.AddTag("RevitFaceReference", ref)
        surfaces.append(output1(sf1))
        gpoints.append(ref.GlobalPoint.ToPoint(True))

    OUT = surfaces, gpoints

except Exception as e:
    import traceback
    OUT = "Exception:\n{0}\n\nTraceback:\n{1}".format(
        str(e),
        traceback.format_exc()
    )
# ----------------------------------------
code_block = CodeBlock(r=python_script) { r[0]; r[1]; }
faces = Output(code_block.out0)
pickPoints = Output(code_block.out1)
