# Dynamo custom node SelectLinkedElement.dyf (Dynamo 4.0.2.3852)
# category: Springs.Revit.Selection.Actions
# Select the linked instance first, followed by the element. If your selection fails, just press escape.
# To refresh the node, connect a boolean switch node.

refresh = Input(refresh: bool = true)
python_script = Python(IN[0]=refresh)  # PythonNet3
# ---------- python_script.python (53 lines) ----------
#-Reope----------------------------------------#
#                                              #
#      Copyright(c) 2019, Dimitar Venkov       #
#                                              #
# https://github.com/dimven/SpringNodes/issues #
# https://www.reope.com/                       #
#                                              #
#    ____    _____   _____   ____    _____     #
#   |  _ \ *|  ___|*|  _  |*|  _ \ *|  ___|    #
#   | |_) |*| |___ *| | | |*| |_) |*| |___     #
#   |  _ < *|  ___|*| | | |*|  __/ *|  ___|    #
#   | | | |*| |___ *| |_| |*| |    *| |___     #
#   |_| \_|*|_____|*|_____|*|_|    *|_____|    #
#                                              #
#                                              #
#-Reope-----Updated by Mark Ackerley-----------#

import clr
clr.AddReference("RevitAPIUI")
from Autodesk.Revit.UI import Selection

clr.AddReference("RevitAPI")
from Autodesk.Revit.DB import RevitLinkInstance, Transform

clr.AddReference("RevitServices")
import RevitServices
from RevitServices.Persistence import DocumentManager
uidoc = DocumentManager.Instance.CurrentUIApplication.ActiveUIDocument
doc = uidoc.Document

clr.AddReference("RevitNodes")
import Revit
clr.ImportExtensions(Revit.Elements)
clr.ImportExtensions(Revit.GeometryConversion)

try:
    sel1 = uidoc.Selection
    ot = Selection.ObjectType.LinkedElement
    el_ref = sel1.PickObject(ot, "Pick a linked element.")

    linkInst = doc.GetElement(el_ref.ElementId)
    linkDoc = linkInst.GetLinkDocument()
    linkEl = linkDoc.GetElement(el_ref.LinkedElementId).ToDSType(True)
    tf1 = linkInst.GetTotalTransform().ToCoordinateSystem(True)

    OUT = linkEl, tf1

except Exception as e:
    import traceback
    OUT = "Exception:\n{0}\n\nTraceback:\n{1}".format(
        str(e),
        traceback.format_exc()
    )
# ----------------------------------------
code_block = CodeBlock(r=python_script) { r[0]; r[1]; }
element = Output(code_block.out0)
transform = Output(code_block.out1)
