# Dynamo custom node SelectLinkedFace.dyf (Dynamo 4.0.2.3852)
# category: Springs.Revit.Selection.Actions
# Select the linked instance first, followed by the face. The face will be transformed to the host file's coordinate system. If your selection fails, just press escape.
# To refresh the node, connect a boolean switch node.

refresh = Input(refresh: bool = true)
python_script = Python(IN[0]=refresh)  # PythonNet3
# ---------- python_script.python (70 lines) ----------
#-Reope----------------------------------------#
#                                              #
#      Copyright(c) 2017, Dimitar Venkov       #
#                                              #
# https://github.com/dimven/SpringNodes/issues #
# https://www.reope.com/                       #
#                                              #
#    ____    _____   _____   ____    _____     #
#   |  _ \ *|  ___|*|  _  |*|  _ \ *|  ___|    #
#   | |_) |*| |___ *| | | |*| |_) |*| |___     #
#   |  _ < *|  ___|*| | | |*|  __/ *|  ___|    #
#   | | | |*| |___ *| |_| |*| |    *| |___     #
#   |_| \_|*|_____|*|_____|*|_|    *|_____|    #
#                                              #
#                                              #
#-Reope-----Updated by Mark Ackerley-----------#

import clr
clr.AddReference("RevitAPIUI")
from Autodesk.Revit.UI import *

clr.AddReference("RevitServices")
import RevitServices
from RevitServices.Persistence import DocumentManager
uidoc = DocumentManager.Instance.CurrentUIApplication.ActiveUIDocument
doc = uidoc.Document

clr.AddReference("RevitNodes")
import Revit
clr.ImportExtensions(Revit.Elements)
clr.ImportExtensions(Revit.GeometryConversion)

clr.AddReference("RevitAPI")
from Autodesk.Revit.DB import RevitLinkInstance, FamilyInstance

def output1(x):
    x = list(x)
    if len(x) == 1: return x[0]
    else: return x

try:
    sel1 = uidoc.Selection
    ot1 = Selection.ObjectType.Element
    ot2 = Selection.ObjectType.PointOnElement

    li_ref = sel1.PickObject(ot1, "Select a link instance first.")
    link1 = doc.GetElement(li_ref.ElementId)

    if isinstance(link1, RevitLinkInstance):
        tf1 = link1.GetTotalTransform()
        face_ref = sel1.PickObject(ot2, "Pick a face.")
        linkDoc = link1.GetLinkDocument()
        el1 = linkDoc.GetElement(face_ref.LinkedElementId)
        face_ref2 = face_ref.CreateReferenceInLink()
        sf0 = el1.GetGeometryObjectFromReference(face_ref2)
        if isinstance(el1, FamilyInstance):
            tf1 *= el1.GetTotalTransform()
        sf1 = list(sf0.Convert(face_ref2, tf1.ToCoordinateSystem(True)))
        for s in sf1:
            s.Tags.AddTag("RevitFaceReference", face_ref)
        OUT = output1(sf1), face_ref.GlobalPoint.ToPoint(True)
    else:
        OUT = "Failed to pick a link instance.", None

except Exception as e:
    import traceback
    OUT = "Exception:\n{0}\n\nTraceback:\n{1}".format(
        str(e),
        traceback.format_exc()
    )
# ----------------------------------------
code_block = CodeBlock(r=python_script) { r[0]; r[1]; }
surface = Output(code_block.out0)
pickPoint = Output(code_block.out1)
