# Dynamo custom node Sheet.Views+.dyf (Dynamo 4.0.2.3852)
# category: Springs.Revit.Query
# Extracts all views and schedules (minus the revision schedule) placed on the input sheet (or sheets).
# Will be depreciated once the bult in node works with all plan types.

sheet = Input(sheet: var[])
python_script = Python(IN[0]=sheet)  # PythonNet3
# ---------- python_script.python (66 lines) ----------
#-Reope----------------------------------------#
#                                              #
#      Copyright(c) 2016, Dimitar Venkov       #
#                                              #
# https://github.com/dimven/SpringNodes/issues #
# https://www.reope.com/                       #
#                                              #
#    ____    _____   _____   ____    _____     #
#   |  _ \ *|  ___|*|  _  |*|  _ \ *|  ___|    #
#   | |_) |*| |___ *| | | |*| |_) |*| |___     #
#   |  _ < *|  ___|*| | | |*|  __/ *|  ___|    #
#   | | | |*| |___ *| |_| |*| |    *| |___     #
#   |_| \_|*|_____|*|_____|*|_|    *|_____|    #
#                                              #
#                                              #
#-Reope-----Updated by Mark Ackerley-----------#

import clr
clr.AddReference("RevitServices")
from RevitServices.Persistence import DocumentManager
doc = DocumentManager.Instance.CurrentDBDocument

clr.AddReference("RevitNodes")
import Revit
clr.ImportExtensions(Revit.Elements)

clr.AddReference("RevitAPI")
from Autodesk.Revit.DB import *

def tolist(obj1):
    if isinstance(obj1, str): return [obj1]
    return obj1 if isinstance(obj1, list) else [obj1]

try:
    is_list = isinstance(IN[0], list)
    sheets = UnwrapElement(tolist(IN[0]))

    rev_str = "<Revision Schedule>"
    sched_dict = {}

    fec1 = FilteredElementCollector(doc).OfClass(ScheduleSheetInstance)
    for s in fec1:
        if rev_str not in s.Name:
            key = s.OwnerViewId.Value
            if key not in sched_dict:
                sched_dict[key] = [s]
            else:
                sched_dict[key].append(s)

    sheet_views, sheets_scheds = [], []
    for sheet in sheets:
        viewsid = sheet.GetAllPlacedViews()
        views = [doc.GetElement(v).ToDSType(True) for v in viewsid]
        sheet_views.append(views)
        s_id = sheet.Id.Value
        scheds = sched_dict[s_id] if s_id in sched_dict else []
        sheets_scheds.append(scheds)

    OUT = sheet_views, sheets_scheds

except Exception as e:
    import traceback
    OUT = "Exception:\n{0}\n\nTraceback:\n{1}".format(
        str(e),
        traceback.format_exc()
    )
# ----------------------------------------
code_block = CodeBlock(o=python_script) { o[0]; o[1]; }
view_s = Output(code_block.out0)  # "view(s)"
schedule_s = Output(code_block.out1)  # "schedule(s)"
