# Dynamo custom node TextNote.ByPoint.dyf (Dynamo 4.0.2.3852)
# category: Springs.Revit.Create
# Places a text note at a given point in the view. View, text type and content can either be a single item for all points or the same length as the number of points.
# Set track to false if you'd like to place notes on every run.

view = Input(view: var[])
point = Input(point: var[])
content = Input(content: string[])
textType = Input(textType: var[] = null)
horAlign = Input(horAlign: string = "Center")
track = Input(track: bool = true)
byPoint = Python(IN[0]=view, IN[1]=point, IN[2]=content, IN[3]=textType, IN[4]=horAlign, IN[5]=track)  # "TextNote.ByPoint"; PythonNet3
# ---------- byPoint.python (82 lines) ----------
#-Reope----------------------------------------#
#                                              #
#      Copyright(c) 2018, Dimitar Venkov       #
#                                              #
# https://github.com/dimven/SpringNodes/issues #
# https://www.reope.com/                       #
#                                              #
#    ____    _____   _____   ____    _____     #
#   |  _ \ *|  ___|*|  _  |*|  _ \ *|  ___|    #
#   | |_) |*| |___ *| | | |*| |_) |*| |___     #
#   |  _ < *|  ___|*| | | |*|  __/ *|  ___|    #
#   | | | |*| |___ *| |_| |*| |    *| |___     #
#   |_| \_|*|_____|*|_____|*|_|    *|_____|    #
#                                              #
#                                              #
#-Reope-----Updated by Mark Ackerley-----------#

import clr
clr.AddReference("RevitServices")
import RevitServices
from RevitServices.Persistence import DocumentManager
from RevitServices.Transactions import TransactionManager
doc = DocumentManager.Instance.CurrentDBDocument

clr.AddReference('RevitAPI')
import Autodesk.Revit.DB as DB

clr.AddReference("RevitNodes")
import Revit
clr.ImportExtensions(Revit.Elements)
clr.ImportExtensions(Revit.GeometryConversion)

def tolist(obj1):
    if isinstance(obj1, str): return [obj1]
    return obj1 if isinstance(obj1, list) else [obj1]

try:
    is_list = isinstance(IN[1], list)
    view = UnwrapElement(tolist(IN[0]))
    pts = tolist(IN[1])
    content = list(map(str, tolist(IN[2])))
    txtType = UnwrapElement(tolist(IN[3]))
    _txtAlign = str(IN[4])
    persistent = not IN[5]

    txtAlign_dict = {
        "Center": DB.HorizontalTextAlignment.Center,
        "Left":   DB.HorizontalTextAlignment.Left,
        "Right":  DB.HorizontalTextAlignment.Right
    }
    txtAlign = txtAlign_dict.get(_txtAlign, DB.HorizontalTextAlignment.Center)

    if txtType[0] is None:
        txtType[0] = doc.GetElement(doc.GetDefaultElementTypeId(DB.ElementTypeGroup.TextNoteType))

    txtType_len = len(txtType) == 1
    view_len = len(view) == 1
    content_len = len(content) == 1

    out1 = []
    TransactionManager.Instance.EnsureInTransaction(doc)
    for i, pt in enumerate(pts):
        p = pt.ToXyz(True)
        j = 0 if txtType_len else i
        k = 0 if view_len else i
        m = 0 if content_len else i
        try:
            tn = DB.TextNote.Create(doc, view[k].Id, p, content[m], txtType[j].Id)
            tn.HorizontalAlignment = txtAlign
            out1.append(tn.ToDSType(persistent))
        except:
            out1.append(None)
    TransactionManager.Instance.TransactionTaskDone()

    OUT = out1 if is_list else out1[0]

except Exception as e:
    import traceback
    OUT = "Exception:\n{0}\n\nTraceback:\n{1}".format(
        str(e),
        traceback.format_exc()
    )
# ----------------------------------------
textNote = Output(byPoint)
