# Dynamo custom node Utility.Announce.dyf (Dynamo 4.0.2.3852)
# category: Springs.Actions
# Uses the standard windows speech synthesiser to make an announcement when the note gets executed. Useful when placed after a long running task.

message = Input(message: string = "Dynamo task complete.")
passThrough = Input(passThrough: var[]..[])
count = List.Count(list=passThrough)
python_script = Python(IN[0]=message, IN[1]=count)  # PythonNet3
# ---------- python_script.python (45 lines) ----------
#-Reope----------------------------------------#
#                                              #
#      Copyright(c) 2016, Dimitar Venkov       #
#                                              #
# https://github.com/dimven/SpringNodes/issues #
# https://www.reope.com/                       #
#                                              #
#    ____    _____   _____   ____    _____     #
#   |  _ \ *|  ___|*|  _  |*|  _ \ *|  ___|    #
#   | |_) |*| |___ *| | | |*| |_) |*| |___     #
#   |  _ < *|  ___|*| | | |*|  __/ *|  ___|    #
#   | | | |*| |___ *| |_| |*| |    *| |___     #
#   |_| \_|*|_____|*|_____|*|_|    *|_____|    #
#                                              #
#                                              #
#-Reope-----Updated by Mark Ackerley-----------#

import clr
import System

import clr
import System
from System.Diagnostics import ProcessStartInfo, Process

try:
    if IN[1]:
        text = IN[0]
        script = "Add-Type -AssemblyName System.Speech; $s = New-Object System.Speech.Synthesis.SpeechSynthesizer; $s.Rate = 3; $s.Speak('%s')" % text
        
        psi = ProcessStartInfo()
        psi.FileName = "powershell"
        psi.Arguments = "-WindowStyle Hidden -Command \"%s\"" % script
        psi.CreateNoWindow = True
        psi.UseShellExecute = False
        Process.Start(psi)
        OUT = "Speaking: %s" % text
    else:
        OUT = "Set trigger to True"

except Exception as e:
    import traceback
    OUT = "Exception:\n{0}\n\nTraceback:\n{1}".format(
        str(e),
        traceback.format_exc()
    )
# ----------------------------------------
passThrough_2 = Output(passThrough)  # "passThrough"
