# Dynamo custom node Wall.IsCurtainWall.dyf (Dynamo 4.0.2.3852)
# category: Springs.Revit.Query
# Returns true if the wall is a curtain wall.

wall = Input(wall: var[])
python_script = Python(IN[0]=wall)  # PythonNet3
# ---------- python_script.python (39 lines) ----------
#-Reope----------------------------------------#
#                                              #
#      Copyright(c) 2018, Dimitar Venkov       #
#                                              #
# https://github.com/dimven/SpringNodes/issues #
# https://www.reope.com/                       #
#                                              #
#    ____    _____   _____   ____    _____     #
#   |  _ \ *|  ___|*|  _  |*|  _ \ *|  ___|    #
#   | |_) |*| |___ *| | | |*| |_) |*| |___     #
#   |  _ < *|  ___|*| | | |*|  __/ *|  ___|    #
#   | | | |*| |___ *| |_| |*| |    *| |___     #
#   |_| \_|*|_____|*|_____|*|_|    *|_____|    #
#                                              #
#                                              #
#-Reope-----Updated by Mark Ackerley-----------#

import clr
clr.AddReference("RevitNodes")
import Revit
clr.ImportExtensions(Revit.Elements)

def tolist(obj1):
    if isinstance(obj1, str): return [obj1]
    return obj1 if isinstance(obj1, list) else [obj1]

try:
    is_list = isinstance(IN[0], list)
    walls = UnwrapElement(tolist(IN[0]))

    result = [getattr(w, 'CurtainGrid', None) is not None for w in walls]
    OUT = result if is_list else result[0]

except Exception as e:
    import traceback
    OUT = "Exception:\n{0}\n\nTraceback:\n{1}".format(
        str(e),
        traceback.format_exc()
    )
# ----------------------------------------
bool = Output(python_script)
